# Dynamo graph 01.2_Создание 3d и выгрузка в Navis.dyn (Dynamo 2.6.2.15705)
# packages: archi-lab.net 2021.25.2721, spring nodes 210.1.1

current = Document.Current()
filePath = Document.FilePath(document=current)
python_script = Python(IN[0]=filePath)
# ---------- python_script.python (39 lines) ----------
# Загрузить стандартную библиотеку Python и библиотеку DesignScript
import os
import sys
import clr
clr.AddReference('ProtoGeometry')
from Autodesk.DesignScript.Geometry import *

fpath = IN[0]

fname = fpath[fpath.rfind("\\")+1:-4]
pathpart = fpath[:fpath.rfind("\\")+1]


#Ищем папку Navisworks
if pathpart[:pathpart.rfind("Revit")] != (-1):
	nwc1 = pathpart[:pathpart.rfind("Revit")]
else:
	nwc1 = pathpart

nwc2 = pathpart.rfind("Rvit")
finalway = pathpart

nwcsearch = os.listdir(nwc1)
for folder in nwcsearch:
	if folder == "Navisworks":
		cnt = 0
		if os.path.isdir(nwc1 + folder + "\\Влож\\"):
			finalway = nwc1 + folder + "\\Влож\\"
			cnt += 1
		else:
			os.mkdir(nwc1 + folder + "\\Влож\\")
			finalway = nwc1 + folder + "\\Влож\\"
			cnt += 1
		if cnt > 0:
			break
	else:
		continue

OUT = fname,finalway
# ----------------------------------------
code_block = CodeBlock(a=python_script) { a[0]; a[1]; }

# group: Создание 3d-вида для выгрузки
origin = Point.Origin()
code_block_2 = CodeBlock { 10; }
code_block_3 = CodeBlock { false; }
byCoordinates = Vector.ByCoordinates(x=code_block_2, y=code_block_2, z=code_block_2, normalized=code_block_3)
add = Point.Add(point=origin, vectorToAdd=byCoordinates)
byEyePointAndTarget = AxonometricView.ByEyePointAndTarget(eyePoint=add, target=origin)
string = StringInput("Уровень детализации")
code_block_4 = CodeBlock { 3; }
setParameterByName = Element.SetParameterByName(element=byEyePointAndTarget, parameterName=string, value=code_block_4)
python_script_2 = Python(IN[0]=setParameterByName)
# ---------- python_script_2.python (26 lines) ----------
# Загрузить стандартную библиотеку Python и библиотеку DesignScript
import sys
import clr
clr.AddReference('ProtoGeometry')
from Autodesk.DesignScript.Geometry import *
clr.AddReference('RevitAPI')
from Autodesk.Revit.DB import *

clr.AddReference('RevitServices')
import RevitServices
from RevitServices.Persistence import DocumentManager
from RevitServices.Transactions import TransactionManager

doc = DocumentManager.Instance.CurrentDBDocument
list = []

TransactionManager.Instance.EnsureInTransaction(doc)

view = UnwrapElement(IN[0])

view.get_Parameter(BuiltInParameter.MODEL_GRAPHICS_STYLE).Set(4)
list.append(view)

TransactionManager.Instance.TransactionTaskDone()

OUT = list
# ----------------------------------------

enumerate_naviswork_coordinates = Custom[Enumerate Naviswork Coordinates and Exportscope]()  # package spring nodes; Use with the "Export NWC in Document" node.
code_block_5 = CodeBlock(a=enumerate_naviswork_coordinates.ExportScope, b=enumerate_naviswork_coordinates.ChooseCoordinates) { a[1]; b[1]; }
code_block_6 = CodeBlock { false; }
code_block_7 = CodeBlock { true; }

# group: Скрываем элементы, не соответствующие разделам
code_block_8 = CodeBlock { "Уровни"; }
byName = Category.ByName(name=code_block_8)
all_elements_of_category_in_view = ElementsOfCategoryInView(Category=byName, View=python_script_2)
code_block_9 = CodeBlock { "Линии"; }
byName_2 = Category.ByName(name=code_block_9)
all_elements_of_category_in_view_2 = ElementsOfCategoryInView(Category=byName_2, View=python_script_2)
code_block_10 = CodeBlock { "Элементы узлов"; }
byName_3 = Category.ByName(name=code_block_10)
all_elements_of_category_in_view_3 = ElementsOfCategoryInView(Category=byName_3, View=python_script_2)
code_block_11 = CodeBlock { "Границы 3D вида"; }
byName_4 = Category.ByName(name=code_block_11)
all_elements_of_category_in_view_4 = ElementsOfCategoryInView(Category=byName_4, View=python_script_2)
code_block_12 = CodeBlock { "Оси"; }
byName_5 = Category.ByName(name=code_block_12)
all_elements_of_category_in_view_5 = ElementsOfCategoryInView(Category=byName_5, View=python_script_2)
code_block_13 = CodeBlock { "Связанные файлы"; }
byName_6 = Category.ByName(name=code_block_13)
all_elements_of_category_in_view_6 = ElementsOfCategoryInView(Category=byName_6, View=python_script_2)
element_types = ElementTypes("CADLinkType")
all_elements_of_type = ElementsOfType(element_type=element_types)
element_types_2 = ElementTypes("ImportInstance")
all_elements_of_type_2 = ElementsOfType(element_type=element_types_2)

list_create = List.Create(item0=all_elements_of_category_in_view, item1=all_elements_of_category_in_view_2, item2=all_elements_of_category_in_view_3, item3=all_elements_of_category_in_view_4, item4=all_elements_of_category_in_view_5, item5=all_elements_of_category_in_view_6, item6=all_elements_of_type, item7=all_elements_of_type_2)

# group (continued): Скрываем элементы, не соответствующие разделам
flatten = List.Flatten(list=list_create)
hideElements = archilab.Revit.Views.Views.HideElements(view=python_script_2, elements=flatten)

code_block_14 = CodeBlock(pass=python_script_2, waitfor=hideElements) { [pass,waitfor][0]; }

# group: Второй этап скрытия - убираем элементы с нулевым заполнением ЕО-параметров
ꟿ_collect_elementsinview = Custom[ꟿ Collect.ElementsInView](view=code_block_14)  # package spring nodes; Selects all elements visible in the input view.
flatten_2 = List.Flatten(list=ꟿ_collect_elementsinview)
code_block_15 = CodeBlock()
# ---------- code_block_15.designscript (2 lines) ----------
["EO_Подраздел проекта","EO_Раздел проекта","EO_Наименование документа","EO_Шифр тома",
"EO_Номер тома"];
# ----------------------------------------
getParameterValueByName = Element.GetParameterValueByName(element=flatten_2, parameterName=code_block_15, lacing=CrossProduct)
code_block_16 = CodeBlock { 0; 1; 2; 3; 4; }
code_block_17 = CodeBlock(t1=getParameterValueByName, num0=code_block_16.out0, num1=code_block_16.out1, num2=code_block_16.out2, num3=code_block_16.out3, num4=code_block_16.out4)
# ---------- code_block_17.designscript (12 lines) ----------
eo0 = DSCore.List.GetItemAtIndex(t1@L2<1>, num0);
eo1 = DSCore.List.GetItemAtIndex(t1@L2<1>, num1);
eo2 = DSCore.List.GetItemAtIndex(t1@L2<1>, num2);
eo3 = DSCore.List.GetItemAtIndex(t1@L2<1>, num3);
eo4 = DSCore.List.GetItemAtIndex(t1@L2<1>, num4);

check0 = eo0!="N/A"&&eo0!="null"&&eo0!="";
check1 = eo1!="N/A"&&eo1!="null"&&eo1!="";
check2 = eo2!="N/A"&&eo2!="null"&&eo2!="";
check3 = eo3!="N/A"&&eo3!="null"&&eo3!="";
check4 = eo0!="N/A"&&eo4!="null"&&eo4!="";
checkout = check0||check1||check2||check3||check4;
# ----------------------------------------
filterByBoolMask = List.FilterByBoolMask(list=flatten_2, mask=code_block_17.checkout)
hideElements_2 = archilab.Revit.Views.Views.HideElements(view=code_block_14, elements=filterByBoolMask.out)

code_block_18 = CodeBlock(pass=code_block_7, waitfor=hideElements_2) { [pass,waitfor][0]; }
export_nwc_in_document = Custom[Export NWC in Document](document=current, DirectoryPath=code_block.out1, view=python_script_2, Filename=code_block.out0, exportScope=code_block_5.out0, chooseCoordinates=code_block_5.out1, ExportLinks=code_block_6, RunIt=code_block_18)  # package spring nodes; !! This node needs Navisworks Exporters for Revit to export NWC. This node exports Views to NWC files in the active or given document. Navisworks options are embedded inside the python script.
