# Dynamo graph 03_Проверка файлов.dyn (Dynamo 2.6.2.15705)
# packages: spring nodes 210.1.1

python_script = Python()  # frozen; unwired: IN[0], IN[1]
# ---------- python_script.python (31 lines) ----------
# Загрузить стандартную библиотеку Python и библиотеку DesignScript
import sys
import clr
clr.AddReference('ProtoGeometry')
from Autodesk.DesignScript.Geometry import *

# Введенные в этом узле данные сохраняется в виде списка в переменных IN.
fulllist = IN[0]
parameters = IN[1]
newlist_i = []

for i in fulllist:
	list_temp = []
	n = 0
	
	for j in range(len(parameters)+1):
		if j[0].isdigit or :
			para = parameters[n]
			list_temp.append(para + " не заполнен!")
			n += 1
			
	if list_temp:
		newlist_i.append(list_temp)	

OUT = newlist_i

"""
if j == "":
			list_temp.append(parameters[n] + " не заполнен или отсутствует!")
			n += 1
"""
# ----------------------------------------
code_block = CodeBlock { ["Название файла","Имя","ID","EO_Номер тома","EO_Шифр тома","EO_Наименование документа","EO_Раздел проекта","EO_Подраздел проекта","EO_Местоположение"]; }

# group: EXCEL с результатами выгрузки
file_path = Filename("..\..\..\..\..\01_Проекты\01_Дюртюли-Ачит\00_Исходные данные\Revit\врем\1.xlsx")  # graph input

code_block_2 = CodeBlock { "Sheet1"; }
file_from_path = FileObject(path=file_path)
string = StringInput("Sheet1")
boolean = BoolSelector(false)
importExcel = Data.ImportExcel(file=file_from_path, sheetName=string, showExcel=boolean)
count = List.Count(list=importExcel)
code_block_3 = CodeBlock { 0; }
current = Document.Current()
filePath = Document.FilePath(document=current)
python_script_2 = Python(IN[0]=filePath)
# ---------- python_script_2.python (10 lines) ----------
# Загрузить стандартную библиотеку Python и библиотеку DesignScript
import sys
import clr
clr.AddReference('ProtoGeometry')
from Autodesk.DesignScript.Geometry import *

# Введенные в этом узле данные сохраняется в виде списка в переменных IN.
fp = IN[0]

OUT = fp[fp.rfind("\\")+1:-4]
# ----------------------------------------

# group: Создание 3д вида и отбор элтов определенной категории
origin = Point.Origin()
code_block_4 = CodeBlock { 10; false; }
byCoordinates = Vector.ByCoordinates(x=code_block_4.out0, y=code_block_4.out0, z=code_block_4.out0, normalized=code_block_4.out1)
add = Point.Add(point=origin, vectorToAdd=byCoordinates)
string_2 = StringInput("checkcheckcheck3d")
byEyePointAndTarget = AxonometricView.ByEyePointAndTarget(eyePoint=add, target=origin, name=string_2)
code_block_5 = CodeBlock { ["Каркас несущий","Стены","Перекрытия","Фундамент несущей конструкции","Обобщенные модели","Несущие колонны","Колонны","Перекрытия","Соединения несущих конструкций","Двери", "Окна","Крыши","Потолки","Ограждение","Лестницы","Оборудование"]; }
byName = Category.ByName(name=code_block_5)
ꟿ_collect_elementsinview = Custom[ꟿ Collect.ElementsInView](view=byEyePointAndTarget, category=byName)  # package spring nodes; Selects all elements visible in the input view.

flatten = List.Flatten(list=ꟿ_collect_elementsinview)
isNull = Object.IsNull(obj=flatten)
filterByBoolMask = List.FilterByBoolMask(list=flatten, mask=isNull)
code_block_6 = CodeBlock(a=filterByBoolMask.out) { a.Name; }
code_block_7 = CodeBlock(a=filterByBoolMask.out) { a.Id; }
code_block_8 = CodeBlock { ["EO_Номер тома","EO_Шифр тома","EO_Наименование документа","EO_Раздел проекта","EO_Подраздел проекта","EO_Местоположение"]; }
getParameterValueByName = Element.GetParameterValueByName(element=filterByBoolMask.out, parameterName=code_block_8, lacing=CrossProduct)
code_block_9 = CodeBlock(a=getParameterValueByName) { a==""?"Отсутствует или не заполнен":a; }
addItemToFront = List.AddItemToFront(item=code_block_7@L1, list=code_block_9@L2)
addItemToFront_2 = List.AddItemToFront(item=code_block_6@L1, list=addItemToFront@L2)
addItemToFront_3 = List.AddItemToFront(item=python_script_2@L1, list=addItemToFront_2@L2, lacing=Longest)
boolean_2 = BoolSelector(false)
exportExcel = Data.ExportExcel(filePath=file_path, sheetName=code_block_2, startRow=count, startCol=code_block_3, data=addItemToFront_3, overWrite=boolean_2)
transpose = List.Transpose(lists=addItemToFront_3)
