# Dynamo graph 09.1_Export IFC 2x3 с шифрами.dyn (Dynamo 2.6.2.15705)
# packages: spring nodes 210.1.1, Orchid 206.6.0.8434, archi-lab.net 2021.25.2721

o_document_current = Orchid.RevitProject.Common.Document.Current()
filePath = Document.FilePath(document=o_document_current)
wwwwwwwwwwwwwwwwwwwwww = Python(IN[0]=filePath)
# ---------- wwwwwwwwwwwwwwwwwwwwww.python (8 lines) ----------
# Загрузить стандартную библиотеку Python и библиотеку DesignScript
import sys
import clr
clr.AddReference('ProtoGeometry')
from Autodesk.DesignScript.Geometry import *

a = IN[0]
OUT = a[:a.rfind("\\")+1]
# ----------------------------------------

# group: Скрываем элементы, не соответствующие разделам
code_block = CodeBlock { "Уровни"; }
byName = Category.ByName(name=code_block)
all_elements_of_category_in_view = ElementsOfCategoryInView(Category=byName)  # unwired: View
code_block_2 = CodeBlock { "Линии"; }
byName_2 = Category.ByName(name=code_block_2)
all_elements_of_category_in_view_2 = ElementsOfCategoryInView(Category=byName_2)  # unwired: View
code_block_3 = CodeBlock { "Элементы узлов"; }
byName_3 = Category.ByName(name=code_block_3)
all_elements_of_category_in_view_3 = ElementsOfCategoryInView(Category=byName_3)  # unwired: View
code_block_4 = CodeBlock { "Границы 3D вида"; }
byName_4 = Category.ByName(name=code_block_4)
all_elements_of_category_in_view_4 = ElementsOfCategoryInView(Category=byName_4)  # unwired: View
code_block_5 = CodeBlock { "Оси"; }
byName_5 = Category.ByName(name=code_block_5)
all_elements_of_category_in_view_5 = ElementsOfCategoryInView(Category=byName_5)  # unwired: View
code_block_6 = CodeBlock { "Связанные файлы"; }
byName_6 = Category.ByName(name=code_block_6)
all_elements_of_category_in_view_6 = ElementsOfCategoryInView(Category=byName_6)  # unwired: View
element_types = ElementTypes("CADLinkType")
all_elements_of_type = ElementsOfType(element_type=element_types)
element_types_2 = ElementTypes("ImportInstance")
all_elements_of_type_2 = ElementsOfType(element_type=element_types_2)
list_create = List.Create(item0=all_elements_of_category_in_view, item1=all_elements_of_category_in_view_2, item2=all_elements_of_category_in_view_3, item3=all_elements_of_category_in_view_4, item4=all_elements_of_category_in_view_5, item5=all_elements_of_category_in_view_6, item6=all_elements_of_type, item7=all_elements_of_type_2)
flatten = List.Flatten(list=list_create)

# group: Временный 3d-вид
origin = Point.Origin()
code_block_7 = CodeBlock { 10; }
code_block_8 = CodeBlock { false; }
byCoordinates = Vector.ByCoordinates(x=code_block_7, y=code_block_7, z=code_block_7, normalized=code_block_8)
add = Point.Add(point=origin, vectorToAdd=byCoordinates)
byEyePointAndTarget = AxonometricView.ByEyePointAndTarget(eyePoint=add, target=origin)
hideElements = archilab.Revit.Views.Views.HideElements(view=byEyePointAndTarget, elements=flatten)

o_datastream_await = Orchid.Common.DataStream.Await(pass=byEyePointAndTarget, waitFor=hideElements)

# group: Добавить шифр в название
ꟿ_collect_elementsinview = Custom[ꟿ Collect.ElementsInView](view=o_datastream_await)  # package spring nodes; Selects all elements visible in the input view.
string = StringInput("EO_Номер тома")
getParameterValueByName = Element.GetParameterValueByName(element=ꟿ_collect_elementsinview, parameterName=string)
code_block_9 = CodeBlock(a=getParameterValueByName) { a!=""; }
filterByBoolMask = List.FilterByBoolMask(list=getParameterValueByName, mask=code_block_9)
flatten_2 = List.Flatten(list=filterByBoolMask.in)
uniqueItems = List.UniqueItems(list=flatten_2)
code_block_10 = CodeBlock { "-"; }
join = String.Join(separator=code_block_10)  # frozen; unwired: string0
length = String.Length(str=join)

python_script = Python(IN[0]=uniqueItems)
# ---------- python_script.python (20 lines) ----------
# Загрузить стандартную библиотеку Python и библиотеку DesignScript
import sys
import clr
clr.AddReference('ProtoGeometry')
from Autodesk.DesignScript.Geometry import *

toms = IN[0]

flist = []

for tom in toms:
	if "Том " in tom:
		flist.append(tom[4:])
	elif "Том" in tom:
		flist.append(tom[3:])
	elif "N/A" in tom:
		continue	
		

OUT = "-".join(flist)
# ----------------------------------------
o_datastream_await_2 = Orchid.Common.DataStream.Await(pass=o_datastream_await, waitFor=python_script)
o_document_name = Orchid.RevitProject.Common.Document.Name(document=o_document_current)
code_block_11 = CodeBlock(a=o_document_name, b=python_script) { a + "_" + b; }
o_ifc_versions = Version("IFC2x3 Coordination View")
code_block_12 = CodeBlock { "0"; }
code_block_13 = CodeBlock { "C:\\00_BIM\\01_Библиотеки\\02_Revit\\08_Настройки IFC\\IFC2x3_EO Settings.json"; }
export_ifc = Custom[Export IFC](DirectoryPath=wwwwwwwwwwwwwwwwwwwwww, view=o_datastream_await_2, Filename=code_block_11, IFCversion=o_ifc_versions, ProjectOrigin=code_block_12, UserDefinedPSet=code_block_13)  # package spring nodes; Export View to IFC file in the active document. For use with the Select Phase node. Some other IFC options are embedded inside the python script.
length_2 = String.Length(str=wwwwwwwwwwwwwwwwwwwwww)
length_3 = String.Length(str=code_block_11)
