# Dynamo graph 09_Export IFC 2x3 с шифрами_v2.dyn (Dynamo 2.6.2.15705)
# packages: spring nodes 210.1.1, Orchid 206.6.0.8434, archi-lab.net 2021.25.2721

o_document_current = Orchid.RevitProject.Common.Document.Current()
filePath = Document.FilePath(document=o_document_current)
получение_директории_текущего = Python(IN[0]=filePath)  # "Получение директории текущего файла"
# ---------- получение_директории_текущего.python (8 lines) ----------
# Загрузить стандартную библиотеку Python и библиотеку DesignScript
import sys
import clr
clr.AddReference('ProtoGeometry')
from Autodesk.DesignScript.Geometry import *

a = IN[0]
OUT = a[:a.rfind("\\")+1]
# ----------------------------------------

# group: Скрываем элементы, не соответствующие разделам
code_block = CodeBlock()
# ---------- code_block.designscript (7 lines) ----------
["Уровни",
"Линии",
"Элементы узлов",
"Границы 3D вида",
"Оси",
"Связанные файлы"
];
# ----------------------------------------
byName = Category.ByName(name=code_block)
all_elements_of_category = ElementsOfCategory(Category=byName)
element_types = ElementTypes("CADLinkType")
all_elements_of_type = ElementsOfType(element_type=element_types)
element_types_2 = ElementTypes("ImportInstance")
all_elements_of_type_2 = ElementsOfType(element_type=element_types_2)
list_create = List.Create(item0=all_elements_of_category, item1=all_elements_of_type, item2=all_elements_of_type_2)
flatten = List.Flatten(list=list_create)

# group: Временный 3d-вид
origin = Point.Origin()
code_block_2 = CodeBlock { 10; }
code_block_3 = CodeBlock { false; }
byCoordinates = Vector.ByCoordinates(x=code_block_2, y=code_block_2, z=code_block_2, normalized=code_block_3)
add = Point.Add(point=origin, vectorToAdd=byCoordinates)
byEyePointAndTarget = AxonometricView.ByEyePointAndTarget(eyePoint=add, target=origin)

python_script = Python(IN[0]=byEyePointAndTarget)
# ---------- python_script.python (27 lines) ----------
# Загрузить стандартную библиотеку Python и библиотеку DesignScript
import sys
import clr
clr.AddReference('ProtoGeometry')
from Autodesk.DesignScript.Geometry import *
clr.AddReference('RevitAPI')
from Autodesk.Revit.DB import *

clr.AddReference('RevitServices')
import RevitServices
from RevitServices.Persistence import DocumentManager
from RevitServices.Transactions import TransactionManager

doc = DocumentManager.Instance.CurrentDBDocument
list = []

TransactionManager.Instance.EnsureInTransaction(doc)

view = UnwrapElement(IN[0])

view.LookupParameter('Уровень детализации').Set(3)
view.get_Parameter(BuiltInParameter.MODEL_GRAPHICS_STYLE).Set(4)
list.append(view)

TransactionManager.Instance.TransactionTaskDone()

OUT = list
# ----------------------------------------

# group (continued): Временный 3d-вид
hideElements = archilab.Revit.Views.Views.HideElements(view=python_script, elements=flatten)

o_datastream_await = Orchid.Common.DataStream.Await(pass=python_script, waitFor=hideElements)
o_document_name = Orchid.RevitProject.Common.Document.Name(document=o_document_current)

# group: Добавить шифр в название
ꟿ_collect_elementsinview = Custom[ꟿ Collect.ElementsInView](view=o_datastream_await)  # package spring nodes; Selects all elements visible in the input view.
string = StringInput("EO_Номер тома")

flatten_2 = List.Flatten(list=ꟿ_collect_elementsinview)

# group (continued): Добавить шифр в название
создание_строки_с_шифрами = Python(IN[0]=flatten_2, IN[1]=string)
# ---------- создание_строки_с_шифрами.python (38 lines) ----------
import clr

#Import the Revit API
clr.AddReference('RevitAPI')
import Autodesk
from Autodesk.Revit.DB import *

#Import DocumentManager and TransactionManager
clr.AddReference('RevitServices')
import RevitServices
from RevitServices.Persistence import DocumentManager
from RevitServices.Transactions import TransactionManager

#Reference the active Document and application
doc = DocumentManager.Instance.CurrentDBDocument

elems = UnwrapElement(IN[0])
parname = IN[1]


tlist,flist = [],[]


for elem in elems:
	try:
		elem_name = elem.LookupParameter(parname).AsString()
		if elem_name not in (" ", "", "0", 0, None):
			tlist.append(elem_name)
	except:
		continue

uniqlist = set(tlist)
for ul in uniqlist:
	if ul[:4] == "Том ":
		flist.append(ul[4:])
	else:
		flist.append(ul)	
OUT = "-".join(flist)
# ----------------------------------------

code_block_4 = CodeBlock(a=o_document_name, b=создание_строки_с_шифрами) { a + "_" + b + "_I230C2"; }
o_ifc_versions = Version("IFC2x3 Coordination View 2.0")
code_block_5 = CodeBlock { "0"; }
пользовательский_пресет = Filename("C:\Program Files\Autodesk\Revit 2021\AddIns\Autodesk.IFC.Export.UI\IFC2x3_MySpec.txt")  # "ПОЛЬЗОВАТЕЛЬСКИЙ ПРЕСЕТ ВЫГРУЖАЕМЫХ ПАРАМЕТРОВ"
export_ifc = Custom[Export IFC](DirectoryPath=получение_директории_текущего, view=o_datastream_await, Filename=code_block_4, IFCversion=o_ifc_versions, ProjectOrigin=code_block_5, UserDefinedPSet=пользовательский_пресет)  # package spring nodes; Export View to IFC file in the active document. For use with the Select Phase node. Some other IFC options are embedded inside the python script.
