# Dynamo graph 10_Переименование по ГОСТ.dyn (Dynamo 2.6.2.15705)
# packages: Orchid 206.6.0.5797

# group: Скопировать исходные файлы в нужную папку и указать путь
string = StringInput("C:\01_Проекты\01_Шали-Бавлы\02_Исходящие\1 этап\Revit")

boolean = BoolSelector(true)
o_directory_contents = Orchid.Common.Directory.Contents(directory=string, deepSearch=boolean)
code_block = CodeBlock { "\\"; }
split = String.Split(str=o_directory_contents, separator0=code_block)
lastItem = List.LastItem(list=split@L2)
python_script = Python(IN[0]=lastItem)
# ---------- python_script.python (19 lines) ----------
# Загрузить стандартную библиотеку Python и библиотеку DesignScript
import sys
import clr
clr.AddReference('ProtoGeometry')
from Autodesk.DesignScript.Geometry import *

# Введенные в этом узле данные сохраняется в виде списка в переменных IN.
lst = IN[0]
f_ext = []

for l in lst:
	name = l[:l.rfind(".")]
	ext = l[l.rfind(".")+1:]
	f_ext.append([name,ext])

# Разместите код под этой строкой

# Назначьте вывод переменной OUT.
OUT = f_ext
# ----------------------------------------
code_block_2 = CodeBlock { 1; 0; }
getItemAtIndex = List.GetItemAtIndex(list=python_script@L2, index=code_block_2.out0)
getItemAtIndex_2 = List.GetItemAtIndex(list=python_script@L2, index=code_block_2.out1)
file_path = Filename("..\..\..\..\..\01_Проекты\01_Шали-Бавлы\01_Рабочая\1 этап\xls\Шали-Бавлы_1 этап_Наим по ГОСТ.xlsx")
# note: 1) Сбобрать все файлы из директории
# 2) Нод с частями из ГОСТ
file_from_path = FileObject(path=file_path)
string_2 = StringInput("Лист1")
boolean_2 = BoolSelector(false)
importExcel = Data.ImportExcel(file=file_from_path, sheetName=string_2, showExcel=boolean_2)
code_block_3 = CodeBlock { 2; }
dropItems = List.DropItems(list=importExcel, amount=code_block_3)
code_block_4 = CodeBlock { 0; 13; }
getItemAtIndex_3 = List.GetItemAtIndex(list=dropItems@L2, index=code_block_4.out0)
getItemAtIndex_4 = List.GetItemAtIndex(list=dropItems@L2, index=code_block_4.out1)
byKeysValues = DesignScript.Builtin.Dictionary.ByKeysValues(keys=getItemAtIndex_3, values=getItemAtIndex_4)
valueAtKey = DesignScript.Builtin.Dictionary.ValueAtKey(dictionary=byKeysValues, key=lastItem)
o_file_rename = Orchid.Common.File.Rename(directory=string, extension=getItemAtIndex, sourceName=getItemAtIndex_2, targetName=valueAtKey)
