# Dynamo graph 13_Вставка спеки с параметрами.dyn (Dynamo 2.6.2.15705)

string = StringInput("C:\00_BIM\01_Библиотеки\02_Revit\90_Шаблоны проектов\EO\Ш_П-опора_28м.rvt")
openDocumentFile = Rhythm.Revit.Application.Applications.OpenDocumentFile(filePath=string)
element_types = ElementTypes("ViewSchedule")
elementsOfTypeInDocument = Rhythm.Revit.Selection.Collector.ElementsOfTypeInDocument(document=openDocumentFile, elementType=element_types)
code_block = CodeBlock(a=elementsOfTypeInDocument) { a.Name == "EO-Спецификация"; }
filterByBoolMask = List.FilterByBoolMask(list=elementsOfTypeInDocument, mask=code_block)
copyElementsFromDocument = Rhythm.Revit.Application.Documents.CopyElementsFromDocument(sourceDocument=openDocumentFile, elements=filterByBoolMask.in)
code_block_2 = CodeBlock(pass=openDocumentFile, wait=copyElementsFromDocument) { [pass,wait]; }
code_block_3 = CodeBlock(a=code_block_2) { a[0]; }
boolean = BoolSelector(false)
closeDocument = Rhythm.Revit.Application.Applications.CloseDocument(document=code_block_3, save=boolean)
