# Dynamo graph 14_Копирование файлов с помощью excel.dyn (Dynamo 2.6.2.15705)

# group: ИСХОДНЫЕ ДАННЫЕ
исходный_excel_файл = Filename("C:\01_Проекты\01_Шали-Бавлы\01_Рабочая\3 этап\xls\Шали-Бавлы_3 этап_Здания и сооружения.xlsx")
папка_с_шаблонами = Directory("C:\01_Проекты\01_Шали-Бавлы\01_Рабочая\3 этап\Revit\!Шаблоны")
папка_назначения = Directory("C:\01_Проекты\01_Шали-Бавлы\01_Рабочая\3 этап\Revit\Влож")

file_from_path = FileObject(path=исходный_excel_файл)
string = StringInput("Номер,пикет")
boolean = BoolSelector(true)
boolean_2 = BoolSelector(true)
importExcel = Data.ImportExcel(file=file_from_path, sheetName=string, readAsStrings=boolean, showExcel=boolean_2)
code_block = CodeBlock { 3; }
dropItems = List.DropItems(list=importExcel, amount=code_block)
directory_from_path = DirectoryObject(path=папка_с_шаблонами)
getDirectoryContents = FileSystem.GetDirectoryContents(directory=directory_from_path)
directory_from_path_2 = DirectoryObject(path=папка_назначения)
python_script = Python(IN[0]=dropItems, IN[1]=getDirectoryContents.files, IN[2]=directory_from_path_2)
# ---------- python_script.python (37 lines) ----------
# Загрузить стандартную библиотеку Python и библиотеку DesignScript
import sys
import clr
clr.AddReference('ProtoGeometry')
from Autodesk.DesignScript.Geometry import *
import shutil

# Введенные в этом узле данные сохраняется в виде списка в переменных IN.
allExcel = IN[0]
templates = IN[1]
destfolder = IN[2]

tlist1, tlist2 = [], []


for stroka in allExcel:
	# Имя файла по ГОСТу
	gostfilename = stroka[21]
	# Имя шаблона
	complect = stroka[7]
		
	if complect == "" or not complect:
		continue
	
	
	for template in templates:
		templatename = template[template.rfind("\\")+1:-4]
		if templatename == complect:
			newdest = str(destfolder) + "\\" + gostfilename + ".rvt"
			shutil.copy2(template,newdest)
			tlist2.append([template,newdest])
			break
	
	
	tlist1.append(complect)

OUT = tlist2
# ----------------------------------------
