# Dynamo graph 15_Подгрузка файлов.dyn (Dynamo 2.6.2.15705)
# packages: Morpheus 2019.8.26

# group: Подгружаемые файлы
directory_path = Directory("C:\01_Проекты\01_Шали-Бавлы\01_Рабочая\3 этап\Revit\Влож")
directory_from_path = DirectoryObject(path=directory_path)
string = StringInput("*.rvt")
getDirectoryContents = FileSystem.GetDirectoryContents(directory=directory_from_path, searchString=string)

# group: Вытаскиваем уже имеющиеся файлы
element_types = ElementTypes("RevitLinkInstance")
all_elements_of_type = ElementsOfType(element_type=element_types)
code_block = CodeBlock(a=all_elements_of_type) { a.Name; }
code_block_2 = CodeBlock { " : "; }
split = String.Split(str=code_block, separator0=code_block_2)
code_block_3 = CodeBlock { 0; }
getItemAtIndex = List.GetItemAtIndex(list=split@L2, index=code_block_3)

# group: Вычисляем неподгруженные файлы
python_script = Python(IN[0]=getDirectoryContents.files, IN[1]=getItemAtIndex)
# ---------- python_script.python (23 lines) ----------
# Загрузить стандартную библиотеку Python и библиотеку DesignScript
import sys
import clr
clr.AddReference('ProtoGeometry')
from Autodesk.DesignScript.Geometry import *

incomefiles_dirty = IN[0]
existlinks = IN[1]

incomefiles = []
existlinkswpaths = []
templist1, templist2 = [], []

for ifile in incomefiles_dirty:
	if "*.0***.rvt" or "копи" not in ifile:
		incomefiles.append(ifile)

for incfile in incomefiles:
	filename = incfile[incfile.rfind("\\")+1:]
	if filename not in existlinks:
		templist1.append(incfile)
		
OUT = templist1
# ----------------------------------------

originToOrigin = Custom[LinkModel.OriginToOrigin](Filepaths=python_script)  # package Morpheus; Link models origin to origin. Optionally, the node can place the models on the selected worksets and pin them in place.
code_block_4 = CodeBlock(a=python_script) { a[0..6]; }
