# Dynamo graph 16_Перемещение моделей по XYZ.dyn (Dynamo 2.6.2.15705)

element_types = ElementTypes("RevitLinkInstance")
all_elements_of_type = ElementsOfType(element_type=element_types)

# group: ИСХОДНЫЕ ДАННЫЕ
выбрать_таблицу_с_данными = Filename("C:\01_Проекты\01_Шали-Бавлы\01_Рабочая\3 этап\xls\Шали-Бавлы_3 этап_Здания и сооружения.xlsx")

file_from_path = FileObject(path=выбрать_таблицу_с_данными)
string = StringInput("Номер,пикет")
importExcel = Data.ImportExcel(file=file_from_path, sheetName=string)
code_block = CodeBlock { 3; }
dropItems = List.DropItems(list=importExcel, amount=code_block)
XYZ = Python(IN[0]=all_elements_of_type, IN[1]=dropItems)
# ---------- XYZ.python (42 lines) ----------
# Загрузить стандартную библиотеку Python и библиотеку DesignScript
import sys
import clr
clr.AddReference('ProtoGeometry')
from Autodesk.DesignScript.Geometry import *

# Введенные в этом узле данные сохраняется в виде списка в переменных IN.
revitlinkinstances = IN[0]
allExcel = IN[1]
xyzlist = []
tlist = []
cnt = 0

for rli in revitlinkinstances:
	linkname = rli.Name
	filename = linkname[:linkname.find(" : ")-4]
	tlist.append(filename)
	for stroka in allExcel:
		gostfilename = stroka[21]
		complect = stroka[7]
		
		x,y,z = str(stroka[22]),str(stroka[23]),str(stroka[24])
		
		if any([x == "0",x == "0.0",y == "0",y == "0.0",z == "0",z == "0.0",x == "",y == "",z == ""]):
			cnt =+ 1
			break
		if "," in x:
			x = x.replace(",",".")
		if "," in y:
			y = y.replace(",",".")
		if "," in z:
			z = z.replace(",",".")
				
		if filename == gostfilename:
			xyzlist.append([rli,gostfilename,x,y,z])
			cnt =+ 1
			break

# Разместите код под этой строкой

# Назначьте вывод переменной OUT.
OUT = xyzlist
# ----------------------------------------
code_block_2 = CodeBlock { 0; 2; 3; 4; }
# note: ПОМНИ: у генпланистов X и Y поменяны местами!!! Так что ниже - не баг, а фича.
revitLinkInstance = List.GetItemAtIndex(list=XYZ@L2, index=code_block_2.out0)
X = List.GetItemAtIndex(list=XYZ@L2, index=code_block_2.out2)
toNumber = String.ToNumber(str=X)
Y = List.GetItemAtIndex(list=XYZ@L2, index=code_block_2.out1)
toNumber_2 = String.ToNumber(str=Y)
Z = List.GetItemAtIndex(list=XYZ@L2, index=code_block_2.out3)
toNumber_3 = String.ToNumber(str=Z)
дополнительная_прибавка_по_z = CodeBlock { 0; }
code_block_3 = CodeBlock(z=toNumber_3, zz=дополнительная_прибавка_по_z) { z+zz; }
code_block_4 = CodeBlock(x=toNumber, y=toNumber_2, z=code_block_3) { x*1000; y*1000; z*1000; }
byCoordinates = Point.ByCoordinates(x=code_block_4.out0, y=code_block_4.out1, z=code_block_4.out2)
set_location = Python(IN[0]=revitLinkInstance, IN[1]=byCoordinates)
# ---------- set_location.python (72 lines) ----------
#Alban de Chasteigner 2020
#twitter : @geniusloci_bim
#geniusloci.bim@gmail.com
#https://github.com/albandechasteigner/GeniusLociForDynamo

import clr
# Import RevitAPI Classes
clr.AddReference('RevitAPI')
import Autodesk
from Autodesk.Revit.DB import *

clr.AddReference("RevitNodes")
import Revit
clr.ImportExtensions(Revit.GeometryConversion)

clr.AddReference("RevitServices")
import RevitServices
from RevitServices.Persistence import DocumentManager
from RevitServices.Transactions import TransactionManager
doc = DocumentManager.Instance.CurrentDBDocument

elements = UnwrapElement(IN[0]) if isinstance(IN[0],list) else [UnwrapElement(IN[0])]
locations = IN[1] if isinstance(IN[1],list) else [IN[1]]

TransactionManager.Instance.EnsureInTransaction(doc)
for element,location in zip(elements,locations):
	if hasattr(element, "Location"):
		loc = element.Location
		if loc:	
			# point-based elements (e.g. most loadable families)
			if isinstance(loc,LocationPoint):
				loca=loc.Point
			# line-based elements (e.g. walls)
			elif isinstance(loc,LocationCurve):
				loca=loc.Curve.Evaluate(0.5,True)
			elif isinstance(element,Instance):
				loca = element.GetTotalTransform().Origin
			elif hasattr(element, "Origin"):
				loca = element.Origin
			##Section Marker and ReferenceElevationMarker(Doesn't work for ReferenceElevationMarker)
			elif ElementId(BuiltInCategory.OST_Viewers) == element.Category.Id :
				viewSection = doc.GetElement(ElementId(element.Id.IntegerValue + 1))
				loca = viewSection.Origin
			#Elevation Marker
			elif isinstance(element,Autodesk.Revit.DB.ElevationMarker) :
				marker = doc.GetElement(ElementId(element.Id.IntegerValue + 1))
				box=marker.BoundingBox[doc.ActiveView]
				loca = (box.Min+box.Max)/2
			# Grid	
			elif isinstance(element,Autodesk.Revit.DB.Grid):
				loca=element.Curve.Evaluate(0.5,True)
			# view specific elements (e.g. filled regions)
			elif hasattr(element, "OwnerViewId") and element.OwnerViewId != ElementId.InvalidElementId :
				view=element.Document.GetElement(element.OwnerViewId)
				box = element.BoundingBox[view]
				loca = (box.Min+box.Max)/2
			# sketch-based elements (e.g. floors)
			else :
				box = element.get_BoundingBox(None)
				loca = (box.Min+box.Max)/2
			ElementTransformUtils.MoveElement(doc,element.Id,location.ToRevitType()-loca)
	elif hasattr(element, "OwnerViewId"):
		view=element.Document.GetElement(element.OwnerViewId)
		box = element.BoundingBox[view]
		loca = (box.Min+box.Max)/2
		ElementTransformUtils.MoveElement(doc,element.Id,location.ToRevitType()-loca)
	elif isinstance(element,Leader):
		element.End=location.ToXyz()
TransactionManager.Instance.TransactionTaskDone()

if isinstance(IN[0], list): OUT = elements
else: OUT = elements[0]
# ----------------------------------------
set_rotation = Python()  # frozen; unwired: IN[0], IN[1]
# ---------- set_rotation.python (145 lines) ----------
#Alban de Chasteigner 2020
#twitter : @geniusloci_bim
#geniusloci.bim@gmail.com
#https://github.com/albandechasteigner/GeniusLociForDynamo

import clr
clr.AddReference("RevitNodes")
import Revit
clr.ImportExtensions(Revit.GeometryConversion)

clr.AddReference("RevitAPI")
import Autodesk
from Autodesk.Revit.DB import *
import math

clr.AddReference("RevitServices")
import RevitServices
from RevitServices.Persistence import DocumentManager
from RevitServices.Transactions import TransactionManager
doc = DocumentManager.Instance.CurrentDBDocument

elements = UnwrapElement(IN[0]) if isinstance(IN[0],list) else [UnwrapElement(IN[0])]
angles = [i* math.pi/180 for i in IN[1]] if isinstance(IN[1],list) else [IN[1]* math.pi/180]

def GetCropBox(view):
	provider= ParameterValueProvider(ElementId(BuiltInParameter.ID_PARAM))
	rule = FilterElementIdRule(provider, FilterNumericEquals(), view.Id )
	filter= ElementParameterFilter(rule)
	return doc.GetElement(FilteredElementCollector(view.Document).WherePasses(filter).ToElementIds().Find(lambda x: x.IntegerValue != view.Id.IntegerValue))

TransactionManager.Instance.EnsureInTransaction(doc)
for angle, element in zip(angles, elements):
	#if angle>math.pi:
		#angle=abs(angle-2*math.pi)
	#else:angle
	#Get initial Rotation Angle using transform
	#transform=element.GetTransform()
	#vectorTran = transform.OfVector(transform.BasisX)
	#rot = transform.BasisX.AngleOnPlaneTo(vectorTran, transform.BasisZ) 
	#rot = rot * (180 / math.pi)
	if hasattr(element, "Location"):
		loc = element.Location
		if loc:	
			# Annotation symbol, importInstance and linkInstance
			if hasattr(element, "GetTotalTransform"):
				trans=element.GetTotalTransform()
				loca = trans.Origin
				rot = -trans.BasisX.AngleOnPlaneTo(XYZ.BasisX, XYZ.BasisZ)
			# point-based elements (e.g. most loadable families)
			elif isinstance(loc,LocationPoint):
				loca=loc.Point
				if hasattr(loc, "Rotation"):
					rot=loc.Rotation
				# Group, assembly
				else:rot = 0
			# line-based elements (e.g. walls)
			elif isinstance(loc,LocationCurve):
				loca=loc.Curve.Evaluate(0.5,True)
				rot=loc.Curve.Direction.AngleTo(XYZ.BasisX)
			elif isinstance(element,Grid):
				line=element.Curve
				start=line.GetEndPoint(0)
				end=line.GetEndPoint(1)   
				box=BoundingBoxXYZ()
				box.Min = start
				box.Max = end
				loca = (box.Min+box.Max)/2
				rot = 0			
			elif isinstance(element,ReferencePlane):
				doc=element.Document
				view = doc.ActiveView
				for crv in element.GetCurvesInView(DatumExtentType.ViewSpecific,view):
					line = crv
				start=line.GetEndPoint(0)
				end=line.GetEndPoint(1)   
				box=BoundingBoxXYZ()
				box.Min = start
				box.Max = end
				loca = (box.Min+box.Max)/2
				rot = 0	
			# CropBox
			elif element.Category == None :
				view=doc.GetElement(element.get_Parameter(BuiltInParameter.ID_PARAM).AsElementId())
				box = view.CropBox
				transform = box.Transform
				min = transform.OfPoint(box.Min)
				max = transform.OfPoint(box.Max)
				loca = (min+max)/2
				rot = 0	
			# ViewSection Marker
			elif ElementId(BuiltInCategory.OST_Viewers) == element.Category.Id :
				viewSection = doc.GetElement(ElementId(element.Id.IntegerValue + 1))
				shape=viewSection.GetCropRegionShapeManager().GetCropShape()
				#Last line of the rectangle
				l=[s for s in shape[0]][3]
				loca = l.Evaluate(0.5, True)
				#loca = viewSection.Origin
				rot = 0
			# SectionBox
			elif ElementId(BuiltInCategory.OST_SectionBox) == element.Category.Id:
				box = doc.GetElement(ElementId(element.Id.IntegerValue + 1)).GetSectionBox()
				transform = box.Transform
				min = transform.OfPoint(box.Min)
				max = transform.OfPoint(box.Max)
				loca = (min+max)/2
				rot = 0
			else:
				box = element.get_BoundingBox(None)
				loca = (box.Min+box.Max)/2
				rot = 0
				# sketch-based elements (ceiling, floor and roof)
				if hasattr(element, "FindInserts"):
					for ref in HostObjectUtils.GetTopFaces(element):
						geomFace=element.GetGeometryObjectFromReference(ref)
						#Get BoundingBox max UV point
						maxUV = geomFace.GetBoundingBox().Max
						#Get transform
						trans=geomFace.ComputeDerivatives(maxUV)
						if isinstance(element,Ceiling):
							rot = abs(trans.BasisZ.AngleOnPlaneTo(XYZ.BasisX, XYZ.BasisZ)-2*math.pi)
						else:
							rot = abs(trans.BasisY.AngleOnPlaneTo(XYZ.BasisX, XYZ.BasisZ)-math.pi)
				else:rot = 0
		#PlanView, SectionView and 3D View
		elif hasattr(element, "CropBox") :
			box = element.CropBox
			element = GetCropBox(element)
			transform = box.Transform
			min = transform.OfPoint(box.Min)
			max = transform.OfPoint(box.Max)
			loca = (min+max)/2
			rot = 0									
	# view specific elements (e.g. filled regions)
	elif hasattr(element, "OwnerViewId"):
		view=doc.GetElement(element.OwnerViewId)
		box = element.BoundingBox[view]
		loca = (box.Min+box.Max)/2
		rot = 0
	line = Line.CreateBound(loca, XYZ(loca.X,loca.Y,loca.Z+1))
	#Set Rotation
	Autodesk.Revit.DB.ElementTransformUtils.RotateElement(doc, element.Id, line, angle-rot)
TransactionManager.Instance.TransactionTaskDone()

if isinstance(IN[0], list): OUT = elements
else: OUT = elements[0]
# ----------------------------------------
