# Dynamo graph 17_Заполнение EO_Местоположения (минус группы).dyn (Dynamo 2.6.2.15705)
# packages: Orchid 206.6.0.8434

right_categories = Python()  # unwired: IN[0]
# ---------- right_categories.python (214 lines) ----------
# Загрузить стандартную библиотеку Python и библиотеку DesignScript
import sys
import clr
clr.AddReference('ProtoGeometry')
from Autodesk.DesignScript.Geometry import *

# Введенные в этом узле данные сохраняется в виде списка в переменных IN.
dataEnteringNode = IN
a = ['OST_TrussChord',
'OST_TrussWeb',
'OST_Coupler',
'OST_StructConnectionOthers',
'OST_StructConnectionBolts',
'OST_StructConnectionAnchors',
'OST_StructConnectionPlates',
'OST_StructConnectionProfiles',
'OST_StructConnectionReference',
'OST_StructConnectionSymbol',
'OST_StructConnections',
'OST_FabricReinforcementWire',
'OST_FabricReinforcementBoundary',
'OST_FabricReinforcement',
'OST_RebarShape',
'OST_PathRein',
'OST_AreaRein',
'OST_Rebar',
'OST_FabricationPipeworkInsulation',
'OST_FabricationDuctworkLining',
'OST_FabricationContainmentDrop',
'OST_FabricationContainmentRise',
'OST_FabricationPipeworkDrop',
'OST_FabricationPipeworkRise',
'OST_FabricationContainmentSymbology',
'OST_FabricationContainmentCenterLine',
'OST_FabricationContainment',
'OST_FabricationPipework',
'OST_FabricationHangers',
'OST_FabricationDuctwork',
'OST_PipeSegments',
'OST_PlaceHolderPipes',
'OST_PlaceHolderDucts',
'OST_ElectricalInternalCircuits',
'OST_PanelScheduleGraphics',
'OST_CableTrayRun',
'OST_ConduitRun',
'OST_ConduitDrop',
'OST_ConduitRiseDrop',
'OST_CableTrayDrop',
'OST_CableTrayRiseDrop',
'OST_Conduit',
'OST_CableTray',
'OST_ConduitFitting',
'OST_CableTrayFitting',
'OST_HVAC_Zones',
'OST_SwitchSystem',
'OST_Sprinklers',
'OST_LightingDevices',
'OST_FireAlarmDevices',
'OST_DataDevices',
'OST_CommunicationDevices',
'OST_SecurityDevices',
'OST_NurseCallDevices',
'OST_TelephoneDevices',
'OST_PipeAccessory',
'OST_PipeCurvesRiseDrop',
'OST_FlexPipeCurves',
'OST_PipeFitting',
'OST_PipeCurves',
'OST_PipingSystem',
'OST_Wire',
'OST_ElectricalCircuit',
'OST_FlexDuctCurves',
'OST_DuctAccessory',
'OST_DuctSystem',
'OST_DuctTerminal',
'OST_DuctFitting',
'OST_DuctCurves',
'OST_BridgeBearings',
'OST_BridgeGirders',
'OST_BridgeFoundations',
'OST_BridgeDecks',
'OST_BridgeArches',
'OST_BridgeCables',
'OST_BridgeTowers',
'OST_BridgePiers',
'OST_BridgeAbutments',
'OST_MEPSpaces',
'OST_MassShade',
'OST_MassOpening',
'OST_MassSkylights',
'OST_MassGlazing',
'OST_MassRoof',
'OST_MassExteriorWall',
'OST_MassInteriorWall',
'OST_MassZone',
'OST_MassForm',
'OST_MassFloor',
'OST_Mass',
'OST_DividedSurface_PatternFill',
'OST_RampsStringer',
'OST_Areas',
'OST_RoofSoffit',
'OST_EdgeSlab',
'OST_Gutter',
'OST_Fascia',
'OST_Entourage',
'OST_Planting',
'OST_StructuralStiffener',
'OST_SpecialityEquipment',
'OST_ColumnAnalyticalRigidLinks',
'OST_Topography',
'OST_StructuralTruss',
'OST_AnalyticalRigidLinks',
'OST_StructuralColumns',
'OST_KickerBracing',
'OST_StructuralFramingSystem',
'OST_VerticalBracing',
'OST_HorizontalBracing',
'OST_Purlin',
'OST_Joist',
'OST_Girder',
'OST_StructuralFramingOther',
'OST_StructuralFraming',
'OST_StructuralFoundation',
'OST_Roads',
'OST_Parking',
'OST_PlumbingFixtures',
'OST_MechanicalEquipment',
'OST_LightingFixtureSource',
'OST_LightingFixtures',
'OST_FurnitureSystems',
'OST_ElectricalFixtures',
'OST_ElectricalEquipment',
'OST_Casework',
'OST_StairsSupports',
'OST_RailingHandRailAboveCut',
'OST_RailingTopRailAboveCut',
'OST_RailingTermination',
'OST_RailingSupport',
'OST_RailingHandRail',
'OST_RailingTopRail',
'OST_StairsOutlinesAboveCut',
'OST_StairsOutlines',
'OST_StairsTrisers',
'OST_StairsLandings',
'OST_StairsRuns',
'OST_CeilingsCutPattern',
'OST_CeilingsDefault',
'OST_CeilingsFinish2',
'OST_CeilingsFinish1',
'OST_CeilingsSubstrate',
'OST_CeilingsInsulation',
'OST_CeilingsStructure',
'OST_CeilingsMembrane',
'OST_FloorsInteriorEdges',
'OST_FloorsCutPattern',
'OST_FloorsDefault',
'OST_FloorsFinish2',
'OST_FloorsFinish1',
'OST_FloorsSubstrate',
'OST_FloorsInsulation',
'OST_FloorsStructure',
'OST_FloorsMembrane',
'OST_RoofsInteriorEdges',
'OST_RoofsCutPattern',
'OST_RoofsDefault',
'OST_RoofsFinish2',
'OST_RoofsFinish1',
'OST_RoofsSubstrate',
'OST_RoofsInsulation',
'OST_RoofsStructure',
'OST_RoofsMembrane',
'OST_WallsCutPattern',
'OST_WallsDefault',
'OST_WallsFinish2',
'OST_WallsFinish1',
'OST_WallsSubstrate',
'OST_WallsInsulation',
'OST_WallsStructure',
'OST_WallsMembrane',
'OST_CurtaSystem',
'OST_Cornices',
'OST_Ramps',
'OST_CurtainWallMullions',
'OST_CurtainWallPanels',
'OST_AreaReferenceVisibility',
'OST_RoomReferenceVisibility',
'OST_Rooms',
'OST_GenericModel',
'OST_StairsRailingRail',
'OST_StairsRailingBaluster',
'OST_StairsRailing',
'OST_StairsSupportsAboveCut',
'OST_StairsStringerCarriage',
'OST_Stairs',
'OST_Columns',
'OST_Ceilings',
'OST_Roofs',
'OST_Floors',
'OST_DoorsGlassProjection',
'OST_DoorsFrameMullionProjection',
'OST_DoorsOpeningProjection',
'OST_DoorsPanelProjection',
'OST_Doors',
'OST_WindowsOpeningProjection',
'OST_WindowsSillHeadProjection',
'OST_WindowsFrameMullionProjection',
'OST_WindowsGlassProjection',
'OST_Windows',
'OST_Walls'];
# Разместите код под этой строкой

# Назначьте вывод переменной OUT.
OUT = a
# ----------------------------------------
byName = Category.ByName(name=right_categories)
o_group_indocument = Orchid.RevitProject.Elements.Group.InDocument()
o_group_ungroup = Orchid.RevitProject.Elements.Group.UnGroup(group=o_group_indocument)
code_block = CodeBlock(pass=byName, waitfor=o_group_ungroup) { [pass,waitfor][0]; }
all_elements_of_category = ElementsOfCategory(Category=code_block)
flatten = List.Flatten(list=all_elements_of_category)
string = StringInput("EO_Местоположение")
o_document_current = Orchid.RevitProject.Common.Document.Current()
o_document_path = Orchid.RevitProject.Common.Document.Path(document=o_document_current)

# group: ИСХОДНЫЕ ДАННЫЕ
file_path = Filename("C:\01_Проекты\01_Шали-Бавлы\01_Рабочая\3 этап\xls\Шали-Бавлы_3 этап_Здания и сооружения.xlsx")

file_from_path = FileObject(path=file_path)
string_2 = StringInput("Номер,пикет")
boolean = BoolSelector(true)
boolean_2 = BoolSelector(false)
importExcel = Data.ImportExcel(file=file_from_path, sheetName=string_2, readAsStrings=boolean, showExcel=boolean_2)
code_block_2 = CodeBlock { 3; }
dropItems = List.DropItems(list=importExcel, amount=code_block_2)
поиск_местоположения = Python(IN[0]=o_document_path, IN[1]=dropItems)
# ---------- поиск_местоположения.python (26 lines) ----------
# Загрузить стандартную библиотеку Python и библиотеку DesignScript
import sys
import clr
clr.AddReference('ProtoGeometry')
from Autodesk.DesignScript.Geometry import *

# Введенные в этом узле данные сохраняется в виде списка в переменных IN.
currentdocpath = IN[0]
allExcel = IN[1]
EO_mestopolozheniye = ""

for stroka in allExcel:
	
	gostfilename = stroka[21]
	mestopol = stroka[8]
	currentdocname = currentdocpath[currentdocpath.rfind("\\")+1:-4]
	if currentdocname == gostfilename:
		EO_mestopolozheniye = mestopol
		break
	
			

# Разместите код под этой строкой

# Назначьте вывод переменной OUT.
OUT = EO_mestopolozheniye
# ----------------------------------------
python_script = Python(IN[0]=flatten, IN[1]=string, IN[2]=поиск_местоположения)
# ---------- python_script.python (34 lines) ----------
import clr

#Import the Revit API
clr.AddReference('RevitAPI')
import Autodesk
from Autodesk.Revit.DB import *

#Import DocumentManager and TransactionManager
clr.AddReference('RevitServices')
import RevitServices
from RevitServices.Persistence import DocumentManager
from RevitServices.Transactions import TransactionManager

#Reference the active Document and application
doc = DocumentManager.Instance.CurrentDBDocument

elem = UnwrapElement(IN[0])
parname = IN[1]
value = IN[2]

tlist = []


for i in range(len(elem)):
	elem_param = elem[i].LookupParameter(parname)
	try:
		TransactionManager.Instance.EnsureInTransaction(doc)
		elem_param.Set(value)
		tlist.append("success")
		TransactionManager.Instance.TransactionTaskDone()
	except:
		tlist.append("no parameter")

OUT = tlist
# ----------------------------------------
