# Dynamo graph 18_КСИ-Местоположение в таблицу элементов.dyn (Dynamo 2.6.2.15705)

# group: Общая таблица элементов
file_path = Filename("C:\01_Проекты\01_Шали-Бавлы\01_Рабочая\2 этап\xls\Шали-Бавлы_2 этап_Элементы_23062023.xlsx")
file_from_path = FileObject(path=file_path)
string = StringInput("Шали-Бавлы_2 этап_Элементы_2306")
boolean = BoolSelector(true)
boolean_2 = BoolSelector(false)
importExcel = Data.ImportExcel(file=file_from_path, sheetName=string, readAsStrings=boolean, showExcel=boolean_2)

# group: Таблица местоположений
file_path_2 = Filename("C:\01_Проекты\01_Шали-Бавлы\01_Рабочая\2 этап\xls\Шали-Бавлы_2 этап_КСИ.xlsm")
file_from_path_2 = FileObject(path=file_path_2)
string_2 = StringInput("КСИ - местоположения")
boolean_3 = BoolSelector(true)
boolean_4 = BoolSelector(false)
importExcel_2 = Data.ImportExcel(file=file_from_path_2, sheetName=string_2, readAsStrings=boolean_3, showExcel=boolean_4)

code_block = CodeBlock { 1; }
dropItems = List.DropItems(list=importExcel_2, amount=code_block)
code_block_2 = CodeBlock { 4; }
getItemAtIndex = List.GetItemAtIndex(list=dropItems@L2, index=code_block_2)
code_block_3 = CodeBlock { 4; }
getItemAtIndex_2 = List.GetItemAtIndex(list=dropItems@L2, index=code_block_3)
