# Dynamo graph 21_Очистка файлов.dyn "20_Очистка файлов" (Dynamo 2.6.2.15705)

element_types = ElementTypes("ImageInstance")  # frozen
all_elements_of_type = ElementsOfType(element_type=element_types)
code_block = CodeBlock(a=all_elements_of_type) { a.Name; }
element_types_2 = ElementTypes("ImportInstance")
all_elements_of_type_2 = ElementsOfType(element_type=element_types_2)
element_types_3 = ElementTypes("CADLinkType")
all_elements_of_type_3 = ElementsOfType(element_type=element_types_3)
element_types_4 = ElementTypes("RevitLinkInstance")
all_elements_of_type_4 = ElementsOfType(element_type=element_types_4)
categories = Categories("OST_Schedules")
all_elements_of_category = ElementsOfCategory(Category=categories)
element_types_5 = ElementTypes("RevitLinkType")
all_elements_of_type_5 = ElementsOfType(element_type=element_types_5)
list_create = List.Create(item0=all_elements_of_type_2, item1=all_elements_of_type_3, item2=all_elements_of_type_4, item3=all_elements_of_category, item4=all_elements_of_type_5)
flatten = List.Flatten(list=list_create)
delete = Element.Delete(element=flatten)
