# Dynamo graph 24_Выгрузка EO.dyn (Dynamo 2.6.2.15705)
# packages: Orchid 206.6.0.8434

# group: Сбор абсолютно всех элементов
right_categories = Python()  # frozen; unwired: IN[0]
# ---------- right_categories.python (216 lines) ----------
# Загрузить стандартную библиотеку Python и библиотеку DesignScript
import sys
import clr
clr.AddReference('ProtoGeometry')
from Autodesk.DesignScript.Geometry import *

# Введенные в этом узле данные сохраняется в виде списка в переменных IN.
dataEnteringNode = IN
a = ['OST_TrussChord',
'OST_TrussWeb',
'OST_Coupler',
'OST_StructConnectionOthers',
'OST_StructConnectionBolts',
'OST_StructConnectionAnchors',
'OST_StructConnectionPlates',
'OST_StructConnectionProfiles',
'OST_StructConnectionReference',
'OST_StructConnectionSymbol',
'OST_StructConnections',
'OST_FabricReinforcementWire',
'OST_FabricReinforcementBoundary',
'OST_FabricReinforcement',
'OST_RebarShape',
'OST_PathRein',
'OST_AreaRein',
'OST_Rebar',
'OST_FabricationPipeworkInsulation',
'OST_FabricationDuctworkLining',
'OST_FabricationContainmentDrop',
'OST_FabricationContainmentRise',
'OST_FabricationPipeworkDrop',
'OST_FabricationPipeworkRise',
'OST_FabricationContainmentSymbology',
'OST_FabricationContainmentCenterLine',
'OST_FabricationContainment',
'OST_FabricationPipework',
'OST_FabricationHangers',
'OST_FabricationDuctwork',
'OST_PipeSegments',
'OST_PlaceHolderPipes',
'OST_PlaceHolderDucts',
'OST_ElectricalInternalCircuits',
'OST_PanelScheduleGraphics',
'OST_CableTrayRun',
'OST_ConduitRun',
'OST_ConduitDrop',
'OST_ConduitRiseDrop',
'OST_CableTrayDrop',
'OST_CableTrayRiseDrop',
'OST_Conduit',
'OST_CableTray',
'OST_ConduitFitting',
'OST_CableTrayFitting',
'OST_HVAC_Zones',
'OST_SwitchSystem',
'OST_Sprinklers',
'OST_LightingDevices',
'OST_FireAlarmDevices',
'OST_DataDevices',
'OST_CommunicationDevices',
'OST_SecurityDevices',
'OST_NurseCallDevices',
'OST_TelephoneDevices',
'OST_PipeAccessory',
'OST_PipeCurvesRiseDrop',
'OST_FlexPipeCurves',
'OST_PipeFitting',
'OST_PipeCurves',
'OST_PipingSystem',
'OST_Wire',
'OST_ElectricalCircuit',
'OST_FlexDuctCurves',
'OST_DuctAccessory',
'OST_DuctSystem',
'OST_DuctTerminal',
'OST_DuctFitting',
'OST_DuctCurves',
'OST_BridgeBearings',
'OST_BridgeGirders',
'OST_BridgeFoundations',
'OST_BridgeDecks',
'OST_BridgeArches',
'OST_BridgeCables',
'OST_BridgeTowers',
'OST_BridgePiers',
'OST_BridgeAbutments',
'OST_MEPSpaces',
'OST_MassShade',
'OST_MassOpening',
'OST_MassSkylights',
'OST_MassGlazing',
'OST_MassRoof',
'OST_MassExteriorWall',
'OST_MassInteriorWall',
'OST_MassZone',
'OST_MassForm',
'OST_MassFloor',
'OST_Mass',
'OST_DividedSurface_PatternFill',
'OST_RampsStringer',
'OST_Areas',
'OST_RoofSoffit',
'OST_EdgeSlab',
'OST_Gutter',
'OST_Fascia',
'OST_Entourage',
'OST_Planting',
'OST_StructuralStiffener',
'OST_SpecialityEquipment',
'OST_ColumnAnalyticalRigidLinks',
'OST_Topography',
'OST_StructuralTruss',
'OST_AnalyticalRigidLinks',
'OST_StructuralColumns',
'OST_KickerBracing',
'OST_StructuralFramingSystem',
'OST_VerticalBracing',
'OST_HorizontalBracing',
'OST_Purlin',
'OST_Joist',
'OST_Girder',
'OST_StructuralFramingOther',
'OST_StructuralFraming',
'OST_StructuralFoundation',
'OST_Roads',
'OST_Parking',
'OST_PlumbingFixtures',
'OST_MechanicalEquipment',
'OST_LightingFixtureSource',
'OST_LightingFixtures',
'OST_FurnitureSystems',
'OST_ElectricalFixtures',
'OST_ElectricalEquipment',
'OST_Casework',
'OST_StairsSupports',
'OST_RailingHandRailAboveCut',
'OST_RailingTopRailAboveCut',
'OST_RailingTermination',
'OST_RailingSupport',
'OST_RailingHandRail',
'OST_RailingTopRail',
'OST_StairsOutlinesAboveCut',
'OST_StairsOutlines',
'OST_StairsTrisers',
'OST_StairsLandings',
'OST_StairsRuns',
'OST_CeilingsCutPattern',
'OST_CeilingsDefault',
'OST_CeilingsFinish2',
'OST_CeilingsFinish1',
'OST_CeilingsSubstrate',
'OST_CeilingsInsulation',
'OST_CeilingsStructure',
'OST_CeilingsMembrane',
'OST_FloorsInteriorEdges',
'OST_FloorsCutPattern',
'OST_FloorsDefault',
'OST_FloorsFinish2',
'OST_FloorsFinish1',
'OST_FloorsSubstrate',
'OST_FloorsInsulation',
'OST_FloorsStructure',
'OST_FloorsMembrane',
'OST_RoofsInteriorEdges',
'OST_RoofsCutPattern',
'OST_RoofsDefault',
'OST_RoofsFinish2',
'OST_RoofsFinish1',
'OST_RoofsSubstrate',
'OST_RoofsInsulation',
'OST_RoofsStructure',
'OST_RoofsMembrane',
'OST_WallsCutPattern',
'OST_WallsDefault',
'OST_WallsFinish2',
'OST_WallsFinish1',
'OST_WallsSubstrate',
'OST_WallsInsulation',
'OST_WallsStructure',
'OST_WallsMembrane',
'OST_CurtaSystem',
'OST_Cornices',
'OST_Ramps',
'OST_CurtainWallMullions',
'OST_CurtainWallPanels',
'OST_AreaReferenceVisibility',
'OST_RoomReferenceVisibility',
'OST_Rooms',
'OST_GenericModel',
'OST_StairsRailingRail',
'OST_StairsRailingBaluster',
'OST_StairsRailing',
'OST_StairsSupportsAboveCut',
'OST_StairsStringerCarriage',
'OST_Stairs',
'OST_Columns',
'OST_Ceilings',
'OST_Roofs',
'OST_Floors',
'OST_DoorsGlassProjection',
'OST_DoorsFrameMullionProjection',
'OST_DoorsOpeningProjection',
'OST_DoorsPanelProjection',
'OST_Doors',
'OST_WindowsOpeningProjection',
'OST_WindowsSillHeadProjection',
'OST_WindowsFrameMullionProjection',
'OST_WindowsGlassProjection',
'OST_Windows',
'OST_Walls',
'OST_Furniture'
];
# Разместите код под этой строкой

# Назначьте вывод переменной OUT.
OUT = a
# ----------------------------------------
byName = Category.ByName(name=right_categories)
all_elements_of_category = ElementsOfCategory(Category=byName)
flatten = List.Flatten(list=all_elements_of_category)

проверка_ео_и_кси = Python(IN[0]=flatten)  # unwired: IN[1]
# ---------- проверка_ео_и_кси.python (65 lines) ----------
import clr
import os.path
from datetime import datetime
import codecs

#Import the Revit API
clr.AddReference('RevitAPI')
import Autodesk
from Autodesk.Revit.DB import *

#Import DocumentManager and TransactionManager
clr.AddReference('RevitServices')
import RevitServices
from RevitServices.Persistence import DocumentManager
from RevitServices.Transactions import TransactionManager


#Reference the active Document and application
doc = DocumentManager.Instance.CurrentDBDocument

# ИСХОДНЫЕ ДАННЫЕ
elem = UnwrapElement(IN[0])
params = UnwrapElement(IN[1])


# ПЕРЕМЕННЫЕ
tlist = []
ellist = []

# КОД

for el in elem:
	wronglist = []
	nullpar = []
	misspar = []
	cnt1 = 0
	cnt2 = 0
	
	elid = unicode(el.Id)
	
	
	for par in params:
		try:
			elem_param = el.LookupParameter(par).AsString()
			if elem_param in (None, "", " ", "0", 0, "none", "None"):
				nullpar.append(par)
				cnt1 += 1
		except:
			misspar.append(par)
			cnt2 += 1
	
	if cnt1 == 0 and cnt2 == 0:
		ellist.append(el)
	elif cnt1 > 0 and cnt2 == 0:
		npar = "Не заполнены: " + ",".join(nullpar) + ";"
		tlist.append(elid + ": " + npar)
	elif cnt2 > 0 and cnt1 == 0: 
		mpar = "Не существуют: " + ",".join(misspar) + ";"
		tlist.append(elid + ": " + mpar)
	else:
		npar = "Не заполнены: " + ",".join(nullpar) + ";"
		mpar = "Не существуют: " + ",".join(misspar) + ";"
		tlist.append(elid + ": " + npar + " " + mpar)	
		
OUT = ellist,tlist
# ----------------------------------------
code_block = CodeBlock(a=проверка_ео_и_кси) { a[0]; }
current = Document.Current()
o_document_path = Orchid.RevitProject.Common.Document.Path(document=current)
watch = Watch(o_document_path)
code_block_2 = CodeBlock(a=проверка_ео_и_кси) { a[1]; }
o_document_name = Orchid.RevitProject.Common.Document.Name(document=current)
# note: Проверка на наличие лог-файла.
# Если его нет - то содается новый.
# Выводится путь лог-файла.
python_script = Python(IN[0]=watch, IN[1]=code_block_2, IN[2]=o_document_name)
# ---------- python_script.python (33 lines) ----------
# Загрузить стандартную библиотеку Python и библиотеку DesignScript
import sys
import clr
clr.AddReference('ProtoGeometry')
from Autodesk.DesignScript.Geometry import *
import os.path
from datetime import datetime
import codecs

date = unicode(datetime.now())
time = unicode(datetime.now().time())

# ИСХОДНЫЕ ДАННЫЕ
fpath = IN[0]
logg = IN[1]
fname = IN[2]

newfpath = fpath[:fpath.rfind("\\")+1] + "log.txt"
if os.path.isfile(newfpath) == False:
	f = codecs.open(newfpath, 'w', 'utf-8')
	f.write("Лог создан: " + date + "   " + time + "\n")
	f.write("\n\n" + "Проверка файла " + fname + "   " + date + "\n")
	for l in logg:
		f.write(l + "\n")
	f.close()
else:
	f = codecs.open(newfpath, 'a', 'utf-8')
	f.write("\n\n" + "Проверка файла " + fname + "   " + date + "\n")
	for l in logg:
		f.write(l + "\n")
	f.close()

OUT = newfpath
# ----------------------------------------
o_datastream_await = Orchid.Common.DataStream.Await(pass=code_block, waitFor=python_script)
# note: Сбор элементов с незаполненным EO-кодификатором (чтобы заново все не кодировать)
сбор_незаполненных_элементов = Python(IN[0]=o_datastream_await)
# ---------- сбор_незаполненных_элементов.python (61 lines) ----------
import clr

#Import the Revit API
clr.AddReference('RevitAPI')
import Autodesk
from Autodesk.Revit.DB import *

#Import DocumentManager and TransactionManager
clr.AddReference('RevitServices')
import RevitServices
from RevitServices.Persistence import DocumentManager
from RevitServices.Transactions import TransactionManager

#Reference the active Document and application
doc = DocumentManager.Instance.CurrentDBDocument

elem = UnwrapElement(IN[0])
eoparam = "EO_Кодификатор_V0"
ksiparam = "КСИ Составной код#XNKC0004"
eolist, ksilist = [], []
tlist = []

for el in elem:
	try:
		elem_param1 = str(el.LookupParameter("EO_Кодификатор_V0").AsString())
		elem_param2 = str(el.LookupParameter("КСИ Составной код#XNKC0004").AsString())
		if len(elem_param1) < 10 and len(elem_param2) > 10:
			eolist.append(el)
		elif len(elem_param1) > 10 and len(elem_param2) < 10:
			ksilist.append(el)
		elif len(elem_param1) < 10 and len(elem_param2) < 10:
			eolist.append(el)
			ksilist.append(el)
			
		tlist.append([elem_param1,elem_param2])
	except:	
		continue
	
"""	
	
	try:
		elem_param1 = el.LookupParameter("КСИ Составной код#XNKC0004").AsString()
		
		if len(elem_param1) < 10:
			eolist.append(el)
		
	except:
		continue
"""
"""
if len(eolist) > 1 and len(ksilist) == 0:
	OUT = eolist, ["0"]
elif len(eolist) == 0 and len(ksilist) > 1:
	OUT = ["0"], ksilist
elif len(eolist) > 1 and len(ksilist) > 1:
	OUT = eolist,ksilist
else:
	OUT = ["0"], ["0"]
"""

OUT = eolist,ksilist
# ----------------------------------------
code_block_3 = CodeBlock(a=сбор_незаполненных_элементов) { a[0]; }
code_block_4 = CodeBlock { "EO_Кодификатор_V0"; }
имя_файла = Python(IN[0]=o_document_name)
# ---------- имя_файла.python (20 lines) ----------
# Загрузить стандартную библиотеку Python и библиотеку DesignScript
import sys
import clr
clr.AddReference('ProtoGeometry')
from Autodesk.DesignScript.Geometry import *

# Введенные в этом узле данные сохраняется в виде списка в переменных IN.
a = IN[0]
b = ""

for i in a:
	if i == "-" or i == " " or i == "+":
		b += ""
	else:
		b += i

# Разместите код под этой строкой

# Назначьте вывод переменной OUT.
OUT = b
# ----------------------------------------
count = List.Count(list=code_block_3)
code_block_5 = CodeBlock(el=code_block_3) { el.Name; el.GetCategory.Name; }
eo_кодификатор_v0_генерация = Python(IN[0]=имя_файла, IN[1]=count, IN[2]=code_block_5.out0, IN[3]=code_block_5.out1)  # "EO_Кодификатор_V0 - Генерация уникального кода"
# ---------- eo_кодификатор_v0_генерация.python (67 lines) ----------
# Загрузить стандартную библиотеку Python и библиотеку DesignScript
import sys
import clr
import random
import string

clr.AddReference('ProtoGeometry')
from Autodesk.DesignScript.Geometry import *

def generate_alphanum_random_string(length):
    letters_and_digits = string.ascii_letters + string.digits
    rand_string = ''.join(random.sample(letters_and_digits, length))
    return rand_string

# ИСХОДНЫЕ ДАННЫЕ
fn = IN[0]
listcount = IN[1]
names = IN[2]
cats = IN[3]

# ПЕРЕМЕННЫЕ
uidlist = []
nameslist = []
catlist = []
flist = []

for l in range(listcount):
	uidik = generate_alphanum_random_string(16)
	
	if len(names[l]) == 0:
		newname = "empty"
	else:
		ln = len(names[l])
		n1, n2, n3, n4 = names[l][0], names[l][ln//4], names[l][ln//2], names[l][3 * ln//4]

		if n1 in (" ", "<", ">", "-", "{", "}"):
			n1 = "0"
		if n2 in (" ", "<", ">", "-", "{", "}"):
			n2 = "1"
		if n3 in (" ", "<", ">", "-", "{", "}"):
			n3 = "2"
		if n4 in (" ", "<", ">", "-", "{", "}"):
			n4 = "3"
		newname = unicode(n1) + unicode(n2) + unicode(n3) + unicode(n4)	
	
	if len(cats[l]) == 0:
		newcatname = "empty"
	else:
		lc = len(cats[l])
		c1, c2, c3, c4 = cats[l][0], cats[l][lc//4], cats[l][lc//2], cats[l][3 * lc//4]
		if c1 in (" ", "<", ">", "-", "{", "}"):
			c1 = "0"
		if c2 in (" ", "<", ">", "-", "{", "}"):
			c2 = "1"
		if c3 in (" ", "<", ">", "-", "{", "}"):
			c3 = "2"
		if c4 in (" ", "<", ">", "-", "{", "}"):
			c4 = "3"
		newcatname = unicode(c1) + unicode(c2) + unicode(c3) + unicode(c4)	
	
	
	
	
	flist.append(unicode(fn)+"_"+unicode(newcatname)+"_"+unicode(newname)+"_"+unicode(uidik))

OUT = flist
	
# ----------------------------------------
заполнение_кодификатора = Python(IN[0]=code_block_3, IN[1]=code_block_4, IN[2]=eo_кодификатор_v0_генерация)
# ---------- заполнение_кодификатора.python (34 lines) ----------
import clr

#Import the Revit API
clr.AddReference('RevitAPI')
import Autodesk
from Autodesk.Revit.DB import *

#Import DocumentManager and TransactionManager
clr.AddReference('RevitServices')
import RevitServices
from RevitServices.Persistence import DocumentManager
from RevitServices.Transactions import TransactionManager

#Reference the active Document and application
doc = DocumentManager.Instance.CurrentDBDocument

elem = UnwrapElement(IN[0])
parname = IN[1]
values = UnwrapElement(IN[2])

tlist = []


for i in range(len(elem)):
	elem_param = elem[i].LookupParameter('EO_Кодификатор_V0')
	try:
		TransactionManager.Instance.EnsureInTransaction(doc)
		elem_param.Set(values[i])
		tlist.append("success")
		TransactionManager.Instance.TransactionTaskDone()
	except:
		tlist.append("no parameter")

OUT = tlist
# ----------------------------------------
code_block_6 = CodeBlock(a=сбор_незаполненных_элементов) { a[1]; }
заполнение_кси_составного_кода = Python(IN[0]=code_block_6)
# ---------- заполнение_кси_составного_кода.python (49 lines) ----------
import clr

#Import the Revit API
clr.AddReference('RevitAPI')
import Autodesk
from Autodesk.Revit.DB import *

#Import DocumentManager and TransactionManager
clr.AddReference('RevitServices')
import RevitServices
from RevitServices.Persistence import DocumentManager
from RevitServices.Transactions import TransactionManager

#Reference the active Document and application
doc = DocumentManager.Instance.CurrentDBDocument

#ИСХОДНЫЕ ДАННЫЕ
elem = UnwrapElement(IN[0])
ksiparam = "КСИ Составной код#XNKC0004"

#КСИ-Коды для сборки
#"КСИ Класс строительной информации#XNKC0003"
#"КСИ Функциональный код многоуровневый#XNKF0002"
#"КСИ Место расположения#XNKL0001"
#"КСИ Код типа класса#XNKT0001"


ksilist = []
tlist = []

for el in elem:
	try:	
		TransactionManager.Instance.EnsureInTransaction(doc)
		ksimain = el.LookupParameter("КСИ Составной код#XNKC0004")
		
		ksi1 = str(el.LookupParameter("КСИ Класс строительной информации#XNKC0003").AsString())
		ksi2 = str(el.LookupParameter("КСИ Функциональный код многоуровневый#XNKF0002").AsString())
		ksi3 = str(el.LookupParameter("КСИ Место расположения#XNKL0001").AsString())
		ksi4 = str(el.LookupParameter("КСИ Код типа класса#XNKT0001").AsString())
		
		ksisum = "<" + ksi1 + ">=" + ksi2 + "//++" + ksi3 + "//" + ksi4
		ksimain.Set(ksisum)
		tlist.append(success)
		TransactionManager.Instance.ForceCloseTransaction(doc)
	except:	
		continue
	

OUT = tlist
# ----------------------------------------

# group: ИСХОДНЫЕ ДАННЫЕ
папка_с_файлами = Directory("C:\01_Проекты\01_Шали-Бавлы\01_Рабочая\3 этап\Revit\Влож")
file_path = Filename("C:\Users\aprohorov\Desktop\TEST_Тома.xlsx")
code_block_7 = CodeBlock { "Sheet1"; }
список_проверяемых_параметров_на = CodeBlock()  # "Список проверяемых параметров на заполненность"
# ---------- список_проверяемых_параметров_на.designscript (9 lines) ----------
[

"EO_Раздел проекта",
"EO_Подраздел проекта",
"EO_Шифр тома",
"EO_Наименование документа",
"EO_Местоположение"

];
# ----------------------------------------
шифр_проекта = CodeBlock { "6139"; }

o_directory_frompath = Orchid.Common.Directory.FromPath(path=папка_с_файлами)
string = StringInput("*.rvt")
o_directory_contents = Orchid.Common.Directory.Contents(directory=o_directory_frompath, searchString=string)
o_document_backgroundopen = Orchid.RevitProject.Common.Document.BackgroundOpen(file=o_directory_contents)
code_block_8 = CodeBlock { 0; 0; }
code_block_9 = CodeBlock { "Шифр проекта"; }
addItemToFront = List.AddItemToFront(item=code_block_9, list=список_проверяемых_параметров_на)
o_selection_modelelement = Orchid.RevitProject.Elements.Selection.ModelElement(document=o_document_backgroundopen)
flatten_2 = List.Flatten(list=o_selection_modelelement.Element)
проверка_ео_и_кси_2 = Python(IN[0]=flatten_2, IN[1]=список_проверяемых_параметров_на, IN[2]=шифр_проекта)
# ---------- проверка_ео_и_кси_2.python (69 lines) ----------
import clr
import os.path
from datetime import datetime
import codecs

#Import the Revit API
clr.AddReference('RevitAPI')
import Autodesk
from Autodesk.Revit.DB import *

#Import DocumentManager and TransactionManager
clr.AddReference('RevitServices')
import RevitServices
from RevitServices.Persistence import DocumentManager
from RevitServices.Transactions import TransactionManager


#Reference the active Document and application
doc = DocumentManager.Instance.CurrentDBDocument

# ИСХОДНЫЕ ДАННЫЕ
elem = UnwrapElement(IN[0])
params = UnwrapElement(IN[1])
projectnumber = IN[2]


# ПЕРЕМЕННЫЕ
tlist = []
ellist = []
flist = []
# КОД

for el in elem:
	wronglist = []
	nullpar = []
	misspar = []
	
	elparam = [projectnumber]
	
	cnt1 = 0
	cnt2 = 0
	
	elid = unicode(el.Id)
	
	
	for par in params:
		try:
			elem_param = el.LookupParameter(par).AsString()
			if elem_param in (None, "", " ", "0", 0, "none", "None", "N/A"):
				nullpar.append(par)
				cnt1 += 1
				
			else:
				elparam.append(elem_param)
		except:
			misspar.append(par)
			cnt2 += 1
			
	
	if cnt1 == 0 and cnt2 == 0:
		ellist.append(";".join(elparam))

ellist = set(ellist)

for el in ellist:
	flist.append(el.split(";"))


OUT = flist
# ----------------------------------------
addItemToFront_2 = List.AddItemToFront(item=addItemToFront, list=проверка_ео_и_кси_2)
boolean = BoolSelector(true)
exportExcel = Data.ExportExcel(filePath=file_path, sheetName=code_block_7, startRow=code_block_8.out0, startCol=code_block_8.out1, data=addItemToFront_2, overWrite=boolean)
o_datastream_await_2 = Orchid.Common.DataStream.Await(pass=o_document_backgroundopen, waitFor=exportExcel)
boolean_2 = BoolSelector(false)
o_document_close = Orchid.RevitProject.Common.Document.Close(document=o_datastream_await_2, save=boolean_2)
file_from_path = FileObject(path=file_path)
boolean_3 = BoolSelector(true)
boolean_4 = BoolSelector(false)
importExcel = Data.ImportExcel(file=file_from_path, sheetName=code_block_7, readAsStrings=boolean_3, showExcel=boolean_4)
