# Dynamo graph AddInfotoMaterial v2.dyn (Dynamo 2.12.0.5650)

string = StringInput("D:\Revit\ID.xlsx")
string_2 = StringInput("Materials")
string_3 = StringInput("M1")
string_4 = StringInput("Материалы")
byName = Category.ByName(name=string_4)
all_elements_of_category = ElementsOfCategory(Category=byName)
code_block = CodeBlock(a=all_elements_of_category) { a.Name; }
string_5 = StringInput("ADSK")
contains = String.Contains(string=code_block, searchFor=string_5)
filterByBoolMask = List.FilterByBoolMask(list=all_elements_of_category, mask=contains)
code_block_2 = CodeBlock(a=filterByBoolMask.in) { a.Name; }
string_6 = StringInput("Стадия")
contains_2 = String.Contains(string=code_block_2, searchFor=string_6)
filterByBoolMask_2 = List.FilterByBoolMask(list=filterByBoolMask.in, mask=contains_2)
code_block_3 = CodeBlock(a=all_elements_of_category) { a.Name; }
string_7 = StringInput("NIIPI")
contains_3 = String.Contains(string=code_block_3, searchFor=string_7)
filterByBoolMask_3 = List.FilterByBoolMask(list=all_elements_of_category, mask=contains_3)
code_block_4 = CodeBlock(a=filterByBoolMask_2.out, b=filterByBoolMask_3.in) { [a,b]; }
flatten = List.Flatten(list=code_block_4)
count = List.Count(list=flatten)
cycle = List.Cycle(list=string_3, amount=count)
code_block_5 = CodeBlock(n=flatten) { 1..#List.Count(n)..1; }
string_from_object = FromObject(object=code_block_5)
length = String.Length(string=string_from_object)
code_block_6 = CodeBlock(a=length, b=string_from_object) { a == 1?"00000"+b:(a == 2?"0000"+b:(a == 3?"000"+b:(a == 4?"00"+b:(a == 5?"0"+b:(a == 6?b:0))))); }
code_block_7 = CodeBlock(a=flatten) { a.Name; }
code_block_8 = CodeBlock(a=cycle, b=code_block_6, c=code_block_7) { List.Transpose([a,b,c]); }
code_block_9 = CodeBlock { 1; 0; }
boolean = BoolSelector(false)
openXMLExportExcel = Data.OpenXMLExportExcel(filePath=string, sheetName=string_2, data=code_block_8, startRow=code_block_9.out0, startColumn=code_block_9.out1, writeAsString=boolean)  # frozen
string_8 = StringInput("C0")
setParameterByName = Element.SetParameterByName(element=flatten, parameterName=string_8, value=string_3)
string_9 = StringInput("C1")
setParameterByName_2 = Element.SetParameterByName(element=setParameterByName, parameterName=string_9, value=code_block_6)
