# Dynamo graph AddInfotoMaterial.dyn (Dynamo 2.12.0.5650)

python_script = Python()  # IronPython2; frozen; unwired: IN[0], IN[1]
# ---------- python_script.python (43 lines) ----------
import clr # Модуль для подгрузки .NET библиотек

# Библиотеки Revit API
clr.AddReference('RevitAPI') # Основная библиотека Revit API
clr.AddReference('RevitAPIUI') # Библиотека Revit API интерфейса
from Autodesk.Revit.DB import * # Указать классы для импорта
# from Autodesk.Revit.UI import * # Убрать решетку (если надо) и указать классы

# Библиотеки Dynamo
clr.AddReference('RevitNodes') # Конвертация элементов и геометрии
import Revit # Расширяем исходные методы классов через ImportExtensions
clr.ImportExtensions(Revit.GeometryConversion)
clr.ImportExtensions(Revit.Elements)
clr.AddReference('RevitServices') # Работа с документом и транзакциями
from RevitServices.Persistence import DocumentManager as DM # Менеджер документа
from RevitServices.Transactions import TransactionManager as TM # Менеджер транзакций

# Системные библиотеки
import System # Работа с системными типами и структурами данных .NET
from System.Collections.Generic import * # Можно конкретно указать List
import sys # Настройки интерпретатора IronPython, путь к библиотекам
sys.path.append(r'C:\Program Files (x86)\IronPython 2.7\Lib')

# Документ и транзакции
doc = DM.Instance.CurrentDBDocument # Получение файла документа
# uidoc = DM.Instance.CurrentUIApplication.ActiveUIDocument # Интерфейс

names_mat, current_mat = IN[0], IN[1]
fmat, endmat = [], []

for m in current_mat:
	if ("ADSK" in m.Name or "NIIPI" in m.Name) and "Стадия" not in m.Name:
		fmat.append(m)

for j in fmat:
	cnt = 0
	for k in names_mat:
		if j.Name == k:
			cnt += 1
	if cnt == 0:
		endmat.append(j)

OUT = endmat
# ----------------------------------------
python_script_2 = Python()  # IronPython2; frozen; unwired: IN[0]
# ---------- python_script_2.python (32 lines) ----------
import sys
import clr
clr.AddReference('ProtoGeometry')
from Autodesk.DesignScript.Geometry import *


materials = IN[0]
names,materials_new = [],[]

for i in materials:
	if ("ADSK" in i.Name or "NIIPI" in i.Name) and "Стадия" not in i.Name:
		"""ni = (i.Name).find("_", 5)"""
		materials_new.append(i)
		np = (i.Name[5:]).replace("_"," ")
		if np.count(" ") == 1:
			ni = np.find(" ")
			n1, n2 = np[:ni], np[ni+1:]
			if n1.lower() in n2.lower():
				names.append(n2)
			else:
				if "Грунт" in n1 or "Древесина" in n1:	
					names.append(n2)
				else:
					names.append(n1 + " " + n2)
		else:
			if "покрытие" in np or "Минеральная" in np or "Полимерная" in np or "Изоляция" in np or "Грунт" in np:
				ni1 = np.find(" ")
				ni2 = np.find(" ", ni1+1)
				names.append(np[ni2+1:])
			else:
				names.append(np)
OUT = materials_new, names
# ----------------------------------------
code_block = CodeBlock(a=python_script_2) { a[0]; a[1]; }
python_script_3 = Python(IN[0]=code_block.out0, IN[1]=code_block.out1)  # IronPython2
# ---------- python_script_3.python (38 lines) ----------
import clr # Модуль для подгрузки .NET библиотек

# Библиотеки Revit API
clr.AddReference('RevitAPI') # Основная библиотека Revit API
clr.AddReference('RevitAPIUI') # Библиотека Revit API интерфейса
from Autodesk.Revit.DB import * # Указать классы для импорта
# from Autodesk.Revit.UI import * # Убрать решетку (если надо) и указать классы

# Библиотеки Dynamo
clr.AddReference('RevitNodes') # Конвертация элементов и геометрии
import Revit # Расширяем исходные методы классов через ImportExtensions
clr.ImportExtensions(Revit.GeometryConversion)
clr.ImportExtensions(Revit.Elements)
clr.AddReference('RevitServices') # Работа с документом и транзакциями
from RevitServices.Persistence import DocumentManager as DM # Менеджер документа
from RevitServices.Transactions import TransactionManager as TM # Менеджер транзакций

# Системные библиотеки
import System # Работа с системными типами и структурами данных .NET
from System.Collections.Generic import * # Можно конкретно указать List
import sys # Настройки интерпретатора IronPython, путь к библиотекам
sys.path.append(r'C:\Program Files (x86)\IronPython 2.7\Lib')

# Документ и транзакции
doc = DM.Instance.CurrentDBDocument # Получение файла документа
# uidoc = DM.Instance.CurrentUIApplication.ActiveUIDocument # Интерфейс

materials, names_materials = IN[0], IN[1]

modif_materials = []

if len

for i,j in zip(materials,names_materials):
	mm = Revit.Elements.Element.SetParameterByName(i, "Группа модели", j)
	modif_materials.append(i)
	
OUT = modif_materials
# ----------------------------------------
string = StringInput("D:\Revit\Материалы\material_log.txt")
code_block_2 = CodeBlock { "[DynamoSync] Изменены параметры " + a + " материалов. Неизвестных базе материалов: " + b + "."; }  # unwired: a, b
code_block_3 = CodeBlock { "D:\\Revit\\Материалы\\material_log.txt"; }
python_script_4 = Python(IN[0]=code_block_2, IN[1]=code_block_3)  # IronPython2; frozen; unwired: IN[2], IN[3], IN[4]
# ---------- python_script_4.python (62 lines) ----------
# -*- coding: UTF-8 -*-
import clr
import os
import time
import codecs
from datetime import datetime

clr.AddReference("ProtoGeometry")
from Autodesk.DesignScript.Geometry import *

clr.AddReference("RevitNodes")
import Revit

clr.ImportExtensions(Revit.Elements)
clr.ImportExtensions(Revit.GeometryConversion)

clr.AddReference("RevitServices")
import RevitServices
from RevitServices.Persistence import DocumentManager
from RevitServices.Transactions import TransactionManager as TM

clr.AddReference("RevitAPI")
import Autodesk
from Autodesk.Revit.DB import *

clr.AddReference('System.Core')
from System.Collections.Generic import *


doc = DocumentManager.Instance.CurrentDBDocument
TM.Instance.EnsureInTransaction(doc) 

TM.Instance.ForceCloseTransaction()

sync, l = IN[0], IN[1]
prname, uid, matname = UnwrapElement(IN[2]), UnwrapElement(IN[3]), UnwrapElement(IN[4])

t = datetime.now().strftime("%Y-%m-%d %H:%M:%S")



with codecs.open(l, "a", encoding = 'utf-8') as file:
	file.write("\n" + "\n" + "\n" + "---------" + t + "      " + prname + "---------" + "\n")
	for i in range(len(matname)):
		file.write("\n" + uid[i] + "    " + matname[i])



modelPath = doc.GetWorksharingCentralModelPath()
centralServerPath = ModelPathUtils.ConvertModelPathToUserVisiblePath(modelPath)

chckt = FilteredWorksetCollector(doc).OfKind(WorksetKind.UserWorkset)
transOpts = TransactWithCentralOptions()
syncOpts = SynchronizeWithCentralOptions()
syncOpts.Comment = sync
relinquishOpts = RelinquishOptions(True)
syncOpts.SetRelinquishOptions(relinquishOpts)
syncOpts.SaveLocalAfter = True
	
doc.SynchronizeWithCentral(transOpts, syncOpts)

OUT = 0
# ----------------------------------------

# group: DB
string_2 = StringInput("D:\Revit\ID.xlsx")
string_3 = StringInput("Materials")
code_block_4 = CodeBlock { 0; 1; }
boolean = BoolSelector(true)
openXMLImportExcel = Data.OpenXMLImportExcel(filePath=string_2, sheetName=string_3, startRow=code_block_4.out1, startColumn=code_block_4.out0, readAsString=boolean)
code_block_5 = CodeBlock { 0; }
removeItemAtIndex = List.RemoveItemAtIndex(list=openXMLImportExcel, indices=code_block_5)
code_block_6 = CodeBlock { 2; }
getItemAtIndex = List.GetItemAtIndex(list=removeItemAtIndex@L2, index=code_block_6)
code_block_7 = CodeBlock { 0; }
getItemAtIndex_2 = List.GetItemAtIndex(list=removeItemAtIndex@L2, index=code_block_7)
byKeysValues = DesignScript.Builtin.Dictionary.ByKeysValues(keys=getItemAtIndex, values=getItemAtIndex_2)

# group: Project Materials
categories = Categories("OST_Materials")
all_elements_of_category = ElementsOfCategory(Category=categories)
python_script_5 = Python(IN[0]=all_elements_of_category)  # IronPython2
# ---------- python_script_5.python (35 lines) ----------
import clr # Модуль для подгрузки .NET библиотек

# Библиотеки Revit API
clr.AddReference('RevitAPI') # Основная библиотека Revit API
clr.AddReference('RevitAPIUI') # Библиотека Revit API интерфейса
from Autodesk.Revit.DB import * # Указать классы для импорта
# from Autodesk.Revit.UI import * # Убрать решетку (если надо) и указать классы

# Библиотеки Dynamo
clr.AddReference('RevitNodes') # Конвертация элементов и геометрии
import Revit # Расширяем исходные методы классов через ImportExtensions
clr.ImportExtensions(Revit.GeometryConversion)
clr.ImportExtensions(Revit.Elements)
clr.AddReference('RevitServices') # Работа с документом и транзакциями
from RevitServices.Persistence import DocumentManager as DM # Менеджер документа
from RevitServices.Transactions import TransactionManager as TM # Менеджер транзакций

# Системные библиотеки
import System # Работа с системными типами и структурами данных .NET
from System.Collections.Generic import * # Можно конкретно указать List
import sys # Настройки интерпретатора IronPython, путь к библиотекам
sys.path.append(r'C:\Program Files (x86)\IronPython 2.7\Lib')

# Документ и транзакции
doc = DM.Instance.CurrentDBDocument # Получение файла документа
# uidoc = DM.Instance.CurrentUIApplication.ActiveUIDocument # Интерфейс

current_mat = IN[0]
fmat = []

for m in current_mat:
	if ("ADSK" in m.Name or "NIIPI" in m.Name) and "Стадия" not in m.Name:
		fmat.append(m)

OUT = fmat
# ----------------------------------------
code_block_8 = CodeBlock(a=python_script_5) { a.Name; }
byKeysValues_2 = DesignScript.Builtin.Dictionary.ByKeysValues(keys=code_block_8, values=python_script_5)

code_block_9 = CodeBlock { 1; }
getItemAtIndex_3 = List.GetItemAtIndex(list=removeItemAtIndex@L2, index=code_block_9)
byKeysValues_3 = DesignScript.Builtin.Dictionary.ByKeysValues(keys=getItemAtIndex, values=getItemAtIndex_3)
добавление_идентификации_в = CodeBlock(d11=byKeysValues, d2=byKeysValues_2, d12=byKeysValues_3)  # "Добавление идентификации в материалы"
# ---------- добавление_идентификации_в.designscript (8 lines) ----------
dk1 = Dictionary.Keys(d11);
dk2 = Dictionary.Keys(d2);
k_inter = List.SetIntersection(dk1,dk2);
vat2 = Dictionary.ValueAtKey(d2,k_inter);
vat11 = Dictionary.ValueAtKey(d11,k_inter);
vat12 = Dictionary.ValueAtKey(d12,k_inter);
set_C0 = Element.SetParameterByName(vat2,"C0",vat11);
set_C1 = Element.SetParameterByName(vat2,"C1",vat12);
# ----------------------------------------
добавление_идентификации_в_2 = CodeBlock(d11=byKeysValues, d2=byKeysValues_2) { dk1 = Dictionary.Keys(d11); dk2 = Dictionary.Keys(d2); k_diff = List.SetDifference(dk2,dk1); }  # "Добавление идентификации в материалы"
count = List.Count(list=openXMLImportExcel)
code_block_10 = CodeBlock(a=count) { a+1; }
openXMLExportExcel = Data.OpenXMLExportExcel()  # unwired: filePath, sheetName, data
c1_существующие = CodeBlock(a=getItemAtIndex_3) { a; }
python_script_6 = Python()  # IronPython2; unwired: IN[0]
# ---------- python_script_6.python (15 lines) ----------
# Загрузить стандартную библиотеку Python и библиотеку DesignScript
import sys
import clr
clr.AddReference('ProtoGeometry')
from Autodesk.DesignScript.Geometry import *

# Введенные в этом узле данные сохраняется в виде списка в переменных IN.
exist_id = IN[0]
all_range = range(0,999999,1)


# Разместите код под этой строкой

# Назначьте вывод переменной OUT.
OUT = all_range
# ----------------------------------------
