# Dynamo graph AddParamtoFam.dyn (Dynamo 2.12.0.5650)
# packages: Orchid 203.2.0.7778, Orchid 212.1.0.7978

string = StringInput("M:\BIM\Revit\Семейства\00_NIIPI\АР\Двери")
contents = Orchid.Common.Directory.Contents(directory=string)
backgroundOpen = Orchid.RevitProject.Common.Document.BackgroundOpen(file=contents)
code_block = CodeBlock { "ADSK_Открывание"; "01 Обязательные ОБЩИЕ"; "Text"; "PG_DATA"; }
create = Orchid.RevitFamily.SharedParameter.Create(familyDocument=backgroundOpen, parameterName=code_block.out0, groupName=code_block.out1, type=code_block.out2, group=code_block.out3)
await_ = Orchid.Common.DataStream.Await(pass=backgroundOpen, waitFor=create)
save = Orchid.RevitProject.Common.Document.Save(document=await_)
string_2 = StringInput("Описание")
string_3 = StringInput("Дверь")
setValue = Orchid.RevitFamily.Parameter.SetValue(familyDocument=backgroundOpen, parameterName=string_2, value=string_3)  # frozen
code_block_2 = CodeBlock(a=setValue) { a != null? b : null; }  # unwired: b
code_block_3 = CodeBlock(a=contents) { a[0]; }
add = Orchid.RevitFamily.SharedParameter.Add(groupName=code_block.out1, group=code_block.out2)  # frozen; unwired: parameterName
