# Dynamo graph AllElementsFromCat.dyn (Dynamo 2.0.5.13212)

выбрать_категорию_элементов = Categories(index=628)  # graph input
all_elements_of_category = ElementsOfCategory(Category=выбрать_категорию_элементов)
name = Custom[Element.Name+](element=all_elements_of_category)  # Gets an element's name. Unlike the OOTB node, this node should work for all Revit elements that have names and will also return the localized names of system parameters, parameter groups, display unit types, parameter types, unit symbol types and unit types.
watch = Watch(name)
true_удалить_false_не_удалять = BoolSelector(true)  # graph input
ꟿ_document_deleteelements = Custom[ꟿ Document.DeleteElements](element=all_elements_of_category, confirm=true_удалить_false_не_удалять)  # Attempts to delete the input list of elements from the active Revit document.The node returns the number of successfully deleted elements and their Ids as a string. Carefully observe the deleted elements count. It may be greater than the input list because hosted elements or tags will be deleted as well. If an element in the list can not be deleted (for example last revision or last view), the whole list will fail to be deleted.
