# Dynamo graph BIMCube.dyn (Dynamo 2.10.1.3976)

выбрать_первый_элемент = DSModelElementSelection()  # 1 picked in the model; graph input
выбрать_второй_элемент = DSModelElementSelection()  # 1 picked in the model; graph input
python_script = Python(IN[0]=выбрать_первый_элемент, IN[1]=выбрать_второй_элемент)  # IronPython2
# ---------- python_script.python (43 lines) ----------
import sys
import clr
clr.AddReference('ProtoGeometry')
from Autodesk.DesignScript.Geometry import *
clr.AddReference('RevitAPI')
import Autodesk.Revit.DB as DB
clr.AddReference('RevitNodes')
import Revit
clr.ImportExtensions(Revit.GeometryConversion)

el1, el2 = UnwrapElement(IN[0]), UnwrapElement(IN[1])

a1 = el1.get_BoundingBox(None)
cor11, cor12 = a1.Max.ToPoint(), a1.Min.ToPoint()

a2 = el2.get_BoundingBox(None)
cor21, cor22 = a2.Max.ToPoint(), a2.Min.ToPoint()

cub1 = Cuboid.ByCorners(cor11, cor12)
cub2 = Cuboid.ByCorners(cor21, cor22)

if Geometry.DoesIntersect(cub1, cub2) == True:
	cub_i = Geometry.Intersect(cub1, cub2)
	OUT = cub_i
else:
	c1, c2 = Solid.Centroid(cub1), Solid.Centroid(cub2)
	if cub1.Volume < cub2.Volume:
		fc = c1
	else:
		fc = c2
	dX = abs(c1.X - c2.X)
	dY = abs(c1.Y - c2.Y)
	dZ = abs(c1.Z - c2.Z)
	if dX > dY:
		e = dX
	else:
		e = dY
	if e < 250:
		e = 250
	if dZ < 250:
		dZ = 300
	cub3 = Cuboid.ByLengths(fc, e, e, dZ)
	OUT = cub3
# ----------------------------------------
centroid = Solid.Centroid(solid=python_script)
byOriginNormal = Plane.ByOriginNormal(origin=centroid)
code_block = CodeBlock { 2; }
scale = Geometry.Scale(geometry=python_script, plane=byOriginNormal, xamount=code_block, yamount=code_block, zamount=code_block)
vertices = Topology.Vertices(topology=scale)
pointGeometry = Vertex.PointGeometry(vertex=vertices)
flatten = List.Flatten(list=pointGeometry)
code_block_2 = CodeBlock(a=flatten) { a.X; }
minimumItem = List.MinimumItem(list=code_block_2)
code_block_3 = CodeBlock(a=flatten) { a.Y; }
minimumItem_2 = List.MinimumItem(list=code_block_3)
code_block_4 = CodeBlock(a=flatten) { a.Z; }
minimumItem_3 = List.MinimumItem(list=code_block_4)
byCoordinates = Point.ByCoordinates(x=minimumItem, y=minimumItem_2, z=minimumItem_3)
maximumItem = List.MaximumItem(list=code_block_2)
maximumItem_2 = List.MaximumItem(list=code_block_3)
maximumItem_3 = List.MaximumItem(list=code_block_4)
byCoordinates_2 = Point.ByCoordinates(x=maximumItem, y=maximumItem_2, z=maximumItem_3)
byCorners = Cuboid.ByCorners(lowPoint=byCoordinates, highPoint=byCoordinates_2)
centroid_2 = Solid.Centroid(solid=byCorners)
string = StringInput("IssueCube")
byName = FamilyType.ByName(name=string)
python_script_2 = Python(IN[0]=centroid_2, IN[1]=byName)  # IronPython2
# ---------- python_script_2.python (35 lines) ----------
import clr # Модуль для подгрузки .NET библиотек

# Библиотеки Revit API
clr.AddReference('RevitAPI') # Основная библиотека Revit API
clr.AddReference('RevitAPIUI') # Библиотека Revit API интерфейса
from Autodesk.Revit.DB import * # Указать классы для импорта
# from Autodesk.Revit.UI import * # Убрать решетку (если надо) и указать классы

# Библиотеки Dynamo
clr.AddReference('RevitNodes') # Конвертация элементов и геометрии
import Revit # Расширяем исходные методы классов через ImportExtensions
clr.ImportExtensions(Revit.GeometryConversion)
clr.ImportExtensions(Revit.Elements)
clr.AddReference('RevitServices') # Работа с документом и транзакциями
from RevitServices.Persistence import DocumentManager as DM # Менеджер документа
from RevitServices.Transactions import TransactionManager as TM # Менеджер транзакций
from Autodesk.Revit.DB.Structure import *

doc = DM.Instance.CurrentDBDocument
point = UnwrapElement(IN[0])
ft = UnwrapElement(IN[1])

elementlist = list()

ST = StructuralType.NonStructural

TM.Instance.EnsureInTransaction(doc) # Открытие транзакции

nj = doc.Create.NewFamilyInstance(point.ToXyz(), ft, ST)
elementlist.append(nj)

TM.Instance.TransactionTaskDone() # Закрытие транзакции


OUT = elementlist
# ----------------------------------------
string_2 = StringInput("a")
length = Cuboid.Length(cuboid=byCorners)
setParameterByName = Element.SetParameterByName(element=python_script_2, parameterName=string_2, value=length)
string_3 = StringInput("Height")
height = Cuboid.Height(cuboid=byCorners)
setParameterByName_2 = Element.SetParameterByName(element=python_script_2, parameterName=string_3, value=height)
string_4 = StringInput("b")
width = Cuboid.Width(cuboid=byCorners)
setParameterByName_3 = Element.SetParameterByName(element=python_script_2, parameterName=string_4, value=width)
string_5 = StringInput("Марка")
byFamilyType = FamilyInstance.ByFamilyType(familyType=byName)
count = List.Count(list=byFamilyType)
code_block_5 = CodeBlock(n=count) { n + 1; }
АР = BoolSelector(true)  # graph input
КР = BoolSelector(false)  # graph input
ВК = BoolSelector(true)  # graph input
ОВ = BoolSelector(true)  # graph input
ПБ = BoolSelector(false)  # graph input
ЭО = BoolSelector(false)  # graph input
python_script_3 = Python(IN[0]=code_block_5, IN[1]=АР, IN[2]=КР, IN[3]=ВК, IN[4]=ОВ, IN[5]=ПБ, IN[6]=ЭО)  # IronPython2
# ---------- python_script_3.python (40 lines) ----------
# Загрузить стандартную библиотеку Python и библиотеку DesignScript
import sys
import clr
clr.AddReference('ProtoGeometry')
from Autodesk.DesignScript.Geometry import *

# Введенные в этом узле данные сохраняется в виде списка в переменных IN.
cnt, ap, kp, vk, ov, pb, ao = IN[0], IN[1], IN[2], IN[3], IN[4], IN[5], IN[6]

if ap == True:
	ap = "-АР"
else:
	ap = ""
	
if kp == True:
	kp = "-КР"
else:
	kp = ""
	
if vk == True:
	vk = "-ВК"
else:
	vk = ""
	
if ov == True:
	ov = "-ОВ"
else:
	ov = ""
	
if pb == True:
	pb = "-ПБ"
else:
	pb = ""
	
if ao == True:
	ao = "-ЭО"
else:
	ao = ""

OUT = str(cnt) + ap + kp + vk + ov + pb + ao 
# ----------------------------------------
setParameterByName_4 = Element.SetParameterByName(element=python_script_2, parameterName=string_5, value=python_script_3)
string_6 = StringInput("Комментарии")
комментарий = StringInput("Исправить местоположение сальника")  # graph input
code_block_6 = CodeBlock(a=выбрать_первый_элемент) { a.Id; }
code_block_7 = CodeBlock(a=выбрать_второй_элемент) { a.Id; }
python_script_4 = Python(IN[0]=комментарий, IN[1]=code_block_6, IN[2]=code_block_7)  # IronPython2
# ---------- python_script_4.python (19 lines) ----------
# Загрузить стандартную библиотеку Python и библиотеку DesignScript
import sys
import clr
clr.AddReference('ProtoGeometry')
from Autodesk.DesignScript.Geometry import *

# Введенные в этом узле данные сохраняется в виде списка в переменных IN.
s = str(IN[0])
id1 = str(IN[1])
id2 = str(IN[2])
dt = ""


if s[len(s) - 1] != ".":
	dt = "."
else:
	dt = ""

OUT = s + dt + " ID элементов: " + id1 + ";" + id2
# ----------------------------------------
setParameterByName_5 = Element.SetParameterByName(element=python_script_2, parameterName=string_6, value=python_script_4)
vertices_2 = Topology.Vertices()  # unwired: topology
string_7 = StringInput("О_ДН_Раздел АР")
code_block_8 = CodeBlock(razdel=АР) { razdel == true?1:0; }
setParameterByName_6 = Element.SetParameterByName(element=python_script_2, parameterName=string_7, value=code_block_8)
string_8 = StringInput("О_ДН_Раздел КР")
code_block_9 = CodeBlock(razdel=КР) { razdel == true?1:0; }
setParameterByName_7 = Element.SetParameterByName(element=setParameterByName_6, parameterName=string_8, value=code_block_9)
string_9 = StringInput("О_ДН_Раздел ВК")
code_block_10 = CodeBlock(razdel=ВК) { razdel == true?1:0; }
setParameterByName_8 = Element.SetParameterByName(element=setParameterByName_7, parameterName=string_9, value=code_block_10)
string_10 = StringInput("О_ДН_Раздел ОВ")
code_block_11 = CodeBlock(razdel=ОВ) { razdel == true?1:0; }
setParameterByName_9 = Element.SetParameterByName(element=setParameterByName_8, parameterName=string_10, value=code_block_11)
string_11 = StringInput("О_ДН_Раздел ЭМ")
code_block_12 = CodeBlock(razdel=ЭО) { razdel == true?1:0; }
setParameterByName_10 = Element.SetParameterByName(element=setParameterByName_9, parameterName=string_11, value=code_block_12)
string_12 = StringInput("Исправлено")
code_block_13 = CodeBlock { 0; }
setParameterByName_11 = Element.SetParameterByName(element=setParameterByName_10, parameterName=string_12, value=code_block_13)
