# Dynamo graph CheckWorksets_Auto.dyn (Dynamo 2.10.1.3976)
# packages: IГIS 0.1.1, Orchid 203.2.0.7778

IГIS = Node_Storage()
string = StringInput("Стены")
byName = Category.ByName(name=string)
all_elements_of_category = ElementsOfCategory(Category=byName)
code_block = CodeBlock { ["КР_Опалубка","КР_Опалубка_Стены", "АР_Стены"]; }
проверка_наличия_рн = Python(IN[0]=code_block)  # IronPython2
# ---------- проверка_наличия_рн.python (29 lines) ----------
# Загрузить стандартную библиотеку Python и библиотеку DesignScript
import sys
import clr
clr.AddReference('ProtoGeometry')
from Autodesk.DesignScript.Geometry import *
clr.AddReference('RevitAPI') # Основная библиотека Revit API
clr.AddReference('RevitAPIUI')
from Autodesk.Revit.DB import *

clr.AddReference('RevitServices')
from RevitServices.Persistence import DocumentManager as DM

doc = DM.Instance.CurrentDBDocument

ch_w = UnwrapElement(IN[0])
f_w = []

ws = [i for i in FilteredWorksetCollector(doc).OfKind(WorksetKind.UserWorkset)]

"""ws_n = [i.Name for i in FilteredWorksetCollector(doc).OfKind(WorksetKind.UserWorkset)]
ws_id = [i.Id for i in FilteredWorksetCollector(doc).OfKind(WorksetKind.UserWorkset)]
"""

for i in ch_w:
	for j in ws:
		if i == j.Name:
			f_w.append(j.Id)

OUT = f_w
# ----------------------------------------
string_from_object = FromObject(object=проверка_наличия_рн)
string_2 = StringInput("Рабочий набор")
parameterByName = Parameter.ParameterByName(element=all_elements_of_category, name=string_2)
value = Parameter.Value(parameter=parameterByName)
string_from_object_2 = FromObject(object=value)
python_script = Python(IN[0]=string_from_object, IN[1]=string_from_object_2)  # IronPython2
# ---------- python_script.python (34 lines) ----------
# Загрузить стандартную библиотеку Python и библиотеку DesignScript
import sys
import clr
clr.AddReference('ProtoGeometry')
from Autodesk.DesignScript.Geometry import *
clr.AddReference('RevitAPI') # Основная библиотека Revit API
clr.AddReference('RevitAPIUI')
from Autodesk.Revit.DB import *

clr.AddReference('RevitServices')
from RevitServices.Persistence import DocumentManager as DM

doc = DM.Instance.CurrentDBDocument

ch_w, all_w = UnwrapElement(IN[0]), UnwrapElement(IN[1])
temp1_w = []

for i in all_w:
	cnt = 0
	for j in ch_w:
		if i == j and cnt == 0:
			temp1_w.append(True)
			cnt += 1
		else:
			continue
	if cnt == 0:
		temp1_w.append(False)
			
			
fid_w = list(set(all_w) - set(ch_w))
# Разместите код под этой строкой

# Назначьте вывод переменной OUT.
OUT = temp1_w
# ----------------------------------------
filterByBoolMask = List.FilterByBoolMask(list=all_elements_of_category, mask=python_script)
string_3 = StringInput("NIIPI_Неправильный РН")
code_block_2 = CodeBlock { 1; }
setParameterByName = Element.SetParameterByName(element=filterByBoolMask.out, parameterName=string_3, value=code_block_2)
string_4 = StringInput("NIIPI_ID элемента")
code_block_3 = CodeBlock(a=filterByBoolMask.out) { a.Id; }
string_from_object_3 = FromObject(object=code_block_3)
setParameterByName_2 = Element.SetParameterByName(element=filterByBoolMask.out, parameterName=string_4, value=string_from_object_3)
string_5 = StringInput("NIIPI_Автор элемента")
current = Orchid.RevitProject.Common.Document.Current()
info = Orchid.RevitProject.Elements.Element.Info(document=current, element=filterByBoolMask.out)
setParameterByName_3 = Element.SetParameterByName(element=filterByBoolMask.out, parameterName=string_5, value=info.Creator)
string_6 = StringInput("NIIPI_Комментарии РН")
getCategory = Element.GetCategory(element=filterByBoolMask.out)
code_block_4 = CodeBlock(cat=getCategory) { "Элемент категории " + cat + " не может находиться в данном рабочем наборе!"; }
setParameterByName_4 = Element.SetParameterByName(element=filterByBoolMask.out, parameterName=string_6, value=code_block_4)
