# Dynamo graph Coord Z of lowest point IFC.dyn (Dynamo 2.10.1.3976)

select_model_element = DSModelElementSelection()  # 1 picked in the model
geometry = Element.Geometry(element=select_model_element)
vertexPositions = Mesh.VertexPositions(mesh=geometry)
flatten = List.Flatten(list=vertexPositions)
code_block = CodeBlock(a=vertexPositions) { a.Z; }
flatten_2 = List.Flatten(list=code_block)
sortByKey = List.SortByKey(list=flatten, keys=flatten_2)
code_block_2 = CodeBlock(a=sortByKey.sortedList) { a[0].Z; }
select_model_element_2 = DSModelElementSelection()  # 1 picked in the model
geometry_2 = Element.Geometry(element=select_model_element_2)
vertexPositions_2 = Mesh.VertexPositions(mesh=geometry_2)
