# Dynamo graph CreatingDoorsAndWall.dyn (Dynamo 2.12.0.5650)
# packages: Orchid 212.1.0.7978

select_model_element = DSModelElementSelection()  # 1 picked in the model
string = StringInput("M:\BIM\Revit\Семейства\00_NIIPI\АР\Двери")
string_2 = StringInput("M:\BIM\Revit\Семейства\00_NIIPI\АР\Окна\Стена")
code_block = CodeBlock(a=string, b=string_2) { [a,b]; }
directory_from_path = DirectoryObject(path=code_block)
getDirectoryContents = FileSystem.GetDirectoryContents(directory=directory_from_path)
flatten = List.Flatten(list=getDirectoryContents.files)
python_script = Python(IN[0]=flatten)  # IronPython2
# ---------- python_script.python (45 lines) ----------
# Загрузить стандартную библиотеку Python и библиотеку DesignScript
import sys
import clr # Модуль для подгрузки .NET библиотек

# Библиотеки Revit API
clr.AddReference('RevitAPI') # Основная библиотека Revit API
clr.AddReference('RevitAPIUI') # Библиотека Revit API интерфейса
from Autodesk.Revit.DB import * # Указать классы для импорта
# from Autodesk.Revit.UI import * # Убрать решетку (если надо) и указать классы

# Библиотеки Dynamo
clr.AddReference('RevitNodes') # Конвертация элементов и геометрии
import Revit # Расширяем исходные методы классов через ImportExtensions
clr.ImportExtensions(Revit.GeometryConversion)
clr.ImportExtensions(Revit.Elements)
clr.AddReference('RevitServices') # Работа с документом и транзакциями
from RevitServices.Persistence import DocumentManager as DM # Менеджер документа
from RevitServices.Transactions import TransactionManager as TM # Менеджер транзакций

# Системные библиотеки
import System # Работа с системными типами и структурами данных .NET
from System.Collections.Generic import * # Можно конкретно указать List
import sys # Настройки интерпретатора IronPython, путь к библиотекам
sys.path.append(r'C:\Program Files (x86)\IronPython 2.7\Lib')

# Документ и транзакции
doc = DM.Instance.CurrentDBDocument # Получение файла документа
# uidoc = DM.Instance.CurrentUIApplication.ActiveUIDocument # Интерфейс
TM.Instance.EnsureInTransaction(doc) # Открытие транзакции
### Действия внутри транзакции ###
TM.Instance.TransactionTaskDone() # Закрытие транзакции



fpaths_uncl = UnwrapElement(IN[0])
a = []
for i in fpaths_uncl:
	if ".0" not in i and "даптив" not in i:
		ind1 = i.rfind("\\")
		ind2 = i.rfind(".rfa")
		a.append(i[ind1+1:ind2])
		doc.LoadFamily(i)
			
	
OUT = a
# ----------------------------------------
byName = Family.ByName(name=python_script)
types = Family.Types(family=byName)
code_block_2 = CodeBlock { 0; }
getItemAtIndex = List.GetItemAtIndex(list=types@L2, index=code_block_2)
flatten_2 = List.Flatten(list=getItemAtIndex)
select_face = DSFaceSelection()  # 1 picked in the model
perimeterCurves = Surface.PerimeterCurves(surface=select_face)
flatten_3 = List.Flatten(list=perimeterCurves)
length = Curve.Length(curve=flatten_3)
sortByKey = List.SortByKey(list=flatten_3, keys=length)
code_block_3 = CodeBlock(a=sortByKey.sortedList) { a[0..1]; }
code_block_4 = CodeBlock { 0.5; }
pointAtParameter = Curve.PointAtParameter(curve=code_block_3, param=code_block_4)
code_block_5 = CodeBlock(a=pointAtParameter) { a[0]; a[1]; }
byStartPointEndPoint = Line.ByStartPointEndPoint(startPoint=code_block_5.out0, endPoint=code_block_5.out1)
code_block_6 = CodeBlock { 5000; }
pointsAtSegmentLengthFromPoint = Curve.PointsAtSegmentLengthFromPoint(curve=byStartPointEndPoint, point=code_block_5.out0, segmentLength=code_block_6)
code_block_7 = CodeBlock(a=pointsAtSegmentLengthFromPoint, b=flatten_2) { a[0..List.Count(b)-1]; }
byHostAndPoint = Orchid.RevitProject.Elements.FamilyInstance.ByHostAndPoint(host=select_model_element, familyType=flatten_2, point=code_block_7, lacing=Longest)
