# Dynamo graph CreatingExcelForScriptList.dyn (Dynamo 2.0.5.13212)

string = StringInput("E:\LocalWork\DynamoScripts\Работоспособность скриптов.xlsx")
string_2 = StringInput("Лист1")
code_block = CodeBlock { 0; }
string_3 = StringInput("Скрипт")
string_4 = StringInput("E:\LocalWork\DynamoScripts")
string_5 = StringInput("*.dyn")
contents = Orchid.Common.Directory.Contents(directory=string_4, searchString=string_5)
string_6 = StringInput("\")
split = String.Split(str=contents, separater0=string_6)
lastItem = List.LastItem(list=split@L2)
addItemToFront = List.AddItemToFront(item=string_3, list=lastItem)
code_block_2 = CodeBlock { "Работоспособность"; "Работает из проигрывателя"; "Краткое описание"; "Примечание"; }
code_block_3 = CodeBlock(a=addItemToFront, b=code_block_2.out0, c=code_block_2.out1, d=code_block_2.out2, e=code_block_2.out3) { [a,[b],[c],[d],[e]]; }
transpose = List.Transpose(lists=code_block_3)
boolean = BoolSelector(true)
exportExcel = Data.ExportExcel(filePath=string, sheetName=string_2, startRow=code_block, startCol=code_block, data=transpose, overWrite=boolean)
