# Dynamo graph CreatingWorksets.dyn (Dynamo 2.10.1.3976)

python_script = Python()  # IronPython2; unwired: IN[0]
# ---------- python_script.python (19 lines) ----------
# Загрузить стандартную библиотеку Python и библиотеку DesignScript
import sys
import clr
clr.AddReference('ProtoGeometry')
from Autodesk.DesignScript.Geometry import *
clr.AddReference('RevitAPI')
from Autodesk.Revit.DB import *
clr.AddReference('RevitServices')
from RevitServices.Persistence import DocumentManager as DM
from RevitServices.Transactions import TransactionManager as TM
doc = DM.Instance.CurrentDBDocument

a, l = IN[0], []
for i in a:
	TM.Instance.EnsureInTransaction(doc)
	b = Workset.Create(doc, i)
	TM.Instance.TransactionTaskDone()
	l.append(b.Name)
OUT = l
# ----------------------------------------
string = StringInput("D:\В разработке\Dynamo\Worksets.xlsx")
file_from_path = FileObject(path=string)
string_2 = StringInput("Лист1")
boolean = BoolSelector(true)
boolean_2 = BoolSelector(true)
importExcel = Data.ImportExcel(file=file_from_path, sheetName=string_2, readAsStrings=boolean, showExcel=boolean_2)
