# Dynamo graph DelMatFromFamily_CrumpleNeeded.dyn (Dynamo 2.0.5.13212)

boolean = BoolSelector(true)
materialsbyprefix = Custom[© MaterialsByPrefix](Refresh=boolean)  # Returns all materials in the current document, sorted by whether they contain a specified prefix.
code_block = CodeBlock(a=materialsbyprefix.matches, b=materialsbyprefix.theRest) { [a,b]; }
flatten = List.Flatten(list=code_block)
deletecareful = Custom[© DeleteCareful](elements=flatten)  # Given a list of elements, attempt to delete them and then return true or false depending on whether it could be deleted. This script flattens the list structure before attempting.
element_types = ElementTypes(index=278)
all_elements_of_type = ElementsOfType(element_type=element_types)
code_block_2 = CodeBlock(a=all_elements_of_type) { a.Name; }
deletecareful_2 = Custom[© DeleteCareful]()  # unwired: elements
code_block_3 = CodeBlock(a=all_elements_of_type) { a[3..10]; }
code_block_4 = CodeBlock(a=all_elements_of_type) { [a[0..2],a[4],a[6..12],a[16..20],a[22..26],a[28]]; }
