# Dynamo graph DeleteAllElementsOnLevel.dyn (Dynamo 2.0.2.6826)

levels = Levels()  # nothing selected
all_elements_at_level = ElementsAtLevel(Level=levels)
boolean = BoolSelector(false)
ꟿ_document_deleteelements = Custom[ꟿ Document.DeleteElements](element=all_elements_at_level, confirm=boolean)  # Attempts to delete the input list of elements from the active Revit document.The node returns the number of successfully deleted elements and their Ids as a string. Carefully observe the deleted elements count. It may be greater than the input list because hosted elements or tags will be deleted as well. If an element in the list can not be deleted (for example last revision or last view), the whole list will fail to be deleted.
watch = Watch(ꟿ_document_deleteelements.count)
watch_2 = Watch(ꟿ_document_deleteelements.deletedIds_str)
watch_3 = Watch(ꟿ_document_deleteelements.failedIds_str)
