# Dynamo graph DeleteElements.dyn (Dynamo 2.0.2.6826)

element_types = ElementTypes(index=329)
file_path = Filename("F:\LocalWork\Projects\TestModels\Слав_мир_Вестибюль\Views.xlsx")
code_block = CodeBlock { "Views"; }
code_block_2 = CodeBlock { 1; }
code_block_3 = CodeBlock { 0; }
all_elements_of_type = ElementsOfType()  # unwired: element_type
ID = Custom[Element.ID+](element=all_elements_of_type)  # Gets the ID of a given Revit elements. Unlike the OOTB Element.Id node, this node also works on mixed lists of Revit elements and categories.
exportExcel = Data.ExportExcel(filePath=file_path, sheetName=code_block, startRow=code_block_2, startCol=code_block_3, data=ID)
all_elements_of_category = ElementsOfCategory()  # unwired: Category
delete_all_elements_of_category = Custom[Delete All Elements of Category](Category=all_elements_of_category)  # be careful!
watch = Watch(delete_all_elements_of_category.Can_t_delete_Ids)
watch_2 = Watch(delete_all_elements_of_category.elementsToDelete)
categories = Categories()  # nothing selected
select_model_element = DSModelElementSelection()  # nothing selected
getCategory = Element.GetCategory(element=select_model_element)
