# Dynamo graph DeleteMaterialsFromFamily.dyn (Dynamo 2.0.5.13212)

categories = Categories(index=335)
all_elements_of_category = ElementsOfCategory(Category=categories)
code_block = CodeBlock(a=all_elements_of_category) { a.Name; }
current = RevitModel.Documents.Current()
elementIndocument = RevitModel.Documents.ElementIndocument(doc=current)
code_block_2 = CodeBlock { "Материал"; }
parameterByName = Parameter.ParameterByName(element=elementIndocument, name=code_block_2)
code_block_3 = CodeBlock(a=parameterByName) { a==null; }
filterByBoolMask = List.FilterByBoolMask(list=elementIndocument, mask=code_block_3)
code_block_4 = CodeBlock { "Материал"; }
parameterByName_2 = Parameter.ParameterByName(element=filterByBoolMask.out, name=code_block_4)
code_block_5 = CodeBlock(a=parameterByName_2) { a.Value.Name; }
setDifference = List.SetDifference(list1=code_block, list2=code_block_5)
byName = Material.ByName(name=setDifference)
delete = archilab.Revit.Elements.Elements.Delete(element=byName)
