# Dynamo graph ElementsfromWorksets.dyn (Dynamo 2.0.2.6826)

file_path = Filename("F:\LocalWork\Projects\TestModels\Слав_мир_Вестибюль\Лист Microsoft Excel.xlsx")
code_block = CodeBlock { "Elements from Workset"; }
code_block_2 = CodeBlock { 1; }
code_block_3 = CodeBlock { 0; }
worksets = WorksetUi(index=10)
byWorkset = archilab.Revit.Selection.Select.ByWorkset(workset=worksets)
name = Custom[Element.Name+](element=byWorkset)  # Gets an element's name. Unlike the OOTB node, this node should work for all Revit elements that have names and will also return the localized names of system parameters, parameter groups, display unit types, parameter types, unit symbol types and unit types.
id = Element.Id(element=byWorkset)
list_create = List.Create(item0=name, item1=id, item2=byWorkset)
transpose = List.Transpose(lists=list_create)
exportExcel = Data.ExportExcel(filePath=file_path, sheetName=code_block, startRow=code_block_2, startCol=code_block_3, data=transpose)
