# Dynamo graph ExportSize_Auto.dyn (Dynamo 2.10.1.3976)

current = Document.Current()
filePath = Document.FilePath(document=current)
python_script = Python(IN[0]=filePath)  # CPython3
# ---------- python_script.python (48 lines) ----------
import clr # Модуль для подгрузки .NET библиотек
import os
from datetime import datetime
# Библиотеки Revit API
clr.AddReference('RevitAPI') # Основная библиотека Revit API
clr.AddReference('RevitAPIUI') # Библиотека Revit API интерфейса
from Autodesk.Revit.DB import * # Указать классы для импорта
# from Autodesk.Revit.UI import * # Убрать решетку (если надо) и указать классы

# Библиотеки Dynamo
clr.AddReference('RevitNodes') # Конвертация элементов и геометрии
import Revit # Расширяем исходные методы классов через ImportExtensions
clr.ImportExtensions(Revit.GeometryConversion)
clr.ImportExtensions(Revit.Elements)
clr.AddReference('RevitServices') # Работа с документом и транзакциями
from RevitServices.Persistence import DocumentManager as DM # Менеджер документа
from RevitServices.Transactions import TransactionManager as TM # Менеджер транзакций

# Системные библиотеки
import System # Работа с системными типами и структурами данных .NET
from System.Collections.Generic import * # Можно конкретно указать List
import sys # Настройки интерпретатора IronPython, путь к библиотекам
sys.path.append(r'C:\Program Files (x86)\IronPython 2.7\Lib')

# Документ и транзакции
doc = DM.Instance.CurrentDBDocument # Получение файла документа
# uidoc = DM.Instance.CurrentUIApplication.ActiveUIDocument # Интерфейс

c_path = UnwrapElement(IN[0])
c_name_startind = c_path.rfind("\\")
c_name = c_path[c_name_startind + 1:-4]
c_path_rvt = c_path[c_name_startind + 1:]
c_txt = ""

now = datetime.now()

f = open(r"D:\Revit\CheckModels.txt", "a")
f.write("\n")
f.write("\n")
f.write("\n")
f.write("***********************")
f.write("\n")
f.write(str(now.strftime("%d.%m.%Y %H:%M:%S")))
f.write("\n")
f.write(str(c_name))
f.write("\n")
f.write(str("Текущий размер:") + str(os.path.getsize(c_path)/1000000) + str("МБ"))
f.close()
# ----------------------------------------
