# Dynamo graph ForSignatureFamily.dyn (Dynamo 2.0.5.13212)

имя_семейства_подписей = StringInput("MPP_Подписи_v.02")  # graph input; frozen
byName = Family.ByName(name=имя_семейства_подписей)
проверяемая_фамилия = StringInput("Спицин")
file_path = Filename("..\Families\Подписи\TEST_SIGN.rfa")
ʳʰʸᵗʰᵐ_applications = Rhythm.Revit.Application.Applications.OpenDocumentFile(filePath=file_path)
end = Revit.Transaction.Transaction.End(input=ʳʰʸᵗʰᵐ_applications)
string = StringInput("ИванГовнов")
string_2 = StringInput("INVALID")
string_3 = StringInput("YesNo")
code_block = CodeBlock { false; }
createFamilyParameter = RevitModel.FamilyInstance.CreateFamilyParameter(doc=end, name=string, group=string_2, type=string_3, instance=code_block)
code_block_2 = CodeBlock(a=createFamilyParameter, doc1=ʳʰʸᵗʰᵐ_applications) { a!=null?doc1:null; }
code_block_3 = CodeBlock { true; }
ʳʰʸᵗʰᵐ_applications_2 = Rhythm.Revit.Application.Applications.CloseDocument(document=code_block_2, save=code_block_3)
code_block_4 = CodeBlock(a=ʳʰʸᵗʰᵐ_applications_2, fp=file_path) { a!=null?fp:null; }
python_script = Python(IN[0]=code_block_4)
# ---------- python_script.python (34 lines) ----------
import clr
clr.AddReference('RevitAPI')
from Autodesk.Revit.DB import *

clr.AddReference("RevitServices")
import RevitServices
from RevitServices.Persistence import DocumentManager
from RevitServices.Transactions import TransactionManager
doc = DocumentManager.Instance.CurrentDBDocument

class FamilyOption(IFamilyLoadOptions) :
	def OnFamilyFound(self, familyInUse, overwriteParameterValues):
		overwriteParameterValues.Value = False
		return True

	def OnSharedFamilyFound(self, sharedFamily, familyInUse, source, overwriteParameterValues):
		overwriteParameterValues.Value = False
		return True

toList = lambda x : x if hasattr(x, '__iter__') else [x]
pathsFamily = toList(IN[0])

TransactionManager.Instance.EnsureInTransaction(doc)

loadedFam = []
opts = FamilyOption()
for path in pathsFamily :
	refFam = clr.Reference[Family]()
	doc.LoadFamily(path, opts, refFam)
	loadedFam.append(refFam.Value)

TransactionManager.Instance.TransactionTaskDone()

OUT = loadedFam
# ----------------------------------------
types = Family.Types(family=python_script)
flatten = List.Flatten(list=types)
code_block_5 = CodeBlock(a=flatten) { a[0]; }
duplicate = Custom[FamilyType.Duplicate](elementType=code_block_5, name=string)  # Duplicates a family type
parameterByName = Parameter.ParameterByName(element=duplicate, name=string)
name = Parameter.Name(parameter=parameterByName)
name_2 = FamilyType.Name(familyType=duplicate)
code_block_6 = CodeBlock(a=name_2, b=name) { a==b; }
setParameterByName = Element.SetParameterByName(element=duplicate, parameterName=name, value=code_block_6)  # frozen
правила_не_редактировать = StringInput("""Как нужно работать с этим скриптом:
1) В семействе у типоразмера и параметра видимости  название ДОЛЖНО БЫТЬ ОДНО И ТО ЖЕ!!!!! 
2) В проверяемой фамилии должно быть написано то же самое, что и в названии параметра видимости;
3) Если не сработало - проверь п.1 и п.2. Если ты, человек, точно уверен в том, что в моем скрипте что-то не то - так уж и быть, подходи.""")  # graph input
group = Parameter.Group(parameter=parameterByName)
