# Dynamo graph ImportImages.dyn (Dynamo 2.10.1.3976)
# packages: Orchid 203.2.0.7778

string = StringInput("Материалы")
byName = Category.ByName(name=string)
all_elements_of_category = ElementsOfCategory(Category=byName)
code_block = CodeBlock(a=all_elements_of_category) { a.Name; }
code_block_2 = CodeBlock(a=all_elements_of_category) { a[193]; }
parameters = Element.Parameters(element=code_block_2)
contains = String.Contains()  # unwired: str, searchFor
categories = Categories("OST_RasterImages")
categories_2 = Categories("OST_RasterImages")
all_elements_of_category_2 = ElementsOfCategory(Category=categories_2)
code_block_3 = CodeBlock(a=all_elements_of_category_2) { a.Name; }
boolean = BoolSelector(false)
string_2 = StringInput("D:\Revit\Материалы\Текстуры\Технониколь\Разрешение 256х256")
contents = Orchid.Common.Directory.Contents(directory=string_2)
string_from_object = FromObject(object=contents)
current = Document.Current()
activeView = Document.ActiveView(document=current)
