# Dynamo graph Mesh2Solid.dyn (Dynamo 2.10.1.3976)
# packages: MeshToolkit 3.0.0, spring nodes 204.1.0

select_model_element = DSModelElementSelection()  # 1 picked in the model
select_model_elements = DSModelElementsSelection()  # 3 picked in the model
geometry = Element.Geometry(element=select_model_elements)
ꟿ_mesh_totkmesh = Custom[ꟿ Mesh.ToTkMesh](mesh=geometry)  # package spring nodes; Converts a Dynamo mesh to a toolkit mesh. You obviously need to have the appropriate version of the mesh toolkit package downloaded first.
code_block = CodeBlock { 64; }
smooth = Autodesk.Dynamo.MeshToolkit.Mesh.Smooth(mesh=ꟿ_mesh_totkmesh, scale=code_block)
ꟿ_tkmesh_tomesh = Custom[ꟿ TkMesh.ToMesh](tkMesh=smooth)  # package spring nodes; Attempts to convert a toolkit mesh to a Dynamo mesh. You obviously need to have the appropriate version of the mesh toolkit package downloaded first.
vertexPositions = Mesh.VertexPositions(mesh=ꟿ_tkmesh_tomesh)
flatten = List.Flatten(list=vertexPositions@L2)
faceIndices = Mesh.FaceIndices(mesh=ꟿ_tkmesh_tomesh)  # frozen
flatten_2 = List.Flatten(list=faceIndices@L2)
A = IndexGroup.A(indexGroup=flatten_2)
B = IndexGroup.B(indexGroup=flatten_2)
C = IndexGroup.C(indexGroup=flatten_2)
python_script = Python(IN[0]=A, IN[1]=B, IN[2]=C)  # IronPython2
# ---------- python_script.python (29 lines) ----------
# Загрузить стандартную библиотеку Python и библиотеку DesignScript
import sys
import clr
clr.AddReference('ProtoGeometry')
from Autodesk.DesignScript.Geometry import *

a,b,c,fin = IN[0],IN[1],IN[2],[]
t = [a,b,c]
	
"""
for i in range(0, l_a):
	fin.append(a[i])
	fin.append(b[i])
	fin.append(c[i])
"""

len_a = len(a)
for i in range(len(a)):
	temp_list = []
	temp_l = len(a[i])
	for j in range(temp_l):
		temp_list.append(a[i][j])
		temp_list.append(b[i][j])
		temp_list.append(c[i][j])
	fin.append(temp_list)



OUT = fin
# ----------------------------------------
getItemAtIndex = List.GetItemAtIndex(list=flatten@L2, index=python_script@L2)
code_block_2 = CodeBlock { 3; }
chop = List.Chop(list=getItemAtIndex@L2, lengths=code_block_2)
byPerimeterPoints = Surface.ByPerimeterPoints(points=chop)
area = Surface.Area(surface=byPerimeterPoints)
code_block_3 = CodeBlock(a=area) { a < 30?false:true; }
filterByBoolMask = List.FilterByBoolMask(list=byPerimeterPoints, mask=code_block_3)
byJoinedSurfaces = PolySurface.ByJoinedSurfaces(surfaces=filterByBoolMask.in)  # frozen
byJoinedSurfaces_2 = Solid.ByJoinedSurfaces(facesOfSolid=byJoinedSurfaces@L1)
volume = Solid.Volume(solid=byJoinedSurfaces_2)
code_block_4 = CodeBlock(a=volume) { a*(DSCore.Math.Pow(10, -9)); }
byGeometry = BoundingBox.ByGeometry(geom=byJoinedSurfaces_2)
toCuboid = BoundingBox.ToCuboid(boundingBox=byGeometry)  # frozen
width = Cuboid.Width(cuboid=toCuboid)
code_block_5 = CodeBlock(a=width) { a/1000; }
length = Cuboid.Length(cuboid=toCuboid)
code_block_6 = CodeBlock(a=length) { a/1000; }
height = Cuboid.Height(cuboid=toCuboid)
code_block_7 = CodeBlock(a=height) { a/1000; }
code_block_8 = CodeBlock(a=code_block_5, b=code_block_6, c=code_block_7) { a*b*c; }
code_block_9 = CodeBlock { name1; }  # unwired: name1
code_block_10 = CodeBlock { 0.30480000097536; }
scale = Geometry.Scale(geometry=byJoinedSurfaces_2, amount=code_block_10)
count = List.Count(list=byJoinedSurfaces_2)
code_block_11 = CodeBlock(a=count) { 1..#a..1; }
code_block_12 = CodeBlock(a=code_block_11) { "name" + a; }
categories = Categories("OST_StructuralFraming")
string = StringInput("D:\GenericModel.rft")
string_2 = StringInput("Dynamo")
byName = Material.ByName(name=string_2)
byGeometry_2 = FamilyType.ByGeometry(solidGeometry=scale, name=code_block_12, category=categories, templatePath=string, material=byName)
byGeometry_3 = BoundingBox.ByGeometry(geom=byJoinedSurfaces_2@L1)
minPoint = BoundingBox.MinPoint(boundingBox=byGeometry_3)
byPoint = FamilyInstance.ByPoint(familyType=byGeometry_2, point=minPoint)
unconnectedBoundaries = PolySurface.UnconnectedBoundaries(polySurface=byJoinedSurfaces)
code_block_13 = CodeBlock(a=filterByBoolMask.out) { a; }
code_block_14 = CodeBlock(a=select_model_elements) { a[0]; }
categories_2 = Categories("OST_StructuralFraming")
byMesh = DirectShape.ByMesh(mesh=ꟿ_tkmesh_tomesh, category=categories_2)
select_face = DSFaceSelection()  # nothing selected
