# Dynamo graph NWC Export Views using Multiple View Templates.dyn (Dynamo 2.0.5.13212)

code_block = CodeBlock { "NWC Export Views Using Multiple View Template"; }
code_block_2 = CodeBlock { "Экспорт"; }
code_block_3 = CodeBlock { "Выберете 3D-вид"; }
get_3d_views = Python()  # unwired: IN[0]
# ---------- get_3d_views.python (48 lines) ----------
#Copyright(c) 2015, Konrad Sobon
# @arch_laboratory, http://archi-lab.net

import clr
clr.AddReference('ProtoGeometry')
from Autodesk.DesignScript.Geometry import *

# Import DocumentManager and TransactionManager
clr.AddReference("RevitServices")
import RevitServices
from RevitServices.Persistence import DocumentManager
from RevitServices.Transactions import TransactionManager

# Import RevitAPI
clr.AddReference("RevitAPI")
import Autodesk
from Autodesk.Revit.DB import *

doc = DocumentManager.Instance.CurrentDBDocument
uiapp = DocumentManager.Instance.CurrentUIApplication
app = uiapp.Application

from System.Collections.Generic import *

# Import ToDSType(bool) extension method
clr.AddReference("RevitNodes")
import Revit
clr.ImportExtensions(Revit.Elements)

#The inputs to this node will be stored as a list in the IN variable.
dataEnteringNode = IN

#collect all views in the model
collector = FilteredElementCollector(doc)
views = collector.OfClass(View).ToElements()

#sort views into separate lists based on view type
threeD = []

for i in views:
	if not i.IsTemplate:		
		if i.ViewType == ViewType.ThreeD:
			threeD.append(i.ToDSType(True))
		else:
			continue

#Assign your output to the OUT variable
OUT = threeD
# ----------------------------------------
name = Element.Name(element=get_3d_views)
code_block_4 = CodeBlock { 100.000; }

# group: [Data Shapes]
ui_listview_data = Custom[UI.Listview Data](InputName=code_block_3, Keys=name, Values=get_3d_views, Height_optionnal=code_block_4)  # Create data for ListView input in UI.MultiInputForm ++ . Check out www.data-shapes.net for more infos.

code_block_5 = CodeBlock { "Названия шаблонов вида"; }
python_script = Python()  # graph input
# ---------- python_script.python (9 lines) ----------
import clr
clr.AddReference('RevitAPI')
from Autodesk.Revit.DB import*
clr.AddReference('RevitServices')
from RevitServices.Persistence import DocumentManager
doc = DocumentManager.Instance.CurrentDBDocument

tempnames = [v.Name for v in FilteredElementCollector(doc).OfClass(View).ToElements() if v.IsTemplate and v.ViewType == ViewType.ThreeD]
OUT = tempnames
# ----------------------------------------
code_block_6 = CodeBlock { 100.000; }

# group: [Data Shapes]
ui_listview_data_2 = Custom[UI.Listview Data](InputName=code_block_5, Keys=python_script, Values=python_script, Height_optionnal=code_block_6)

# group: Divide File Toggle Button - [Data-Shapes]
code_block_7 = CodeBlock { "Разделить файл на уровни?"; }
boolean = BoolSelector(false)  # graph input
ui_boolean_input = Custom[UI.Boolean input](InputName=code_block_7, DefaultValue=boolean)  # Creates a boolean input for UI.MultipleInputForm ++ . Check out www.data-shapes.net for more infos!

# group: [Data-Shapes]
code_block_8 = CodeBlock { "Местоположение файла экспорта"; }
code_block_9 = CodeBlock { "Выбрать:"; }
ui_directorypath_data = Custom[UI.DirectoryPath Data](InputName=code_block_8, ButtonText=code_block_9)  # Creates a DirectoryPath input for UI.MultipleInputForm ++ . Check out www.data-shapes.net for more infos!

create = List.Create(item0=ui_listview_data, item1=ui_listview_data_2, item2=ui_boolean_input, item3=ui_directorypath_data)
boolean_2 = BoolSelector(true)  # graph input
code_block_10 = CodeBlock { "Cancel"; }
number = DoubleInput(800)  # graph input

# group: [Data Shapes]
ui_multipleinputform = Custom[UI.MultipleInputForm ++](Description_optional=code_block, ButtonText_optional=code_block_2, Inputs=create, Toggle=boolean_2, CancelButtonText_optional=code_block_10, MaxHeight_optional=number)  # Create a form with multiple inputs. see www.data-shapes.net for tutorials and infos!

# group: Views
code_block_11 = CodeBlock { 0; }
getItemAtIndex = List.GetItemAtIndex(list=ui_multipleinputform.User_Inputs, index=code_block_11)

code_block_12 = CodeBlock(x=ui_multipleinputform.User_Inputs) { x[3]; }

# group: Templates
code_block_13 = CodeBlock { 1; }
getItemAtIndex_2 = List.GetItemAtIndex(list=ui_multipleinputform.User_Inputs, index=code_block_13)

code_block_14 = CodeBlock(x=ui_multipleinputform.User_Inputs) { x[2]; }
python_script_2 = Python(IN[0]=getItemAtIndex, IN[1]=code_block_12, IN[2]=getItemAtIndex_2, IN[3]=code_block_14)
# ---------- python_script_2.python (49 lines) ----------
import clr
clr.AddReference('RevitAPI')
from Autodesk.Revit.DB import*

clr.AddReference('RevitServices')
from RevitServices.Persistence import DocumentManager
from RevitServices.Transactions import TransactionManager

doc = DocumentManager.Instance.CurrentDBDocument

def tolist(input):
	if isinstance(input,list):
		return input
	else:
		return [input]

views = UnwrapElement(tolist(IN[0]))
directorypath = IN[1]
templatenames = tolist(IN[2])
expdivlevel = IN[3]
templates = []
templatescollector = [t for t in FilteredElementCollector(doc).OfClass(View).ToElements() if t.IsTemplate]
for i in templatescollector:
	for tn in templatenames:
		if i.Name  == tn:
			templates.append(i)
		else:
			pass
nop = NavisworksExportOptions()
nop.ExportScope = NavisworksExportScope.View
nop.ExportLinks = True
nop.DivideFileIntoLevels = False
nop.ConvertElementProperties = True
nop.DivideFileIntoLevels = expdivlevel
nop.Coordinates = NavisworksCoordinates.Shared

TransactionManager.Instance.ForceCloseTransaction()
for v in views:
	for t in templates:

		tr = Transaction(doc,t.Name)
		tr.Start()
		v.ViewTemplateId = t.Id
		tr.Commit()
		nop.ViewId = v.Id
		doc.Export(IN[1],v.Name + "_" + t.Name,nop)


OUT = [t.Name for t in templates]
# ----------------------------------------
get_all_views = Custom[Get All Views]()  # taken from archi-lab
