# Dynamo graph PinElems.dyn (Dynamo 2.10.1.3976)

выбрать_категорию = Categories("OST_Floors")  # graph input
all_elements_of_category = ElementsOfCategory(Category=выбрать_категорию)
isPinned = Element.IsPinned(element=all_elements_of_category)
filterByBoolMask = List.FilterByBoolMask(list=all_elements_of_category, mask=isPinned)
boolean = BoolSelector(true)
setPinnedStatus = Element.SetPinnedStatus(element=filterByBoolMask.out, pinned=boolean)
