# Dynamo graph R19_CreateWallwMaterial.dyn (Dynamo 2.0.4.12684)

string = StringInput("Материалы")
byName = Category.ByName(name=string)
all_elements_of_category = ElementsOfCategory(Category=byName)
string_2 = StringInput("ADSK_Позиция отделки")
code_block = CodeBlock(n=all_elements_of_category) { 1..#List.Count(n)..1; }
string_from_object = FromObject(obj=code_block)
setParameterByName = Element.SetParameterByName(element=all_elements_of_category, parameterName=string_2, value=string_from_object)
string_3 = StringInput("TestWall")
byName_2 = WallType.ByName(name=string_3)
code_block_2 = CodeBlock(a=all_elements_of_category) { a.Name; }
code_block_3 = CodeBlock(a=code_block_2) { "Материал_"+a; }
code_block_4 = CodeBlock { 10; }
string_4 = StringInput("Structure")
create_compound_system = Custom[Create Compound System FamilyType](ElementOrFamilyType=byName_2, NewName=code_block_3, Material=all_elements_of_category, Thickness=code_block_4, LayerFunction=string_4, lacing=Longest)  # Creates a new compound wall, floor, roof or ceiling Type and assigns material, width and function.
code_block_5 = CodeBlock(n=create_compound_system) { 0..#List.Count(n)..20; 0; 25; }
byCoordinates = Point.ByCoordinates(x=code_block_5.out0, y=code_block_5.out1)
byCoordinates_2 = Point.ByCoordinates(x=code_block_5.out0, y=code_block_5.out2)
byStartPointEndPoint = Line.ByStartPointEndPoint(startPoint=byCoordinates, endPoint=byCoordinates_2)
code_block_6 = CodeBlock { 250; }
levels = Levels(index=0)
byCurveAndHeight = Wall.ByCurveAndHeight(curve=byStartPointEndPoint, height=code_block_6, level=levels, wallType=create_compound_system)
