# Dynamo graph R19_MappingMaterialswImages.dyn (Dynamo 2.0.4.12684)

string = StringInput("Материалы")
byName = Category.ByName(name=string)
all_elements_of_category = ElementsOfCategory(Category=byName)
code_block = CodeBlock(a=all_elements_of_category) { a.Name; }
byKeysValues = DesignScript.Builtin.Dictionary.ByKeysValues(keys=code_block, values=all_elements_of_category)
string_2 = StringInput("D:\Revit\Материалы\Текстуры\Технониколь\Разрешение 256х256")
contents = Orchid.Common.Directory.Contents(directory=string_2)
boolean = BoolSelector(true)
importImage = Orchid.RevitProject.Common.Document.ImportImage(path=contents, overwrite=boolean)
code_block_2 = CodeBlock(a=importImage) { a.Name; }
python_script = Python(IN[0]=code_block_2, IN[1]=code_block, IN[2]=importImage)
# ---------- python_script.python (34 lines) ----------
# Включить поддержку Python и загрузить библиотеку DesignScript
import clr
clr.AddReference('ProtoGeometry')
from Autodesk.DesignScript.Geometry import *
# Библиотека DSCoreNodes.dll, содержащая классы, аналогичные базовым нодам Dynamo
clr.AddReference('DSCoreNodes')
import DSCore # Импортирование пространства имен DSCore
clr.ImportExtensions(DSCore) # Добавление дополнительных методов и свойств к текущим классам
# Загрузка всех классов данного пространства имен (лучше заменить на конкретные классы)
from DSCore import *
# Библиотека RevitNodes.dll, содержащая классы, аналогичные базовым нодам Dynamo
clr.AddReference('RevitNodes')
import Revit # Импортирование пространства имен Revit
clr.ImportExtensions(Revit.Elements) # Добавление дополнительных методов и свойств к текущим классам
# Загрузка всех классов данного пространства имен (лучше заменить на конкретные классы)
from Revit.Elements import *


# Введенные в этом узле данные сохраняется в виде списка в переменных IN.
img, mats, imgg = UnwrapElement(IN[0]), UnwrapElement(IN[1]), UnwrapElement(IN[2])
a, b, c = [], [], []

for h in img:
	b.append(h.replace(".jpg",""))
	
for i in mats:
	for j in b:
		if i.lower().find(j.lower()) != -1:
			p = j + ".jpg"
			t = i
			a.append([p,t])
			
# Назначьте вывод переменной OUT.
OUT = a
# ----------------------------------------
code_block_3 = CodeBlock { 1; }
getItemAtIndex = List.GetItemAtIndex(list=python_script@L2, index=code_block_3)
valueAtKey = DesignScript.Builtin.Dictionary.ValueAtKey(dictionary=byKeysValues, key=getItemAtIndex)
string_3 = StringInput("Изображение")
byKeysValues_2 = DesignScript.Builtin.Dictionary.ByKeysValues(keys=code_block_2, values=importImage)
code_block_4 = CodeBlock { 0; }
getItemAtIndex_2 = List.GetItemAtIndex(list=python_script@L2, index=code_block_4)
valueAtKey_2 = DesignScript.Builtin.Dictionary.ValueAtKey(dictionary=byKeysValues_2, key=getItemAtIndex_2)
setParameterByName = Element.SetParameterByName(element=valueAtKey, parameterName=string_3, value=valueAtKey_2)
