# Dynamo graph Армирование кривой плиты.dyn (Dynamo 2.0.5.13212)

IГIS = Node_Storage()
n2_выбор_ближайшей_параллельной = DSFaceSelection()  # "2. Выбор ближайшей параллельной поверхности расположения арматуры"; 1 picked in the model; graph input
perimeterCurves = Surface.PerimeterCurves(surface=n2_выбор_ближайшей_параллельной)
flatten = List.Flatten(list=perimeterCurves)
code_block = CodeBlock(a=flatten) { a.Length; }
sortByKey = List.SortByKey(list=flatten, keys=code_block)
code_block_2 = CodeBlock(a=sortByKey.sorted_list) { a[2]; a[3]; }
n5_смещение_от_поверхности = DoubleInput(100)  # "5. Смещение от поверхности отсчета арматуры (для точности прибавить половину диаметра арматуры). Значение больше нуля - смещение будет всегда вверх. Меньше нуля - всегда вниз."; graph input
floor = Math.Floor(number=n5_смещение_от_поверхности)
тест = CodeBlock(offsetLR=floor) { offsetLR<0?"Я не принимаю отрицательные значения. Покорми меня положительными":offsetLR; }
n4_выбор_поверхности_отсчета = DSFaceSelection()  # "4. Выбор поверхности отсчета арматуры"; 1 picked in the model; graph input
perimeterCurves_2 = Surface.PerimeterCurves(surface=n4_выбор_поверхности_отсчета)
flatten_2 = List.Flatten(list=perimeterCurves_2)
code_block_3 = CodeBlock(a=flatten_2) { a.Length; }
sortByKey_2 = List.SortByKey(list=flatten_2, keys=code_block_3)
code_block_4 = CodeBlock(a=sortByKey_2.sorted_list) { a[0].StartPoint; a[0].EndPoint; }
byTwoPoints = Vector.ByTwoPoints(start=code_block_4.out0, end=code_block_4.out1)
n3_смещение_от_параллельной = DoubleInput(200)  # "3. Смещение от параллельной поверхности"; graph input
floor_2 = Math.Floor(number=n3_смещение_от_параллельной)
тест_2 = CodeBlock(offsetUD=floor_2) { offsetUD; }
code_block_5 = CodeBlock(crv_s1=code_block_2.out0, crv_s2=code_block_2.out1, offsetLR=тест, fc=n4_выбор_поверхности_отсчета, nrml=byTwoPoints, offsetUD=тест_2)
# ---------- code_block_5.designscript (17 lines) ----------
crv_s1;
crv_s2;
offsetLR;
test1 = Autodesk.DesignScript.Geometry.DistanceTo(fc,crv_s1.StartPoint)<=10?crv_s1:Autodesk.DesignScript.Curve.Reverse(crv_s1);
test2 = Autodesk.DesignScript.Geometry.DistanceTo(fc,crv_s2.StartPoint)<=10?crv_s2:Autodesk.DesignScript.Curve.Reverse(crv_s2);
test3 = Autodesk.DesignScript.Geometry.DistanceTo(fc,test1.StartPoint)<=10?test1:"CHECK_SCRIPT - longline 1 is not correct";
test4 = Autodesk.DesignScript.Geometry.DistanceTo(fc,test2.StartPoint)<=10?test2:"CHECK_SCRIPT - longline 2 is not correct";
t3_f = DSCore.List.Flatten(test3,1);
t4_f = DSCore.List.Flatten(test4,1);
pnt1 = Autodesk.DesignScript.Geometry.Curve.PointAtSegmentLength(t3_f,offsetLR);
pnt2 = Autodesk.DesignScript.Geometry.Curve.PointAtSegmentLength(t4_f,offsetLR);
pAp1 = Autodesk.DesignScript.Geometry.Curve.ParameterAtPoint(t3_f,pnt1);
pAp2 = Autodesk.DesignScript.Geometry.Curve.ParameterAtPoint(t4_f,pnt2);
lrOffsettedCrv1 = Autodesk.DesignScript.Geometry.Curve.TrimByStartParameter(t3_f,pAp1);
lrOffsettedCrv2 = Autodesk.DesignScript.Geometry.Curve.TrimByStartParameter(t4_f,pAp2);
udOffsettedCrv1 = Autodesk.DesignScript.Geometry.Translate(lrOffsettedCrv1,nrml,offsetUD);
udOffsettedCrv2 = Autodesk.DesignScript.Geometry.Translate(lrOffsettedCrv2,nrml,offsetUD);
# ----------------------------------------
code_block_6 = CodeBlock(crv1=code_block_5.udOffsettedCrv1, crv2=code_block_5.udOffsettedCrv2) { crv1; crv2; }
code_block_7 = CodeBlock { [0,0.02,0.04,0.06,0.08,0.10,0.12,0.14,0.16,0.18,0.20,0.22,0.24,0.26,0.28,0.30,0.32,0.34,0.36,0.38,0.40,0.42,0.44,0.46,0.48,0.50,0.52,0.54,0.56,0.58,0.60,0.62,0.64,0.66,0.68,0.70,0.72,0.74,0.76,0.78,0.80,0.82,0.84,0.86,0.88,0.90,0.92,0.94,0.96,0.98,1]; }
pointAtParameter = Curve.PointAtParameter(curve=[code_block_6.crv1, code_block_6.crv1], param=code_block_7, lacing=Longest)
byBestFitThroughPoints = Arc.ByBestFitThroughPoints(points=pointAtParameter)
radius = Arc.Radius(arc=byBestFitThroughPoints)
pointAtParameter_2 = Curve.PointAtParameter(curve=[code_block_6.crv2, code_block_6.crv2], param=code_block_7, lacing=Longest)
byBestFitThroughPoints_2 = Arc.ByBestFitThroughPoints(points=pointAtParameter_2)
radius_2 = Arc.Radius(arc=byBestFitThroughPoints_2)
code_block_8 = CodeBlock(R1=radius, R2=radius_2, crv1=code_block_6.crv1, crv2=code_block_6.crv2) { R1>=R2?([crv1,crv2]):([crv2,crv1]); }
code_block_9 = CodeBlock(a=code_block_8) { a[0]; a[1]; }
length = Curve.Length(curve=code_block_9.out0)
n11_шаг_стержней = DoubleInput(150)  # "11. Шаг стержней"; graph input
code_block_10 = CodeBlock(a=n11_шаг_стержней) { a <= 0? 150 : a; }
floor_3 = Math.Floor(number=code_block_10)
curve_1 = Python(IN[0]=length, IN[1]=floor_3)
# ---------- curve_1.python (14 lines) ----------
l = UnwrapElement(IN[0])[0]
s = IN[1]

a = 1 / (l / s)

newList = [0]
s = 0
e = 1
while e > s:
	s = s + a
	if s > e:
	    break
	newList.append(s)
OUT = newList
# ----------------------------------------
pointAtParameter_3 = Curve.PointAtParameter(curve=code_block_9.out0, param=curve_1, lacing=Longest)
pointAtParameter_4 = Curve.PointAtParameter(curve=code_block_9.out1, param=curve_1, lacing=Longest)
byStartPointEndPoint = Line.ByStartPointEndPoint(startPoint=pointAtParameter_3, endPoint=pointAtParameter_4)
startPoint = Curve.StartPoint(curve=byStartPointEndPoint)
n6_ближняя_грань_плиты_к_выпускам = DSFaceSelection()  # "6. Ближняя грань плиты к выпускам (грань траектории)"; 1 picked in the model; graph input
code_block_11 = CodeBlock(a=n6_ближняя_грань_плиты_к_выпускам) { a; }
distanceTo = Geometry.DistanceTo(geometry=startPoint, other=code_block_11, lacing=Longest)
average = Math.Average(numbers=distanceTo)
n7_укажите_смещение_арматуры_от = DoubleInput(500)  # "7. Укажите смещение арматуры от грани, ближней к отгибу (минус половина диаметра арматуры)"; graph input
floor_4 = Math.Floor(number=n7_укажите_смещение_арматуры_от)
code_block_12 = CodeBlock(dist=average, crv1=byStartPointEndPoint, offSetOtOtgiba=floor_4)
# ---------- code_block_12.designscript (17 lines) ----------
//оффсет от края с отгибами
test1 = dist<=5?Autodesk.DesignScript.Geometry.Curve.Reverse(crv1):crv1;
crvLen1 = Autodesk.DesignScript.Geometry.Curve.Length(test1);
cLFin1 = DSCore.Math.Abs(offSetOtOtgiba-crvLen1);
offsetCrv1 = Autodesk.DesignScript.Geometry.Curve.PointAtSegmentLength(test1,cLFin1);
PaP1 = Autodesk.DesignScript.Geometry.Curve.ParameterAtPoint(test1,offsetCrv1);
trimCrv1 = Autodesk.DesignScript.Geometry.Curve.TrimByEndParameter(test1,PaP1);

//оффсет от противоположного края

crvLen2 = Autodesk.DesignScript.Geometry.Curve.Length(trimCrv1);
//cLfin2_v1 = DSCore.Math.Abs(inpLen-crvLen2);
//cLfin2_v2 = DSCore.Math.Abs(inpLen-offSetOtOtgiba);
//cLfin2 = inpLen == 0?cLfin2_v2:cLfin2_v1;
//offsetCrv2 = Autodesk.DesignScript.Geometry.Curve.PointAtSegmentLength(trimCrv1,cLfin2);
//PaP2 = Autodesk.DesignScript.Geometry.Curve.ParameterAtPoint(trimCrv1,offsetCrv2);
//trim2crv = Autodesk.DesignScript.Geometry.Curve.TrimByStartParameter(trimCrv1,PaP2);
# ----------------------------------------
code_block_13 = CodeBlock(a=code_block_12.trimCrv1) { a; }
code_block_14 = CodeBlock { 1; }
curve_1_2 = List.Chop(list=code_block_13, lengths=code_block_14)
rebarStyle = RevitRebarStyle(index=0)
n16_диаметр_арматурного_стержня = RevitRebarBarType(index=0)  # "16. Диаметр арматурного стержня"; graph input
rebarHookType = RevitRebarHookType(index=0)
rebarHookOrientation = RevitRebarHookOrientation(index=0)
n1_выбор_объекта_в_котором_будет = DSModelElementSelection()  # "1. Выбор объекта, в котором будет арматура"; 1 picked in the model; graph input
n8_выпуски_вверх_true_или_вниз = BoolSelector(true)  # "8. Выпуски вверх (true) или вниз (false)?"; graph input
code_block_15 = CodeBlock(a=n8_выпуски_вверх_true_или_вниз) { a; }
code_block_16 = CodeBlock { 0.5; }
normalAtParameter = Curve.NormalAtParameter(curve=curve_1_2, param=code_block_16)
code_block_17 = CodeBlock(bl=code_block_15, vctr=normalAtParameter) { bl==true?vctr:Autodesk.DesignScript.Geometry.Vector.Reverse(vctr); }
fromCurve = StructuralDesign.Rebar.Create.FromCurve(curve=curve_1_2, rebarStyle=rebarStyle, rebarBarType=n16_диаметр_арматурного_стержня, startHookType=rebarHookType, endHookType=rebarHookType, startHookOrientation=rebarHookOrientation, endHookOrientation=rebarHookOrientation, hostElement=n1_выбор_объекта_в_котором_будет, vector=code_block_17)
views = Views(index=1)
n9_нужно_ли_делать_арматуру = BoolSelector(true)  # "9. Нужно ли делать арматуру объемной?"; graph input
code_block_18 = CodeBlock(bl=n9_нужно_ли_делать_арматуру) { bl; }
setSolidInView = StructuralDesign.Rebar.Create.SetSolidInView(rebar=fromCurve, view=views, solid=code_block_18)
n10_форма_арматурного_стержня = RevitRebarShape(index=3)  # "10. Форма арматурного стержня. Работает с прямыми (01), Гшками (12)"; graph input
code_block_19 = CodeBlock(rbrshp=n10_форма_арматурного_стержня) { rbrshp; }
setRebarShapeId = StructuralDesign.Rebar.Create.SetRebarShapeId(rebar=setSolidInView, rebarShape=code_block_19)
code_block_20 = CodeBlock { "A"; }
n13_размер_а_укажите_длину = DoubleInput(0)  # "13. Размер А. Укажите длину арматуры в плите. Если значение будет равно нулю - стержень дотянется до противоположного края плиты."; graph input
code_block_21 = CodeBlock(a=n13_размер_а_укажите_длину) { a; }
floor_5 = Math.Floor(number=code_block_21)
rebarHostCover = StructuralDesign.Rebar.Properties.RebarHostCover(element=n1_выбор_объекта_в_котором_будет)
code_block_22 = CodeBlock(other_hostcover=rebarHostCover.Other) { other_hostcover; }
code_block_23 = CodeBlock(a=code_block_12.crvLen2, o=code_block_22) { a-o; }
code_block_24 = CodeBlock(a=code_block_23) { a; }
floor_6 = Math.Floor(number=code_block_24)
code_block_25 = CodeBlock(val_a=floor_5, a=floor_6) { val_a <= 0? a : val_a; }
setParameterByName = Element.SetParameterByName(element=setRebarShapeId, parameterName=code_block_20, value=code_block_25)
code_block_26 = CodeBlock { "B"; }
n12_размер_б_длина_выпуска_если = DoubleInput(0)  # "12. Размер Б. Длина выпуска. Если значение будет равно нулю - выпуск будет равен 1000."; graph input
floor_7 = Math.Floor(number=n12_размер_б_длина_выпуска_если)
code_block_27 = CodeBlock(val_b=floor_7) { val_b <= 0? 1000 : val_b; }
setParameterByName_2 = Element.SetParameterByName(element=setRebarShapeId, parameterName=code_block_26, value=code_block_27)
code_block_28 = CodeBlock { "R"; }
n14_радиус_гшки_при_необходимости = DoubleInput(0)  # "14. Радиус Гшки (при необходимости)"; graph input
floor_8 = Math.Floor(number=n14_радиус_гшки_при_необходимости)
code_block_29 = CodeBlock(val_r=floor_8) { val_r <= 0? 200 : val_r; }
setParameterByName_3 = Element.SetParameterByName(element=setRebarShapeId, parameterName=code_block_28, value=code_block_29)
code_block_30 = CodeBlock { "Марка"; }
n15_укажите_марку_арматуры = StringInput("1")  # "15. Укажите марку арматуры"; graph input
code_block_31 = CodeBlock(mrk=n15_укажите_марку_арматуры) { mrk; }
setParameterByName_4 = Element.SetParameterByName(element=setRebarShapeId, parameterName=code_block_30, value=code_block_31)
