# Dynamo graph Rebar3D.dyn (Dynamo 2.10.1.3976)
# packages: Dynamo for Rebar 2.0.2

выбрать_арматуру_рамкой = DSModelElementsSelection()  # 186 picked in the model; graph input
выбрать_арматуру_единичный_выбор = DSModelElementSelection()  # 1 picked in the model; graph input
рамка_true_единичный_false = BoolSelector(false)  # graph input
python_script = Python(IN[0]=выбрать_арматуру_рамкой, IN[1]=выбрать_арматуру_единичный_выбор, IN[2]=рамка_true_единичный_false)  # IronPython2
# ---------- python_script.python (22 lines) ----------
# Загрузить стандартную библиотеку Python и библиотеку DesignScript
import sys
import clr
clr.AddReference('ProtoGeometry')
from Autodesk.DesignScript.Geometry import *
clr.AddReference('RevitAPIUI')
from Autodesk.Revit.UI import *

# Введенные в этом узле данные сохраняется в виде списка в переменных IN.
a, b, bl = IN[0], [IN[1]], IN[2]
if bl == True:
	try:
		lb = len(a)
		OUT = a
	except:
		TaskDialog.Show("Rebar3D", "Ни одного элемента не выбрано!")
elif bl == False:
	try:
		lb = len(b)
		OUT = b
	except:
		TaskDialog.Show("Rebar3D", "Ни одного элемента не выбрано!")
# ----------------------------------------
current = Document.Current()
activeView = Document.ActiveView(document=current)
boolean = BoolSelector(true)
setSolidInView = Rebar.SetSolidInView(rebar=python_script, view=activeView, solid=boolean)
