# Dynamo graph RenameFamParam.dyn (Dynamo 2.0.5.13212)

current = Orchid.RevitProject.Common.Document.Current()

# group: Добавление С_ к параметрам семейства
parameters = Orchid.RevitFamily.Document.Parameters(familyDocument=current)
name = Orchid.RevitFamily.Parameter.Name(parameter=parameters)
code_block = CodeBlock { ["ADSK", "MPP"]; }
boolean = BoolSelector(true)
contains = Orchid.Common.String.Contains(string=name, searchFor=code_block, ignoreCase=boolean)
code_block_2 = CodeBlock()
# ---------- code_block_2.designscript (13 lines) ----------
[
"Отметка по умолчанию",
"Изображение типоразмера",
"Ключевая пометка",
"Группа модели",
"Изготовитель",
"Комментарии к типоразмеру",
"URL",
"Описание",
"Код по классификатору",
"Стоимость"

];
# ----------------------------------------
contains_2 = Orchid.Common.String.Contains(string=name, searchFor=code_block_2, ignoreCase=boolean)
code_block_3 = CodeBlock { "С_"; }
startsWith = String.StartsWith(str=name, searchFor=code_block_3)
code_block_4 = CodeBlock(a1=contains, a2=contains_2, a3=startsWith) { a1 == false && a2 == false && a3 == false; }
filterByBoolMask = List.FilterByBoolMask(list=name, mask=code_block_4)
code_block_5 = CodeBlock(a=filterByBoolMask.in) { "С_" + a; }
rename = Orchid.RevitFamily.Parameter.Rename(familyDocument=current, sourceName=filterByBoolMask.in, targetName=code_block_5)

boolean_2 = BoolSelector(true)
familyparameters = Custom[© FamilyParameters](document=current, Refresh=boolean_2)  # Obtains all parameters in the document, as well as their properties.
SParameters = List.FilterByBoolMask(list=familyparameters.elements, mask=familyparameters.isShared)
SParametersNames = List.FilterByBoolMask(list=familyparameters.names, mask=familyparameters.isShared)
SParametersGroups = List.FilterByBoolMask(list=familyparameters.groups, mask=familyparameters.isShared)
byKeysValues = DesignScript.Builtin.Dictionary.ByKeysValues(keys=SParametersNames.out, values=SParametersGroups.out)
byKeysValues_2 = DesignScript.Builtin.Dictionary.ByKeysValues(keys=SParametersNames.in, values=SParametersGroups.in)
keys = DesignScript.Builtin.Dictionary.Keys(dictionary=byKeysValues_2)
file_path = Filename(".\ChangeParam.xlsx")
file_from_path = FileObject(path=file_path)
string = StringInput("Лист1")
boolean_3 = BoolSelector(true)
importExcel = Data.ImportExcel(file=file_from_path, sheetName=string, readAsStrings=boolean_3)
code_block_6 = CodeBlock { 0; 1; }
getItemAtIndex = List.GetItemAtIndex(list=importExcel@L2, index=code_block_6.out1)
getItemAtIndex_2 = List.GetItemAtIndex(list=importExcel@L2, index=code_block_6.out0)
byKeysValues_3 = DesignScript.Builtin.Dictionary.ByKeysValues(keys=getItemAtIndex, values=getItemAtIndex_2)
keys_2 = DesignScript.Builtin.Dictionary.Keys(dictionary=byKeysValues_3)
setIntersection = List.SetIntersection(list1=keys_2, list2=keys)
setDifference = List.SetDifference(list1=keys, list2=setIntersection)

# group: Неидентифицированные общие параметры, отправляющиеся в категорию "Набор"
byName = Orchid.RevitFamily.Parameter.ByName(familyDocument=current, name=setDifference)
code_block_7 = CodeBlock(a=byName) { a.Id; }
python_script = Python(IN[0]=code_block_7)
# ---------- python_script.python (18 lines) ----------
import clr
clr.AddReference('RevitAPI')
from Autodesk.Revit.DB import *

clr.AddReference("RevitServices")
import RevitServices
from RevitServices.Persistence import DocumentManager

doc = DocumentManager.Instance.CurrentDBDocument

a = UnwrapElement(IN[0])

param_ids = a # Список id-шников параметров
t = Transaction(doc)
t.Start("test")
for param_id in param_ids:
    doc.GetElement(ElementId(param_id)).GetDefinition().ParameterGroup = BuiltInParameterGroup.PG_COUPLER_ARRAY
t.Commit()
# ----------------------------------------

# group: Присвоение общим параметрам нужной группы
byName_2 = Orchid.RevitFamily.Parameter.ByName(familyDocument=current, name=setIntersection)
code_block_8 = CodeBlock(a=byName_2) { a.Id; }
valueAtKey = DesignScript.Builtin.Dictionary.ValueAtKey(dictionary=byKeysValues_3, key=setIntersection)
python_script_2 = Python(IN[0]=code_block_8, IN[1]=valueAtKey)
# ---------- python_script_2.python (20 lines) ----------
import clr
clr.AddReference('RevitAPI')
from Autodesk.Revit.DB import *

clr.AddReference("RevitServices")
import RevitServices
from RevitServices.Persistence import DocumentManager

doc = DocumentManager.Instance.CurrentDBDocument

param_ids = UnwrapElement(IN[0])
parameter_groups = UnwrapElement(IN[1])

t = Transaction(doc)
t.Start("test")

for param_id, group_name in zip(param_ids, parameter_groups):
    doc.GetElement(ElementId(param_id)).GetDefinition().ParameterGroup = eval("BuiltInParameterGroup." + group_name)
    
t.Commit()
# ----------------------------------------
