# Dynamo graph RenamingFiles.dyn (Dynamo 2.0.5.13212)

string = StringInput("\\mpp.mospp.ru\MPP\DPM\00_Библиотека\00_Отделы\08_ОИМ\020 В работе\021 Шаблоны\RVT\КР\СемействаКР\Закладные детали\Сальники")
directory_from_path = DirectoryObject(path=string)
code_block = CodeBlock { "*.00*"; }
boolean = BoolSelector(true)
getDirectoryContents = FileSystem.GetDirectoryContents(directory=directory_from_path, searchString=code_block, includeSubdirectories=boolean)
python_script = Python(IN[0]=getDirectoryContents.files)
# ---------- python_script.python (12 lines) ----------
import sys
pyt_path = r'C:\Program Files (x86)\IronPython 2.7\Lib'
sys.path.append(pyt_path)

import os
t2 = []
s = UnwrapElement(IN[0])
for i in s:
	if "МРР_КЖ_Конструкция_ЗаклДеталь" in i:
		t = i.replace("МРР_КЖ_Конструкция_ЗаклДеталь", "МРР")
		t2 = os.renames(i, t)
OUT = []
# ----------------------------------------
deleteFile = FileSystem.DeleteFile()  # unwired: path
