# Dynamo graph SetLevelForSpec_DoorWindow.dyn (Dynamo 2.10.1.3976)
# packages: Data-Shapes 2022.2.96

element_types = ElementTypes("ParameterElement")
all_elements_of_type = ElementsOfType(element_type=element_types)
code_block = CodeBlock(a=all_elements_of_type) { a.Name; }
string = StringInput("Скрипт для массового назначения этажей для дверей или окон НА ТЕКУЩЕМ ВИДЕ")
string_2 = StringInput("Применить")
code_block_2 = CodeBlock { "Выберите категорию"; }
code_block_3 = CodeBlock { ["Окна","Двери"]; }
byName = Category.ByName(name=code_block_3)
dropdown_data = Custom[DropDown Data](InputName=code_block_2, Keys=code_block_3, Values=byName)  # package Data-Shapes; Create data for DropDown input in UI.MultiInputForm ++ . Check out www.data-shapes.net for more infos.
code_block_4 = CodeBlock { "Выберите нужный уровень"; }
python_script = Python(IN[0]=all_elements_of_type)  # IronPython2
# ---------- python_script.python (12 lines) ----------
# Загрузить стандартную библиотеку Python и библиотеку DesignScript
import sys
import clr
clr.AddReference('ProtoGeometry')
from Autodesk.DesignScript.Geometry import *

params = UnwrapElement(IN[0])
filteredparams = []
for j in params:
	if "СпецЭт" in j.Name:
		filteredparams.append(j.Name)
OUT = filteredparams
# ----------------------------------------
dropdown_data_2 = Custom[DropDown Data](InputName=code_block_4, Keys=python_script, Values=python_script)
code_block_5 = CodeBlock { "Заполнить или очистить параметр этажей?"; }
code_block_6 = CodeBlock { ["Заполнить", "Очистить"]; }
radiobuttons_data = Custom[RadioButtons Data](InputName=code_block_5, Keys=code_block_6, Values=code_block_6)  # package Data-Shapes; Create radio buttons input for UI.MultipleInputForm ++ .
code_block_7 = CodeBlock(a=dropdown_data, b=dropdown_data_2, c=radiobuttons_data) { [a, b, c]; }
boolean = BoolSelector(true)
string_3 = StringInput("Отмена")
multipleinputform = Custom[MultipleInputForm ++](Description_optional=string, ButtonText_optional=string_2, Inputs=code_block_7, Toggle=boolean, CancelButtonText_optional=string_3)  # package Data-Shapes; Create a form with multiple inputs. see www.data-shapes.net for tutorials and infos!
code_block_8 = CodeBlock(a=multipleinputform.User_Inputs) { a[0]; a[1]; a[2]; }
current = Document.Current()
activeView = Document.ActiveView(document=current)
all_elements_of_category_in_view = ElementsOfCategoryInView(Category=code_block_8.out0, View=activeView)
code_block_9 = CodeBlock(a=code_block_8.out2) { a == "Заполнить"?1:0; }
setParameterByName = Element.SetParameterByName(element=all_elements_of_category_in_view, parameterName=code_block_8.out1, value=code_block_9)
count = List.Count(list=setParameterByName)
python_script_2 = Python(IN[0]=count)  # IronPython2
# ---------- python_script_2.python (12 lines) ----------
# Загрузить стандартную библиотеку Python и библиотеку DesignScript
import sys
import clr
clr.AddReference('ProtoGeometry')
from Autodesk.DesignScript.Geometry import *
clr.AddReference('RevitAPIUI')
from Autodesk.Revit.UI import *

cnt = str(IN[0])
TaskDialog.Show("Скрипт", "Выполнено! Обработано дверей: " + cnt)

OUT = 0
# ----------------------------------------
