# Dynamo graph SignatureScript.dyn (Dynamo 2.12.0.5650)

string = StringInput("Листы")
byName = Category.ByName(name=string)
all_elements_of_category = ElementsOfCategory(Category=byName)
string_2 = StringInput("ADSK_Штамп Раздел проекта")
getParameterValueByName = Element.GetParameterValueByName(element=all_elements_of_category, parameterName=string_2)
введите_раздел_проекта = StringInput("АР")  # graph input
code_block = CodeBlock(rp=getParameterValueByName, prp=введите_раздел_проекта) { rp == prp?true:false; }
filterByBoolMask = List.FilterByBoolMask(list=all_elements_of_category, mask=code_block)
titleBlock = Sheet.TitleBlock(sheet=filterByBoolMask.in)
parameters = Element.Parameters(element=titleBlock)
string_3 = StringInput("Подпись_Строка1")
string_4 = StringInput("NIIPI_Подписи")
byName_2 = Family.ByName(name=string_4)
введите_фамилию_для_поиска = StringInput("Прохоров")  # graph input
byFamilyAndName = FamilyType.ByFamilyAndName(family=byName_2, name=введите_фамилию_для_поиска)
setParameterByName = Element.SetParameterByName(element=titleBlock, parameterName=string_3, value=byFamilyAndName)
python_script = Python()  # IronPython2; frozen; unwired: IN[0]
# ---------- python_script.python (34 lines) ----------
import clr # Модуль для подгрузки .NET библиотек

# Библиотеки Revit API
clr.AddReference('RevitAPI') # Основная библиотека Revit API
clr.AddReference('RevitAPIUI') # Библиотека Revit API интерфейса
from Autodesk.Revit.DB import * # Указать классы для импорта
# from Autodesk.Revit.UI import * # Убрать решетку (если надо) и указать классы

# Библиотеки Dynamo
clr.AddReference('RevitNodes') # Конвертация элементов и геометрии
import Revit # Расширяем исходные методы классов через ImportExtensions
clr.ImportExtensions(Revit.GeometryConversion)
clr.ImportExtensions(Revit.Elements)
clr.AddReference('RevitServices') # Работа с документом и транзакциями
from RevitServices.Persistence import DocumentManager as DM # Менеджер документа
from RevitServices.Transactions import TransactionManager as TM # Менеджер транзакций

# Системные библиотеки
import System # Работа с системными типами и структурами данных .NET
from System.Collections.Generic import * # Можно конкретно указать List
import sys # Настройки интерпретатора IronPython, путь к библиотекам
sys.path.append(r'C:\Program Files (x86)\IronPython 2.7\Lib')

# Документ и транзакции
doc = DM.Instance.CurrentDBDocument # Получение файла документа
# uidoc = DM.Instance.CurrentUIApplication.ActiveUIDocument # Интерфейс

# Введенные в этом узле данные сохраняется в виде списка в переменных IN.
fs = IN[0]

# Разместите код под этой строкой
a = FilteredElementCollector(doc).OfClass(FamilySymbol).ToElements()
# Назначьте вывод переменной OUT.
OUT = a
# ----------------------------------------
code_block_2 = CodeBlock(a=byFamilyAndName) { a==null?"Такой подписи не существует":"Нет"; }
ошибка = Watch(code_block_2)
