# Dynamo graph SquareofSurfaces.dyn (Dynamo 2.0.5.13212)

выбрать_поверхность = DSFaceSelection()  # 1 picked in the model; graph input
area = Surface.Area(surface=выбрать_поверхность)
площадь_в_миллиметрах = Watch(area)  # graph output
code_block = CodeBlock(ar=area) { ar/100000; }
площадь_в_метрах = Watch(code_block)  # graph output
