# Dynamo graph SteelIsolation3D.dyn (Dynamo 2.0.4.12684)

startPoint = Curve.StartPoint()  # unwired: curve
select_face = DSFaceSelection()  # 1 picked in the model
family_types = FamilyTypes(index=14)
vertices = Topology.Vertices(topology=select_face)
flatten = List.Flatten(list=vertices)
pointGeometry = Vertex.PointGeometry(vertex=flatten)
byPoints = Polygon.ByPoints(points=pointGeometry)
center = Polygon.Center(polygon=byPoints)
ꟿ_familyinstance_byfaceandpoint = Custom[ꟿ FamilyInstance.ByFaceAndPoint](face=select_face, type=family_types, point=center)  # Places instances on the input face oriented to the face's U tangent and the global Z axis.
string = StringInput("MPP_Размер_Ширина_вспом")
code_block = CodeBlock { 0..1; 1; }
sublists = List.Sublists(list=pointGeometry, ranges=code_block.out0, offset=code_block.out1)
code_block_2 = CodeBlock { -2; }
dropItems = List.DropItems(list=sublists, amount=code_block_2)
code_block_3 = CodeBlock { 0; 1; }
getItemAtIndex = List.GetItemAtIndex(list=dropItems, index=code_block_3.out0)
getItemAtIndex_2 = List.GetItemAtIndex(list=dropItems, index=code_block_3.out1)
byStartPointEndPoint = Line.ByStartPointEndPoint(startPoint=getItemAtIndex, endPoint=getItemAtIndex_2)
length = Curve.Length(curve=byStartPointEndPoint)
code_block_4 = CodeBlock { 0; 1; }
getItemAtIndex_3 = List.GetItemAtIndex(list=length, index=code_block_4.out0)
setParameterByName = Element.SetParameterByName(element=ꟿ_familyinstance_byfaceandpoint, parameterName=string, value=getItemAtIndex_3)
string_2 = StringInput("MPP_Размер_Длина_вспом")
getItemAtIndex_4 = List.GetItemAtIndex(list=length, index=code_block_4.out1)
setParameterByName_2 = Element.SetParameterByName(element=ꟿ_familyinstance_byfaceandpoint, parameterName=string_2, value=getItemAtIndex_4)
