# Dynamo graph Synchronize_Auto.dyn (Dynamo 2.10.1.3976)

python_script = Python()  # IronPython2; unwired: IN[0]
# ---------- python_script.python (43 lines) ----------
import clr
clr.AddReference('ProtoGeometry')
from Autodesk.DesignScript.Geometry import *

# Import Element wrapper extension methods
clr.AddReference("RevitNodes")
import Revit
clr.ImportExtensions(Revit.Elements)

# Import geometry conversion extension methods
clr.ImportExtensions(Revit.GeometryConversion)

# Import DocumentManager and TransactionManager
clr.AddReference("RevitServices")
import RevitServices
from RevitServices.Persistence import DocumentManager
from RevitServices.Transactions import TransactionManager

# Import RevitAPI
clr.AddReference("RevitAPI")
import Autodesk
from Autodesk.Revit.DB import *

# Import system library
clr.AddReference('System.Core')
from System.Collections.Generic import *

doc = DocumentManager.Instance.CurrentDBDocument
uiapp = DocumentManager.Instance.CurrentUIApplication
app = uiapp.Application


chckt = FilteredWorksetCollector(doc).OfKind(WorksetKind.UserWorkset)
transOpts = TransactWithCentralOptions()
syncOpts = SynchronizeWithCentralOptions()
relinquishOpts = RelinquishOptions(True)
syncOpts.SetRelinquishOptions(relinquishOpts)
syncOpts.SaveLocalAfter = False
doc.SynchronizeWithCentral(transOpts, syncOpts)



OUT = 0
# ----------------------------------------
