# Dynamo graph DeleteElementsById.dyn (Dynamo 2.0.4.12684)

давай_сюда_свои_сраные_айдишники = CodeBlock { []; }  # "ДАВАЙ СЮДА СВОИ СРАНЫЕ АЙДИШНИКИ, КОЖАНЫЙ МЕШОК"
byElementId = archilab.Revit.Selection.Select.ByElementId(id=давай_сюда_свои_сраные_айдишники)
delete = archilab.Revit.Elements.Elements.Delete(element=byElementId)
