# Dynamo graph EXAMPLE_MoscowSubwayV8_TEST_Base&Rail&Crons&LVT.dyn (Dynamo 2.7.0.9206)

IГIS = Node_Storage()

# group: Размещение тюбингов, ящиков, кронштейнов под провода, основания под рельсы
code_block = CodeBlock { 1; }
code_block_2 = CodeBlock { 1; }

# group: Здесь нужно выбрать линию, подгруженную из Автокала. Выполняется преобразование в геометрию Dynamo
select_model_element = DSModelElementSelection()  # 1 picked in the model
curvesFromCADLayers = CAD.CurvesFromCADLayers(importInstance=select_model_element)
flatten = List.Flatten(list=curvesFromCADLayers.Curve)

code_block_3 = CodeBlock { 0; }
code_block_4 = CodeBlock(n=flatten) { List.Count(n)-1; }
code_block_5 = CodeBlock(curves=flatten, st=code_block_3, e=code_block_4) { curves[st..e]; }

# group (continued): Здесь нужно выбрать линию, подгруженную из Автокала. Выполняется преобразование в геометрию Dynamo
byJoinedCurves = PolyCurve.ByJoinedCurves(curves=code_block_5)
startPoint = Curve.StartPoint(curve=byJoinedCurves)

endPoint = Curve.EndPoint(curve=byJoinedCurves)

# group (continued): Здесь нужно выбрать линию, подгруженную из Автокала. Выполняется преобразование в геометрию Dynamo
n400 = CodeBlock(pCurve=byJoinedCurves, StPoint=startPoint, EnPoint=endPoint)  # "400"
# ---------- n400.designscript (3 lines) ----------
pnt400 = Autodesk.Curve.PointsAtChordLengthFromPoint(pCurve, StPoint, 400);
lt = List.Flatten(pnt400,1);
elst = List.Flatten([StPoint,lt,EnPoint],1);
# ----------------------------------------
code_block_6 = CodeBlock(a=n400.elst)
# ---------- code_block_6.designscript (4 lines) ----------
//3000 - необходимое смещение для центра тоннеля
List.Flatten(a.X,1);
List.Flatten(a.Y,1);
List.Flatten(a.Z+3000,1);
# ----------------------------------------
byCoordinates = Point.ByCoordinates(x=code_block_6.out0, y=code_block_6.out1, z=code_block_6.out2)

# group: Создание колец
code_block_7 = CodeBlock(points=byCoordinates) { points; }
code_block_8 = CodeBlock(points=code_block_7) { s = List.Sublists(points,0..1,1); d = List.DropItems(s,-1); }
code_block_9 = CodeBlock { 0; 1; }
getItemAtIndex = List.GetItemAtIndex(list=code_block_8.d@L2, index=code_block_9.out0)
getItemAtIndex_2 = List.GetItemAtIndex(list=code_block_8.d@L2, index=code_block_9.out1)
code_block_10 = CodeBlock(start=getItemAtIndex, end=getItemAtIndex_2, points=byCoordinates)
# ---------- code_block_10.designscript (3 lines) ----------
glines = Line.ByStartPointEndPoint(start,end);
vectors = Autodesk.Vector.ByTwoPoints(start,end);
circles = Circle.ByCenterPointRadiusNormal(points,2700,vectors);
# ----------------------------------------

n400_2 = CodeBlock(circles=code_block_10.circles)  # "400"
# ---------- n400_2.designscript (6 lines) ----------
surf200 = Surface.ByPatch(circles);
revFaces = ImportInstance.ByGeometry(surf200);
faces200 = Revit.Elements.Element.Faces(revFaces);
cpoints200 = Circle.CenterPoint(circles);
pointatparam200 = Autodesk.Curve.PointAtParameter(circles,0);
vectors200 = Autodesk.Vector.ByTwoPoints(cpoints200,pointatparam200);
# ----------------------------------------
code_block_11 = CodeBlock(face200=n400_2.faces200, cpoints200=n400_2.cpoints200, vectors200=n400_2.vectors200) { face200; cpoints200; vectors200; }
code_block_12 = CodeBlock(face200=code_block_11.face200, cpoints200=code_block_11.cpoints200, vectors200=code_block_11.vectors200) { face200; cpoints200; vectors200; }
размещение_основания_под_рельсы = CodeBlock(face200=code_block_12.face200, cpoints200=code_block_12.cpoints200, vectors200=code_block_12.vectors200)
# ---------- размещение_основания_под_рельсы.designscript (4 lines) ----------
famtype = FamilyType.ByName("Base_ByFace");
baseRails = FamilyInstance.ByFace(famtype,face200,cpoints200,vectors200);
fl_fam = List.Flatten(baseRails);
basesFaces = FamilyInstance.GetHost(fl_fam);
# ----------------------------------------
delete = archilab.Revit.Elements.Elements.Delete(element=размещение_основания_под_рельсы.basesFaces)
проверка = CodeBlock(bases=размещение_основания_под_рельсы.fl_fam, ch=delete) { bases; checkBlock = ch[0]; }
проверка_2 = CodeBlock(checkBlock=проверка.checkBlock, bases=проверка.bases) { ch = checkBlock==true?bases:null; facesBase200 = Revit.Elements.Element.Faces(ch); }
code_block_13 = CodeBlock { 12; }
getItemAtIndex_3 = List.GetItemAtIndex(list=проверка_2.facesBase200@L2, index=code_block_13)
perimeterCurves = Surface.PerimeterCurves(surface=getItemAtIndex_3)
code_block_14 = CodeBlock { 1; }
getItemAtIndex_4 = List.GetItemAtIndex(list=perimeterCurves@L2, index=code_block_14)
code_block_15 = CodeBlock(curves=getItemAtIndex_4, basesFace=getItemAtIndex_3)
# ---------- code_block_15.designscript (5 lines) ----------
curvesStP = Autodesk.Curve.StartPoint(curves);
curvesEnP = Autodesk.Curve.EndPoint(curves);
lines = Line.ByStartPointEndPoint(curvesStP,curvesEnP);
basesFace_sl = List.Sublists(basesFace,0,1);
lines_sl = List.Sublists(lines,0,1);
# ----------------------------------------
размещение_рельс = CodeBlock(basesFace_sl=code_block_15.basesFace_sl, lines_sl=code_block_15.lines_sl)
# ---------- размещение_рельс.designscript (5 lines) ----------
famtype = FamilyType.ByName("Rails_ByLine");

rails = FamilyInstance.ByFace(famtype,basesFace_sl,lines_sl);
ch = List.Flatten(rails);
ch.Name[0]!=null?basesFace_sl:null;
# ----------------------------------------
code_block_16 = CodeBlock(vectors200=n400_2.vectors200) { vectors200; }
code_block_17 = CodeBlock(vectors200=code_block_16) { vectors200; }
code_block_18 = CodeBlock(basesFace_sl=размещение_рельс.out3, lines_sl=code_block_15.lines_sl, vectors200=code_block_17)
# ---------- code_block_18.designscript (7 lines) ----------
basesFace_sl;
lines_sl;

basesFace_Crons = List.TakeEveryNthItem(basesFace_sl,7,8);
lines_Crons = List.TakeEveryNthItem(lines_sl,7,8);
vectors200_Crons = List.TakeEveryNthItem(vectors200,7,8);
crPoints = Autodesk.Curve.PointAtParameter(lines_Crons,0.5);
# ----------------------------------------
размещение_кронштейна_для = CodeBlock(basesFace_Crons=code_block_18.basesFace_Crons, crPoints=code_block_18.crPoints, vectors200_Crons=code_block_18.vectors200_Crons, basesFace_sl=code_block_18.basesFace_sl, lines_sl=code_block_18.lines_sl)  # "Размещение кронштейна для контактного рельса"
# ---------- размещение_кронштейна_для.designscript (6 lines) ----------
famtype = FamilyType.ByName("CronsteinContactRail");
rails = FamilyInstance.ByFace(famtype,basesFace_Crons,crPoints,vectors200_Crons);
ch = List.Flatten(rails);

ch.Name[0]!=null?basesFace_sl:null;
lines_sl;
# ----------------------------------------
code_block_19 = CodeBlock(vectors200=code_block_17) { vectors200; }
code_block_20 = CodeBlock(basesFace_sl=размещение_кронштейна_для.out3, lines_sl=размещение_кронштейна_для.lines_sl, vectors200=code_block_19)
# ---------- code_block_20.designscript (7 lines) ----------
basesFace_sl;
lines_sl;

basesFace_lvt = List.TakeEveryNthItem(basesFace_sl,3,4);
lines_lvt = List.TakeEveryNthItem(lines_sl,3,4);
vectors200_lvt = List.TakeEveryNthItem(vectors200,3,4);
lvtPoints = Autodesk.Curve.PointAtParameter(lines_lvt,0.5);
# ----------------------------------------
размещение_полушпал = CodeBlock(basesFace_lvt=code_block_20.basesFace_lvt, lvtPoints=code_block_20.lvtPoints, vectors200_lvt=code_block_20.vectors200_lvt)
# ---------- размещение_полушпал.designscript (3 lines) ----------
famtype = FamilyType.ByName("LVT-M");
rails = FamilyInstance.ByFace(famtype,basesFace_lvt,lvtPoints,vectors200_lvt);
ch = List.Flatten(rails);
# ----------------------------------------

# group: Размещение рельс, кронштейна под контактный рельс, полушпал
code_block_21 = CodeBlock { 1; }
code_block_22 = CodeBlock { 1; }

code_block_23 = CodeBlock { 10; }
n1400 = CodeBlock()  # "1400"; frozen; unwired: surf200, faces200, cpoints200, pointatparam200
# ---------- n1400.designscript (6 lines) ----------
surf1400 = List.TakeEveryNthItem(surf200,7,8);
faces1400 = List.TakeEveryNthItem(faces200,7,8);
cpoints1400 = List.TakeEveryNthItem(cpoints200,7,8);
pointatparam1400 = List.TakeEveryNthItem(pointatparam200,7,8);
vectors1400 = Autodesk.Vector.ByTwoPoints(cpoints1400,pointatparam1400);
lines1400 = Line.ByStartPointEndPoint(cpoints1400,pointatparam1400);
# ----------------------------------------
code_block_24 = CodeBlock(a=проверка_2.ch) { a; }
code_block_25 = CodeBlock(a=проверка.checkBlock) { a; }
