# Dynamo graph MoscowSubwayV8_BETA_ElectricalBoxes.dyn (Dynamo 2.0.4.12684)

IГIS = Node_Storage()
family_types = FamilyTypes(index=3)

# group: Здесь нужно выбрать линию, подгруженную из Автокала. Выполняется преобразование в геометрию Dynamo
select_model_element = DSModelElementSelection()  # 1 picked in the model
curvesFromCADLayers = CAD.CurvesFromCADLayers(importInstance=select_model_element)
byJoinedCurves = PolyCurve.ByJoinedCurves(curves=curvesFromCADLayers.Curve)
startPoint = Curve.StartPoint(curve=byJoinedCurves)
code_block = CodeBlock { 1400; }

pointsAtChordLengthFromPoint = Curve.PointsAtChordLengthFromPoint(curve=byJoinedCurves, point=startPoint, chordLength=code_block)
code_block_2 = CodeBlock(n=pointsAtChordLengthFromPoint, firstpoint=startPoint) { lst = List.Flatten(n,1); nlst = [firstpoint,lst]; newlist = List.Flatten(nlst,1); }

# group (continued): Здесь нужно выбрать линию, подгруженную из Автокала. Выполняется преобразование в геометрию Dynamo
code_block_3 = CodeBlock(a=code_block_2.newlist)
# ---------- code_block_3.designscript (4 lines) ----------
//3000 - необходимое смещение для центра тоннеля
List.Flatten(a.X,1);
List.Flatten(a.Y,1);
List.Flatten(a.Z+3000,1);
# ----------------------------------------
byCoordinates = Point.ByCoordinates(x=code_block_3.out0, y=code_block_3.out1, z=code_block_3.out2)

# group: ОГРАНИЧИТЕЛИ
code_block_4 = CodeBlock { 0; }
последний_индекс = CodeBlock()
# ---------- последний_индекс.designscript (5 lines) ----------
//Для отладки
//Подставь свое значение
//при неоходимости

0;
# ----------------------------------------
code_block_5 = CodeBlock(n=byCoordinates) { List.Count(n-1); }
code_block_6 = CodeBlock(a=последний_индекс, n=code_block_5) { a == 0?n:a; }
ОГРАНИЧИТЕЛЬ = CodeBlock(start=code_block_4, end=code_block_6) { start; end; }

code_block_7 = CodeBlock(points=byCoordinates, start=ОГРАНИЧИТЕЛЬ.start, end=ОГРАНИЧИТЕЛЬ.end) { points[start..end]; }

# group: Моделирование колец (не тюбингов!!)
code_block_8 = CodeBlock { TUBING; }  # unwired: TUBING
code_block_9 = CodeBlock(points=code_block_7) { points; 2700; }
code_block_10 = CodeBlock(TUBING=code_block_7) { TUBING; }
code_block_11 = CodeBlock { 0..1; }
code_block_12 = CodeBlock { 1; }
sublists = List.Sublists(list=code_block_10, ranges=code_block_11, offset=code_block_12)
code_block_13 = CodeBlock { -1; }
dropItems = List.DropItems(list=sublists, amount=code_block_13)
code_block_14 = CodeBlock { 0; }
getItemAtIndex = List.GetItemAtIndex(list=dropItems@L2, index=code_block_14)
code_block_15 = CodeBlock { 1; }
getItemAtIndex_2 = List.GetItemAtIndex(list=dropItems@L2, index=code_block_15)
byTwoPoints = Vector.ByTwoPoints(start=getItemAtIndex, end=getItemAtIndex_2)
byCenterPointRadiusNormal = Circle.ByCenterPointRadiusNormal(centerPoint=code_block_9.points, radius=code_block_9.out1, normal=byTwoPoints)

byPatch = Surface.ByPatch(closedCurve=byCenterPointRadiusNormal)
code_block_16 = CodeBlock(surf=byPatch) { surf; }
centerPoint = Circle.CenterPoint(circle=byCenterPointRadiusNormal)
code_block_17 = CodeBlock(CircleCenterPoint=centerPoint) { CircleCenterPoint; }
code_block_18 = CodeBlock { 0.25; }
pointAtParameter = Curve.PointAtParameter(curve=byCenterPointRadiusNormal, param=code_block_18)
byTwoPoints_2 = Vector.ByTwoPoints(start=centerPoint, end=pointAtParameter)
code_block_19 = CodeBlock(vector=byTwoPoints_2) { Autodesk.Vector.Reverse(vector); }

# group: Размещение осветительных ящиков
string = StringInput("ElectricBox_Light")
byName = FamilyType.ByName(name=string)
code_block_20 = CodeBlock { 25; 0; }
code_block_21 = CodeBlock(surf=code_block_16, n=code_block_20.out0, offset=code_block_20.out1, points=code_block_17, vectors=code_block_19) { List.TakeEveryNthItem(surf,n,offset); List.TakeEveryNthItem(points,n,offset); List.TakeEveryNthItem(vectors,n,offset); }
byGeometry = ImportInstance.ByGeometry(geometry=code_block_21.out0)
faces = Element.Faces(element=byGeometry)
byFace = FamilyInstance.ByFace(familyType=family_types, face=faces, location=code_block_21.out1, referenceDirection=code_block_21.out2)
getHost = FamilyInstance.GetHost(familyInstance=byFace)
flatten = List.Flatten(list=byFace)

code_block_22 = CodeBlock(host1=getHost) { host1; }
code_block_23 = CodeBlock(host1=code_block_22) { host1; }
family_types_2 = FamilyTypes(index=4)
code_block_24 = CodeBlock(surf=code_block_16) { surf; }
code_block_25 = CodeBlock { 63; 0; }
code_block_26 = CodeBlock(CircleCenterPoint=code_block_17) { CircleCenterPoint; }
code_block_27 = CodeBlock(vctr=code_block_19) { vctr; }

# group: Расстановка путейных ящиков
byName_2 = FamilyType.ByName()  # unwired: name
string_2 = StringInput("ElectricBox_Way")
code_block_28 = CodeBlock(lst=flatten, surf=code_block_24) { lst[0]!=null?surf:null; }
code_block_29 = CodeBlock(surf=code_block_28, n=code_block_25.out0, offset=code_block_25.out1, points=code_block_26, vectors=code_block_27) { List.TakeEveryNthItem(surf,n,offset); List.TakeEveryNthItem(points,n,offset); List.TakeEveryNthItem(vectors,n,offset); }
byGeometry_2 = ImportInstance.ByGeometry(geometry=code_block_29.out0)
faces_2 = Element.Faces(element=byGeometry_2)
byFace_2 = FamilyInstance.ByFace(familyType=family_types_2, face=faces_2, location=code_block_29.out1, referenceDirection=code_block_29.out2)

getHost_2 = FamilyInstance.GetHost(familyInstance=byFace_2)
code_block_30 = CodeBlock(host2=getHost_2) { host2; }
code_block_31 = CodeBlock(a=code_block_23, b=code_block_30) { List.Flatten([a,b],1); }
delete = archilab.Revit.Elements.Elements.Delete(element=code_block_31)
