# Dynamo graph MoscowSubwayV8_BETA_Rail.dyn "MoscowSubwayV8_BETA_Rails" (Dynamo 2.0.4.12684)

IГIS = Node_Storage()

# group: Здесь нужно выбрать линию, подгруженную из Автокала. Выполняется преобразование в геометрию Dynamo
select_model_element = DSModelElementSelection()  # 1 picked in the model
curvesFromCADLayers = CAD.CurvesFromCADLayers(importInstance=select_model_element)
byJoinedCurves = PolyCurve.ByJoinedCurves(curves=curvesFromCADLayers.Curve)
startPoint = Curve.StartPoint(curve=byJoinedCurves)
code_block = CodeBlock { 275; }

pointsAtChordLengthFromPoint = Curve.PointsAtChordLengthFromPoint(curve=byJoinedCurves, point=startPoint, chordLength=code_block)
code_block_2 = CodeBlock(n=pointsAtChordLengthFromPoint, firstpoint=startPoint) { lst = List.Flatten(n,1); nlst = [firstpoint,lst]; newlist = List.Flatten(nlst,1); }

# group (continued): Здесь нужно выбрать линию, подгруженную из Автокала. Выполняется преобразование в геометрию Dynamo
code_block_3 = CodeBlock(a=code_block_2.newlist)
# ---------- code_block_3.designscript (4 lines) ----------
//3000 - необходимое смещение для центра тоннеля
List.Flatten(a.X,1);
List.Flatten(a.Y,1);
List.Flatten(a.Z+3000,1);
# ----------------------------------------
byCoordinates = Point.ByCoordinates(x=code_block_3.out0, y=code_block_3.out1, z=code_block_3.out2)

# group: ОГРАНИЧИТЕЛИ
code_block_4 = CodeBlock { 0; }
последний_индекс = CodeBlock()
# ---------- последний_индекс.designscript (6 lines) ----------
//Для отладки
//Подставь свое значение
//при необходимости
//если не надо - оставь 0!!!!

0;
# ----------------------------------------
code_block_5 = CodeBlock(n=byCoordinates) { List.Count(n-1); }
code_block_6 = CodeBlock(a=последний_индекс, n=code_block_5) { a == 0?n:a; }
ОГРАНИЧИТЕЛЬ = CodeBlock(start=code_block_4, end=code_block_6) { start; end; }

code_block_7 = CodeBlock(points=byCoordinates, start=ОГРАНИЧИТЕЛЬ.start, end=ОГРАНИЧИТЕЛЬ.end) { points[start..end]; }

# group: Моделирование колец (не тюбингов!!)
code_block_8 = CodeBlock { TUBING; }  # unwired: TUBING
code_block_9 = CodeBlock(points=code_block_7) { points; 2700; }
code_block_10 = CodeBlock(TUBING=code_block_7) { TUBING; }
code_block_11 = CodeBlock { 0..1; }
code_block_12 = CodeBlock { 1; }
sublists = List.Sublists(list=code_block_10, ranges=code_block_11, offset=code_block_12)
code_block_13 = CodeBlock { -1; }
dropItems = List.DropItems(list=sublists, amount=code_block_13)
code_block_14 = CodeBlock { 0; }
getItemAtIndex = List.GetItemAtIndex(list=dropItems@L2, index=code_block_14)
code_block_15 = CodeBlock { 1; }
getItemAtIndex_2 = List.GetItemAtIndex(list=dropItems@L2, index=code_block_15)
byTwoPoints = Vector.ByTwoPoints(start=getItemAtIndex, end=getItemAtIndex_2)
byCenterPointRadiusNormal = Circle.ByCenterPointRadiusNormal(centerPoint=code_block_9.points, radius=code_block_9.out1, normal=byTwoPoints)
byStartPointEndPoint = Line.ByStartPointEndPoint(startPoint=getItemAtIndex, endPoint=getItemAtIndex_2)

# group: Создание системы координат
code_block_16 = CodeBlock { 0.5; }
pointAtParameter = Curve.PointAtParameter(curve=byCenterPointRadiusNormal, param=code_block_16)
vectorX = Vector.ByTwoPoints(start=code_block_9.points, end=pointAtParameter)
code_block_17 = CodeBlock { 0.25; }
pointAtParameter_2 = Curve.PointAtParameter(curve=byCenterPointRadiusNormal, param=code_block_17)
vectorY = Vector.ByTwoPoints(start=code_block_9.points, end=pointAtParameter_2)
byOriginVectors = CoordinateSystem.ByOriginVectors(origin=code_block_9.points, xAxis=vectorX, yAxis=vectorY, lacing=Longest)

code_block_18 = CodeBlock(cs=byOriginVectors) { cs; }
code_block_19 = CodeBlock(cs=code_block_18) { cs; }
code_block_20 = CodeBlock(cs=code_block_19) { cs; }
code_block_21 = CodeBlock(cs=code_block_20) { cs; }
code_block_22 = CodeBlock(gcurves=byStartPointEndPoint) { gcurves; }
code_block_23 = CodeBlock(lines=code_block_22) { lines; }
code_block_24 = CodeBlock(lines=code_block_23) { lines; }

# group: Моделирование левого рельса
code_block_25 = CodeBlock(cs=code_block_20) { cs; }
file_path = Filename("Исходные данные\Общее\Left_Rail_Points.xls")  # graph input
file_from_path = FileObject(path=file_path)
string = StringInput("Summary")
importExcel = Data.ImportExcel(file=file_from_path, sheetName=string)
code_block_26 = CodeBlock { 0; 1; 2; }
getItemAtIndex_3 = List.GetItemAtIndex(list=importExcel@L2, index=code_block_26.out0)
toNumber = String.ToNumber(str=getItemAtIndex_3)
code_block_27 = CodeBlock(a=toNumber)
# ---------- code_block_27.designscript (24 lines) ----------
a[0];
a[1];
a[2];
a[3];
a[4];
a[5];
a[6];
a[7];
a[8];
a[9];
a[10];
a[11];
a[12];
a[13];
a[14];
a[15];
a[16];
a[17];
a[18];
a[19];
a[20];
a[21];
a[22];
a[23];
# ----------------------------------------
getItemAtIndex_4 = List.GetItemAtIndex(list=importExcel@L2, index=code_block_26.out1)
toNumber_2 = String.ToNumber(str=getItemAtIndex_4)
code_block_28 = CodeBlock(a=toNumber_2)  # same code as code_block_27
n8 = Point.ByCartesianCoordinates(cs=code_block_25, x=code_block_27.out7, y=code_block_28.out7)  # "8"
n16 = Point.ByCartesianCoordinates(cs=code_block_25, x=code_block_27.out15, y=code_block_28.out15)  # "16"
n1 = Point.ByCartesianCoordinates(cs=code_block_25, x=code_block_27.out0, y=code_block_28.out0)  # "1"
n2 = Point.ByCartesianCoordinates(cs=code_block_25, x=code_block_27.out1, y=code_block_28.out1)  # "2"
n1_2 = Line.ByStartPointEndPoint(startPoint=n1, endPoint=n2)  # "1-2"
n3 = Point.ByCartesianCoordinates(cs=code_block_25, x=code_block_27.out2, y=code_block_28.out2)  # "3"
n2_3 = Line.ByStartPointEndPoint(startPoint=n2, endPoint=n3)  # "2-3"
n4 = Point.ByCartesianCoordinates(cs=code_block_25, x=code_block_27.out3, y=code_block_28.out3)  # "4"
n3_4 = Line.ByStartPointEndPoint(startPoint=n3, endPoint=n4)  # "3-4"
n5 = Point.ByCartesianCoordinates(cs=code_block_25, x=code_block_27.out4, y=code_block_28.out4)  # "5"
n4_5 = Line.ByStartPointEndPoint(startPoint=n4, endPoint=n5)  # "4-5"
n6 = Point.ByCartesianCoordinates(cs=code_block_25, x=code_block_27.out5, y=code_block_28.out5)  # "6"
n5_6 = Line.ByStartPointEndPoint(startPoint=n5, endPoint=n6)  # "5-6"
n7 = Point.ByCartesianCoordinates(cs=code_block_25, x=code_block_27.out6, y=code_block_28.out6)  # "7"
n6_7 = Line.ByStartPointEndPoint(startPoint=n6, endPoint=n7)  # "6-7"
n9 = Point.ByCartesianCoordinates(cs=code_block_25, x=code_block_27.out8, y=code_block_28.out8)  # "9"
n7_9 = Line.ByStartPointEndPoint(startPoint=n7, endPoint=n9)  # "7-9"
n10 = Point.ByCartesianCoordinates(cs=code_block_25, x=code_block_27.out9, y=code_block_28.out9)  # "10"
n9_10 = Line.ByStartPointEndPoint(startPoint=n9, endPoint=n10)  # "9-10"
n11 = Point.ByCartesianCoordinates(cs=code_block_25, x=code_block_27.out10, y=code_block_28.out10)  # "11"
n10_11 = Line.ByStartPointEndPoint(startPoint=n10, endPoint=n11)  # "10-11"
n12 = Point.ByCartesianCoordinates(cs=code_block_25, x=code_block_27.out11, y=code_block_28.out11)  # "12"
n11_12 = Line.ByStartPointEndPoint(startPoint=n11, endPoint=n12)  # "11-12"
n13 = Point.ByCartesianCoordinates(cs=code_block_25, x=code_block_27.out12, y=code_block_28.out12)  # "13"
n12_13 = Line.ByStartPointEndPoint(startPoint=n12, endPoint=n13)  # "12-13"
n14 = Point.ByCartesianCoordinates(cs=code_block_25, x=code_block_27.out13, y=code_block_28.out13)  # "14"
n13_14 = Line.ByStartPointEndPoint(startPoint=n13, endPoint=n14)  # "13-14"
n15 = Point.ByCartesianCoordinates(cs=code_block_25, x=code_block_27.out14, y=code_block_28.out14)  # "15"
n14_15 = Line.ByStartPointEndPoint(startPoint=n14, endPoint=n15)  # "14-15"
n17 = Point.ByCartesianCoordinates(cs=code_block_25, x=code_block_27.out16, y=code_block_28.out16)  # "17"
n15_17 = Line.ByStartPointEndPoint(startPoint=n15, endPoint=n17)  # "15-17"
n18 = Point.ByCartesianCoordinates(cs=code_block_25, x=code_block_27.out17, y=code_block_28.out17)  # "18"
n17_18 = Line.ByStartPointEndPoint(startPoint=n17, endPoint=n18)  # "17-18"
n19 = Point.ByCartesianCoordinates(cs=code_block_25, x=code_block_27.out18, y=code_block_28.out18)  # "19"
n18_19 = Line.ByStartPointEndPoint(startPoint=n18, endPoint=n19)  # "18-19"
n20 = Point.ByCartesianCoordinates(cs=code_block_25, x=code_block_27.out19, y=code_block_28.out19)  # "20"
n19_20 = Line.ByStartPointEndPoint(startPoint=n19, endPoint=n20)  # "19-20"
n21 = Point.ByCartesianCoordinates(cs=code_block_25, x=code_block_27.out20, y=code_block_28.out20)  # "21"
n20_21 = Line.ByStartPointEndPoint(startPoint=n20, endPoint=n21)  # "20-21"
n22 = Point.ByCartesianCoordinates(cs=code_block_25, x=code_block_27.out21, y=code_block_28.out21)  # "22"
n21_22 = Line.ByStartPointEndPoint(startPoint=n21, endPoint=n22)  # "21-22"
n23 = Point.ByCartesianCoordinates(cs=code_block_25, x=code_block_27.out22, y=code_block_28.out22)  # "23"
n22_23 = Line.ByStartPointEndPoint(startPoint=n22, endPoint=n23)  # "22-23"
n24 = Point.ByCartesianCoordinates(cs=code_block_25, x=code_block_27.out23, y=code_block_28.out23)  # "24"
n23_24 = Line.ByStartPointEndPoint(startPoint=n23, endPoint=n24)  # "23-24"
n24_1 = Line.ByStartPointEndPoint(startPoint=n24, endPoint=n1)  # "24-1"
list_create = List.Create(item0=n1_2, item1=n2_3, item2=n3_4, item3=n4_5, item4=n5_6, item5=n6_7, item6=n7_9, item7=n9_10, item8=n10_11, item9=n11_12, item10=n12_13, item11=n13_14, item12=n14_15, item13=n15_17, item14=n17_18, item15=n18_19, item16=n19_20, item17=n20_21, item18=n21_22, item19=n22_23, item20=n23_24, item21=n24_1)
transpose = List.Transpose(lists=list_create)
byJoinedCurves_2 = PolyCurve.ByJoinedCurves(curves=transpose)
code_block_29 = CodeBlock { 0; 1; }
code_block_30 = CodeBlock(start=code_block_29.out0, end=code_block_29.out1, offset=code_block_29.out1) { start..end; offset; }
sublists_2 = List.Sublists(list=byJoinedCurves_2, ranges=code_block_30.out0, offset=code_block_30.offset)
sublists_3 = List.Sublists(list=code_block_24, ranges=code_block_30.out0, offset=code_block_30.offset)
byLoft = Solid.ByLoft(crossSections=sublists_2, guideCurves=sublists_3, lacing=Longest)  # graph output
bv_remove_nulls = Custom[bv Remove Nulls](List=byLoft)  # forked from Lunchbox
string_2 = StringInput("Каркас несущий")
byName = Category.ByName(name=string_2)
string_3 = StringInput("Сталь, углеродистая")
byName_2 = Material.ByName(name=string_3)
count = List.Count(list=bv_remove_nulls)
code_block_31 = CodeBlock(n=count) { 1..#n..1; }
code_block_32 = CodeBlock(n=code_block_31) { "ContactRail"+n; }
byGeometry = DirectShape.ByGeometry(geometry=bv_remove_nulls, category=byName, material=byName_2, name=code_block_32)

code_block_33 = CodeBlock(a=n1_2) { a[0]; }
string_from_object = FromObject(obj=byGeometry)
code_block_34 = CodeBlock(a=string_from_object) { a[0]; }
code_block_35 = CodeBlock(LRail=code_block_34) { LRail; }
code_block_36 = CodeBlock(LRail=code_block_35) { LRail; }
code_block_37 = CodeBlock(lines=code_block_24) { lines; }

# group: Моделирование правого рельса
code_block_38 = CodeBlock(cs=code_block_21) { cs; }
file_path_2 = Filename("Исходные данные\Общее\Right_Rail_Points.xls")  # graph input
file_from_path_2 = FileObject(path=file_path_2)
string_4 = StringInput("Summary")
importExcel_2 = Data.ImportExcel(file=file_from_path_2, sheetName=string_4)
code_block_39 = CodeBlock { 0; 1; 2; }
getItemAtIndex_5 = List.GetItemAtIndex(list=importExcel_2@L2, index=code_block_39.out0)
toNumber_3 = String.ToNumber(str=getItemAtIndex_5)
code_block_40 = CodeBlock(a=toNumber_3)  # same code as code_block_27
getItemAtIndex_6 = List.GetItemAtIndex(list=importExcel_2@L2, index=code_block_39.out1)
toNumber_4 = String.ToNumber(str=getItemAtIndex_6)
code_block_41 = CodeBlock(a=toNumber_4)  # same code as code_block_27
n8_2 = Point.ByCartesianCoordinates(cs=code_block_38, x=code_block_40.out7, y=code_block_41.out7)  # "8"
n1_3 = Point.ByCartesianCoordinates(cs=code_block_38, x=code_block_40.out0, y=code_block_41.out0)  # "1"
n2_2 = Point.ByCartesianCoordinates(cs=code_block_38, x=code_block_40.out1, y=code_block_41.out1)  # "2"
n1_2_2 = Line.ByStartPointEndPoint(startPoint=n1_3, endPoint=n2_2)  # "1-2"
n3_2 = Point.ByCartesianCoordinates(cs=code_block_38, x=code_block_40.out2, y=code_block_41.out2)  # "3"
n2_3_2 = Line.ByStartPointEndPoint(startPoint=n2_2, endPoint=n3_2)  # "2-3"
n4_2 = Point.ByCartesianCoordinates(cs=code_block_38, x=code_block_40.out3, y=code_block_41.out3)  # "4"
n3_4_2 = Line.ByStartPointEndPoint(startPoint=n3_2, endPoint=n4_2)  # "3-4"
n5_2 = Point.ByCartesianCoordinates(cs=code_block_38, x=code_block_40.out4, y=code_block_41.out4)  # "5"
n4_5_2 = Line.ByStartPointEndPoint(startPoint=n4_2, endPoint=n5_2)  # "4-5"
n6_2 = Point.ByCartesianCoordinates(cs=code_block_38, x=code_block_40.out5, y=code_block_41.out5)  # "6"
n5_6_2 = Line.ByStartPointEndPoint(startPoint=n5_2, endPoint=n6_2)  # "5-6"
n7_2 = Point.ByCartesianCoordinates(cs=code_block_38, x=code_block_40.out6, y=code_block_41.out6)  # "7"
n6_7_2 = Line.ByStartPointEndPoint(startPoint=n6_2, endPoint=n7_2)  # "6-7"
n9_2 = Point.ByCartesianCoordinates(cs=code_block_38, x=code_block_40.out8, y=code_block_41.out8)  # "9"
n7_9_2 = Line.ByStartPointEndPoint(startPoint=n7_2, endPoint=n9_2)  # "7-9"
n10_2 = Point.ByCartesianCoordinates(cs=code_block_38, x=code_block_40.out9, y=code_block_41.out9)  # "10"
n9_10_2 = Line.ByStartPointEndPoint(startPoint=n9_2, endPoint=n10_2)  # "9-10"
n11_2 = Point.ByCartesianCoordinates(cs=code_block_38, x=code_block_40.out10, y=code_block_41.out10)  # "11"
n10_11_2 = Line.ByStartPointEndPoint(startPoint=n10_2, endPoint=n11_2)  # "10-11"
n12_2 = Point.ByCartesianCoordinates(cs=code_block_38, x=code_block_40.out11, y=code_block_41.out11)  # "12"
n11_12_2 = Line.ByStartPointEndPoint(startPoint=n11_2, endPoint=n12_2)  # "11-12"
n13_2 = Point.ByCartesianCoordinates(cs=code_block_38, x=code_block_40.out12, y=code_block_41.out12)  # "13"
n12_13_2 = Line.ByStartPointEndPoint(startPoint=n12_2, endPoint=n13_2)  # "12-13"
n14_2 = Point.ByCartesianCoordinates(cs=code_block_38, x=code_block_40.out13, y=code_block_41.out13)  # "14"
n13_14_2 = Line.ByStartPointEndPoint(startPoint=n13_2, endPoint=n14_2)  # "13-14"
n15_2 = Point.ByCartesianCoordinates(cs=code_block_38, x=code_block_40.out14, y=code_block_41.out14)  # "15"
n14_15_2 = Line.ByStartPointEndPoint(startPoint=n14_2, endPoint=n15_2)  # "14-15"
n17_2 = Point.ByCartesianCoordinates(cs=code_block_38, x=code_block_40.out16, y=code_block_41.out16)  # "17"
n15_17_2 = Line.ByStartPointEndPoint(startPoint=n15_2, endPoint=n17_2)  # "15-17"
n18_2 = Point.ByCartesianCoordinates(cs=code_block_38, x=code_block_40.out17, y=code_block_41.out17)  # "18"
n17_18_2 = Line.ByStartPointEndPoint(startPoint=n17_2, endPoint=n18_2)  # "17-18"
n19_2 = Point.ByCartesianCoordinates(cs=code_block_38, x=code_block_40.out18, y=code_block_41.out18)  # "19"
n18_19_2 = Line.ByStartPointEndPoint(startPoint=n18_2, endPoint=n19_2)  # "18-19"
n20_2 = Point.ByCartesianCoordinates(cs=code_block_38, x=code_block_40.out19, y=code_block_41.out19)  # "20"
n19_20_2 = Line.ByStartPointEndPoint(startPoint=n19_2, endPoint=n20_2)  # "19-20"
n21_2 = Point.ByCartesianCoordinates(cs=code_block_38, x=code_block_40.out20, y=code_block_41.out20)  # "21"
n20_21_2 = Line.ByStartPointEndPoint(startPoint=n20_2, endPoint=n21_2)  # "20-21"
n22_2 = Point.ByCartesianCoordinates(cs=code_block_38, x=code_block_40.out21, y=code_block_41.out21)  # "22"
n21_22_2 = Line.ByStartPointEndPoint(startPoint=n21_2, endPoint=n22_2)  # "21-22"
n23_2 = Point.ByCartesianCoordinates(cs=code_block_38, x=code_block_40.out22, y=code_block_41.out22)  # "23"
n22_23_2 = Line.ByStartPointEndPoint(startPoint=n22_2, endPoint=n23_2)  # "22-23"
n24_1_2 = Line.ByStartPointEndPoint(startPoint=n23_2, endPoint=n1_3)  # "24-1"
list_create_2 = List.Create(item0=n1_2_2, item1=n2_3_2, item2=n3_4_2, item3=n4_5_2, item4=n5_6_2, item5=n6_7_2, item6=n7_9_2, item7=n9_10_2, item8=n10_11_2, item9=n11_12_2, item10=n12_13_2, item11=n13_14_2, item12=n14_15_2, item13=n15_17_2, item14=n17_18_2, item15=n18_19_2, item16=n19_20_2, item17=n20_21_2, item18=n21_22_2, item19=n22_23_2, item20=n24_1_2)
transpose_2 = List.Transpose(lists=list_create_2)
byJoinedCurves_3 = PolyCurve.ByJoinedCurves(curves=transpose_2)
code_block_42 = CodeBlock { 0; 1; }
code_block_43 = CodeBlock(start=code_block_42.out0, end=code_block_42.out1, offset=code_block_42.out1) { start..end; offset; }
sublists_4 = List.Sublists(list=byJoinedCurves_3, ranges=code_block_43.out0, offset=code_block_43.offset)
sublists_5 = List.Sublists(list=code_block_37, ranges=code_block_43.out0, offset=code_block_43.offset)
byLoft_2 = Solid.ByLoft(crossSections=sublists_4, guideCurves=sublists_5, lacing=Longest)  # graph output
bv_remove_nulls_2 = Custom[bv Remove Nulls](List=byLoft_2)
string_5 = StringInput("Каркас несущий")
byName_3 = Category.ByName(name=string_5)
string_6 = StringInput("Сталь, углеродистая")
byName_4 = Material.ByName(name=string_6)
count_2 = List.Count(list=bv_remove_nulls_2)
code_block_44 = CodeBlock(n=count_2) { 1..#n..1; }
code_block_45 = CodeBlock(n=code_block_44) { "ContactRail"+n; }
n16_2 = Point.ByCartesianCoordinates(cs=code_block_38, x=code_block_40.out15, y=code_block_41.out15)  # "16"
n24_2 = Point.ByCartesianCoordinates(cs=code_block_38, x=code_block_40.out23, y=code_block_41.out23)  # "24"

code_block_46 = CodeBlock(Lrail=code_block_36, a=bv_remove_nulls_2) { String.StartsWith(Lrail,"C",false)==true?a:0; }

# group (continued): Моделирование правого рельса
byGeometry_2 = DirectShape.ByGeometry(geometry=code_block_46, category=byName_3, material=byName_4, name=code_block_45)
