# Dynamo graph MoscowSubwayV8_TEST.dyn (Dynamo 2.0.4.12684)

IГIS = Node_Storage()

# group: Провода
code_block = CodeBlock { 1; }
code_block_2 = CodeBlock { 1; }

# group: Размещение тюбингов, ящиков, кронштейнов под провода, основания под рельсы
code_block_3 = CodeBlock { 1; }
code_block_4 = CodeBlock { 1; }

startPoint = Curve.StartPoint()  # unwired: curve

# group: Здесь нужно выбрать линию, подгруженную из Автокала. Выполняется преобразование в геометрию Dynamo
select_model_element = DSModelElementSelection()  # 1 picked in the model
curvesFromCADLayers = CAD.CurvesFromCADLayers(importInstance=select_model_element)
flatten = List.Flatten(list=curvesFromCADLayers.Curve)

# group: ОГРАНИЧИТЕЛИ
code_block_5 = CodeBlock { 0; }
последний_индекс = CodeBlock()
# ---------- последний_индекс.designscript (5 lines) ----------
//Для отладки
//Подставь свое значение
//при неоходимости

3;
# ----------------------------------------
code_block_6 = CodeBlock(n=flatten) { List.Count(n-1); }
code_block_7 = CodeBlock(a=последний_индекс, n=code_block_6) { a == 0?n:a; }
ОГРАНИЧИТЕЛЬ = CodeBlock(start=code_block_5, end=code_block_7) { start; end; }

code_block_8 = CodeBlock(curves=flatten, start=ОГРАНИЧИТЕЛЬ.start, end=ОГРАНИЧИТЕЛЬ.end) { curves[start..end]; }

# group (continued): Здесь нужно выбрать линию, подгруженную из Автокала. Выполняется преобразование в геометрию Dynamo
byJoinedCurves = PolyCurve.ByJoinedCurves(curves=code_block_8)
startPoint_2 = Curve.StartPoint(curve=byJoinedCurves)
n200 = CodeBlock(pCurve=byJoinedCurves, StPoint=startPoint_2)  # "200"
# ---------- n200.designscript (12 lines) ----------
pnt1400 = Autodesk.Curve.PointsAtChordLengthFromPoint(pCurve, StPoint, 1400);
lt = List.Flatten(pnt1400,1);
elst = List.Flatten([StPoint,lt],1);
newPcurve = PolyCurve.ByPoints(elst);
PcurvStPoint = Autodesk.Curve.StartPoint(newPcurve);
PcurvEndPoint = Autodesk.Curve.EndPoint(pCurve);

pnt200 = Autodesk.Curve.PointsAtChordLengthFromPoint(newPcurve, PcurvStPoint, 200);
lst = List.Flatten(pnt200,1);
nlst = [PcurvStPoint,lst];

newlist = List.AddItemToEnd(PcurvEndPoint,List.Flatten(nlst,1));
# ----------------------------------------

code_block_9 = CodeBlock(a=n200.newlist) { a; }

# group (continued): Здесь нужно выбрать линию, подгруженную из Автокала. Выполняется преобразование в геометрию Dynamo
code_block_10 = CodeBlock(a=code_block_9)
# ---------- code_block_10.designscript (4 lines) ----------
//3000 - необходимое смещение для центра тоннеля
List.Flatten(a.X,1);
List.Flatten(a.Y,1);
List.Flatten(a.Z+3000,1);
# ----------------------------------------
byCoordinates = Point.ByCoordinates(x=code_block_10.out0, y=code_block_10.out1, z=code_block_10.out2)

code_block_11 = CodeBlock(points=byCoordinates) { points; }
code_block_12 = CodeBlock(points=code_block_11) { points; }
code_block_13 = CodeBlock(points=code_block_12) { points; }

# group: Создание колец
code_block_14 = CodeBlock(points=byCoordinates) { points; }
code_block_15 = CodeBlock(points=code_block_14) { s = List.Sublists(points,0..1,1); d = List.DropItems(s,-1); }
code_block_16 = CodeBlock { 0; 1; }
getItemAtIndex = List.GetItemAtIndex(list=code_block_15.d@L2, index=code_block_16.out0)
getItemAtIndex_2 = List.GetItemAtIndex(list=code_block_15.d@L2, index=code_block_16.out1)
code_block_17 = CodeBlock(start=getItemAtIndex, end=getItemAtIndex_2, points=byCoordinates)
# ---------- code_block_17.designscript (3 lines) ----------
glines = Line.ByStartPointEndPoint(start,end);
vectors = Autodesk.Vector.ByTwoPoints(start,end);
circles = Circle.ByCenterPointRadiusNormal(points,2700,vectors);
# ----------------------------------------

# group: Создание системы координат
code_block_18 = CodeBlock(circles=code_block_17.circles, points=code_block_12)
# ---------- code_block_18.designscript (4 lines) ----------
x = Autodesk.Curve.PointAtParameter(circles,0.5);
y = Autodesk.Curve.PointAtParameter(circles,0.25);
vector_x = Autodesk.Vector.ByTwoPoints(points,x);
vector_y = Autodesk.Vector.ByTwoPoints(points,y);
# ----------------------------------------
byOriginVectors = CoordinateSystem.ByOriginVectors(origin=code_block_13, xAxis=code_block_18.vector_x, yAxis=code_block_18.vector_y)

code_block_19 = CodeBlock(cs=byOriginVectors) { cs1400 = List.TakeEveryNthItem(cs,7,8); }
code_block_20 = CodeBlock(cs1400=code_block_19) { cs1400; }
code_block_21 = CodeBlock(cs1400=code_block_20) { cs1400; }
code_block_22 = CodeBlock(cs1400=code_block_21) { cs1400; }
code_block_23 = CodeBlock(cs1400=code_block_22) { cs1400; }
code_block_24 = CodeBlock(cs1400=code_block_20)
# ---------- code_block_24.designscript (3 lines) ----------
wp1_1400 = Point.ByCartesianCoordinates(cs1400,2340.0161,1078.0585,0);
s = List.Sublists(wp1_1400,0..2,2);
d = List.DropItems(s,-1);
# ----------------------------------------
code_block_25 = CodeBlock { 0; 1; 2; }
n0 = List.GetItemAtIndex(list=code_block_24.d@L2, index=code_block_25.out0)  # "0"
n3 = List.GetItemAtIndex(list=code_block_24.d@L2, index=code_block_25.out1)  # "3"
n6 = List.GetItemAtIndex(list=code_block_24.d@L2, index=code_block_25.out2)  # "6"
code_block_26 = CodeBlock(pnt0=n0, pnt3=n3, pnt6=n6)
# ---------- code_block_26.designscript (16 lines) ----------
line1 = Line.ByStartPointEndPoint(pnt0,pnt3);
line2 = Line.ByStartPointEndPoint(pnt3,pnt6);
pnt1 = Autodesk.Curve.PointAtParameter(line1,0.01);
pnt5 = Autodesk.Curve.PointAtParameter(line2,0.99);

lst2 = Autodesk.Curve.PointAtParameter(line1,0.5);
lst4 = Autodesk.Curve.PointAtParameter(line2,0.5);
a = Math.RandomList(List.Count(lst2));
ar = Math.RemapRange(a,50,110);
b = Math.RandomList(List.Count(lst4));
br = Math.RemapRange(b,50,110);
pnt2 = Point.ByCoordinates(lst2.X,lst2.Y,(lst2.Z-ar));
pnt4 = Point.ByCoordinates(lst4.X,lst4.Y,(lst4.Z-br));
wirepoints=[pnt0,pnt1,pnt2,pnt3,pnt4,pnt5,pnt6];
final_wirepoints = List.Transpose(wirepoints);
fam = FamilyType.ByName("WireAdaptive");
# ----------------------------------------
byPoints = AdaptiveComponent.ByPoints(points=code_block_26.final_wirepoints, familyType=code_block_26.fam)
code_block_27 = CodeBlock(cs1400=code_block_21, Wire1=byPoints)
# ---------- code_block_27.designscript (4 lines) ----------
wp1_1400 = Point.ByCartesianCoordinates(cs1400,2469.2173,742.6185,0);
s = List.Sublists(wp1_1400,0..2,2);
d = List.DropItems(s,-1);
Wire1.Name[0]!=null?d:null;
# ----------------------------------------
code_block_28 = CodeBlock { 0; 1; 2; }
n0_2 = List.GetItemAtIndex(list=code_block_27.out3@L2, index=code_block_28.out0)  # "0"
n3_2 = List.GetItemAtIndex(list=code_block_27.out3@L2, index=code_block_28.out1)  # "3"
n6_2 = List.GetItemAtIndex(list=code_block_27.out3@L2, index=code_block_28.out2)  # "6"
code_block_29 = CodeBlock(pnt0=n0_2, pnt3=n3_2, pnt6=n6_2)  # same code as code_block_26
byPoints_2 = AdaptiveComponent.ByPoints(points=code_block_29.final_wirepoints, familyType=code_block_29.fam)
code_block_30 = CodeBlock(cs1400=code_block_22, Wire2=byPoints_2)
# ---------- code_block_30.designscript (4 lines) ----------
wp1_1400 = Point.ByCartesianCoordinates(cs1400,2576.2133,152.8327,0);
s = List.Sublists(wp1_1400,0..2,2);
d = List.DropItems(s,-1);
Wire2.Name[0]!=null?d:null;
# ----------------------------------------
code_block_31 = CodeBlock { 0; 1; 2; }
n0_3 = List.GetItemAtIndex(list=code_block_30.out3@L2, index=code_block_31.out0)  # "0"
n3_3 = List.GetItemAtIndex(list=code_block_30.out3@L2, index=code_block_31.out1)  # "3"
n6_3 = List.GetItemAtIndex(list=code_block_30.out3@L2, index=code_block_31.out2)  # "6"
code_block_32 = CodeBlock(pnt0=n0_3, pnt3=n3_3, pnt6=n6_3)  # same code as code_block_26
byPoints_3 = AdaptiveComponent.ByPoints(points=code_block_32.final_wirepoints, familyType=code_block_32.fam)
code_block_33 = CodeBlock(cs1400=code_block_23, Wire3=byPoints_3)
# ---------- code_block_33.designscript (4 lines) ----------
wp1_1400 = Point.ByCartesianCoordinates(cs1400,2579.9995,-86.9163,0);
s = List.Sublists(wp1_1400,0..2,2);
d = List.DropItems(s,-1);
Wire3.Name[0]!=null?d:null;
# ----------------------------------------
code_block_34 = CodeBlock { 0; 1; 2; }
n0_4 = List.GetItemAtIndex(list=code_block_33.out3@L2, index=code_block_34.out0)  # "0"
n3_4 = List.GetItemAtIndex(list=code_block_33.out3@L2, index=code_block_34.out1)  # "3"
n6_4 = List.GetItemAtIndex(list=code_block_33.out3@L2, index=code_block_34.out2)  # "6"
code_block_35 = CodeBlock(pnt0=n0_4, pnt3=n3_4, pnt6=n6_4)  # same code as code_block_26
byPoints_4 = AdaptiveComponent.ByPoints(points=code_block_35.final_wirepoints, familyType=code_block_35.fam)
code_block_36 = CodeBlock(Wire4=byPoints_4) { check = Wire4.Name[0]; }
code_block_37 = CodeBlock(checkWires=code_block_36) { checkWires; }
code_block_38 = CodeBlock(circles=code_block_17.circles)
# ---------- code_block_38.designscript (17 lines) ----------
surf200 = Surface.ByPatch(circles);
ii200 = ImportInstance.ByGeometry(surf200);
faces200 = Revit.Elements.Element.Faces(ii200);

surf1400 = List.TakeEveryNthItem(surf200,7,8);
faces1400 = List.TakeEveryNthItem(faces200,7,8);

cpoints200 = Circle.CenterPoint(circles);

cpoints1400 = List.TakeEveryNthItem(cpoints200,7,8);

pointatparam200 = Autodesk.Curve.PointAtParameter(circles,0);
vectors200 = Autodesk.Vector.ByTwoPoints(cpoints200,pointatparam200);

pointatparam1400 = List.TakeEveryNthItem(pointatparam200,7,8);
vectors1400 = Autodesk.Vector.ByTwoPoints(cpoints1400,pointatparam1400);
lines1400 = Line.ByStartPointEndPoint(cpoints1400,pointatparam1400);
# ----------------------------------------
code_block_39 = CodeBlock(face1400=code_block_38.faces1400, cpoints1400=code_block_38.cpoints1400, vectors1400=code_block_38.vectors1400) { face1400; cpoints1400; vectors1400; }
code_block_40 = CodeBlock(checkWire=code_block_37, face1400=code_block_39.face1400) { checkWire!=null?face1400:null; }
размещение_тюбингов_с_поворотом = CodeBlock(face1400=code_block_40, cpoints1400=code_block_39.cpoints1400, vectors1400=code_block_39.vectors1400)
# ---------- размещение_тюбингов_с_поворотом.designscript (5 lines) ----------
famtype = FamilyType.ByName("concrete_tubing_1400_v2");
tubings = FamilyInstance.ByFace(famtype,face1400,cpoints1400,vectors1400);
ch = List.Flatten(tubings);
n = 180..#(List.Count(ch)-1)..30;
rotated_tub = FamilyInstance.SetRotation(tubings,n);
# ----------------------------------------
code_block_41 = CodeBlock(face1400=code_block_39.face1400, cpoints1400=code_block_39.cpoints1400, vectors1400=code_block_39.vectors1400) { face1400; cpoints1400; vectors1400; }
проверка = CodeBlock(ch=размещение_тюбингов_с_поворотом.ch, face1400=code_block_41.face1400) { ch[0]!=null?face1400:null; }
размещение_кронштейнов_под = CodeBlock(face1400=проверка, cpoints1400=code_block_41.cpoints1400, vectors1400=code_block_41.vectors1400)  # "Размещение кронштейнов под провода"
# ---------- размещение_кронштейнов_под.designscript (3 lines) ----------
famtype = FamilyType.ByName("1400");
cronswires = FamilyInstance.ByFace(famtype,face1400,cpoints1400,vectors1400);
ch = List.Flatten(cronswires);
# ----------------------------------------
расстояние_между_ящиками = CodeBlock { s1 = 9; e1 = 21; s2 = 14; e2 = 21; }
code_block_42 = CodeBlock(face1400=code_block_41.face1400, s1=расстояние_между_ящиками.s1, e1=расстояние_между_ящиками.e1, cpoints1400=code_block_41.cpoints1400, vectors1400=code_block_41.vectors1400, s2=расстояние_между_ящиками.s2, e2=расстояние_между_ящиками.e2)
# ---------- code_block_42.designscript (6 lines) ----------
facesLightBox = List.TakeEveryNthItem(face1400,s1,e1);
cpointsLightBox = List.TakeEveryNthItem(cpoints1400,s1,e1);
vectorsLightBox = List.TakeEveryNthItem(vectors1400,s1,e1);
facesWaybox = List.TakeEveryNthItem(face1400,s2,e2);
cpointsWaybox = List.TakeEveryNthItem(cpoints1400,s2,e2);
vectorsWaybox = List.TakeEveryNthItem(vectors1400,s2,e2);
# ----------------------------------------
проверка_2 = CodeBlock(ch=размещение_кронштейнов_под.ch, face1400_mod=code_block_42.facesLightBox) { ch[0]!=null?face1400_mod:null; }
размещение_осветительных_ящиков = CodeBlock(face1400_mod=проверка_2, cpoints1400_mod=code_block_42.cpointsLightBox, vectors1400_mod=code_block_42.vectorsLightBox)
# ---------- размещение_осветительных_ящиков.designscript (3 lines) ----------
famtype = FamilyType.ByName("ElectricBox_Light");
LightBox = FamilyInstance.ByFace(famtype,face1400_mod,cpoints1400_mod,vectors1400_mod);
ch = List.Flatten(LightBox);
# ----------------------------------------
code_block_43 = CodeBlock(face1400_mod=code_block_42.facesWaybox, cpoints1400_mod=code_block_42.cpointsWaybox, vectors1400_mod=code_block_42.vectorsWaybox) { face1400_mod; cpoints1400_mod; vectors1400_mod; }
проверка_3 = CodeBlock(ch=размещение_осветительных_ящиков.ch, face1400_mod=code_block_43.face1400_mod) { ch[0]!=null?face1400_mod:null; }
размещение_путевых_ящиков = CodeBlock(face1400_mod=проверка_3, cpoints1400_mod=code_block_43.cpoints1400_mod, vectors1400_mod=code_block_43.vectors1400_mod)
# ---------- размещение_путевых_ящиков.designscript (3 lines) ----------
famtype = FamilyType.ByName("ElectricBox_Way");
Waybox = FamilyInstance.ByFace(famtype,face1400_mod,cpoints1400_mod,vectors1400_mod);
ch = List.Flatten(Waybox);
# ----------------------------------------
code_block_44 = CodeBlock(face200=code_block_38.faces200, cpoints200=code_block_38.cpoints200, vectors200=code_block_38.vectors200) { face200; cpoints200; vectors200; }
code_block_45 = CodeBlock(face200=code_block_44.face200, cpoints200=code_block_44.cpoints200, vectors200=code_block_44.vectors200) { face200; cpoints200; vectors200; }
проверка_4 = CodeBlock(ch=размещение_путевых_ящиков.ch, face200=code_block_45.face200) { ch[0]!=null?face200:null; }
размещение_основания_под_рельсы = CodeBlock(face200=проверка_4, cpoints200=code_block_45.cpoints200, vectors200=code_block_45.vectors200)
# ---------- размещение_основания_под_рельсы.designscript (3 lines) ----------
famtype = FamilyType.ByName("Base_ByFace");
baseRails = FamilyInstance.ByFace(famtype,face200,cpoints200,vectors200);
ch = List.Flatten(baseRails);
# ----------------------------------------
проверка_5 = CodeBlock(ch=размещение_основания_под_рельсы.ch, bases=размещение_основания_под_рельсы.ch) { checkBlock = ch[0]; bases; }
проверка_6 = CodeBlock(checkBlock=проверка_5.checkBlock, bases=проверка_5.bases) { checkBlock!=null?bases:null; facesBase200 = Revit.Elements.Element.Faces(bases); }
code_block_46 = CodeBlock { 12; }
getItemAtIndex_3 = List.GetItemAtIndex(list=проверка_6.facesBase200@L2, index=code_block_46)
perimeterCurves = Surface.PerimeterCurves(surface=getItemAtIndex_3)
code_block_47 = CodeBlock { 1; }
getItemAtIndex_4 = List.GetItemAtIndex(list=perimeterCurves@L2, index=code_block_47)
code_block_48 = CodeBlock(curves=getItemAtIndex_4, basesFace=getItemAtIndex_3)
# ---------- code_block_48.designscript (5 lines) ----------
curvesStP = Autodesk.Curve.StartPoint(curves);
curvesEnP = Autodesk.Curve.EndPoint(curves);
lines = Line.ByStartPointEndPoint(curvesStP,curvesEnP);
basesFace_sl = List.Sublists(basesFace,0,1);
lines_sl = List.Sublists(lines,0,1);
# ----------------------------------------
размещение_рельс = CodeBlock(basesFace_sl=code_block_48.basesFace_sl, lines_sl=code_block_48.lines_sl)
# ---------- размещение_рельс.designscript (5 lines) ----------
famtype = FamilyType.ByName("Rails_ByLine");

rails = FamilyInstance.ByFace(famtype,basesFace_sl,lines_sl);
ch = List.Flatten(rails);
ch[0]!=null?basesFace_sl:null;
# ----------------------------------------
code_block_49 = CodeBlock(vectors200=code_block_38.vectors200) { vectors200; }
code_block_50 = CodeBlock(vectors200=code_block_49) { vectors200; }
code_block_51 = CodeBlock(basesFace_sl=размещение_рельс.out3, lines_sl=code_block_48.lines_sl, vectors200=code_block_50)
# ---------- code_block_51.designscript (7 lines) ----------
basesFace_sl;
lines_sl;

basesFace_Crons = List.TakeEveryNthItem(basesFace_sl,14,15);
lines_Crons = List.TakeEveryNthItem(lines_sl,14,15);
vectors200_Crons = List.TakeEveryNthItem(vectors200,14,15);
crPoints = Autodesk.Curve.PointAtParameter(lines_Crons,0.5);
# ----------------------------------------
размещение_кронштейна_для = CodeBlock(basesFace_Crons=code_block_51.basesFace_Crons, crPoints=code_block_51.crPoints, vectors200_Crons=code_block_51.vectors200_Crons, basesFace_sl=code_block_51.basesFace_sl, lines_sl=code_block_51.lines_sl)  # "Размещение кронштейна для контактного рельса"
# ---------- размещение_кронштейна_для.designscript (6 lines) ----------
famtype = FamilyType.ByName("CronsteinContactRail");
rails = FamilyInstance.ByFace(famtype,basesFace_Crons,crPoints,vectors200_Crons);
ch = List.Flatten(rails);

ch[0]!=null?basesFace_sl:null;
lines_sl;
# ----------------------------------------
code_block_52 = CodeBlock(vectors200=code_block_50) { vectors200; }
code_block_53 = CodeBlock(basesFace_sl=размещение_кронштейна_для.out3, lines_sl=размещение_кронштейна_для.lines_sl, vectors200=code_block_52)
# ---------- code_block_53.designscript (7 lines) ----------
basesFace_sl;
lines_sl;

basesFace_lvt = List.TakeEveryNthItem(basesFace_sl,7,8);
lines_lvt = List.TakeEveryNthItem(lines_sl,7,8);
vectors200_lvt = List.TakeEveryNthItem(vectors200,7,8);
lvtPoints = Autodesk.Curve.PointAtParameter(lines_lvt,0.5);
# ----------------------------------------
размещение_кронштейна_для_2 = CodeBlock(basesFace_lvt=code_block_53.basesFace_lvt, lvtPoints=code_block_53.lvtPoints, vectors200_lvt=code_block_53.vectors200_lvt, basesFace_sl=code_block_53.basesFace_sl, lines_sl=code_block_53.lines_sl)  # "Размещение кронштейна для контактного рельса"
# ---------- размещение_кронштейна_для_2.designscript (6 lines) ----------
famtype = FamilyType.ByName("LVT-M");
rails = FamilyInstance.ByFace(famtype,basesFace_lvt,lvtPoints,vectors200_lvt);
ch = List.Flatten(rails);

ch[0]!=null?basesFace_sl:null;
lines_sl;
# ----------------------------------------

# group: Размещение рельс, кронштейна под контактный рельс, полушпал
code_block_54 = CodeBlock { 1; }
code_block_55 = CodeBlock { 1; }
