# Dynamo graph MoscowSubwayV8_TEST_Base&Rail&Crons&LVT.dyn (Dynamo 2.0.4.12684)

file_path = Filename("Исходные данные\Трассы\XLS\Новаторы_Опарина_MOD\Новаторы_Опарина_LeftWay_MOD.xls")
file_from_path = FileObject(path=file_path)
string = StringInput("Summary")
importExcel = Data.ImportExcel(file=file_from_path, sheetName=string)
code_block = CodeBlock { 0; 1; 2; }
getItemAtIndex = List.GetItemAtIndex(list=importExcel@L2, index=code_block.out0)
toNumber = String.ToNumber(str=getItemAtIndex)
getItemAtIndex_2 = List.GetItemAtIndex(list=importExcel@L2, index=code_block.out1)
toNumber_2 = String.ToNumber(str=getItemAtIndex_2)
getItemAtIndex_3 = List.GetItemAtIndex(list=importExcel@L2, index=code_block.out2)
toNumber_3 = String.ToNumber(str=getItemAtIndex_3)
code_block_2 = CodeBlock(z=toNumber_3) { z+3000; }
byCoordinates = Point.ByCoordinates(x=toNumber, y=toNumber_2, z=code_block_2)
byPoints = PolyCurve.ByPoints(points=byCoordinates)

# group: ИМПОРТ ИЗ АВТОКАЛА
select_model_element = DSModelElementSelection()  # 1 picked in the model; frozen
curvesFromCADLayers = CAD.CurvesFromCADLayers(importInstance=select_model_element)
flatten = List.Flatten(list=curvesFromCADLayers.Curve)
code_block_3 = CodeBlock { 0; }
count = List.Count(list=byCoordinates)
code_block_4 = CodeBlock { 10; }
byJoinedCurves = PolyCurve.ByJoinedCurves()  # frozen; unwired: curves
startPoint = Curve.StartPoint(curve=byPoints)
code_block_5 = CodeBlock { 400; }
pointsAtChordLengthFromPoint = Curve.PointsAtChordLengthFromPoint(curve=byPoints, point=startPoint, chordLength=code_block_5)
endPoint = Curve.EndPoint(curve=byPoints)
list_create = List.Create(item0=startPoint, item1=pointsAtChordLengthFromPoint, item2=endPoint)
flatten_2 = List.Flatten(list=list_create)
X = Point.X(point=flatten_2)
Y = Point.Y(point=flatten_2)
Z = Point.Z(point=flatten_2)
code_block_6 = CodeBlock { 3000; }
add = Z + code_block_6
byCoordinates_2 = Point.ByCoordinates(x=X, y=Y, z=add)

code_block_7 = CodeBlock(n=count) { n-1; }

# group (continued): ИМПОРТ ИЗ АВТОКАЛА
code_block_8 = CodeBlock(crv=byCoordinates, start=code_block_3, end=code_block_7) { crv[start..end]; }  # frozen

# group: Создание колец
code_block_9 = CodeBlock(points400=byCoordinates_2) { points400; }
code_block_10 = CodeBlock { 0..1; 1; -1; }
sublists = List.Sublists(list=code_block_9, ranges=code_block_10.out0, offset=code_block_10.out1)
dropItems = List.DropItems(list=sublists, amount=code_block_10.out2)
code_block_11 = CodeBlock { 0; 1; }
getItemAtIndex_4 = List.GetItemAtIndex(list=dropItems@L2, index=code_block_11.out0)
getItemAtIndex_5 = List.GetItemAtIndex(list=dropItems@L2, index=code_block_11.out1)
byStartPointEndPoint = Line.ByStartPointEndPoint(startPoint=getItemAtIndex_4, endPoint=getItemAtIndex_5)
code_block_12 = CodeBlock { 2700; }
byTwoPoints = Vector.ByTwoPoints(start=getItemAtIndex_4, end=getItemAtIndex_5)
byCenterPointRadiusNormal = Circle.ByCenterPointRadiusNormal(centerPoint=code_block_9, radius=code_block_12, normal=byTwoPoints)

string_2 = StringInput("Base_ByFace")
byName = FamilyType.ByName(name=string_2)
byPatch = Surface.ByPatch(closedCurve=byCenterPointRadiusNormal)
byGeometry = ImportInstance.ByGeometry(geometry=byPatch)
faces = Element.Faces(element=byGeometry)
centerPoint = Circle.CenterPoint(circle=byCenterPointRadiusNormal)
code_block_13 = CodeBlock { 0; }
pointAtParameter = Curve.PointAtParameter(curve=byCenterPointRadiusNormal, param=code_block_13)
byTwoPoints_2 = Vector.ByTwoPoints(start=centerPoint, end=pointAtParameter)
code_block_14 = CodeBlock(faces400=faces, cpoints400=centerPoint, vectors400=byTwoPoints_2) { faces400; cpoints400; vectors400; }
byFace = FamilyInstance.ByFace(familyType=byName, face=code_block_14.faces400, location=code_block_14.cpoints400, referenceDirection=code_block_14.vectors400)
flatten_3 = List.Flatten(list=byFace)
getHost = FamilyInstance.GetHost(familyInstance=flatten_3)
code_block_15 = CodeBlock(a=byCoordinates) { a[0]; }
