# Dynamo graph test2021.dyn (Dynamo 2.10.1.3976)
# packages: PozhiloyPack 0.0.1, bimorphNodes 3.0.3

# group: AutoCAD's line import, points creation
code_block = CodeBlock { 1; }
boolean = BoolSelector(true)
select_model_element = DSModelElementSelection()  # 1 picked in the model
code_block_2 = CodeBlock(b=boolean, a=select_model_element) { b==true?a:null; }
curvesFromCADLayers = CAD.CurvesFromCADLayers(importInstance=code_block_2)
flatten = List.Flatten(list=curvesFromCADLayers.Curve)
code_block_3 = CodeBlock { 0; }
code_block_4 = CodeBlock(n=flatten) { DSCore.List.Count(n)-1; }
code_block_5 = CodeBlock(crv=flatten, start=code_block_3, end=code_block_4) { crv[start..end]; }
code_block_6 = CodeBlock(sorted_crv=code_block_5)
# ---------- code_block_6.designscript (9 lines) ----------
pCrv = PolyCurve.ByJoinedCurves(sorted_crv);
stP = Autodesk.Curve.StartPoint(pCrv);
enP = Autodesk.Curve.EndPoint(pCrv);
points200 = Autodesk.Curve.PointsAtChordLengthFromPoint(pCrv,stP,200);
points200_1 = DSCore.List.Flatten([stP,points200],1);
pX = points200_1.X;
pY = points200_1.Y;
pZ = points200_1.Z+1674.917;
p200_crr = Point.ByCoordinates(pX,pY,pZ);
# ----------------------------------------

# group: Creating faces, vectors, CS
code_block_7 = CodeBlock(points=code_block_6.p200_crr)
# ---------- code_block_7.designscript (13 lines) ----------
s = DSCore.List.DropItems(DSCore.List.Sublists(points,0..1,1),-1);
ch = s[0][0]!=null?FamilyType.ByName("Circle100"):null;
createFamily = AdaptiveComponent.ByPoints(s,ch);
pstart = DSCore.List.GetItemAtIndex(s@L2<1>,0);
pend = DSCore.List.GetItemAtIndex(s@L2<1>,1);
l = Line.ByStartPointEndPoint(pstart,pend);
v = Vector.ByTwoPoints(pstart,pend);
c = Circle.ByCenterPointRadiusNormal(points,100,v);
cP = Circle.CenterPoint(c);
p_csX = Autodesk.Curve.PointAtParameter(c,0.5);
v_csX = Vector.ByTwoPoints(points,p_csX);
p_csY = Autodesk.Curve.PointAtParameter(c,0.25);
v_csY = Vector.ByTwoPoints(points,p_csY);
# ----------------------------------------
byOriginVectors = CoordinateSystem.ByOriginVectors(origin=code_block_7.cP, xAxis=code_block_7.v_csX, yAxis=code_block_7.v_csY, zAxis=code_block_7.v)
faces = Element.Faces(element=code_block_7.createFamily)
code_block_8 = CodeBlock { 2; }
getItemAtIndex = List.GetItemAtIndex(list=faces@L2, index=code_block_8)
byCartesianCoordinates = Point.ByCartesianCoordinates(cs=byOriginVectors)

code_block_9 = CodeBlock(cs200=byOriginVectors) { cs200; }

# group: Wire and pipe placing (by 7 points)
code_block_10 = CodeBlock { 0; 7; }
sublists = List.Sublists(list=code_block_9, ranges=code_block_10.out0, offset=code_block_10.out1)
flatten_2 = List.Flatten(list=sublists)
code_block_11 = CodeBlock { 2325.7574; }
code_block_12 = CodeBlock { 1078.0585; }
string = StringInput("ПвБПнг(А)-HF 1х500")
code_block_13 = CodeBlock { 0; }
adaptivewire_7_points = Custom[AdaptiveWire 7 Points](cs=flatten_2, x_coordinate=code_block_11, y_coordinate=code_block_12, FamilyTypeName=string, z_coordinate=code_block_13)  # package PozhiloyPack
CHECK = CodeBlock(Fam=adaptivewire_7_points, cs=flatten_2) { Fam.Name[0]!=null?cs:null; }
code_block_14 = CodeBlock { 2454.4538; }
code_block_15 = CodeBlock { 742.6185; }
string_2 = StringInput("ПвБПнг(А)-HF 1х500")
code_block_16 = CodeBlock { 0; }
adaptivewire_7_points_2 = Custom[AdaptiveWire 7 Points](cs=CHECK, x_coordinate=code_block_14, y_coordinate=code_block_15, FamilyTypeName=string_2, z_coordinate=code_block_16)
CHECK_2 = CodeBlock(Fam=adaptivewire_7_points_2, cs=CHECK) { Fam.Name[0]!=null?cs:null; }
code_block_17 = CodeBlock { -2437.0256; }
code_block_18 = CodeBlock { 998.8495; }
string_3 = StringInput("ПвБПнг(А)-HF 1х500")
code_block_19 = CodeBlock { 0; }
adaptivewire_7_points_3 = Custom[AdaptiveWire 7 Points](cs=CHECK_2, x_coordinate=code_block_17, y_coordinate=code_block_18, FamilyTypeName=string_3, z_coordinate=code_block_19)
CHECK_3 = CodeBlock(Fam=adaptivewire_7_points_3, cs=CHECK_2) { Fam.Name[0]!=null?cs:null; }
code_block_20 = CodeBlock { 2560.999; }
code_block_21 = CodeBlock { 152.8327; }
string_4 = StringInput("ПвБПнг(А)-HF 1х500")
code_block_22 = CodeBlock { 0; }
adaptivewire_7_points_4 = Custom[AdaptiveWire 7 Points](cs=CHECK_3, x_coordinate=code_block_20, y_coordinate=code_block_21, FamilyTypeName=string_4, z_coordinate=code_block_22)
CHECK_4 = CodeBlock(Fam=adaptivewire_7_points_4, cs=CHECK_3) { Fam.Name[0]!=null?cs:null; }
code_block_23 = CodeBlock { 2564.7852; }
code_block_24 = CodeBlock { -86.9163; }
string_5 = StringInput("ПвБПнг(А)-HF 1х500")
code_block_25 = CodeBlock { 0; }
adaptivewire_7_points_5 = Custom[AdaptiveWire 7 Points](cs=CHECK_4, x_coordinate=code_block_23, y_coordinate=code_block_24, FamilyTypeName=string_5, z_coordinate=code_block_25)
code_block_26 = CodeBlock(cs=CHECK_4, f=adaptivewire_7_points_5) { cs; f; }
CHECK_5 = CodeBlock(Fam=code_block_26.f, cs=code_block_26.cs) { Fam.Name[0]!=null?cs:null; }
code_block_27 = CodeBlock { -2454.299; }
code_block_28 = CodeBlock { 745.0329; }
string_6 = StringInput("ПвБПнг(А)-HF 1х500")
code_block_29 = CodeBlock { 0; }
adaptivewire_7_points_6 = Custom[AdaptiveWire 7 Points](cs=CHECK_5, x_coordinate=code_block_27, y_coordinate=code_block_28, FamilyTypeName=string_6, z_coordinate=code_block_29)
CHECK_6 = CodeBlock(Fam=adaptivewire_7_points_6, cs=CHECK_5) { Fam.Name[0]!=null?cs:null; }
code_block_30 = CodeBlock { -2603.1199; }
code_block_31 = CodeBlock { 403.9316; }
string_7 = StringInput("ПвБПнг(А)-HF 1х500")
code_block_32 = CodeBlock { 0; }
adaptivewire_7_points_7 = Custom[AdaptiveWire 7 Points](cs=CHECK_6, x_coordinate=code_block_30, y_coordinate=code_block_31, FamilyTypeName=string_7, z_coordinate=code_block_32)
CHECK_7 = CodeBlock(Fam=adaptivewire_7_points_7, cs=CHECK_6) { Fam.Name[0]!=null?cs:null; }
code_block_33 = CodeBlock { -2506.3821; }
code_block_34 = CodeBlock { -564.1864; }
string_8 = StringInput("ПвБПнг(А)-HF 1х500")
code_block_35 = CodeBlock { 0; }
adaptivewire_7_points_8 = Custom[AdaptiveWire 7 Points](cs=CHECK_7, x_coordinate=code_block_33, y_coordinate=code_block_34, FamilyTypeName=string_8, z_coordinate=code_block_35)
CHECK_8 = CodeBlock(Fam=adaptivewire_7_points_8, cs=CHECK_7) { Fam.Name[0]!=null?cs:null; }
code_block_36 = CodeBlock { 150; }
code_block_37 = CodeBlock { 2502.6482; }
code_block_38 = CodeBlock { 0; }
code_block_39 = CodeBlock { 5; 10; }
code_block_40 = CodeBlock { "Провод"; }
upper_wire_placing = CodeBlock(cs=CHECK_8, x_c=code_block_36, y_c=code_block_37, z_c=code_block_38, min=code_block_39.out0, max=code_block_39.out1, famName=code_block_40)
# ---------- upper_wire_placing.designscript (23 lines) ----------
pnt = Point.ByCartesianCoordinates(cs,x_c,y_c,z_c);
sortedPnt = DSCore.List.DropItems((DSCore.List.Sublists(pnt,0..2,2)),-1);
pnt0 = DSCore.List.GetItemAtIndex(sortedPnt@L2<1>,0);
pnt3_n = DSCore.List.GetItemAtIndex(sortedPnt@L2<1>,1);
pnt6 = DSCore.List.GetItemAtIndex(sortedPnt@L2<1>,2);
l0_3 = Line.ByStartPointEndPoint(pnt0,pnt3_n);
l3_6 = Line.ByStartPointEndPoint(pnt3_n,pnt6);
c_l0_3 = Autodesk.Curve.PointAtParameter(l0_3,0.5);
c_l3_6 = Autodesk.Curve.PointAtParameter(l3_6,0.5);
//randomizing of sagging
a = Math.RandomList(DSCore.List.Count(c_l0_3));
ar = Math.RemapRange(a,min,max);
pnt2 = Point.ByCoordinates(c_l0_3.X,c_l0_3.Y,(c_l0_3.Z-(ar/2)));
pnt3 = Point.ByCoordinates(pnt3_n.X,pnt3_n.Y,(pnt3_n.Z-ar));
pnt4 = Point.ByCoordinates(c_l3_6.X,c_l3_6.Y,(c_l3_6.Z-(ar/2)));
//
pnt1 = Autodesk.Curve.PointAtParameter(l0_3,0.01);
pnt5 = Autodesk.Curve.PointAtParameter(l3_6,0.99);
lstPoints = [pnt0,pnt1,pnt2,pnt3,pnt4,pnt5,pnt6];
lstPoints_crr = DSCore.List.Transpose(lstPoints);
ch = DSCore.List.GetItemAtIndex(lstPoints_crr@L2<1>,0);
ch1 = ch[0]!=null?FamilyType.ByName(famName):null;
createFamily = AdaptiveComponent.ByPoints(lstPoints_crr,ch1);
# ----------------------------------------

code_block_41 = CodeBlock(endofcreatingBlock=upper_wire_placing.createFamily) { endofcreatingBlock; }

# group: MAINDATA
mainDataBlock = CodeBlock(face200=getItemAtIndex, pnt200=byCartesianCoordinates, vec200=code_block_7.v_csX) { face200; pnt200; vec200; }

# group: Base, Tubs, Boxes, Lights creating
CHECK_9 = CodeBlock(Fam=code_block_41, face200=mainDataBlock.face200, pnt200=mainDataBlock.pnt200, vec200=mainDataBlock.vec200) { ch1 = Fam.Name[0]!=null?face200:null; ch2 = ch1[0]!=null?pnt200:null; ch3 = ch2[0]!=null?vec200:null; }
base_placing = CodeBlock(facesBase=CHECK_9.ch1, vecBase=CHECK_9.ch3, pntBase=CHECK_9.ch2)
# ---------- base_placing.designscript (5 lines) ----------
facesBase;
vecBase;
pntBase;
ch1 = facesBase[0]!=null&&vecBase[0]!=null&&pntBase[0]!=null?FamilyType.ByName("Base200"):null;
createFamily = FamilyInstance.ByFace(ch1,facesBase,pntBase,Vector.Reverse(vecBase));
# ----------------------------------------
slicing_placing_tubings = CodeBlock(face200=base_placing.facesBase, vec200=base_placing.vecBase, pnt200=base_placing.pntBase, fam=base_placing.createFamily)
# ---------- slicing_placing_tubings.designscript (9 lines) ----------
facesTubing = DSCore.List.TakeEveryNthItem(face200,7,8);
vecTubing = DSCore.List.TakeEveryNthItem(vec200,7,8);
pntTubing = DSCore.List.TakeEveryNthItem(pnt200,7,8);
ch1 = fam.Name[0]!=null&&facesTubing[0]!=null&&vecTubing[0]!=null&&pntTubing[0]!=null?FamilyType.ByName("cTubing1400"):null;
createFamily = FamilyInstance.ByFace(ch1,facesTubing,pntTubing,vecTubing);
rotlst = DSCore.List.OfRepeatedItem(30,DSCore.List.Count(createFamily));
rotlst_s = DSCore.List.Sublists(rotlst,0..1,2);
rot = DSCore.List.Flatten((DSCore.List.ReplaceItemAtIndex(rotlst_s@L2<1>,1,-30)),1);
rotFamily = FamilyInstance.SetRotation(createFamily,rot);
# ----------------------------------------
cablecrons_placing = CodeBlock(facesCrons=slicing_placing_tubings.facesTubing, vecCrons=slicing_placing_tubings.vecTubing, pntCrons=slicing_placing_tubings.pntTubing, fam=slicing_placing_tubings.rotFamily)
# ---------- cablecrons_placing.designscript (5 lines) ----------
facesCrons;
vecCrons;
pntCrons;
ch1 = fam.Name[0]!=null&&facesCrons[0]!=null&&vecCrons[0]!=null&&pntCrons[0]!=null?FamilyType.ByName("CC1400"):null;
createFamily = FamilyInstance.ByFace(ch1,facesCrons,pntCrons,Vector.Reverse(vecCrons));
# ----------------------------------------
pipecrons_placing = CodeBlock(facesCrons=cablecrons_placing.facesCrons, vecCrons=cablecrons_placing.vecCrons, pntCrons=cablecrons_placing.pntCrons, fam=cablecrons_placing.createFamily)
# ---------- pipecrons_placing.designscript (5 lines) ----------
facesCrons;
vecCrons;
pntCrons;
ch1 = fam.Name[0]!=null&&facesCrons[0]!=null&&vecCrons[0]!=null&&pntCrons[0]!=null?FamilyType.ByName("PC1400"):null;
createFamily = FamilyInstance.ByFace(ch1,facesCrons,pntCrons,Vector.Reverse(vecCrons));
# ----------------------------------------
upwirecrons_placing = CodeBlock(face200=base_placing.facesBase, vec200=base_placing.vecBase, pnt200=base_placing.pntBase, fam=pipecrons_placing.createFamily)
# ---------- upwirecrons_placing.designscript (5 lines) ----------
facesUWC = DSCore.List.TakeEveryNthItem(face200,14,15);
vecUWC = DSCore.List.TakeEveryNthItem(vec200,14,15);
pntUWC = DSCore.List.TakeEveryNthItem(pnt200,14,15);
ch1 = fam.Name[0]!=null&&facesUWC[0]!=null&&vecUWC[0]!=null&&pntUWC[0]!=null?FamilyType.ByName("UWC1400"):null;
createFamily = FamilyInstance.ByFace(ch1,facesUWC,pntUWC,Vector.Reverse(vecUWC));
# ----------------------------------------
light_placing = CodeBlock(face2800=upwirecrons_placing.facesUWC, vec2800=upwirecrons_placing.vecUWC, pnt2800=upwirecrons_placing.pntUWC, fam=upwirecrons_placing.createFamily)
# ---------- light_placing.designscript (10 lines) ----------
face2800;
vec2800;
pnt2800;
pnt2800_s = DSCore.List.DropItems((DSCore.List.Sublists(pnt2800,0..1,1)),-1);
pnt2800_s_sp = DSCore.List.GetItemAtIndex(pnt2800_s@L2<1>,0);
pnt2800_s_ep = DSCore.List.GetItemAtIndex(pnt2800_s@L2<1>,1);
line2800 = Line.ByStartPointEndPoint(pnt2800_s_sp,pnt2800_s_ep);
new_points = Autodesk.Curve.PointAtParameter(line2800,0.5);
ch1 = fam.Name[0]!=null&&face2800[0]!=null&&vec2800[0]!=null&&new_points[0]!=null?FamilyType.ByName("MPP_ЭОМ_ЭО_ОП_POLET"):null;
createFamily = FamilyInstance.ByFace(ch1,face2800,new_points,Vector.Reverse(vec2800));
# ----------------------------------------
lightbox_placing = CodeBlock(face2800=light_placing.face2800, pnt2800=light_placing.pnt2800, vec2800=light_placing.vec2800, fam=light_placing.createFamily)
# ---------- lightbox_placing.designscript (5 lines) ----------
facesLBox = DSCore.List.TakeEveryNthItem(face2800,9,21);
pntLBox = DSCore.List.TakeEveryNthItem(pnt2800,9,21);
vecLBox = DSCore.List.TakeEveryNthItem(vec2800,9,21);
ch1 = fam.Name[0]!=null&&facesLBox[0]!=null&&vecLBox[0]!=null&&pntLBox[0]!=null?FamilyType.ByName("Осветительный ящик"):null;
createFamily = FamilyInstance.ByFace(ch1,facesLBox,pntLBox,Vector.Reverse(vecLBox));
# ----------------------------------------
lightbox_placing_2 = CodeBlock(face2800=light_placing.face2800, pnt2800=light_placing.pnt2800, vec2800=light_placing.vec2800, fam=lightbox_placing.createFamily)
# ---------- lightbox_placing_2.designscript (5 lines) ----------
facesLBox = DSCore.List.TakeEveryNthItem(face2800,14,21);
pntLBox = DSCore.List.TakeEveryNthItem(pnt2800,14,21);
vecLBox = DSCore.List.TakeEveryNthItem(vec2800,14,21);
ch1 = fam.Name[0]!=null&&facesLBox[0]!=null&&vecLBox[0]!=null&&pntLBox[0]!=null?FamilyType.ByName("Электрический ящик"):null;
createFamily = FamilyInstance.ByFace(ch1,facesLBox,pntLBox,Vector.Reverse(vecLBox));
# ----------------------------------------

code_block_42 = CodeBlock(endofcreatingBlock=lightbox_placing_2.createFamily) { endofcreatingBlock; }

# group: Rails, crons, LVT
CHECK_10 = CodeBlock(Fam=code_block_42, face200=mainDataBlock.face200, pnt200=mainDataBlock.pnt200, vec200=mainDataBlock.vec200, baseFam=base_placing.createFamily)
# ---------- CHECK_10.designscript (4 lines) ----------
ch1 = Fam.Name[0]!=null?face200:null;
ch2 = ch1[0]!=null?pnt200:null;
ch3 = ch2[0]!=null?vec200:null;
ch4 = ch3[0]!=null?baseFam:null;
# ----------------------------------------
faces_2 = Element.Faces(element=CHECK_10.ch4)
# note: сделать поиск линии, максимально близкой к центральной точке
railPlacing = CodeBlock(allFaces=faces_2)
# ---------- railPlacing.designscript (10 lines) ----------
zeroFace = List.GetItemAtIndex(allFaces@L2<1>,12);
zFmod = List.Sublists(zeroFace,0,1);
pCurves = Surface.PerimeterCurves(zeroFace);
linesbP = List.GetItemAtIndex(pCurves@L2<1>,1);
crv_SP = Autodesk.DesignScript.Geometry.Curve.StartPoint(linesbP);
crv_EP = Autodesk.DesignScript.Geometry.Curve.EndPoint(linesbP);
linesNew = Line.ByStartPointEndPoint(crv_SP,crv_EP);
pCmod = List.Sublists(linesNew,0,1);
fName1 = FamilyType.ByName("LeftR");
createFamily = FamilyInstance.ByFace(fName1,zFmod@L2<1>,pCmod@L2<1>);
# ----------------------------------------
LVTPlacing = CodeBlock(facesBase=railPlacing.zeroFace, vec=CHECK_10.ch3, railLines=railPlacing.linesNew, fam=railPlacing.createFamily)
# ---------- LVTPlacing.designscript (9 lines) ----------
facesBase;
vec;
railLines;
ch1 = fam.Name[0]!=null&&facesBase[0]!=null&&vec[0]!=null&&railLines[0]!=null?FamilyType.ByName("Полушпала LVT-M"):null;
loca = Autodesk.DesignScript.Geometry.Curve.PointAtParameter(railLines,0.5);
facesBaseMod = DSCore.List.Flatten(DSCore.List.Sublists(facesBase,0,5));
vecMod = DSCore.List.Flatten(DSCore.List.Sublists(vec,0,5));
locaMod = DSCore.List.Flatten(DSCore.List.Sublists(loca,0,5));
createFamily = FamilyInstance.ByFace(ch1<2>,facesBaseMod<1>,locaMod<1>,Vector.Reverse(vecMod)<1>);
# ----------------------------------------
cronsContactRailPlacing = CodeBlock(facesBase=LVTPlacing.facesBaseMod, vec=LVTPlacing.vecMod, loca=LVTPlacing.locaMod, fam=LVTPlacing.createFamily)
# ---------- cronsContactRailPlacing.designscript (8 lines) ----------
facesBase;
vec;
loca;
ch1 = fam.Name[0]!=null&&facesBase[0]!=null&&vec[0]!=null&&loca[0]!=null?FamilyType.ByName("CCRail"):null;
facesBaseMod = DSCore.List.Flatten(DSCore.List.Sublists(facesBase,0,2));
vecMod = DSCore.List.Flatten(DSCore.List.Sublists(vec,0,2));
locaMod = DSCore.List.Flatten(DSCore.List.Sublists(loca,0,2));
createFamily = FamilyInstance.ByFace(ch1<2>,facesBaseMod<1>,locaMod<1>,Vector.Reverse(vecMod)<1>);
# ----------------------------------------

last_actions = CodeBlock(Fam=cronsContactRailPlacing.createFamily)
# ---------- last_actions.designscript (3 lines) ----------
ch1 = Fam.Name[0][0]!=null?FamilyType.ByName("Circle100"):null;
//takeChild = Elements.Element.GetChildElements(ch1);
//finalAction = Elements.Element.Delete(ch1);
# ----------------------------------------
end = Revit.Transaction.Transaction.End(input=last_actions)
byJoinedCurves = PolyCurve.ByJoinedCurves(curves=curvesFromCADLayers.Curve)
reverse = Curve.Reverse(curve=byJoinedCurves)
curves = PolyCurve.Curves(polyCurve=reverse)
