# Dynamo custom node SublistsByTwoValues.dyf (Dynamo 2.0.4.12684)
# category: GachiMan
# Creates sublist including two points with index  order [[0,1],[1,2],[2,3],....]

ListOfValues = Input(ListOfValues: var[]..[])
code_block = CodeBlock { 0..1; }
code_block_2 = CodeBlock { 1; }
sublists = List.Sublists(list=ListOfValues, ranges=code_block, offset=code_block_2)
code_block_3 = CodeBlock { -1; }
dropItems = List.DropItems(list=sublists, amount=code_block_3)
code_block_4 = CodeBlock { 0; }
getItemAtIndex = List.GetItemAtIndex(list=dropItems@L2, index=code_block_4)
value1 = Output(getItemAtIndex)
code_block_5 = CodeBlock { 1; }
getItemAtIndex_2 = List.GetItemAtIndex(list=dropItems@L2, index=code_block_5)
value2 = Output(getItemAtIndex_2)
FullSublist = Output(dropItems)
