# Dynamo graph WIP_EvacuationWay.dyn (Dynamo 2.12.0.5650)

sketchPlane = View.SketchPlane()  # unwired: view
current = Document.Current()
activeView = Document.ActiveView(document=current)
categories = Categories("OST_StairsLandings")
all_elements_of_category = ElementsOfCategory(Category=categories)
all_elements_in_active_view = ElementsInView()
setIntersection = List.SetIntersection(list1=all_elements_of_category, list2=all_elements_in_active_view)
geometry = Element.Geometry(element=setIntersection)
faces = Topology.Faces(topology=geometry)
surfaceGeometry = Face.SurfaceGeometry(face=faces)
code_block = CodeBlock { 0.5; }
pointAtParameter = Surface.PointAtParameter(surface=surfaceGeometry@L2, u=code_block, v=code_block)
code_block_2 = CodeBlock(a=pointAtParameter) { a.Z; }
sortByKey = List.SortByKey(list=surfaceGeometry@L2, keys=code_block_2@L2)
lastItem = List.LastItem(list=sortByKey.sortedList@L2)
perimeterCurves = Surface.PerimeterCurves(surface=lastItem)
byCurve = DetailCurve.ByCurve(view=activeView, curve=perimeterCurves)
