# Dynamo graph Wall_MaterialTransfer.dyn (Dynamo 2.10.1.3976)
# packages: Genius Loci 2021.7.30

string = StringInput("TESTWALL")
byName = WallType.ByName(name=string)
string_2 = StringInput("Материалы")
byName_2 = Category.ByName(name=string_2)
all_elements_of_category = ElementsOfCategory(Category=byName_2)
code_block = CodeBlock(a=all_elements_of_category) { a.Name; }
code_block_2 = CodeBlock(a=code_block) { "МАТЕРИАЛ_" + a; }
code_block_3 = CodeBlock { 10; }
create_compound_system = Custom[Create Compound System FamilyType](ElementOrFamilyType=byName, NewName=code_block_2, material=all_elements_of_category, Thickness=code_block_3, lacing=Longest)  # package Genius Loci; Creates a new compound wall, floor, roof or ceiling Type and assigns material, width and function.
count = List.Count(list=create_compound_system)
code_block_4 = CodeBlock(a=count) { 0..#a..20; }
code_block_5 = CodeBlock { 0; 25; }
byCoordinates = Point.ByCoordinates(x=code_block_4, y=code_block_5.out0, lacing=Longest)
byCoordinates_2 = Point.ByCoordinates(x=code_block_4, y=code_block_5.out1, lacing=Longest)
byStartPointEndPoint = Line.ByStartPointEndPoint(startPoint=byCoordinates, endPoint=byCoordinates_2)
code_block_6 = CodeBlock { 1000; }
levels = Levels("Этаж 01")
byCurveAndHeight = Wall.ByCurveAndHeight(curve=byStartPointEndPoint, height=code_block_6, level=levels, wallType=create_compound_system)
string_3 = StringInput("ADSK_Позиция отделки")
code_block_7 = CodeBlock(n=all_elements_of_category) { 1..#List.Count(n)..1; }
string_from_object = FromObject(object=code_block_7)
setParameterByName = Element.SetParameterByName(element=all_elements_of_category, parameterName=string_3, value=string_from_object)
