# Dynamo graph WarningsExporttoExcel.dyn (Dynamo 2.10.1.3976)

укажите_путь_расположения_файла = Filename(".\WarningsЭКМ.xlsx")  # "Укажите путь расположения файла Excel"; graph input
название_листа = StringInput("Лист1")  # graph input
code_block = CodeBlock { 0; }
code_block_2 = CodeBlock { "Название проблемы"; }
current = Document.Current()
getWarnings = Warning.GetWarnings(document=current)
description = Warning.Description(warning=getWarnings)
code_block_3 = CodeBlock { 1; }
chop = List.Chop(list=description, lengths=code_block_3)
getFailingElements = Warning.GetFailingElements(warning=getWarnings)
count = List.Count(list=getFailingElements@L2)
cycle = List.Cycle(list=chop, amount=count, lacing=Longest)
flatten = List.Flatten(list=cycle)
addItemToFront = List.AddItemToFront(item=code_block_2, list=flatten)
code_block_4 = CodeBlock { "ID элемента"; }
code_block_5 = CodeBlock(a=getFailingElements) { a.Id; }
flatten_2 = List.Flatten(list=code_block_5)
addItemToFront_2 = List.AddItemToFront(item=code_block_4, list=flatten_2)
code_block_6 = CodeBlock(a=addItemToFront, b=addItemToFront_2) { [a,b]; }
transpose = List.Transpose(lists=code_block_6)
boolean = BoolSelector(true)
exportExcel = Data.ExportExcel(filePath=укажите_путь_расположения_файла, sheetName=название_листа, startRow=code_block, startCol=code_block, data=transpose, overWrite=boolean)
flatten_3 = List.Flatten(list=getFailingElements)
string = StringInput("Комментарии")
flatten_4 = List.Flatten(list=code_block_5)
string_from_object = FromObject(object=flatten_4)
setParameterByName = Element.SetParameterByName(element=flatten_3, parameterName=string, value=string_from_object)
