# Dynamo graph WarningsExporttoSchedule.dyn (Dynamo 2.12.0.5650)
# packages: Orchid 203.2.0.7778

current = Document.Current()
getWarnings = Warning.GetWarnings(document=current)
getFailingElements = Warning.GetFailingElements(warning=getWarnings)
flatten = List.Flatten(list=getFailingElements)
string = StringInput("NIIPI_ID элемента")
code_block = CodeBlock(a=flatten) { a.Id; }
string_from_object = FromObject(object=code_block)
назначение_id = Element.SetParameterByName(element=flatten, parameterName=string, value=string_from_object)
string_2 = StringInput("NIIPI_Предупреждение")
code_block_2 = CodeBlock { 1; }
переключение_предупреждения_в_да = Element.SetParameterByName(element=flatten, parameterName=string_2, value=code_block_2)
string_3 = StringInput("NIIPI_Текст предупреждения")
description = Warning.Description(warning=getWarnings)
code_block_3 = CodeBlock { 1; }
chop = List.Chop(list=description, lengths=code_block_3)
count = List.Count(list=getFailingElements@L2)
cycle = List.Cycle(list=chop@L1, amount=count@L1)
flatten_2 = List.Flatten(list=cycle)
заполнение_текста_предупреждения = Element.SetParameterByName(element=flatten, parameterName=string_3, value=flatten_2)
string_4 = StringInput("NIIPI_Автор элемента")
current_2 = Orchid.RevitProject.Common.Document.Current()
info = Orchid.RevitProject.Elements.Element.Info(document=current_2, element=flatten)
code_block_4 = CodeBlock(creator=info.Creator) { creator; }
назначение_id_2 = Element.SetParameterByName(element=flatten, parameterName=string_4, value=code_block_4)
