# Dynamo graph WarningsExporttoSchedule_Auto.dyn (Dynamo 2.10.1.3976)
# packages: Orchid 203.2.0.7778

current = Document.Current()
getWarnings = Warning.GetWarnings(document=current)
getFailingElements = Warning.GetFailingElements(warning=getWarnings)
flatten = List.Flatten(list=getFailingElements)
current_2 = Orchid.RevitProject.Common.Document.Current()
info = Orchid.RevitProject.Elements.Element.Info(document=current_2, element=flatten)
code_block = CodeBlock(creator=info.Creator) { creator; }
code_block_2 = CodeBlock(a=flatten) { a.Id; }
string_from_object = FromObject(object=code_block_2)
description = Warning.Description(warning=getWarnings)
code_block_3 = CodeBlock { 1; }
chop = List.Chop(list=description, lengths=code_block_3)
count = List.Count(list=getFailingElements@L2)
cycle = List.Cycle(list=chop@L1, amount=count@L1)
flatten_2 = List.Flatten(list=cycle)
code_block_4 = CodeBlock { 1; }
count_2 = List.Count(list=flatten)
cycle_2 = List.Cycle(list=code_block_4, amount=count_2)
python_script = Python(IN[0]=flatten, IN[1]=code_block, IN[2]=string_from_object, IN[3]=flatten_2, IN[4]=cycle_2, IN[5]=getWarnings)  # IronPython2
# ---------- python_script.python (90 lines) ----------
import clr
import os

clr.AddReference("ProtoGeometry")
from Autodesk.DesignScript.Geometry import *

clr.AddReference("RevitNodes")
import Revit
clr.ImportExtensions(Revit.Elements)
clr.ImportExtensions(Revit.GeometryConversion)

clr.AddReference("RevitServices")
import RevitServices
from RevitServices.Persistence import DocumentManager
from RevitServices.Transactions import TransactionManager as TM

clr.AddReference("RevitAPI")
import Autodesk
from Autodesk.Revit.DB import *

clr.AddReference('System.Core')
from System.Collections.Generic import *

doc = DocumentManager.Instance.CurrentDBDocument


# Used to Ensure that object is in a list...
def tolist(obj1):
	if hasattr(obj1,"__iter__"): return obj1
	else: return [obj1]
	
elems = IN[0]
auth = UnwrapElement(IN[1])
elems_id = UnwrapElement(IN[2])
warn_text = UnwrapElement(IN[3])
elem_bool = UnwrapElement(IN[4])
war_cnt = UnwrapElement(IN[5])
cnt = []


modelPath = doc.GetWorksharingCentralModelPath()
centralServerPath = ModelPathUtils.ConvertModelPathToUserVisiblePath(modelPath)
filesize = os.path.getsize(centralServerPath)
fs_fin = str(filesize/1000000)

TM.Instance.EnsureInTransaction(doc)
for e in range(len(elems)):
		try:
			elem = Revit.Elements.Element.SetParameterByName(elems[e],"NIIPI_Автор элемента",auth[e])
			cnt.append(elem)
		except Exception, ex:
			cnt.append(ex.message)

for e in range(len(elems)):
		try:
			elem = Revit.Elements.Element.SetParameterByName(elems[e],"NIIPI_ID элемента",elems_id[e])
			cnt.append(elem)
		except Exception, ex:
			cnt.append(ex.message)
			
for e in range(len(elems)):
		try:
			elem = Revit.Elements.Element.SetParameterByName(elems[e],"NIIPI_Текст предупреждения",warn_text[e])
			cnt.append(elem)
		except Exception, ex:
			cnt.append(ex.message)			

for e in range(len(elems)):
		try:
			elem = Revit.Elements.Element.SetParameterByName(elems[e],"NIIPI_Предупреждение",elem_bool[e])
			cnt.append(elem)
		except Exception, ex:
			cnt.append(ex.message)
			
			
TM.Instance.ForceCloseTransaction()

if len(cnt) > 0:
	chckt = FilteredWorksetCollector(doc).OfKind(WorksetKind.UserWorkset)
	transOpts = TransactWithCentralOptions()
	syncOpts = SynchronizeWithCentralOptions()
	syncOpts.Comment = "[DynamoSync] Размер модели: " + fs_fin + " МБ. Количество предупреждений: " + str(len(war_cnt))
	syncOpts.SaveLocalAfter = False
	relinquishOpts = RelinquishOptions(True)
	syncOpts.SetRelinquishOptions(relinquishOpts)
	syncOpts.SaveLocalAfter = False
	
	doc.SynchronizeWithCentral(transOpts, syncOpts)
	
OUT = cnt
# ----------------------------------------
