# Dynamo custom node AdaptiveWire 7 Points.dyf (Dynamo 2.0.5.13212)
# category: PozhiloyPack

cs = Input(cs: var[]..[])
x_coordinate = Input(x coordinate: var[]..[])
Y_coordinate = Input(Y coordinate: var[]..[])
Z_coordinate = Input(Z coordinate: var[]..[])
code_block = CodeBlock { 50; }
code_block_2 = CodeBlock { 110; }
FamilyTypeName = Input(FamilyTypeName: var[]..[])
code_block_3 = CodeBlock(cs=cs, x_c=x_coordinate, y_c=Y_coordinate, z_c=Z_coordinate, min=code_block, max=code_block_2, famName=FamilyTypeName)
# ---------- code_block_3.designscript (24 lines) ----------
pnt = Point.ByCartesianCoordinates(cs,x_c,y_c,z_c);
sortedPnt = List.DropItems((List.Sublists(pnt,0..2,2)),-1);
pnt0 = List.GetItemAtIndex(sortedPnt@L2<1>,0);
pnt3 = List.GetItemAtIndex(sortedPnt@L2<1>,1);
pnt6 = List.GetItemAtIndex(sortedPnt@L2<1>,2);
l0_3 = Line.ByStartPointEndPoint(pnt0,pnt3);
l3_6 = Line.ByStartPointEndPoint(pnt3,pnt6);
c_l0_3 = Autodesk.Curve.PointAtParameter(l0_3,0.5);
c_l3_6 = Autodesk.Curve.PointAtParameter(l3_6,0.5);
//randomizing of sagging
a = Math.RandomList(List.Count(c_l0_3));
ar = Math.RemapRange(a,min,max);
b = Math.RandomList(List.Count(c_l3_6));
br = Math.RemapRange(b,min,max);
pnt2 = Point.ByCoordinates(c_l0_3.X,c_l0_3.Y,(c_l0_3.Z-ar));
pnt4 = Point.ByCoordinates(c_l3_6.X,c_l3_6.Y,(c_l3_6.Z-ar));
//
pnt1 = Autodesk.Curve.PointAtParameter(l0_3,0.01);
pnt5 = Autodesk.Curve.PointAtParameter(l3_6,0.99);
lstPoints = [pnt0,pnt1,pnt2,pnt3,pnt4,pnt5,pnt6];
lstPoints_crr = List.Transpose(lstPoints);
ch = List.GetItemAtIndex(lstPoints_crr@L2<1>,0);
ch1 = ch[0]!=null?FamilyType.ByName(famName):null;
createFamily = AdaptiveComponent.ByPoints(lstPoints_crr,ch1);
# ----------------------------------------
AdaptiveFamily = Output(code_block_3.createFamily)
