# Dynamo custom node SublistByTwoValues.dyf (Dynamo 2.0.4.12684)
# category: PozhiloyPack
# Creates sublists with indices [[0,1],[1,2],[2,3][3,4],[...,...]]

List = Input(List: var[]..[])
code_block = CodeBlock { 0..1; 1; }
sublists = List.Sublists(list=List, ranges=code_block.out0, offset=code_block.out1)
code_block_2 = CodeBlock { -1; }
dropItems = List.DropItems(list=sublists, amount=code_block_2)
code_block_3 = CodeBlock { 0; }
getItemAtIndex = List.GetItemAtIndex(list=dropItems@L2, index=code_block_3)
Value1 = Output(getItemAtIndex)
code_block_4 = CodeBlock { 1; }
getItemAtIndex_2 = List.GetItemAtIndex(list=dropItems@L2, index=code_block_4)
Value2 = Output(getItemAtIndex_2)
Sublists = Output(dropItems)
