# Dynamo graph topogrbypoints.dyn (Dynamo 2.12.0.5650)

string = StringInput("C:\Users\ProhorovAO\Desktop\a.xlsx")
string_2 = StringInput("Лист1")
openXMLImportExcel = Data.OpenXMLImportExcel(filePath=string, sheetName=string_2)
code_block = CodeBlock { 0; }
getItemAtIndex = List.GetItemAtIndex(list=openXMLImportExcel@L2, index=code_block)
code_block_2 = CodeBlock { 1; }
getItemAtIndex_2 = List.GetItemAtIndex(list=openXMLImportExcel@L2, index=code_block_2)
code_block_3 = CodeBlock { 2; }
getItemAtIndex_3 = List.GetItemAtIndex(list=openXMLImportExcel@L2, index=code_block_3)
byCoordinates = Point.ByCoordinates(x=getItemAtIndex, y=getItemAtIndex_2, z=getItemAtIndex_3)
byPoints = Topography.ByPoints(points=byCoordinates)
