# Dynamo graph АР_Двери_Возврат.dyn "АР_Двери_Тест" (Dynamo 2.12.1.8246)

string = StringInput("Двери")
byName = Category.ByName(name=string)
all_elements_of_category = ElementsOfCategory(Category=byName)
getFamily = FamilyInstance.GetFamily(familyInstance=all_elements_of_category)
code_block = CodeBlock(a=getFamily) { a.Name; }
string_2 = StringInput("Дверь")
contains = String.Contains(string=code_block, searchFor=string_2)
string_3 = StringInput("1ств")
contains_2 = String.Contains(string=code_block, searchFor=string_3)
code_block_2 = CodeBlock(a=contains, b=contains_2) { a==true&&b==true; }
отделение_одностворчатых_дверей = List.FilterByBoolMask(list=all_elements_of_category, mask=code_block_2)
string_4 = StringInput("NIIPI_Текст предупреждения")
python_script = Python(IN[0]=отделение_одностворчатых_дверей.in)  # IronPython2
# ---------- python_script.python (33 lines) ----------
# Загрузить стандартную библиотеку Python и библиотеку DesignScript
import sys
import clr
clr.AddReference('ProtoGeometry')
from Autodesk.DesignScript.Geometry import *
clr.AddReference('RevitAPI')
from Autodesk.Revit.DB import *

clr.AddReference("RevitServices")
import RevitServices
from RevitServices.Persistence import DocumentManager
from RevitServices.Transactions import TransactionManager
doc = DocumentManager.Instance.CurrentDBDocument
# Введенные в этом узле данные сохраняется в виде списка в переменных IN.
drs = UnwrapElement(IN[0])
hand_flipped = []
# Разместите код под этой строкой

for element in drs:
	if element.HandFlipped == True:
		TransactionManager.Instance.EnsureInTransaction(doc)
		
		element.flipHand()
		element.LookupParameter("NIIPI_Текст предупреждения").Set("Переработана!")
		hand_flipped.append(True)
		
		TransactionManager.Instance.ForceCloseTransaction()		
		
	else:
		hand_flipped.append(False)

# Назначьте вывод переменной OUT.
OUT = hand_flipped
# ----------------------------------------
code_block_3 = CodeBlock(a=python_script) { a == true?"Переработана!":(a == "err"?"Ошибка скрипта!":""); }  # frozen
setParameterByName = Element.SetParameterByName(element=отделение_одностворчатых_дверей.in, parameterName=string_4, value=code_block_3)
