# Dynamo graph АР_Заполнение открывания дверей.dyn (Dynamo 2.12.1.8246)

string = StringInput("Двери")
byName = Category.ByName(name=string)
all_elements_of_category = ElementsOfCategory(Category=byName)
getFamily = FamilyInstance.GetFamily(familyInstance=all_elements_of_category)
code_block = CodeBlock(a=getFamily) { a.Name; }
string_2 = StringInput("Дверь")
contains = String.Contains(string=code_block, searchFor=string_2)
string_3 = StringInput("1ств")
contains_2 = String.Contains(string=code_block, searchFor=string_3)
code_block_2 = CodeBlock(a=contains, b=contains_2) { a==true&&b==true; }
filterByBoolMask = List.FilterByBoolMask(list=all_elements_of_category, mask=code_block_2)
string_4 = StringInput("ADSK_Открывание")
python_script = Python(IN[0]=filterByBoolMask.in)  # IronPython2
# ---------- python_script.python (17 lines) ----------
# Загрузить стандартную библиотеку Python и библиотеку DesignScript
import sys
import clr
clr.AddReference('ProtoGeometry')
from Autodesk.DesignScript.Geometry import *

# Введенные в этом узле данные сохраняется в виде списка в переменных IN.
drs = UnwrapElement(IN[0])
hand_flipped = []
# Разместите код под этой строкой
for element in drs:
    if element.HandFlipped != element.FacingFlipped:
        hand_flipped.append(True)
    else:
        hand_flipped.append(False)
# Назначьте вывод переменной OUT.
OUT = hand_flipped
# ----------------------------------------
code_block_3 = CodeBlock(a=python_script) { a == false?"Л":"П"; }
setParameterByName = Element.SetParameterByName(element=filterByBoolMask.in, parameterName=string_4, value=code_block_3)
