# Dynamo graph АР_Отделка помещений.dyn (Dynamo 2.12.0.5650)

select_model_element = DSModelElementSelection()  # 1 picked in the model
geometry = Element.Geometry(element=select_model_element)
intersectAll = Geometry.IntersectAll()  # unwired: geometry, others
string = StringInput("Помещения")
byName = Category.ByName(name=string)
all_elements_of_category = ElementsOfCategory(Category=byName)
geometry_2 = Element.Geometry(element=all_elements_of_category)
centroid = Solid.Centroid(solid=geometry_2)
byOriginNormal = Plane.ByOriginNormal(origin=centroid)
code_block = CodeBlock { 1.01; }
scale = Geometry.Scale(geometry=geometry_2, plane=byOriginNormal, xamount=code_block, yamount=code_block, zamount=code_block)
flatten = List.Flatten(list=scale)
string_2 = StringInput("Стены")
byName_2 = Category.ByName(name=string_2)
all_elements_of_category_2 = ElementsOfCategory(Category=byName_2)
geometry_3 = Element.Geometry(element=all_elements_of_category_2)
flatten_2 = List.Flatten(list=geometry_3)
intersect = Geometry.Intersect(geometry=flatten, other=flatten_2, lacing=CrossProduct)
flatten_3 = List.Flatten(list=intersect@L3)
