# Dynamo graph АР_Подсчет стоек_v1.dyn "АР_Подсчет стоек_v0.1" (Dynamo 2.12.1.8246)

code_block = CodeBlock { "Ограждение"; }
byName = Category.ByName(name=code_block)
all_elements_of_category = ElementsOfCategory(Category=byName)
string = StringInput("ADSK_Количество")
geometry = Element.Geometry(element=all_elements_of_category)
code_block_2 = CodeBlock(a=geometry) { Solid.Volume(a) == 1?true:false; }
code_block_3 = CodeBlock(a=geometry) { Solid.Volume(a) == 1?true:false; }
filterByBoolMask = List.FilterByBoolMask(list=code_block_2, mask=code_block_3)
count = List.Count(list=filterByBoolMask.in@L2)
setParameterByName = Element.SetParameterByName(element=all_elements_of_category, parameterName=string, value=count)
