# Dynamo graph АР_Полы_По помещениям_v2.dyn "АР_Полы по помещениям_v2" (Dynamo 2.12.0.5650)

# group: Создаем солиды помещений и увеличиваем по оси Z
categories = Categories("OST_Rooms")
all_elements_of_category = ElementsOfCategory(Category=categories)
code_block = CodeBlock(a=all_elements_of_category) { a.Area == 0?false:true; }
filterByBoolMask = List.FilterByBoolMask(list=all_elements_of_category, mask=code_block)
string = StringInput("Комментарии")
string_2 = StringInput("Прописать вручную номер в полу")
setParameterByName = Element.SetParameterByName(element=filterByBoolMask.out, parameterName=string, value=string_2)
geometry = Element.Geometry(element=filterByBoolMask.in)
isEmpty = List.IsEmpty(list=geometry@L2)
filterByBoolMask_2 = List.FilterByBoolMask(list=geometry, mask=isEmpty)
centroid = Solid.Centroid(solid=filterByBoolMask_2.out)
byOriginNormal = Plane.ByOriginNormal(origin=centroid)
code_block_2 = CodeBlock { 1.01; }
scale = Geometry.Scale(geometry=filterByBoolMask_2.out, plane=byOriginNormal, zamount=code_block_2)
flatten = List.Flatten(list=scale)
filterByBoolMask_3 = List.FilterByBoolMask(list=filterByBoolMask.in, mask=isEmpty)
code_block_3 = CodeBlock(rms=filterByBoolMask_3.out) { rms; }
string_3 = StringInput("Комментарии")
string_4 = StringInput("Прописать вручную номер в полу")
setParameterByName_2 = Element.SetParameterByName(element=filterByBoolMask_2.in, parameterName=string_3, value=string_4)

название_легенды_с_пирогом = StringInput("Эскизы полов")  # graph input
временная_папка_для_картинок = Directory("C:\Users\ProhorovAO\Desktop")  # graph input
string_5 = StringInput("Изображение типоразмера")

# group: Достаем полы и их геометрию
categories_2 = Categories("OST_Floors")
all_elements_of_category_2 = ElementsOfCategory(Category=categories_2)
elementType = Element.ElementType(element=all_elements_of_category_2)
string_6 = StringInput("Описание")
getParameterValueByName = Element.GetParameterValueByName(element=elementType, parameterName=string_6)
code_block_4 = CodeBlock(a=getParameterValueByName) { a=="Пол"; }
filterByBoolMask_4 = List.FilterByBoolMask(list=all_elements_of_category_2, mask=code_block_4)
geometry_2 = Element.Geometry(element=filterByBoolMask_4.in)
solid_fail = Python(IN[0]=geometry_2)  # IronPython2
# ---------- solid_fail.python (8 lines) ----------
l = IN[0]
out = []
for i in l:
	if i:
		out.append(True)
	else:
		out.append(False)
OUT = out
# ----------------------------------------
filterByBoolMask_5 = List.FilterByBoolMask(list=geometry_2, mask=solid_fail)
flatten_2 = List.Flatten(list=filterByBoolMask_5.in)
filterByBoolMask_6 = List.FilterByBoolMask(list=filterByBoolMask_4.in, mask=solid_fail)
elementType_2 = Element.ElementType(element=filterByBoolMask_4.in)
filterByBoolMask_7 = List.FilterByBoolMask(list=elementType_2, mask=solid_fail)

# note: Достаем все материалы из пола и присваиваем полу
# note: Рассовываем номера помещений по экземплярам пола
python_script = Python(IN[0]=flatten, IN[1]=flatten_2, IN[2]=code_block_3, IN[3]=filterByBoolMask_6.in, IN[4]=filterByBoolMask_7.in)  # IronPython2
# ---------- python_script.python (119 lines) ----------
# Загрузить стандартную библиотеку Python и библиотеку DesignScript
import sys, clr
clr.AddReference('ProtoGeometry')
clr.AddReference('DSCoreNodes') 
clr.AddReference('RevitAPI')
clr.AddReference('RevitServices')
clr.AddReference("System.Core")
from Autodesk.DesignScript.Geometry import *
import Autodesk
from Autodesk.Revit.DB import *
import DSCore
from DSCore import *
import System
clr.ImportExtensions(System.Linq)
import RevitServices
from RevitServices.Persistence import DocumentManager
from RevitServices.Transactions import TransactionManager
from itertools import groupby

uiapp = DocumentManager.Instance.CurrentUIApplication
app = uiapp.Application
version=int(app.VersionNumber)

doc = DocumentManager.Instance.CurrentDBDocument
UIunit = doc.GetUnits().GetFormatOptions(SpecTypeId.Length).GetUnitTypeId()

# Исходники
rooms_geom = UnwrapElement(IN[0])
floors_geom = UnwrapElement(IN[1])
rooms = UnwrapElement(IN[2])
floors = UnwrapElement(IN[3])
f_types = UnwrapElement(IN[4])

# Заполняемые списки
data = dict()

""" пример структуры словаря data
data = {
    level1 : [
		    	[type1, [room1, room2, room3]],
				[type2, [room4, room5]]
			],
    level2 : [
		    	[type1, [room7, room9]],
				[type2, [room10]],
				[type3, []
		    ]
}
"""

for floor, floor_type in zip(floors, f_types):
    lvl = doc.GetElement(floor.LevelId).Name
    foor_type_id = floor_type.Id.IntegerValue
    if lvl in data.keys():
    	count = 0
    	for t in data[lvl]:
    		if t[0] != foor_type_id:
    			count += 1
    	if count == len(data[lvl]):
    		data[lvl].append([foor_type_id, [], []])
    else:
    	data[lvl] = [[foor_type_id, [], []]]

for floor, floor_type, floor_solid in zip(floors, f_types, floors_geom):
    for room, room_solid in zip(rooms, rooms_geom):
        if Geometry.DoesIntersect(floor_solid, room_solid):
            lvl = doc.GetElement(floor.LevelId).Name
            floor_type_id = floor_type.Id.IntegerValue
            room_num = room.LookupParameter("Номер").AsString()
            room_name = room.LookupParameter("Имя").AsString()
            for i in data[lvl]:
            	if i[0] == floor_type_id:
            		i[1].append(room_num)
            		i[2].append(room_name)

for lvl in data.keys():
	for i in data[lvl]:
		i[1] = list(set(i[1]))
		i[1].sort()
		i[1] = '; '.join(i[1])
		i[2] = list(set(i[2]))
		i[2].sort()
		i[2] = '; '.join(i[2])

TransactionManager.Instance.EnsureInTransaction(doc)

for floor, floor_type in zip(floors, f_types):
    lvl = doc.GetElement(floor.LevelId).Name
    floor_type_id = floor_type.Id.IntegerValue
    for i in data[lvl]:
    	if i[0] == floor_type_id:
    		floor.LookupParameter("NIIPI_Номера помещений").Set(i[1])
    		floor.LookupParameter("NIIPI_Имена помещений").Set(i[2])

TransactionManager.Instance.ForceCloseTransaction()


for f in floors:
	struct = []
	cs = f.FloorType.GetCompoundStructure()
	a = list(cs.GetLayers())
	cnt = 1
	
	for x in a:
		aa = f.FloorType.Document.GetElement(x.MaterialId)
		aaa = aa.LookupParameter("Описание")
		b = UnitUtils.ConvertFromInternalUnits(x.Width,UIunit)
		c = str(b)
		d = c[:c.index(".")]
		struct.append((str(cnt) + ") " + aaa.AsValueString() + ": " + d + " мм"))
		cnt+=1
		
	fpar = f.LookupParameter("NIIPI_Состав пола")
		
	TransactionManager.Instance.EnsureInTransaction(doc)
	fpar.Set("\n".join(struct))
	TransactionManager.Instance.ForceCloseTransaction()

OUT = f_types
# ----------------------------------------
end = Revit.Transaction.Transaction.End(input=python_script)
code_block_5 = CodeBlock(a=end) { a; }
uniqueItems = List.UniqueItems(list=code_block_5)
code_block_6 = CodeBlock(a=uniqueItems) { a.Id; }
# note: Добавляем очень красивую картинку в типоразмер пола
python_script_2 = Python(IN[0]=название_легенды_с_пирогом, IN[1]=временная_папка_для_картинок, IN[2]=string_5, IN[3]=code_block_6)  # IronPython2
# ---------- python_script_2.python (165 lines) ----------
import clr
from System.Collections.Generic import List # noqa
clr.AddReference('RevitServices')
from RevitServices.Persistence import DocumentManager # noqa
from RevitServices.Transactions import TransactionManager # noqa

clr.AddReference("RevitNodes")
import Revit # noqa
clr.ImportExtensions(Revit.Elements)
clr.ImportExtensions(Revit.GeometryConversion)

clr.AddReference('RevitAPI')
from Autodesk.Revit import DB # noqa
from Autodesk.Revit.DB import FilteredElementCollector as FEC # noqa

doc = DocumentManager.Instance.CurrentDBDocument

def clean_legends_by_prefix(prefix):
    ids_to_delete = List[DB.ElementId]()
    count = 0
    for view in FEC(doc).OfClass(DB.View):
        if prefix in view.Name:
            ids_to_delete.Add(view.Id)
            count += 1
    with DB.Transaction(doc, 'clean legends') as t:
        t.Start()
        doc.Delete(ids_to_delete)
        t.Commit()
    report.append('{} временных видов удалено'.format(count))

def get_view_by_name(name):
	view = 0
	for v in FEC(doc).OfClass(DB.View):
		if v.Name == name:
			view = v
	return view

def duplicate_floor_legend(legend, name):
    with DB.Transaction(doc, 'duplicate floor legend') as t:
        t.Start()
        dup_legend = doc.GetElement(legend.Duplicate(dupopt))
        dup_legend.LookupParameter("Имя вида").Set(name)
        t.Commit()
    return dup_legend

def set_type_component(component, type_id):
    with DB.Transaction(doc, 'set component type') as t:
        t.Start()
        component.LookupParameter("Тип компонента").Set(type_id)
        t.Commit()

def create_dimensions(current_legend, current_component):
    p_max = current_component.BoundingBox[current_legend].Max
    p_min = current_component.BoundingBox[current_legend].Min
    p_up_left = DB.XYZ(p_min.X, p_max.Y, 0)
    p_up_right = DB.XYZ(p_max.X, p_max.Y, 0)
    p_down_left = DB.XYZ(p_min.X, p_min.Y, 0)
    p_down_right = DB.XYZ(p_max.X, p_min.Y, 0)
    line_1 = DB.Line.CreateBound(p_up_left, p_up_right)
    line_2 = DB.Line.CreateBound(p_down_left, p_down_right)
    dim_line = DB.Line.CreateBound(p_down_left + DB.XYZ(-200/304.8, 0, 0), p_up_left + DB.XYZ(-200/304.8, 0, 0))
    with DB.Transaction(doc, 'create dimension') as t:
        t.Start()
        arr_2 = DB.ReferenceArray()
        d_curve_1 = doc.Create.NewDetailCurve(current_legend, line_1)
        d_curve_2 = doc.Create.NewDetailCurve(current_legend, line_2)
        arr_2.Append(d_curve_1.GeometryCurve.Reference)
        arr_2.Append(d_curve_2.GeometryCurve.Reference)
        doc.Create.NewDimension(current_legend, dim_line, arr_2)
        t.Commit()

def create_flag(current_component, current_legend, floor_type):
    point_place_flag = current_component.BoundingBox[current_legend].Max + DB.XYZ(-200/304.8, 0, 0)
    symbols = FEC(doc).OfCategory(DB.BuiltInCategory.OST_GenericAnnotation).WhereElementIsElementType().ToElements()
    for symbol in symbols:
        if symbol.FamilyName == 'floor_flag':
            flag_symbol = symbol
            break
    layer_count = floor_type.GetCompoundStructure().LayerCount
    with DB.Transaction(doc, 'create flag') as t:
        t.Start()
        flag_instance = doc.Create.NewFamilyInstance(point_place_flag, flag_symbol, current_legend)
        for parameter in flag_instance.GetParameters('колво_строк'):
            parameter.Set(layer_count)
        t.Commit()

def export_images(path_to_images, image_width, legend_views):
    legend_views_id = List[DB.ElementId]()
    for view in legend_views:
        legend_views_id.Add(view.Id)
    img_options = DB.ImageExportOptions()
    img_options.FilePath = path_to_images
    img_options.ZoomType = DB.ZoomFitType.FitToPage
    img_options.PixelSize = image_width
    img_options.ImageResolution = DB.ImageResolution.DPI_300
    img_options.HLRandWFViewsFileType = DB.ImageFileType.JPEGLossless
    img_options.ExportRange = DB.ExportRange.SetOfViews
    img_options.SetViewsAndSheets(legend_views_id)
    doc.ExportImage(img_options)
    images = FEC(doc).OfClass(DB.ImageType).ToElements()
    return images, img_options

def import_and_set_image(current_path, type_id, floor_type_image_parameter):
    image_import_options = DB.ImageTypeOptions(current_path, False, DB.ImageTypeSource.Import)
    image_import_options.Resolution = 300
    image = DB.ImageType.Create(doc, image_import_options)
    if floor_type_image_parameter == 'Изображение типоразмера':
        par = doc.GetElement(type_id).Parameter[DB.BuiltInParameter.ALL_MODEL_TYPE_IMAGE]
    else:
        par = doc.GetElement(type_id).LookupParameter(floor_type_image_parameter)
    par.Set(image.Id)

#----------------------ВХОДНЫЕ ДАННЫЕ----------------------------------
start_legend_name = IN[0]
path_to_images = IN[1]
floor_type_image_parameter = IN[2]
floor_types_id = IN[3]
image_width = 1000
#----------------------------------------------------------------------

dupopt = DB.ViewDuplicateOption.WithDetailing
prefix_legend = 'temp_legend_to_delete'
legend_views = []
report = []

for i, t in enumerate(floor_types_id):
    if not isinstance(t, DB.ElementId):
        floor_types_id[i] = DB.ElementId(t)
floor_types_id = list(set(floor_types_id))

clean_legends_by_prefix(prefix_legend)
start_legend = get_view_by_name(start_legend_name)
first_component = FEC(doc, start_legend.Id).OfCategory(DB.BuiltInCategory.OST_LegendComponents).ToElements()[0]

for type_id in floor_types_id:
    floor_type = doc.GetElement(type_id)
    current_legend_name = prefix_legend + "_" + floor_type.Id.ToString()
    current_legend = duplicate_floor_legend(start_legend, current_legend_name)
    current_component = FEC(doc, current_legend.Id).OfCategory(DB.BuiltInCategory.OST_LegendComponents).ToElements()[0]
    set_type_component(current_component, type_id)
    create_dimensions(current_legend, current_component)
    #create_flag(current_component, current_legend, floor_type)
    legend_views.append(current_legend)

#----------------part2------------------

images, img_export_options = export_images(path_to_images, image_width, legend_views)

with DB.Transaction(doc, 'images') as t:
    t.Start()
    for view, type_id in zip(legend_views, floor_types_id):
        current_path = img_export_options.FilePath + ' - Легенда - ' + view.Name + '.jpg'
        image = 0
        for img in images:
            if img.Path == current_path:
                image = img
        if image:
            image.Reload()
        else:
            import_and_set_image(current_path, type_id, floor_type_image_parameter)
    t.Commit()

clean_legends_by_prefix(prefix_legend)

OUT = report
# ----------------------------------------
python_script_3 = Python(IN[0]=flatten, IN[1]=flatten_2, IN[2]=code_block_3, IN[3]=filterByBoolMask_6.in, IN[4]=filterByBoolMask_7.in)  # IronPython2; frozen
# ---------- python_script_3.python (81 lines) ----------
# Загрузить стандартную библиотеку Python и библиотеку DesignScript
import sys, clr
clr.AddReference('ProtoGeometry')
clr.AddReference('DSCoreNodes') 
clr.AddReference('RevitAPI')
clr.AddReference('RevitServices')
clr.AddReference("System.Core")
from Autodesk.DesignScript.Geometry import *
import Autodesk
from Autodesk.Revit.DB import *
import DSCore
from DSCore import *
import System
clr.ImportExtensions(System.Linq)
import RevitServices
from RevitServices.Persistence import DocumentManager
from RevitServices.Transactions import TransactionManager
from itertools import groupby

uiapp = DocumentManager.Instance.CurrentUIApplication
app = uiapp.Application
version=int(app.VersionNumber)

doc = DocumentManager.Instance.CurrentDBDocument
UIunit = doc.GetUnits().GetFormatOptions(SpecTypeId.Length).GetUnitTypeId()

# Исходники
rooms_geom = UnwrapElement(IN[0])
floors_geom = UnwrapElement(IN[1])
rooms = UnwrapElement(IN[2])
floors = UnwrapElement(IN[3])
f_types = UnwrapElement(IN[4])

# Заполняемые списки

data = {}
""" пример структуры словаря data
data = {
	level1 : {
		type1 : [room1, room2, room3],
		type2 : [room4, room5]
		},
	level2 : {
		type1 : [room7, room9],
		type2 : [room10],
        type3 : []
		}
}
"""

for floor, floor_type, floor_solid in zip(floors, f_types, floors_geom):
    for room, room_solid in zip(rooms, rooms_geom):
        if Geometry.DoesIntersect(floor_solid, room_solid):
            lvl = doc.GetElement(floor.LevelId).Name
            foor_type_id = floor_type.Id.IntegerValue
            # room_num = room.LookupParameter("Номер").AsString()
            # room_name = room.LookupParameter("Имя").AsString()

            if lvl in data.keys():
                if foor_type_id in data[lvl].keys():
                    data[lvl][foor_type_id].append(room)
                else:
                    data[lvl][foor_type_id] = [room]
            else:
                data[lvl] = {}
                data[lvl][foor_type_id] = [room]

TransactionManager.Instance.EnsureInTransaction(doc)
for floor, floor_type in zip(floors, f_types):
    lvl = doc.GetElement(floor.LevelId).Name
    foor_type_id = floor_type.Id.IntegerValue
    if foor_type_id in data[lvl].keys():
    	nums = list(set([r.LookupParameter("Номер").AsString() for r in data[lvl][foor_type_id]])).sort()
    	names = list(set([r.LookupParameter("Имя").AsString() for r in data[lvl][foor_type_id]])).sort()
	    if nums:
	    	floor.LookupParameter("NIIPI_Номера помещений").Set('; '.join(nums))
	    	floor.LookupParameter("NIIPI_Имена помещений").Set('; '.join(names))
TransactionManager.Instance.ForceCloseTransaction()
					

OUT = 'ok'
# ----------------------------------------
