# Dynamo graph АР_Полы_Создание легенд.dyn (Dynamo 2.12.0.5650)

# group: вход
название_легенды_с_пирогом = StringInput("Эскизы полов")  # graph input
создать_легенды_true_назначить_в = BoolSelector(true)  # "Создать легенды-true, назначить в полы - false"; graph input
временная_папка_для_картинок = Directory("C:\Users\ProhorovAO\Desktop")  # graph input
string = StringInput("Изображение типоразмера")

categories = Categories("OST_Floors")
all_elements_of_category = ElementsOfCategory(Category=categories)
elementType = Element.ElementType(element=all_elements_of_category)
string_2 = StringInput("Описание")
getParameterValueByName = Element.GetParameterValueByName(element=elementType, parameterName=string_2)
code_block = CodeBlock(a=getParameterValueByName) { a=="Пол"; }
filterByBoolMask = List.FilterByBoolMask(list=all_elements_of_category, mask=code_block)
elementType_2 = Element.ElementType(element=filterByBoolMask.in)
uniqueItems = List.UniqueItems(list=elementType_2)
code_block_2 = CodeBlock(f=uniqueItems) { f.Id; }
end = Revit.Transaction.Transaction.End(input=code_block_2)
# note: Создаем легенды
python_script = Python(IN[0]=название_легенды_с_пирогом, IN[1]=end, IN[2]=создать_легенды_true_назначить_в)  # IronPython2
# ---------- python_script.python (107 lines) ----------
import clr
from System.Collections.Generic import List # noqa
clr.AddReference('RevitServices')
from RevitServices.Persistence import DocumentManager # noqa
from RevitServices.Transactions import TransactionManager # noqa

clr.AddReference("RevitNodes")
import Revit # noqa
clr.ImportExtensions(Revit.Elements)
clr.ImportExtensions(Revit.GeometryConversion)

clr.AddReference('RevitAPI')
from Autodesk.Revit import DB # noqa
from Autodesk.Revit.DB import FilteredElementCollector as FEC # noqa

doc = DocumentManager.Instance.CurrentDBDocument

def clean_legends_by_prefix(prefix):
    ids_to_delete = List[DB.ElementId]()
    count = 0
    for view in FEC(doc).OfClass(DB.View):
        if prefix in view.Name:
            ids_to_delete.Add(view.Id)
            count += 1
    with DB.Transaction(doc, 'clean legends') as t:
        t.Start()
        doc.Delete(ids_to_delete)
        t.Commit()
    report.append('{} временных видов удалено'.format(count))

def get_view_by_name(name):
    view = 0
    for v in FEC(doc).OfClass(DB.View):
        if v.Name == name:
            view = v
    return view

def duplicate_floor_legend(legend, name):
    with DB.Transaction(doc, 'duplicate floor legend') as t:
        t.Start()
        dup_legend = doc.GetElement(legend.Duplicate(dupopt))
        dup_legend.LookupParameter("Имя вида").Set(name)
        t.Commit()
    return dup_legend

def set_type_component(component, type_id):
    with DB.Transaction(doc, 'set component type') as t:
        t.Start()
        component.LookupParameter("Тип компонента").Set(type_id)
        t.Commit()

def create_dimensions(current_legend, current_component):
    p_max = current_component.BoundingBox[current_legend].Max
    p_min = current_component.BoundingBox[current_legend].Min
    p_up_left = DB.XYZ(p_min.X, p_max.Y, 0)
    p_up_right = DB.XYZ(p_max.X, p_max.Y, 0)
    p_down_left = DB.XYZ(p_min.X, p_min.Y, 0)
    p_down_right = DB.XYZ(p_max.X, p_min.Y, 0)
    line_1 = DB.Line.CreateBound(p_up_left, p_up_right)
    line_2 = DB.Line.CreateBound(p_down_left, p_down_right)
    dim_line = DB.Line.CreateBound(p_down_left + DB.XYZ(-200/304.8, 0, 0), p_up_left + DB.XYZ(-200/304.8, 0, 0))
    with DB.Transaction(doc, 'create dimension') as t:
        t.Start()
        arr_2 = DB.ReferenceArray()
        d_curve_1 = doc.Create.NewDetailCurve(current_legend, line_1)
        d_curve_2 = doc.Create.NewDetailCurve(current_legend, line_2)
        arr_2.Append(d_curve_1.GeometryCurve.Reference)
        arr_2.Append(d_curve_2.GeometryCurve.Reference)
        doc.Create.NewDimension(current_legend, dim_line, arr_2)
        t.Commit()


#----------------------ВХОДНЫЕ ДАННЫЕ----------------------------------
start_legend_name = IN[0]
floor_types_id = IN[1]
#----------------------------------------------------------------------

if IN[2]:
	dupopt = DB.ViewDuplicateOption.WithDetailing
	prefix_legend = 'temp_legend_to_delete'
	legend_views = []
	report = []
	
	for i, t in enumerate(floor_types_id):
	    if not isinstance(t, DB.ElementId):
	        floor_types_id[i] = DB.ElementId(t)
	floor_types_id = list(set(floor_types_id))
	
	clean_legends_by_prefix(prefix_legend)
	start_legend = get_view_by_name(start_legend_name)
	first_component = FEC(doc, start_legend.Id).OfCategory(DB.BuiltInCategory.OST_LegendComponents).ToElements()[0]
	
	for type_id in floor_types_id:
	    floor_type = doc.GetElement(type_id)
	    current_legend_name = prefix_legend + "_" + floor_type.Id.ToString()
	    current_legend = duplicate_floor_legend(start_legend, current_legend_name)
	    current_component = FEC(doc, current_legend.Id).OfCategory(DB.BuiltInCategory.OST_LegendComponents).ToElements()[0]
	    set_type_component(current_component, type_id)
	    create_dimensions(current_legend, current_component)
	    legend_views.append(current_legend)  
	    t_name = floor_type.LookupParameter("Имя типа").AsString()
	    with DB.Transaction(doc, 'create dimension') as t:
	        t.Start()
	        current_legend.LookupParameter("ADSK_Примечание к виду").Set(t_name)
	        t.Commit()
	
	OUT = report
# ----------------------------------------
# note: Создаем картинки и добавляем в полы
python_script_2 = Python(IN[0]=временная_папка_для_картинок, IN[1]=string, IN[2]=создать_легенды_true_назначить_в)  # IronPython2
# ---------- python_script_2.python (94 lines) ----------
import clr
from System.Collections.Generic import List # noqa
clr.AddReference('RevitServices')
from RevitServices.Persistence import DocumentManager # noqa
from RevitServices.Transactions import TransactionManager # noqa

clr.AddReference("RevitNodes")
import Revit # noqa
clr.ImportExtensions(Revit.Elements)
clr.ImportExtensions(Revit.GeometryConversion)

clr.AddReference('RevitAPI')
from Autodesk.Revit import DB # noqa
from Autodesk.Revit.DB import FilteredElementCollector as FEC # noqa

doc = DocumentManager.Instance.CurrentDBDocument

def clean_legends_by_prefix(prefix):
    ids_to_delete = List[DB.ElementId]()
    count = 0
    for view in FEC(doc).OfClass(DB.View):
        if prefix in view.Name:
            ids_to_delete.Add(view.Id)
            count += 1
    with DB.Transaction(doc, 'clean legends') as t:
        t.Start()
        doc.Delete(ids_to_delete)
        t.Commit()
    report.append('{} временных видов удалено'.format(count))

def export_images(path_to_images, image_width, legend_views):
    legend_views_id = List[DB.ElementId]()
    for view in legend_views:
        legend_views_id.Add(view.Id)
    img_options = DB.ImageExportOptions()
    img_options.FilePath = path_to_images
    img_options.ZoomType = DB.ZoomFitType.FitToPage
    img_options.PixelSize = image_width
    img_options.ImageResolution = DB.ImageResolution.DPI_300
    img_options.HLRandWFViewsFileType = DB.ImageFileType.JPEGLossless
    img_options.ExportRange = DB.ExportRange.SetOfViews
    img_options.SetViewsAndSheets(legend_views_id)
    doc.ExportImage(img_options)
    images = FEC(doc).OfClass(DB.ImageType).ToElements()
    return images, img_options

def import_and_set_image(current_path, type_id, floor_type_image_parameter):
    image_import_options = DB.ImageTypeOptions(current_path, False, DB.ImageTypeSource.Import)
    image_import_options.Resolution = 300
    image = DB.ImageType.Create(doc, image_import_options)
    if floor_type_image_parameter == 'Изображение типоразмера':
        par = doc.GetElement(type_id).Parameter[DB.BuiltInParameter.ALL_MODEL_TYPE_IMAGE]
    else:
        par = doc.GetElement(type_id).LookupParameter(floor_type_image_parameter)
    par.Set(image.Id)

#----------------------ВХОДНЫЕ ДАННЫЕ----------------------------------
path_to_images = IN[0]
floor_type_image_parameter = IN[1]
image_width = 1000
#----------------------------------------------------------------------

prefix_legend = 'temp_legend_to_delete'
report = []
#----------------part2------------------

if not IN[2]:
	legend_views = []
	floor_types_id = []
	for view in FEC(doc).OfClass(DB.View):
	    if prefix_legend in view.Name:
	    	legend_views.append(view)
	    	floor_types_id.append(DB.ElementId(int(view.Name.split('_')[-1])))
	        	
	
	images, img_export_options = export_images(path_to_images, image_width, legend_views)
	
	with DB.Transaction(doc, 'images') as t:
	    t.Start()
	    for view, type_id in zip(legend_views, floor_types_id):
	        current_path = img_export_options.FilePath + ' - Легенда - ' + view.Name + '.jpg'
	        image = 0
	        for img in images:
	            if img.Path == current_path:
	                image = img
	        if image:
	            image.Reload()
	        else:
	            import_and_set_image(current_path, type_id, floor_type_image_parameter)
	    t.Commit()
	
	#clean_legends_by_prefix(prefix_legend)
	
	OUT = legend_views, floor_types_id
# ----------------------------------------
