# Dynamo graph АР_Эскизы окон_v0.8.dyn "legend_all_windows_v0.8" (Dynamo 2.10.1.3976)

categories = Categories("OST_Windows")
all_families_of_category = Python(IN[0]=categories)  # IronPython2
# ---------- all_families_of_category.python (17 lines) ----------
import System
import clr
clr.AddReference('RevitAPI')
from Autodesk.Revit.DB import *

clr.AddReference("RevitServices")
import RevitServices
from RevitServices.Persistence import DocumentManager

def ElementTypesByCategory(cat, doc):
	collector = FilteredElementCollector(doc).OfClass(Family)
	return [x for x in collector.ToElements() if x.FamilyCategoryId.IntegerValue == cat.Id]

doc = DocumentManager.Instance.CurrentDBDocument

if isinstance(IN[0], list): OUT = [ElementTypesByCategory(x, doc) for x in IN[0]]
else: OUT = ElementTypesByCategory(IN[0], doc)
# ----------------------------------------
группирование = Python(IN[0]=all_families_of_category)  # IronPython2
# ---------- группирование.python (15 lines) ----------
families = IN[0]

family_sketch = []
family_1casement = []
family_other = []

for family in families:
	if 'Окно_1ств_Эскиз' == family.Name:
		family_sketch.append(family)
	elif 'NIIPI_Окно_1Р_Стена_1ств' == family.Name:
		family_1casement.append(family)
	else:
		family_other.append(family)

OUT = family_sketch, family_1casement, family_other
# ----------------------------------------
# note: Семейство эскизов
code_block = CodeBlock(a=группирование) { a[0]; }
types = Family.Types(family=code_block)
flatten = List.Flatten(list=types)
code_block_2 = CodeBlock { "Окно_1ств_Эскиз"; }
type_duplicates = Python(IN[0]=flatten, IN[1]=code_block_2)  # IronPython2
# ---------- type_duplicates.python (36 lines) ----------
import clr
clr.AddReference('RevitAPI')
from Autodesk.Revit.DB import *

clr.AddReference('RevitNodes')
import Revit
clr.ImportExtensions(Revit.Elements)

clr.AddReference('RevitServices')
import RevitServices
from RevitServices.Persistence import DocumentManager
from RevitServices.Transactions import TransactionManager

doc = DocumentManager.Instance.CurrentDBDocument
famtypes = IN[0]
newname = IN[1]
elementlist = [] 
func_enum = {'Revit.Elements.WallType' : Revit.Elements.WallType.ByName,
			 'Revit.Elements.FloorType' : Revit.Elements.FloorType.ByName,
			 'Revit.Elements.FamilyType' : Revit.Elements.FamilyType.ByName}

sketch = 0
for i in range(len(famtypes)):
	if famtypes[i].Name == newname:
		sketch = famtypes.pop(i)
		break
	
TransactionManager.Instance.EnsureInTransaction(doc)
if not sketch:
	sketch = UnwrapElement(famtypes[0]).Duplicate(newname)

if not sketch:
	sketch = famtypes.pop()
TransactionManager.Instance.TransactionTaskDone()

OUT = sketch, famtypes
# ----------------------------------------
code_block_3 = CodeBlock(a=type_duplicates) { a[0]; }
# note: Семейство 1ств
code_block_4 = CodeBlock(a=группирование) { a[1]; }
code_block_5 = CodeBlock(Fam=code_block_4) { Fam.Name; }
types_2 = Family.Types(family=code_block_4)
code_block_6 = CodeBlock(type=types_2) { type.Name; }
имена_семейств_эскизов = Python(IN[0]=code_block_5, IN[1]=code_block_6)  # IronPython2
# ---------- имена_семейств_эскизов.python (10 lines) ----------
fam_names = IN[0]
fam_types_by_families = IN[1]

new_names = []

for i, types in enumerate(fam_types_by_families):
	for type in types:
		new_names.append(fam_names[i] + '-' + type)

OUT = new_names
# ----------------------------------------
count = List.Count(list=имена_семейств_эскизов)
ofRepeatedItem = List.OfRepeatedItem(item=code_block_3, amount=count)
type_duplicates_2 = Python(IN[0]=ofRepeatedItem, IN[1]=имена_семейств_эскизов)  # IronPython2
# ---------- type_duplicates_2.python (37 lines) ----------
import clr
clr.AddReference('RevitAPI')
from Autodesk.Revit.DB import *

clr.AddReference('RevitNodes')
import Revit
clr.ImportExtensions(Revit.Elements)

clr.AddReference('RevitServices')
import RevitServices
from RevitServices.Persistence import DocumentManager
from RevitServices.Transactions import TransactionManager

doc = DocumentManager.Instance.CurrentDBDocument
famtypes = IN[0]
newnames = IN[1]
elementlist = [] 
func_enum = {'Revit.Elements.WallType' : Revit.Elements.WallType.ByName,
			 'Revit.Elements.FloorType' : Revit.Elements.FloorType.ByName,
			 'Revit.Elements.FamilyType' : Revit.Elements.FamilyType.ByName}

TransactionManager.Instance.EnsureInTransaction(doc)
for i in xrange(len(famtypes) ):
	try:
		elementlist.append(UnwrapElement(famtypes[i]).Duplicate(newnames[i]) )
	except:
		try:
			t1 = famtypes[i].GetType().ToString()
			if t1 in func_enum:
				elementlist.append(func_enum[t1](newnames[i]) )
			else:
				elementlist.append(None)
		except:
			elementlist.append(None)

TransactionManager.Instance.TransactionTaskDone()
OUT = elementlist
# ----------------------------------------

# group: общие
string = StringInput("Высота")
getParameterValueByName = Element.GetParameterValueByName(element=types_2, parameterName=string)
flatten_2 = List.Flatten(list=getParameterValueByName)
setParameterByName = Element.SetParameterByName(element=type_duplicates_2, parameterName=string, value=flatten_2)
string_2 = StringInput("Ширина")
getParameterValueByName_2 = Element.GetParameterValueByName(element=types_2, parameterName=string_2)
flatten_3 = List.Flatten(list=getParameterValueByName_2)
setParameterByName_2 = Element.SetParameterByName(element=type_duplicates_2, parameterName=string_2, value=flatten_3)
string_3 = StringInput("Монтажный зазор")
getParameterValueByName_3 = Element.GetParameterValueByName(element=types_2, parameterName=string_3)
flatten_4 = List.Flatten(list=getParameterValueByName_3)
setParameterByName_3 = Element.SetParameterByName(element=type_duplicates_2, parameterName=string_3, value=flatten_4)
string_4 = StringInput("ADSK_Марка")
getParameterValueByName_4 = Element.GetParameterValueByName(element=types_2, parameterName=string_4)
flatten_5 = List.Flatten(list=getParameterValueByName_4)
setParameterByName_4 = Element.SetParameterByName(element=type_duplicates_2, parameterName=string_4, value=flatten_5)
string_5 = StringInput("Кол-во Верт импостов")
getParameterValueByName_5 = Element.GetParameterValueByName(element=types_2, parameterName=string_5)
flatten_6 = List.Flatten(list=getParameterValueByName_5)
setParameterByName_5 = Element.SetParameterByName(element=type_duplicates_2, parameterName=string_5, value=flatten_6)
string_6 = StringInput("Кол-во Гор импостов")
getParameterValueByName_6 = Element.GetParameterValueByName(element=types_2, parameterName=string_6)
flatten_7 = List.Flatten(list=getParameterValueByName_6)
setParameterByName_6 = Element.SetParameterByName(element=type_duplicates_2, parameterName=string_6, value=flatten_7)
string_7 = StringInput("Импост_Сторона")
getParameterValueByName_7 = Element.GetParameterValueByName(element=types_2, parameterName=string_7)
flatten_8 = List.Flatten(list=getParameterValueByName_7)
setParameterByName_7 = Element.SetParameterByName(element=type_duplicates_2, parameterName=string_7, value=flatten_8)
string_8 = StringInput("Рама_Ширина коробки_СлеваСправа")
getParameterValueByName_8 = Element.GetParameterValueByName(element=types_2, parameterName=string_8)
flatten_9 = List.Flatten(list=getParameterValueByName_8)
setParameterByName_8 = Element.SetParameterByName(element=type_duplicates_2, parameterName=string_8, value=flatten_9)
string_9 = StringInput("Полотно_Ширина рамы коробки")
getParameterValueByName_9 = Element.GetParameterValueByName(element=types_2, parameterName=string_9)
flatten_10 = List.Flatten(list=getParameterValueByName_9)
setParameterByName_9 = Element.SetParameterByName(element=type_duplicates_2, parameterName=string_9, value=flatten_10)
string_10 = StringInput("Рама_Заглубление по X")
getParameterValueByName_10 = Element.GetParameterValueByName(element=types_2, parameterName=string_10)
flatten_11 = List.Flatten(list=getParameterValueByName_10)
setParameterByName_10 = Element.SetParameterByName(element=type_duplicates_2, parameterName=string_10, value=flatten_11)

# group: 1ств
string_11 = StringInput("Открывание_Створка_Правое")
getParameterValueByName_11 = Element.GetParameterValueByName(element=types_2, parameterName=string_11)
flatten_12 = List.Flatten(list=getParameterValueByName_11)
setParameterByName_11 = Element.SetParameterByName(element=type_duplicates_2, parameterName=string_11, value=flatten_12)
string_12 = StringInput("Открывание_Створка_Левое")
getParameterValueByName_12 = Element.GetParameterValueByName(element=types_2, parameterName=string_12)
flatten_13 = List.Flatten(list=getParameterValueByName_12)
setParameterByName_12 = Element.SetParameterByName(element=type_duplicates_2, parameterName=string_12, value=flatten_13)

categories_2 = Categories("OST_Windows")
all_families_of_category_2 = Python(IN[0]=categories_2)  # IronPython2; same code as all_families_of_category
группирование_2 = Python(IN[0]=all_families_of_category_2)  # IronPython2
# ---------- группирование_2.python (15 lines) ----------
families = IN[0]

family_sketch = []
family_1casement = []
family_other = []

for family in families:
	if 'Окно_2ств_Эскиз' == family.Name:
		family_sketch.append(family)
	elif 'NIIPI_Окно_1Р_Стена_2ств' == family.Name:
		family_1casement.append(family)
	else:
		family_other.append(family)

OUT = family_sketch, family_1casement, family_other
# ----------------------------------------
code_block_7 = CodeBlock(a=группирование_2) { a[0]; }
types_3 = Family.Types(family=code_block_7)
flatten_14 = List.Flatten(list=types_3)
code_block_8 = CodeBlock { "Окно_2ств_Эскиз"; }
type_duplicates_3 = Python(IN[0]=flatten_14, IN[1]=code_block_8)  # IronPython2; same code as type_duplicates
code_block_9 = CodeBlock(a=type_duplicates_3) { a[0]; }
# note: Семейство 2ств
code_block_10 = CodeBlock(a=группирование_2) { a[1]; }
code_block_11 = CodeBlock(Fam=code_block_10) { Fam.Name; }
types_4 = Family.Types(family=code_block_10)
code_block_12 = CodeBlock(type=types_4) { type.Name; }
имена_семейств_эскизов_2 = Python(IN[0]=code_block_11, IN[1]=code_block_12)  # IronPython2; same code as имена_семейств_эскизов
count_2 = List.Count(list=имена_семейств_эскизов_2)
ofRepeatedItem_2 = List.OfRepeatedItem(item=code_block_9, amount=count_2)
type_duplicates_4 = Python(IN[0]=ofRepeatedItem_2, IN[1]=имена_семейств_эскизов_2)  # IronPython2; same code as type_duplicates_2
string_13 = StringInput("Фрамуга_Верт импосты")

# group: 2ств
string_14 = StringInput("Полотно1_Размер")
getParameterValueByName_13 = Element.GetParameterValueByName(element=types_4, parameterName=string_14)
flatten_15 = List.Flatten(list=getParameterValueByName_13)
setParameterByName_13 = Element.SetParameterByName(element=type_duplicates_4, parameterName=string_14, value=flatten_15)
string_15 = StringInput("Включить фрамугу")
getParameterValueByName_14 = Element.GetParameterValueByName(element=types_4, parameterName=string_15)
flatten_16 = List.Flatten(list=getParameterValueByName_14)
setParameterByName_14 = Element.SetParameterByName(element=type_duplicates_4, parameterName=string_15, value=flatten_16)
string_16 = StringInput("Фрамуга_Высота")
getParameterValueByName_15 = Element.GetParameterValueByName(element=types_4, parameterName=string_16)
flatten_17 = List.Flatten(list=getParameterValueByName_15)
setParameterByName_15 = Element.SetParameterByName(element=type_duplicates_4, parameterName=string_16, value=flatten_17)
string_17 = StringInput("Открывание створка 01_Правое")
getParameterValueByName_16 = Element.GetParameterValueByName(element=types_4, parameterName=string_17)
flatten_18 = List.Flatten(list=getParameterValueByName_16)
setParameterByName_16 = Element.SetParameterByName(element=type_duplicates_4, parameterName=string_17, value=flatten_18)
string_18 = StringInput("Открывание створка 01_Левое")
getParameterValueByName_17 = Element.GetParameterValueByName(element=types_4, parameterName=string_18)
flatten_19 = List.Flatten(list=getParameterValueByName_17)
setParameterByName_17 = Element.SetParameterByName(element=type_duplicates_4, parameterName=string_18, value=flatten_19)
string_19 = StringInput("Открывание створка 02_Правое")
getParameterValueByName_18 = Element.GetParameterValueByName(element=types_4, parameterName=string_19)
flatten_20 = List.Flatten(list=getParameterValueByName_18)
setParameterByName_18 = Element.SetParameterByName(element=type_duplicates_4, parameterName=string_19, value=flatten_20)
string_20 = StringInput("Открывание створка 02_Левое")
getParameterValueByName_19 = Element.GetParameterValueByName(element=types_4, parameterName=string_20)
flatten_21 = List.Flatten(list=getParameterValueByName_19)
setParameterByName_19 = Element.SetParameterByName(element=type_duplicates_4, parameterName=string_20, value=flatten_21)
getParameterValueByName_20 = Element.GetParameterValueByName(element=types_4, parameterName=string_13)
flatten_22 = List.Flatten(list=getParameterValueByName_20)
setParameterByName_20 = Element.SetParameterByName(element=type_duplicates_4, parameterName=string_13, value=flatten_22)
string_21 = StringInput("Фрамуга_Гор импосты")
getParameterValueByName_21 = Element.GetParameterValueByName(element=types_4, parameterName=string_21)
flatten_23 = List.Flatten(list=getParameterValueByName_21)
setParameterByName_21 = Element.SetParameterByName(element=type_duplicates_4, parameterName=string_21, value=flatten_23)

# group: Вход (уникальное имя легенды, на которой должен быть один компонент с видом спереди)
имя_легенды = StringInput("Легенда 1")  # graph input
параметр_типа_окон = StringInput("Описание")  # graph input
параметр_содержит = StringInput("Окно")  # graph input
тип_шрифта_для_маркировки = StringInput("ADSK_Основной текст_2.5")  # graph input

code_block_13 = CodeBlock(v=имя_легенды) { v; }
get_view_by_name = Python(IN[0]=code_block_13)  # IronPython2
# ---------- get_view_by_name.python (32 lines) ----------
#Script by cgartland
import clr
clr.AddReference("RevitServices")
from RevitServices.Persistence import DocumentManager
clr.AddReference("RevitAPI")
from Autodesk.Revit.DB import FilteredElementCollector, View


doc = DocumentManager.Instance.CurrentDBDocument

def tolist(obj1):
	if hasattr(obj1,"__iter__"): return obj1
	else: return [obj1]

names = tolist(IN[0])
outList = []

views = {}
views_all = FilteredElementCollector(doc).OfClass(View)
# Create a dictionary associating Names to Views
# e.g. {'3D View 1': View3D}
for view in views_all:
	if not view.IsTemplate:
		views[view.Name] = view

for name in names:
	for key in views.keys():
		if name in key:
			outList.append(views[name])


OUT = outList
# ----------------------------------------
все_legendcomponents_в_legend = Python(IN[0]=get_view_by_name)  # IronPython2
# ---------- все_legendcomponents_в_legend.python (29 lines) ----------
import clr

# Import DocumentManager and TransactionManager
clr.AddReference("RevitServices")
import RevitServices
from RevitServices.Persistence import DocumentManager


# Import RevitAPI
clr.AddReference("RevitAPI")
import Autodesk
from Autodesk.Revit.DB import FilteredElementCollector, BuiltInCategory, Options, FamilyInstanceReferenceType

doc = DocumentManager.Instance.CurrentDBDocument
#uiapp = DocumentManager.Instance.CurrentUIApplication
#app = uiapp.Application

#from System.Collections.Generic import *


#The inputs to this node will be stored as a list in the IN variable.
views = UnwrapElement(IN[0])
components = []

for v in views:
	components = FilteredElementCollector(doc,v.Id).OfCategory(BuiltInCategory.OST_LegendComponents).ToElements()


OUT = components
# ----------------------------------------
code_block_14 = CodeBlock(c=все_legendcomponents_в_legend) { c[0]; }
list_create = List.Create(item0=code_block_14)
categories_3 = Categories("OST_Windows")
all_elements_of_category = ElementsOfCategory(Category=categories_3)
code_block_15 = CodeBlock { "Тип"; }
getParameterValueByName_22 = Element.GetParameterValueByName(element=all_elements_of_category, parameterName=code_block_15)
getParameterValueByName_23 = Element.GetParameterValueByName(element=getParameterValueByName_22, parameterName=параметр_типа_окон)
code_block_16 = CodeBlock { true; }
contains = String.Contains(str=getParameterValueByName_23, searchFor=параметр_содержит, ignoreCase=code_block_16)
filterByBoolMask = List.FilterByBoolMask(list=getParameterValueByName_22, mask=contains)

# group: Сортировка и кол-во экземпляров
uniqueItems = List.UniqueItems(list=filterByBoolMask.in)
string_22 = StringInput("ADSK_Марка")
getParameterValueByName_24 = Element.GetParameterValueByName(element=uniqueItems, parameterName=string_22)
code_block_17 = CodeBlock { '-'; }
split = String.Split(str=getParameterValueByName_24, separator0=code_block_17)
lastItem = List.LastItem(list=split, lacing=Longest)
toNumber = String.ToNumber(str=lastItem)
sortByKey = List.SortByKey(list=uniqueItems, keys=toNumber)
sortByKey_2 = List.SortByKey(list=getParameterValueByName_24, keys=toNumber)
string_from_object = FromObject()  # unwired: object
groupByFunction = List.GroupByFunction(list=filterByBoolMask.in, groupFunction=string_from_object)
count_3 = List.Count(list=groupByFunction, lacing=Longest)
sortByKey_3 = List.SortByKey(list=count_3, keys=toNumber)

list_create_2 = List.Create(item0=type_duplicates_2, item1=type_duplicates_4)
flatten_24 = List.Flatten(list=list_create_2)

# group: Замена типов на эскизы
family = FamilyType.Family(familyType=sortByKey.sortedList)
code_block_18 = CodeBlock(Fam=family) { Fam.Name; }
code_block_19 = CodeBlock(type=flatten_24) { type.Name; }
replace_types = Python(IN[0]=code_block_18, IN[1]=sortByKey.sortedList, IN[2]=flatten_24, IN[3]=code_block_19)  # IronPython2
# ---------- replace_types.python (19 lines) ----------
fam_names = IN[0]
fam_types = IN[1]
sketch_types = IN[2]
sketch_type_names = IN[3]

fam_and_type_names = []

for i, type in enumerate(fam_types):
	fam_and_type_names.append(fam_names[i] + '-' + type.Name)

out = []
for fam_and_type, fam_type in zip(fam_and_type_names, fam_types):
	for i, sketch_type_name in enumerate(sketch_type_names):
		if fam_and_type == sketch_type_name:
			fam_type = sketch_types[i]
			break
	out.append(fam_type)

OUT = out
# ----------------------------------------
группирование_3 = Python(IN[0]=code_block_18)  # IronPython2
# ---------- группирование_3.python (11 lines) ----------
family_strings = IN[0]

filter_mask = []

for name in family_strings:
	if 'NIIPI_Окно_1Р_Стена_1ств' == name or 'NIIPI_Окно_1Р_Стена_2ств' == name:
		filter_mask.append(True)
	else:
		filter_mask.append(False)

OUT = filter_mask
# ----------------------------------------

# group: Смещение по X
XAxis = Vector.XAxis()
code_block_20 = CodeBlock { "Ширина"; }
getParameterValueByName_25 = Element.GetParameterValueByName(element=replace_types, parameterName=code_block_20)
python_script = Python(IN[0]=getParameterValueByName_25)  # IronPython2
# ---------- python_script.python (12 lines) ----------
data = IN[0]
out = [0]
sum = 0
for i in range(len(data)-1):
	if data[i] and data[i+1]:
		a = data[i]/2 + data[i+1]/2 + 1200
	else:
		a = 3000
	sum += a
	out.append(sum)

OUT = out
# ----------------------------------------
scale = Vector.Scale(vector=XAxis, scale_factor=python_script)

# group: смещение по Y
YAxis = Vector.YAxis()
boundingBox = Element.BoundingBox(element=replace_types)
maxPoint = BoundingBox.MaxPoint(boundingBox=boundingBox)
X = Point.X(point=maxPoint)
minPoint = BoundingBox.MinPoint(boundingBox=boundingBox)
X_2 = Point.X(point=minPoint)
Y = Point.Y(point=maxPoint)
Y_2 = Point.Y(point=minPoint)
Z = Point.Z(point=maxPoint)
Z_2 = Point.Z(point=minPoint)
code_block_21 = CodeBlock(maxX=X, minX=X_2, maxY=Y, minY=Y_2, maxZ=Z, minZ=Z_2)
# ---------- code_block_21.designscript (6 lines) ----------
// Width
maxX - minX;
// Depth
maxY - minY;
// Height
maxZ - minZ;
# ----------------------------------------
code_block_22 = CodeBlock(Depth=code_block_21.out1) { Depth; }
code_block_23 = CodeBlock(Height=code_block_21.out2) { Height; }
if_ = If(test=группирование_3, true=code_block_22, false=code_block_23)
code_block_24 = CodeBlock { 2; }
div = if_ / code_block_24  # lacing=Longest
maximumItem = List.MaximumItem(list=div)
sub = maximumItem - div
scale_2 = Vector.Scale(vector=YAxis, scale_factor=sub)
maximumItem_2 = List.MaximumItem(list=sub)
code_block_25 = CodeBlock(Width=code_block_21.out0) { Width; }

add = Vector.Add(vector=scale, vectorToAdd=scale_2, lacing=Longest)

# group: Копирование элементов и задание типа
asPoint = Vector.AsPoint(vector=add)
python_script_2 = Python(IN[0]=list_create, IN[1]=asPoint)  # IronPython2
# ---------- python_script_2.python (40 lines) ----------
import clr
from System.Collections.Generic import *
clr.AddReference('RevitAPI')
from Autodesk.Revit.DB import *
import Autodesk

clr.AddReference("RevitNodes")
import Revit
clr.ImportExtensions(Revit.Elements)
clr.ImportExtensions(Revit.GeometryConversion)

clr.AddReference("RevitServices")
import RevitServices
from RevitServices.Persistence import DocumentManager
from RevitServices.Transactions import TransactionManager

doc = DocumentManager.Instance.CurrentDBDocument
items = UnwrapElement(IN[0])
points = UnwrapElement(IN[1])
xyzs = []
for point in points:
	xyzs.append(point.ToXyz())

ids = list()
for item in items:
	ids.append(item.Id)	
itemlist = List[ElementId](ids)

TransactionManager.Instance.EnsureInTransaction(doc)
newitems = []
for xyz in xyzs:
	newitems.append(ElementTransformUtils.CopyElements(doc,itemlist,xyz)[0])
TransactionManager.Instance.TransactionTaskDone()


elementlist = list()
for item in newitems:
	elementlist.append(doc.GetElement(item).ToDSType(False))

OUT = elementlist, IN[0]
# ----------------------------------------
code_block_26 = CodeBlock(el=python_script_2) { el[1]; }
delete = Element.Delete(element=code_block_26)
code_block_27 = CodeBlock(el=python_script_2) { el[0]; }
code_block_28 = CodeBlock { "Тип компонента"; }
setParameterByName_22 = Element.SetParameterByName(element=code_block_27, parameterName=code_block_28, value=replace_types)
filterByBoolMask_2 = List.FilterByBoolMask(list=setParameterByName_22, mask=группирование_3)
code_block_29 = CodeBlock { "Направление взгляда"; }
code_block_30 = CodeBlock { -7; }
setParameterByName_23 = Element.SetParameterByName(element=filterByBoolMask_2.out, parameterName=code_block_29, value=code_block_30)
code_block_31 = CodeBlock { "Направление взгляда"; }
code_block_32 = CodeBlock { -8; }
setParameterByName_24 = Element.SetParameterByName(element=filterByBoolMask_2.in, parameterName=code_block_31, value=code_block_32)

list_create_3 = List.Create(item0=types_2, item1=types_4)
list_create_4 = List.Create(item0=type_duplicates_2, item1=type_duplicates_4)
string_23 = StringInput("""Высота
Ширина
Монтажный зазор
ADSK_Марка
Кол-во Верт импостов
Кол-во Гор импостов
Импост_Сторона
Открывание_Створка_Правое
Открывание_Створка_Левое
Полотно1_Размер
Включить фрамугу
Фрамуга_Высота
Открывание створка 01_Правое
Открывание створка 01_Левое
Открывание створка 02_Правое
Открывание створка 02_Левое
Рама_Ширина коробки_СлеваСправа
Полотно_Ширина рамы коробки
Рама_Заглубление по X
Фрамуга_Гор импосты
Фрамуга_Верт импосты""")
code_block_33 = CodeBlock { "\n"; }
split_2 = String.Split(str=string_23, separator0=code_block_33)

# group: общие
string_24 = StringInput("Ширина")
getParameterValueByName_26 = Element.GetParameterValueByName(element=types_4, parameterName=string_24)
flatten_25 = List.Flatten(list=getParameterValueByName_26)
setParameterByName_25 = Element.SetParameterByName(element=type_duplicates_4, parameterName=string_24, value=flatten_25)
string_25 = StringInput("Монтажный зазор")
getParameterValueByName_27 = Element.GetParameterValueByName(element=types_4, parameterName=string_25)
flatten_26 = List.Flatten(list=getParameterValueByName_27)
setParameterByName_26 = Element.SetParameterByName(element=type_duplicates_4, parameterName=string_25, value=flatten_26)
string_26 = StringInput("ADSK_Марка")
getParameterValueByName_28 = Element.GetParameterValueByName(element=types_4, parameterName=string_26)
flatten_27 = List.Flatten(list=getParameterValueByName_28)
setParameterByName_27 = Element.SetParameterByName(element=type_duplicates_4, parameterName=string_26, value=flatten_27)
string_27 = StringInput("Высота")
getParameterValueByName_29 = Element.GetParameterValueByName(element=types_4, parameterName=string_27)
flatten_28 = List.Flatten(list=getParameterValueByName_29)
setParameterByName_28 = Element.SetParameterByName(element=type_duplicates_4, parameterName=string_27, value=flatten_28)
string_28 = StringInput("Кол-во Верт импостов")
getParameterValueByName_30 = Element.GetParameterValueByName(element=types_4, parameterName=string_28)
flatten_29 = List.Flatten(list=getParameterValueByName_30)
setParameterByName_29 = Element.SetParameterByName(element=type_duplicates_4, parameterName=string_28, value=flatten_29)
string_29 = StringInput("Кол-во Гор импостов")
getParameterValueByName_31 = Element.GetParameterValueByName(element=types_4, parameterName=string_29)
flatten_30 = List.Flatten(list=getParameterValueByName_31)
setParameterByName_30 = Element.SetParameterByName(element=type_duplicates_4, parameterName=string_29, value=flatten_30)
string_30 = StringInput("Импост_Сторона")
getParameterValueByName_32 = Element.GetParameterValueByName(element=types_4, parameterName=string_30)
flatten_31 = List.Flatten(list=getParameterValueByName_32)
setParameterByName_31 = Element.SetParameterByName(element=type_duplicates_4, parameterName=string_30, value=flatten_31)
string_31 = StringInput("Рама_Ширина коробки_СлеваСправа")
getParameterValueByName_33 = Element.GetParameterValueByName(element=types_4, parameterName=string_31)
flatten_32 = List.Flatten(list=getParameterValueByName_33)
setParameterByName_32 = Element.SetParameterByName(element=type_duplicates_4, parameterName=string_31, value=flatten_32)
string_32 = StringInput("Полотно_Ширина рамы коробки")
getParameterValueByName_34 = Element.GetParameterValueByName(element=types_4, parameterName=string_32)
flatten_33 = List.Flatten(list=getParameterValueByName_34)
setParameterByName_33 = Element.SetParameterByName(element=type_duplicates_4, parameterName=string_32, value=flatten_33)
string_33 = StringInput("Рама_Заглубление по X")
getParameterValueByName_35 = Element.GetParameterValueByName(element=types_4, parameterName=string_33)
flatten_34 = List.Flatten(list=getParameterValueByName_35)
setParameterByName_34 = Element.SetParameterByName(element=type_duplicates_4, parameterName=string_33, value=flatten_34)

string_from_object_2 = FromObject(object=sortByKey_3.sortedList)
python_script_3 = Python(IN[0]=sortByKey_2.sortedList, IN[1]=string_from_object_2)  # IronPython2
# ---------- python_script_3.python (7 lines) ----------
mark = IN[0]
count = IN[1]

out = []
for i in range(len(mark)):
	out.append('{} ({} шт.)'.format(mark[i], count[i]))
OUT = out
# ----------------------------------------

# group: Размещение марок
python_script_4 = Python(IN[0]=code_block_14, IN[1]=get_view_by_name)  # IronPython2
# ---------- python_script_4.python (4 lines) ----------
el = IN[0]


OUT = el.BoundingBox
# ----------------------------------------
minPoint_2 = BoundingBox.MinPoint(boundingBox=python_script_4)
maxPoint_2 = BoundingBox.MaxPoint(boundingBox=python_script_4)
code_block_34 = CodeBlock(p1=minPoint_2, p2=maxPoint_2) { p1.X+(p2.X-p1.X)/2; }
code_block_35 = CodeBlock(p=maxPoint_2, m=maximumItem_2) { p.Y+m; }
byCoordinates = Vector.ByCoordinates(x=code_block_34, y=code_block_35)
add_2 = Vector.Add(vector=byCoordinates, vectorToAdd=scale, lacing=Longest)
asPoint_2 = Vector.AsPoint(vector=add_2)
byName = TextNoteType.ByName(name=тип_шрифта_для_маркировки)
code_block_36 = CodeBlock { 0.2; }
python_script_4_2 = Python(IN[2]=get_view_by_name, IN[3]=asPoint_2, IN[4]=python_script_3, IN[5]=byName, IN[6]=code_block_36)  # IronPython2; unwired: IN[0], IN[1]
# ---------- python_script_4_2.python (60 lines) ----------
#Copyright(c) 2018, Ildar Kachurin
# ildar.kachurin@gmail.com
# YouTube Chanel: https://www.youtube.com/channel/UCB65mpqQH_rlNTs0MsCw2Lw?view_as=subscriber

import clr
clr.AddReference('RevitAPI')
import Autodesk
from Autodesk.Revit.DB import*
from Autodesk.Revit.DB.Structure import*

from System.Collections.Generic import*

import System
clr.AddReference('System.Core')
clr.ImportExtensions(System.Linq)

import math

clr.AddReference('ProtoGeometry')
from Autodesk.DesignScript.Geometry import*

clr.AddReference("RevitNodes")
import Revit
clr.ImportExtensions(Revit.Elements)
clr.ImportExtensions(Revit.GeometryConversion)

clr.AddReference("RevitServices")
import RevitServices
from RevitServices.Persistence import DocumentManager
from RevitServices.Transactions import TransactionManager

doc = DocumentManager.Instance.CurrentDBDocument

TransactionManager.Instance.EnsureInTransaction(doc)

view = UnwrapElement(IN[2])
points = UnwrapElement(IN[3])
string = IN[4]
typeText = UnwrapElement(IN[5])
width = IN[6]
xyzlist = []


for point in points:
	xyz = point.ToXyz()
	xyzlist.append(xyz)
	
opts = TextNoteOptions(typeText.Id)
opts.HorizontalAlignment = HorizontalTextAlignment.Center

i=0
while i<points.Count:
	newText = TextNote.Create(doc, view[0].Id, xyzlist[i], width, string[i], opts)
	i=i+1
	
		
TransactionManager.Instance.TransactionTaskDone()


OUT = IN[4]
# ----------------------------------------

code_block_37 = CodeBlock(a=type_duplicates) { a[1]; }
delete_2 = Element.Delete(element=code_block_37, lacing=Longest)
code_block_38 = CodeBlock(a=type_duplicates_3) { a[1]; }
delete_3 = Element.Delete(element=code_block_38, lacing=Longest)
