# Dynamo graph Замена двойных кавычек на одинарные в осях.dyn (Dynamo 2.12.0.5650)

categories = Categories("OST_Grids")
all_elements_of_category = ElementsOfCategory(Category=categories)
string = StringInput("Имя")
code_block = CodeBlock(a=all_elements_of_category) { a.Name; }
python_script = Python(IN[0]=code_block)  # IronPython2
# ---------- python_script.python (21 lines) ----------
# Загрузить стандартную библиотеку Python и библиотеку DesignScript
import sys
import clr
clr.AddReference('ProtoGeometry')
from Autodesk.DesignScript.Geometry import *

# Введенные в этом узле данные сохраняется в виде списка в переменных IN.
name = UnwrapElement(IN[0])
a = []
for i in name:
	if '"' in i:
		m = i.replace('"',"'")
		a.append(m)
	else:
		a.append(i)


# Разместите код под этой строкой

# Назначьте вывод переменной OUT.
OUT = a
# ----------------------------------------
setParameterByName = Element.SetParameterByName(element=all_elements_of_category, parameterName=string, value=python_script)
