# Dynamo graph Коорд_Проверка осей.dyn (Dynamo 2.12.0.5650)

string = StringInput("Оси")
byName = Category.ByName(name=string)
all_elements_of_category = ElementsOfCategory(Category=byName)
string_2 = StringInput("Имя")
getParameterValueByName = Element.GetParameterValueByName(element=all_elements_of_category, parameterName=string_2)
curve = Grid.Curve(grid=all_elements_of_category)
byKeysValues = DesignScript.Builtin.Dictionary.ByKeysValues(keys=getParameterValueByName, values=curve)
python_script = Python(IN[0]=curve, IN[1]=getParameterValueByName)  # IronPython2
# ---------- python_script.python (23 lines) ----------
# Загрузить стандартную библиотеку Python и библиотеку DesignScript
import sys
import clr
clr.AddReference('ProtoGeometry')
from Autodesk.DesignScript.Geometry import *

# Введенные в этом узле данные сохраняется в виде списка в переменных IN.
grid_curves = UnwrapElement(IN[0])
grids_name = UnwrapElement(IN[1])

vert, hor = [], []

for i in range(len(grid_curves)):
	if round(grid_curves[i].StartPoint.X,4) == round(grid_curves[i].EndPoint.X,4):
		vert.append([grid_curves[i].StartPoint.X,grids_name[i]])
for j in range(len(grid_curves)):	
	if round(grid_curves[j].StartPoint.Y,4) == round(grid_curves[j].EndPoint.Y,4):
		hor.append([grid_curves[j].StartPoint.Y,grids_name[j]])	

# Разместите код под этой строкой

# Назначьте вывод переменной OUT.
OUT = hor,vert
# ----------------------------------------
code_block = CodeBlock(a=python_script) { a[0]; a[1]; }
code_block_2 = CodeBlock(a=code_block.out1) { a; }
code_block_3 = CodeBlock { 1; }
getItemAtIndex = List.GetItemAtIndex(list=code_block_2@L2, index=code_block_3)
sortByKey = List.SortByKey(list=code_block_2, keys=getItemAtIndex)
code_block_4 = CodeBlock(a=code_block.out0) { a; }
code_block_5 = CodeBlock { 1; }
getItemAtIndex_2 = List.GetItemAtIndex(list=code_block_4@L2, index=code_block_5)
sortByKey_2 = List.SortByKey(list=code_block_4, keys=getItemAtIndex_2)
openXMLImportExcel = Data.OpenXMLImportExcel()  # unwired: filePath, sheetName
