# Dynamo graph IFC_Correct_Civil3D.dyn (Dynamo 2.14.0.4641)

string = StringInput("\\st1\otz\14 КСК\КСК ШАБЛОН\03_BIM модель\IFC\00_test\CVL")
directory_from_path = DirectoryObject(path=string)
getDirectoryContents = FileSystem.GetDirectoryContents(directory=directory_from_path)
readText = FileSystem.ReadText(file=getDirectoryContents.files)
X = CodeBlock { 2170978.239; }
Y = CodeBlock { 468586.0236; }
Z = CodeBlock { 8888; }
python_script = Python(IN[0]=readText, IN[1]=X, IN[2]=Y, IN[3]=Z, IN[4]=getDirectoryContents.files)  # CPython3
# ---------- python_script.python (55 lines) ----------
# Загрузить стандартную библиотеку Python и библиотеку DesignScript
import sys
import clr
clr.AddReference('ProtoGeometry')
from Autodesk.DesignScript.Geometry import *

# Исходные данные
ifclist = IN[0]
dx,dy,dz = IN[1],IN[2],IN[3]
paths = IN[4]
cnt = 0

for ifc in ifclist:
	spl_ifc = ifc.split(";")
	
	name = paths[cnt][paths[cnt].rfind('\\'):paths[cnt].rfind('.')]
	paths[cnt] = paths[cnt][:paths[cnt].rfind('\\')+1]
	
	with open(paths[cnt] + "_" + str(cnt) + ".ifc", 'w') as f:
		for i in spl_ifc:
			i.strip()
			if len(i) > 5:
				f.write(i.replace("\n","") + ";")
	cnt += 1




#ща буим искать ifccartesianpoint)))))
cnt = 0
lst_str = []

OUT = 0

"""
for i in spl_ifc:
    t_str1, t_str2 = "",""
    t_lst1 = []
    if "IFCCARTESIANPOINT" in i:
        i1, i2 = i.find("(("), i.find("))")
        t_str1 = i[i1+2:i2]
        if t_str1[0] != 0 and t_str1[0] != "0":
        t_lst1 = t_str1.split(",")
        t_lst1[0] = round((float(t_lst1[0]) - avgX),3)
        t_lst1[1] = round((float(t_lst1[1]) - avgY),3)
        t_lst1[2] = round((float(t_lst1[2])),3)
        t_str1 = str(t_lst1[0]) + "," + str(t_lst1[1]) + "," + str(t_lst1[2]) + "));"
        i = "\n" + i[:i1+2] + t_str1 + "\n"

        lst_str.append(i)



OUT = lst_str
"""
# ----------------------------------------
string_2 = StringInput("_DF")
python_script_2 = Python(IN[2]=string_2)  # IronPython2; frozen; unwired: IN[0], IN[1]
# ---------- python_script_2.python (12 lines) ----------
data = IN[0]
path = IN[1]
prefix = IN[2]

name = path[path.rfind('\\'):path.rfind('.')]
path = path[:path.rfind('\\')+1]


with open(path + name + prefix + ".ifc", 'w') as f:
	f.write(data[0])

OUT = name
# ----------------------------------------
string_3 = StringInput("""#10= IFCCARTESIANPOINT((0.,0.,0.))
#14= IFCDIRECTION((1.,0.,0.))""")
code_block = CodeBlock { ""; }
split = String.Split(string=string_3, separator0=code_block)
type = Object.Type(object=split)
split_2 = String.Split()  # unwired: string, separator0
