# Dynamo graph IFC_Correct_Revit.dyn (Dynamo 2.12.0.5650)

путь_к_ifc = Filename("..\..\..\..\14 КСК\КСК ШАБЛОН\03_BIM модель\IFC\02_Edited\АР-КР_КСК_Корпус1.ifc")
file_from_path = FileObject(path=путь_к_ifc)
readText = FileSystem.ReadText(file=file_from_path)
X = CodeBlock { -2170978239; }
Y = CodeBlock { -468586024; }
Z = CodeBlock { 0; }
suffix = StringInput("_FCKD")
python_script = Python(IN[0]=readText, IN[1]=X, IN[2]=Y, IN[3]=Z, IN[4]=путь_к_ifc, IN[5]=suffix)  # CPython3
# ---------- python_script.python (122 lines) ----------
# Загрузить стандартную библиотеку Python и библиотеку DesignScript
import sys
import clr
import re
clr.AddReference('ProtoGeometry')
from Autodesk.DesignScript.Geometry import *


def findind(split_txt, fstr):
        ind = 0
        if fstr == "":
                fstr = "IFCSITE"
        for i in range(len(split_txt)):
                if fstr in split_txt[i]:
                        ind = i
                        ind_i = split_txt[i]
                        break
        return ind,ind_i

def findindv2(split_txt, fstr):
        ind = 0
        ind_i = ""
        if fstr == "":
                fstr = "IFCSITE"
        for i in range(len(split_txt)):
                if fstr in split_txt[i][:5]:
                        ind = i
                        ind_i = split_txt[i]
                        break
        return ind,ind_i

def findstr(split_txt, ind, ind_i):
        n_str2 = ""
        temp_ind = ind_i.find("#",(1 + ind_i.find("#",1)))
        n_str = ind_i[temp_ind:temp_ind+6]
        for ns in range(1, len(n_str)):
                if n_str[ns].isdigit() == True:
                        n_str2 += n_str[ns]
        n_str2 = "#" + n_str2
        return n_str2

#Временные строчки

ind1,ind2,ind3 = 0, 0, 0
ind1_i,ind2_i,ind3_i = "","",""
n_str1, n_str2, n_str21, n_str3, n_str41, n_str42, n_str43 = "","","","","","", ""
n_str4_lst = []
finalIFC = ""

ifc = IN[0]
dX, dY, dZ = IN[1], IN[2], IN[3]
path,suffix = IN[4], IN[5]
split_txt = ifc.split("\n")

#ПЕРВЫЙ ПРОГОН

g1 = findind(split_txt, "")
ind1 = g1[0]
g12 = findstr(split_txt, g1[0], g1[1])

#ВТОРОЙ ПРОГОН
g2 = findindv2(split_txt, g12)
ind2 = g2[0]
n_str2 = g2[1][6:]
ind2_i = n_str2.find("#")
n_str2 = n_str2[ind2_i:]

for j in n_str2:
        if j.isdigit() == True:
                n_str21 += j

n_str21 = "#" + n_str21


#ТРЕТИЙ ПРОГОН
g3 = findindv2(split_txt, n_str21)
ind3 = g3[0]
n_str3 = g3[1][6:]

ind3_i = n_str3.find("#")
ind3_i_zpt = n_str3.find(",")
n_str3 = n_str3[ind3_i:ind3_i_zpt]


#ЧЕТВЕРТЫЙ ПРОГОН
g4 = findindv2(split_txt, n_str3)
ind4 = g4[0]
ind41_i = g4[1].find("((")
ind42_i = g4[1].find("))")

n_str4 = g4[1][ind41_i+2:ind42_i]
n_str4 = n_str4.split(",")

for w in n_str4:
        w = float(w[:-1])
        w = round(w)
        n_str4_lst.append(w)

#Прибавляем координаты. Если надо вычесть - то подаем со знаком минус

n_str4_lst[0] = n_str4_lst[0] + dX
n_str4_lst[1] = n_str4_lst[1] + dY
n_str4_lst[2] = n_str4_lst[2] + dZ

for ww in n_str4_lst:
    n_str41 = str(ww) + ","
    n_str42 = n_str41.replace(".0",".")
    n_str43 += n_str42

n_str43 = "((" + n_str43[:-1] + "))" + "\n"

split_txt[ind4] = g4[1][:ind41_i] + n_str43

finalIFC = "".join(split_txt)
   
# Выводим в новый файл ifc

name = path[path.rfind('\\'):path.rfind('.')]
path = path[:path.rfind('\\')+1]

with open(path + name + suffix + ".ifc", 'w') as f:
	f.write(finalIFC)
# ----------------------------------------
