# Dynamo graph IFC_Correct_Revit_v2.dyn (Dynamo 2.14.0.4641)

string = StringInput("\\st1\otz\14 КСК\КСК ШАБЛОН\03_BIM модель\IFC\02_Edited")
directory_from_path = DirectoryObject(path=string)
getDirectoryContents = FileSystem.GetDirectoryContents(directory=directory_from_path)
readText = FileSystem.ReadText(file=getDirectoryContents.files)
X = CodeBlock { -1000; }
Y = CodeBlock { -1000; }
Z = CodeBlock { 8888; }
python_script = Python(IN[0]=readText, IN[1]=X, IN[2]=Y, IN[3]=Z, IN[4]=getDirectoryContents.files)  # CPython3
# ---------- python_script.python (134 lines) ----------
# Загрузить стандартную библиотеку Python и библиотеку DesignScript
import sys

import re
import clr
clr.AddReference('ProtoGeometry')
from Autodesk.DesignScript.Geometry import *

# Исходные данные
ifclist = IN[0]
dx,dy,dz = IN[1],IN[2],IN[3]
paths = IN[4]


## Прочие
ind1,ind2,ind3 = 0,0,0
lst1,lst2,lst3,lst4,lst5 = [],[],[],[],[]
cnt_paths = 0


for ifc in ifclist:

# Временные переменные
## Индексы
    ifcsite,ifclcpl,ifcaxis,ifccartpnt = 0,0,0,0
    coords, new_coords = [],[]
    cnt1,cnt2,cnt3 = 0,0,0
    sharp1,sharp2,sharp3 = "#","#","#"
    


#Первая итерация - делим построчно и ищем IFCSITE.
#Не \n!!! А точка с запятой. Это надежнее.

    sep = ";"
    spltxt = ifc.split(sep)
    for sp1l in range(len(spltxt)):
        if "IFCSITE" in spltxt[sp1l]:    
            ifcsite = sp1l
            break
    
#Первая итерация - ищем первую решетку в IFCSITE

    for iter1 in re.finditer("#", spltxt[ifcsite]):
        cnt1 += 1
        if cnt1 == 3:
            ind1 = iter1.start()
            for iiter1 in range(1,len(spltxt[ifcsite][ind1:ind1+6])):
                if spltxt[ifcsite][ind1:ind1+6][iiter1].isdigit() == True:
                    sharp1 += spltxt[ifcsite][ind1:ind1+6][iiter1]
                else:
                    break
            lst1.append((ifcsite,sharp1))
  
#Вторая итерация - ищем нужный IFCLOCALPLACEMENT. spltxt[sp2l][1:] - почему единица?
#Потому что на 0 индексе стоит \n и он мешает работать корректно методу .startswith()

    for sp2l in range(len(spltxt)):
        if spltxt[sp2l][1:].startswith(sharp1):    
            ifclcpl = sp2l
            break
        
#Вторая итерация - ищем первую решетку

    for iter2 in re.finditer("#", spltxt[ifclcpl]):
        cnt2 += 1
        if cnt2 == 2:
            ind2 = iter2.start()
            for iiter2 in range(1,len(spltxt[ifclcpl][ind2:ind2+6])):
                if spltxt[ifclcpl][ind2:ind2+6][iiter2].isdigit() == True:
                    sharp2 += spltxt[ifclcpl][ind2:ind2+6][iiter2]
                else:
                    break
            lst2.append((ifclcpl,sharp2))
            
#Третья итерация - ищем нужный IFCAXIS2PLACEMENT3D

    for sp3l in range(0,len(spltxt)):
        if spltxt[sp3l][1:].startswith(sharp2):    
            ifcaxis = sp3l
            break
        
#Третья итерация - ищем первую решетку

    for iter3 in re.finditer("#", spltxt[ifcaxis]):
        cnt3 += 1
        if cnt3 == 2:
            ind3 = iter3.start()
            for iiter3 in range(1,len(spltxt[ifcaxis][ind3:ind3+6])):
                if spltxt[ifcaxis][ind3:ind3+6][iiter3].isdigit() == True:
                    sharp3 += spltxt[ifcaxis][ind3:ind3+6][iiter3]
                else:
                    break
            lst3.append((ifcaxis,sharp3))
            
#Четвертая итерация - ищем нужный IFCCARTESIANPOINT

    for sp4l in range(0,len(spltxt)):
        if spltxt[sp4l][1:].startswith(sharp3):    
            ifccartpnt = sp4l
            break
    skb1 = spltxt[ifccartpnt].find("((")+2
    skb2 = spltxt[ifccartpnt].find("))")
    coords_un = spltxt[ifccartpnt][skb1:skb2]
    coords = coords_un.split(",")
    

#Проверка на количество цифр в разбитой строке

    if len(coords) != 3:
        continue
    else:
        coordXnew = str(float(coords[0]) + dx)
        coordYnew = str(float(coords[1]) + dy)
        coordZnew = str(float(coords[2]) + dz)
        spltxt[ifccartpnt] = sharp3 + "=IFCCARTESIANPOINT((" + coordXnew + "," + coordYnew + "," + coordZnew + "));" + "\n"
        ifc_new = ";".join(spltxt)
        
        onePath = paths[cnt_paths]
        name = onePath[onePath.rfind('\\')+1:onePath.rfind('.')]
        newPath = onePath[:onePath.rfind('\\')+1]
        
        with open(newPath + name + ".ifc", 'w') as f:
            f.write(ifc_new)
        
        lst4.append(newPath + name)
         
        
        cnt_paths += 1
        
    
    
OUT = lst4
        
# ----------------------------------------
