# Dynamo graph Other_Все РН из линков.dyn (Dynamo 2.12.1.8246)
# packages: archi-lab.net 2022.212.3222, Crumple 2022.5.27

getDocuments = archilab.Revit.Selection.Select.GetDocuments()
code_block = CodeBlock(a=getDocuments.Link_Name) { a; }
фильтруем_аркркм = Python(IN[0]=getDocuments.Link_Path)  # IronPython2
# ---------- фильтруем_аркркм.python (15 lines) ----------
# Загрузить стандартную библиотеку Python и библиотеку DesignScript
import sys
import clr
clr.AddReference('ProtoGeometry')
from Autodesk.DesignScript.Geometry import *

# Введенные в этом узле данные сохраняется в виде списка в переменных IN.
paths = IN[0]
name_filter = []
 
for i in paths:
	ii = i[i.rfind("\\")+1:i.rfind(".rvt")]
	if "АР" in ii or "КР" in ii or 'КМ' in ii:
		name_filter.append(ii)
OUT = name_filter
# ----------------------------------------
contains = String.Contains(string=code_block, searchFor=фильтруем_аркркм, lacing=Longest)
filterByBoolMask = List.FilterByBoolMask(list=getDocuments.Link_Doc, mask=contains)
collect_worksets = Custom[© Collect.Worksets](docOrLink=filterByBoolMask.in, lacing=Longest)  # package Crumple; Returns all user worksets and their names in a document.
python_script = Python(IN[0]=collect_worksets.names)  # IronPython2
# ---------- python_script.python (21 lines) ----------
# Загрузить стандартную библиотеку Python и библиотеку DesignScript
import sys
import clr
clr.AddReference('ProtoGeometry')
from Autodesk.DesignScript.Geometry import *

# Введенные в этом узле данные сохраняется в виде списка в переменных IN.
nms = IN[0]
new_nms = []
new_nms_unique = []

for i in nms:
	if len(i) > 1:
		for n in i:
			new_nms.append(n)
	elif len(i) == 1:
		i.append(n)
	else:
		continue

OUT = new_nms
# ----------------------------------------
uniqueItems = List.UniqueItems(list=python_script)
writeText = FileSystem.WriteText()  # unwired: filePath, text
file_path = Filename("..\..\..\..\14 КСК\КСК ШАБЛОН\03_BIM модель\Revit\000_КРД\КРД_КСК_РН.xlsx")
string = StringInput("Лист1")
filterByBoolMask_2 = List.FilterByBoolMask(list=getDocuments.Link_Name, mask=contains)
code_block_2 = CodeBlock(a=collect_worksets.names) { a; }
count = List.Count(list=code_block_2@L2)
cycle = List.Cycle(list=filterByBoolMask_2.in@L1, amount=count@L1)
flatten = List.Flatten(list=cycle)
string_from_object = FromObject(object=flatten)
flatten_2 = List.Flatten(list=code_block_2)
code_block_3 = CodeBlock(a=string_from_object, b=flatten_2) { [a,b]; }
transpose = List.Transpose(lists=code_block_3)
boolean = BoolSelector(true)
openXMLExportExcel = Data.OpenXMLExportExcel(filePath=file_path, sheetName=string, data=transpose, overWrite=boolean, writeAsString=boolean)
