# Dynamo graph Other_Создание параметров из Excel.dyn (Dynamo 2.12.0.5650)
# packages: Orchid 212.1.0.8182

o_document_current = Orchid.RevitProject.Common.Document.Current()
file_path = Filename("M:\BIM\Revit\00_Семейства\00_NIIPI\АР\Прочее\Список параметров для прмч.xlsx")  # graph input
file_from_path = FileObject(path=file_path)
string = StringInput("Лист1")  # graph input
importExcel = Data.ImportExcel(file=file_from_path, sheetName=string)
code_block = CodeBlock { 1; }
dropItems = List.DropItems(list=importExcel, amount=code_block)
code_block_2 = CodeBlock { 0; }
getItemAtIndex = List.GetItemAtIndex(list=dropItems@L2, index=code_block_2)
code_block_3 = CodeBlock { 1; }
getItemAtIndex_2 = List.GetItemAtIndex(list=dropItems@L2, index=code_block_3)
code_block_4 = CodeBlock { 2; }
getItemAtIndex_3 = List.GetItemAtIndex(list=dropItems@L2, index=code_block_4)
boolean = BoolSelector(true)
o_parameter_create = Orchid.RevitFamily.Parameter.Create(familyDocument=o_document_current, parameterName=getItemAtIndex, category=getItemAtIndex_2, group=getItemAtIndex_3, instance=boolean, lacing=Longest)
o_parameter_reorder = Orchid.RevitFamily.Parameter.Reorder(familyDocument=o_document_current, parameters=o_parameter_create)  # graph output
code_block_5 = CodeBlock { []; }
o_familytype_all = Orchid.RevitFamily.FamilyType.All()
code_block_6 = CodeBlock()
# ---------- code_block_6.designscript (2 lines) ----------
["Тип 1","Тип 2","Тип 3","Тип 4","Бетонная перемычка","Опора слева","Опора справа","Ширина проёма","Толщина стены"];
[0,0,0,0,false,100,100,100,100];
# ----------------------------------------
code_block_7 = CodeBlock(a=o_parameter_create) { a.Name; }
setIntersection = List.SetIntersection(list1=code_block_6.out0, list2=code_block_7)
o_parameter_setvalue = Orchid.RevitFamily.Parameter.SetValue(familyDocument=o_document_current, familyType=o_familytype_all, parameterName=setIntersection, value=code_block_6.out1)
