# Dynamo graph МистерПропер.dyn (Dynamo 2.0.2.6826)

select_model_element = DSModelElementSelection()  # 1 picked in the model
getCategory = Element.GetCategory(element=select_model_element)
all_elements_of_category = ElementsOfCategory(Category=getCategory)
delete = archilab.Revit.Elements.Elements.Delete(element=all_elements_of_category)
