# Dynamo graph Общее_Дубликатор листов с префиксом.dyn "Дубликатор листов с префиксом" (Dynamo 2.12.0.5650)
# packages: bimorphNodes 4.0.13

categories = Categories("OST_Schedules")
all_elements_of_category = ElementsOfCategory(Category=categories)
code_block = CodeBlock(a=all_elements_of_category) { a.Name; }
byKeysValues = DesignScript.Builtin.Dictionary.ByKeysValues(keys=code_block, values=all_elements_of_category)
название_спецификации_с_листами = StringInput("Список листов")  # graph input
valueAtKey = DesignScript.Builtin.Dictionary.ValueAtKey(dictionary=byKeysValues, key=название_спецификации_с_листами)
перезагрузка = BoolSelector(true)  # graph input
fromSchedule = Revit.Sheet.FromSchedule(scheduleView=valueAtKey, refresh=перезагрузка)
boolean = BoolSelector(true)
code_block_2 = CodeBlock { 1; }
введите_префикс_невидимый_символ = StringInput("‎")  # graph input
duplicate = Revit.Sheet.Duplicate(sheets=fromSchedule, run=boolean, duplicateWithViews=boolean, duplicateOption=code_block_2, prefix=введите_префикс_невидимый_символ)
string = StringInput("ADSK_Штамп Раздел проекта")
введите_раздел_проекта_ар_кр = StringInput("АР")  # graph input
setParameterByName = Element.SetParameterByName(element=duplicate.Sheet, parameterName=string, value=введите_раздел_проекта_ар_кр)
string_2 = StringInput("ADSK_Штамп Имя листа Польз")
введите_подраздел_проекта_аго_рд = StringInput("АГО")  # graph input
setParameterByName_2 = Element.SetParameterByName(element=setParameterByName, parameterName=string_2, value=введите_подраздел_проекта_аго_рд)
titleBlock = Sheet.TitleBlock(sheet=setParameterByName_2)
string_3 = StringInput("Формат А")
titleBlock_2 = Sheet.TitleBlock(sheet=fromSchedule)
string_4 = StringInput("Формат А")
getParameterValueByName = Element.GetParameterValueByName(element=titleBlock_2, parameterName=string_4)
setParameterByName_3 = Element.SetParameterByName(element=titleBlock, parameterName=string_3, value=getParameterValueByName)
string_5 = StringInput("Кратность")
string_6 = StringInput("Кратность")
getParameterValueByName_2 = Element.GetParameterValueByName(element=titleBlock_2, parameterName=string_6)
setParameterByName_4 = Element.SetParameterByName(element=setParameterByName_3, parameterName=string_5, value=getParameterValueByName_2)
