# Dynamo graph Общее_Отсоединить все элементы геометрии.dyn (Dynamo 2.12.0.5650)

запихни_в_меня_нужные_элементы = DSModelElementsSelection()  # 6 picked in the model; graph input
unjoinAllGeometry = Element.UnjoinAllGeometry(elements=запихни_в_меня_нужные_элементы)
code_block = CodeBlock(a=unjoinAllGeometry) { a[0] != null?"О да, я всё отсоединил":"Что-то пошло не так, проверь геометрию..."; }
watch = Watch(code_block)  # graph output
