# Dynamo graph Передача форматов листов.dyn (Dynamo 2.0.5.13212)

categories = Categories(index=417)
all_elements_of_category = ElementsOfCategory(Category=categories)
elementType = Element.ElementType(element=all_elements_of_category)
all_elements_of_family_type = ElementsOfFamilyType(Family_Type=elementType)
code_block = CodeBlock(a=all_elements_of_family_type) { a.Name; }
setParameterByName = Element.SetParameterByName()  # unwired: element, parameterName, value
categories_2 = Categories(index=233)
all_elements_of_category_2 = ElementsOfCategory(Category=categories_2)
ʳʰʸᵗʰᵐ_sheet_titleblock = Rhythm.Revit.Elements.Sheet.Titleblock(viewSheet=all_elements_of_category_2)
parameters = Element.Parameters(element=all_elements_of_category_2)
string = StringInput("MPP_Формат_и_кратность")
parameterByName = Parameter.ParameterByName(element=all_elements_of_category_2, name=string)
size = RevitModel.Sheets.Size()  # unwired: viewsheet
