# Dynamo graph Перенос привязок стен.dyn (Dynamo 2.0.5.13212)

code_block = CodeBlock { 0..100..#4; }
string = StringInput("E:\LocalWork\test1.xlsx")
string_2 = StringInput("Лист1")
code_block_2 = CodeBlock { 0; }
code_block_3 = CodeBlock { "OST_Floors"; }
byName = Category.ByName(name=code_block_3)
all_elements_of_category = ElementsOfCategory(Category=byName)
code_block_4 = CodeBlock(a=all_elements_of_category) { a.Name; }
string_3 = StringInput("Перекрыт")
boolean = BoolSelector(true)
contains = String.Contains(str=code_block_4, searchFor=string_3, ignoreCase=boolean)
filterByBoolMask = List.FilterByBoolMask(list=all_elements_of_category, mask=contains)
code_block_5 = CodeBlock(a=filterByBoolMask.out) { a; }
string_4 = StringInput("Марка")
count = List.Count(list=code_block_5)
code_block_6 = CodeBlock(n=count) { 100000..200000..#n; }
floor = Math.Floor(number=code_block_6)
code_block_7 = CodeBlock(n=floor) { "f"+n; }
setParameterByName = Element.SetParameterByName(element=code_block_5, parameterName=string_4, value=code_block_7)
floors = Element.Solids(element=setParameterByName)
code_block_8 = CodeBlock(fl=floors) { DSCore.List.Flatten(fl,1); }
count_2 = List.Count(list=code_block_8)
randomList = Math.RandomList(amount=count_2)
code_block_9 = CodeBlock(a=randomList) { DSCore.Math.Floor(a*1000000); }
string_from_object = FromObject(obj=code_block_9)
code_block_10 = CodeBlock { 1; }
chop = List.Chop(list=string_from_object, lengths=code_block_10)
code_block_11 = CodeBlock { "OST_Walls"; }
byName_2 = Category.ByName(name=code_block_11)
all_elements_of_category_2 = ElementsOfCategory(Category=byName_2)
code_block_12 = CodeBlock(a=all_elements_of_category_2) { a.Name; }
string_5 = StringInput("Стен")
boolean_2 = BoolSelector(true)
contains_2 = String.Contains(str=code_block_12, searchFor=string_5, ignoreCase=boolean_2)
filterByBoolMask_2 = List.FilterByBoolMask(list=all_elements_of_category_2, mask=contains_2)
code_block_13 = CodeBlock(a=filterByBoolMask_2.out) { a; }
string_6 = StringInput("Марка")
count_3 = List.Count(list=code_block_13)
code_block_14 = CodeBlock(n=count_3) { 100000..200000..#n; }
floor_2 = Math.Floor(number=code_block_14)
code_block_15 = CodeBlock(n=floor_2) { "w"+n; }
setParameterByName_2 = Element.SetParameterByName(element=code_block_13, parameterName=string_6, value=code_block_15)
code_block_16 = CodeBlock(wls=setParameterByName_2) { wls; }
string_7 = StringInput("Марка")
getParameterValueByName = Element.GetParameterValueByName(element=code_block_16, parameterName=string_7)
code_block_17 = CodeBlock(flrs=setParameterByName) { flrs; }
code_block_18 = CodeBlock(flrs=code_block_17) { flrs; }
code_block_19 = CodeBlock { 1; }
chop_2 = List.Chop(list=code_block_18, lengths=code_block_19)
walls = Element.Solids(element=setParameterByName_2)
bv_remove_nulls = Custom[bv Remove Nulls](List=walls)  # forked from Lunchbox
faces = Topology.Faces(topology=bv_remove_nulls)
surfaceGeometry = Face.SurfaceGeometry(face=faces)
code_block_20 = CodeBlock { 0.5; }
pointAtParameter = Surface.PointAtParameter(surface=surfaceGeometry@L3, u=code_block_20, v=code_block_20)
code_block_21 = CodeBlock(a=pointAtParameter) { DSCore.Math.Floor(a.Z); }
sortByKey = List.SortByKey(list=pointAtParameter@L2, keys=code_block_21@L2)

# group: ВЕРХ
верхи = List.LastItem(list=sortByKey.sorted_list@L2)
code_block_22 = CodeBlock { 1; }
chop_3 = List.Chop(list=верхи, lengths=code_block_22)
doesIntersect = Geometry.DoesIntersect(geometry=chop_3@L2, other=code_block_8, lacing=CrossProduct)
filterByBoolMask_3 = List.FilterByBoolMask(list=chop_2, mask=doesIntersect@L3)
code_block_23 = CodeBlock(a=filterByBoolMask_3.in) { a; }
bv_list_removeempty = Custom[bv List.RemoveEmpty](list=code_block_23)

flatten = List.Flatten(list=bv_list_removeempty)
string_8 = StringInput("Марка")
getParameterValueByName_2 = Element.GetParameterValueByName(element=flatten, parameterName=string_8)

# group: НИЗ
низы = List.FirstItem(list=sortByKey.sorted_list@L2)
code_block_24 = CodeBlock { 1; }
chop_4 = List.Chop(list=низы, lengths=code_block_24)
doesIntersect_2 = Geometry.DoesIntersect(geometry=chop_4@L2, other=code_block_8, lacing=CrossProduct)
filterByBoolMask_4 = List.FilterByBoolMask(list=chop_2, mask=doesIntersect_2@L3)
code_block_25 = CodeBlock(a=filterByBoolMask_4.in) { a; }
bv_list_removeempty_2 = Custom[bv List.RemoveEmpty](list=code_block_25)

flatten_2 = List.Flatten(list=bv_list_removeempty_2)
string_9 = StringInput("Марка")
getParameterValueByName_3 = Element.GetParameterValueByName(element=flatten_2, parameterName=string_9)
code_block_26 = CodeBlock(a=getParameterValueByName, b=getParameterValueByName_2, c=getParameterValueByName_3) { [a,b,c]; }
transpose = List.Transpose(lists=code_block_26)
count_4 = List.Count(list=transpose@L2)
cycle = List.Cycle(list=chop@L2, amount=count_4, lacing=Shortest)
flatten_3 = List.Flatten(list=cycle)
flatten_4 = List.Flatten(list=transpose)
code_block_27 = CodeBlock(a=flatten_3, b=flatten_4) { [a,b]; }
transpose_2 = List.Transpose(lists=code_block_27)
boolean_3 = BoolSelector(true)
exportExcel = Data.ExportExcel(filePath=string, sheetName=string_2, startRow=code_block_2, startCol=code_block_2, data=transpose_2, overWrite=boolean_3)
code_block_28 = CodeBlock(a=walls) { a!=null; }
flatten_5 = List.Flatten(list=code_block_28)
filterByBoolMask_5 = List.FilterByBoolMask(list=setParameterByName_2, mask=flatten_5)
code_block_29 = CodeBlock(a=filterByBoolMask_5.out) { a; }
