# Dynamo graph BIM_Выгрузка имен всех материалов в проекте.dyn (Dynamo 2.12.1.8246)
# packages: Orchid 212.3.0.8318

string = StringInput("M:\BIM\Revit\01_Материалы\Библиотеки\Заполнение материалов.xlsx")
string_2 = StringInput("АР")
o_material_all = Orchid.RevitMaterial.Material.All()
code_block = CodeBlock(a=o_material_all) { a.Name; }
python_script = Python(IN[0]=code_block)  # IronPython2
# ---------- python_script.python (18 lines) ----------
# Загрузить стандартную библиотеку Python и библиотеку DesignScript
import sys
import clr
clr.AddReference('ProtoGeometry')
from Autodesk.DesignScript.Geometry import *

# Введенные в этом узле данные сохраняется в виде списка в переменных IN.
name = IN[0]
name_bool = []

# Разместите код под этой строкой
for i in name:
	if "Dynamo" not in i and "ADSK" not in i:
		name_bool.append(True)
	else:
		name_bool.append(False)
# Назначьте вывод переменной OUT.
OUT = name_bool
# ----------------------------------------
filterByBoolMask = List.FilterByBoolMask(list=o_material_all, mask=python_script)
code_block_2 = CodeBlock(a=filterByBoolMask.in) { a.Name; }
boolean = BoolSelector(true)
boolean_2 = BoolSelector(true)
openXMLExportExcel = Data.OpenXMLExportExcel(filePath=string, sheetName=string_2, data=code_block_2, overWrite=boolean, writeAsString=boolean_2)
