# Dynamo graph BIM_Загрузка значений параметров материалов.dyn (Dynamo 2.12.1.8246)

string = StringInput("M:\BIM\Revit\01_Материалы\Библиотеки\Заполнение материалов.xlsx")
string_2 = StringInput("АР")
boolean = BoolSelector(true)
openXMLImportExcel = Data.OpenXMLImportExcel(filePath=string, sheetName=string_2, readAsString=boolean)
code_block = CodeBlock { 1; }
dropItems = List.DropItems(list=openXMLImportExcel, amount=code_block)
code_block_2 = CodeBlock { 0; }
getItemAtIndex = List.GetItemAtIndex(list=dropItems@L2, index=code_block_2)
byName = Material.ByName(name=getItemAtIndex)
string_3 = StringInput("ADSK_Материал тип подсчета")
code_block_3 = CodeBlock { 1; }
getItemAtIndex_2 = List.GetItemAtIndex(list=dropItems@L2, index=code_block_3)
toNumber = String.ToNumber(string=getItemAtIndex_2)
setParameterByName = Element.SetParameterByName(element=byName, parameterName=string_3, value=toNumber)
string_4 = StringInput("NIIPI_Материал Тип подсчёта описание")
code_block_4 = CodeBlock { 3; }
getItemAtIndex_3 = List.GetItemAtIndex(list=dropItems@L2, index=code_block_4)
setParameterByName_2 = Element.SetParameterByName(element=setParameterByName, parameterName=string_4, value=getItemAtIndex_3)
string_5 = StringInput("ADSK_Примечание")
code_block_5 = CodeBlock { ""; }
setParameterByName_3 = Element.SetParameterByName(element=setParameterByName_2, parameterName=string_5, value=code_block_5, lacing=Longest)
