# Dynamo graph BIM_Создание материалов в одном типе стены.dyn (Dynamo 2.12.1.8246)
# packages: Orchid 212.3.0.8318

wall_types = WallTypes("Стена 1")
o_material_all = Orchid.RevitMaterial.Material.All()
code_block = CodeBlock { 100; }
count = List.Count(list=o_material_all)
code_block_2 = CodeBlock(a=count) { b = a-1; 0..#b..1; }
o_systemfamilytype = Orchid.RevitProject.Elements.SystemFamilyType.CreateCompoundLayer(elementType=wall_types, material=o_material_all, thickness=code_block, index=code_block_2.out1, lacing=Longest)
