# Dynamo graph Самое частое семейство и большая категория.dyn (Dynamo 2.0.5.13212)

element_types = ElementTypes(index=120)
all_elements_of_type = ElementsOfType(element_type=element_types)
elementType = Element.ElementType(element=all_elements_of_type)
getFamily = FamilyInstance.GetFamily(familyInstance=all_elements_of_type)
groupByKey = List.GroupByKey(list=elementType, keys=getFamily)
count = List.Count(list=groupByKey.groups@L2)
sortByKey = List.SortByKey(list=groupByKey.groups, keys=count)
reverse = List.Reverse(list=sortByKey.sorted_list)
count_2 = List.Count(list=reverse@L2)
code_block = CodeBlock { 0; }
getItemAtIndex = List.GetItemAtIndex(list=reverse@L2, index=code_block)
