# Dynamo graph Самое частое семейство с количеством.dyn (Dynamo 2.0.5.13212)

путь = StringInput("E:\LocalWork\Выгрузка-семейств_СлавМир.xlsx")
наименование_листа = StringInput("тпп714")
code_block = CodeBlock(ListName=наименование_листа) { ListName; }
code_block_2 = CodeBlock { 1; }
code_block_3 = CodeBlock { 0; }
не_работает_скрипт_передерни = BoolSelector(true)
element_types = ElementTypes(index=120)
code_block_4 = CodeBlock(b=не_работает_скрипт_передерни, a=element_types) { b==true?a:null; }
all_elements_of_type = ElementsOfType(element_type=code_block_4)
elementType = Element.ElementType(element=all_elements_of_type)
getFamily = FamilyInstance.GetFamily(familyInstance=all_elements_of_type)
groupByKey = List.GroupByKey(list=elementType, keys=getFamily)
count = List.Count(list=groupByKey.groups@L2)
sortByKey = List.SortByKey(list=groupByKey.groups, keys=count)
reverse = List.Reverse(list=sortByKey.sorted_list)
code_block_5 = CodeBlock { 0; }
getItemAtIndex = List.GetItemAtIndex(list=reverse@L2, index=code_block_5)
getCategory = Element.GetCategory(element=getItemAtIndex)
count_2 = List.Count(list=reverse@L2)

# group: TypeParameters
code_block_6 = CodeBlock { ", "; }
parameters = Element.Parameters(element=getItemAtIndex)
isShared = Parameter.IsShared(parameter=parameters@L2)
filterByBoolMask = List.FilterByBoolMask(list=parameters, mask=isShared)
code_block_7 = CodeBlock(a=filterByBoolMask.in) { a.Name; }
string_from_object = FromObject(obj=code_block_7)
join = String.Join(separator=code_block_6, string0=string_from_object@L2)

# group: InstanceParameters
code_block_8 = CodeBlock { ", "; }
byFamilyType = FamilyInstance.ByFamilyType(familyType=getItemAtIndex)
code_block_9 = CodeBlock { 0; }
getItemAtIndex_2 = List.GetItemAtIndex(list=byFamilyType@L2, index=code_block_9)
parameters_2 = Element.Parameters(element=getItemAtIndex_2)
isShared_2 = Parameter.IsShared(parameter=parameters_2@L2)
filterByBoolMask_2 = List.FilterByBoolMask(list=parameters_2, mask=isShared_2)
code_block_10 = CodeBlock(a=filterByBoolMask_2.in) { a.Name; }
string_from_object_2 = FromObject(obj=code_block_10)
join_2 = String.Join(separator=code_block_8, string0=string_from_object_2@L2)

list_create = List.Create(item0=getCategory, item1=getItemAtIndex, item2=count_2, item3=join, item4=join_2)
transpose = List.Transpose(lists=list_create)
exportExcel = Data.ExportExcel(filePath=путь, sheetName=code_block, startRow=code_block_2, startCol=code_block_3, data=transpose)
