# Dynamo graph СлавянскийМир_Секция_6.2.dyn (Dynamo 2.0.2.6826)

all_elements_of_type = ElementsOfType()  # unwired: element_type
element_types = ElementTypes()  # nothing selected
code_block = CodeBlock { [[1..5],[3..5]]; }
code_block_2 = CodeBlock { [7,8]; }
categories = Categories(index=628)
all_elements_of_category = ElementsOfCategory(Category=categories)
id = Element.Id(element=all_elements_of_category)
parameters = Element.Parameters(element=all_elements_of_category)
python_script = Python(IN[0]=id, IN[1]=parameters)
# ---------- python_script.python (23 lines) ----------
# Включить поддержку Python и загрузить библиотеку DesignScript
import clr
clr.AddReference('ProtoGeometry')
from Autodesk.DesignScript.Geometry import *

# Введенные в этом узле данные сохраняется в виде списка в переменных IN.
dataEnteringNode = IN
arrayIDs=IN[0]
arrayParams=IN[1]

newArr = []

#for i, val in enumerate(arrayIDs):
	#newArr[i] = i
	
for i, val in enumerate(arrayParams):
	newParam = 'ID : ' + str(arrayIDs[i])
	val.insert(0, newParam)
	newArr.append(val)
# Разместите код под этой строкой

# Назначьте вывод переменной OUT.
OUT = newArr
# ----------------------------------------
string = StringInput("F:\LocalWork\Projects\TestModels\Вестибюль_Секция_6.2_побитый_жизнью\Analysis_of_Deleted_Elements.xlsx")
string_2 = StringInput("Элементы узлов")
code_block_3 = CodeBlock { 1; 0; false; }
exportExcel = Data.ExportExcel(filePath=string, sheetName=string_2, startRow=code_block_3.out0, startCol=code_block_3.out1, overWrite=code_block_3.out2)  # unwired: data
IГIS = Node_Storage()
boolean = BoolSelector(true)
ꟿ_document_deleteelements = Custom[ꟿ Document.DeleteElements](element=all_elements_of_category, confirm=boolean)  # Attempts to delete the input list of elements from the active Revit document.The node returns the number of successfully deleted elements and their Ids as a string. Carefully observe the deleted elements count. It may be greater than the input list because hosted elements or tags will be deleted as well. If an element in the list can not be deleted (for example last revision or last view), the whole list will fail to be deleted.
watch = Watch(ꟿ_document_deleteelements.count)
watch_2 = Watch(ꟿ_document_deleteelements.deletedIds_str)
watch_3 = Watch(ꟿ_document_deleteelements.failedIds_str)
