# Dynamo graph Стяжки.dyn (Dynamo 2.0.5.13212)

select_face = DSFaceSelection()  # 1 picked in the model
area = Surface.Area(surface=select_face)
code_block = CodeBlock(realArea=area) { realArea; }
current = Document.Current()
activeView = Document.ActiveView(document=current)
vertices = Topology.Vertices(topology=select_face)
pointGeometry = Vertex.PointGeometry(vertex=vertices)
boolean = BoolSelector(true)
byPoints = PolyCurve.ByPoints(points=pointGeometry, connectLastToFirst=boolean)
curves = PolyCurve.Curves(polyCurve=byPoints)
flatten = List.Flatten(list=curves)
string = StringInput("Армстронг")
byName = FilledRegionType.ByName(name=string)
byCurves = FilledRegion.ByCurves(view=activeView, boundary=flatten, regionType=byName)
string_2 = StringInput("Площадь")
getParameterValueByName = Element.GetParameterValueByName(element=byCurves, parameterName=string_2)
code_block_2 = CodeBlock { 3; }
round = Math.Round(number=getParameterValueByName, digits=code_block_2)
code_block_3 = CodeBlock { 1; 2; 3; }
code_block_4 = CodeBlock(r=code_block, d=round, a=code_block_3.out0, c=code_block_3.out1, f=code_block_3.out2) { c1 = r==d?a:b; b = r<=d?c:f; }
length = Curve.Length()  # unwired: curve
minimumItem = List.MinimumItem(list=length)
python_script = Python()  # frozen; unwired: IN[0]
# ---------- python_script.python (25 lines) ----------
# Включить поддержку Python и загрузить библиотеку DesignScript
import clr
clr.AddReference("ProtoGeometry")
from Autodesk.DesignScript.Geometry import *
clr.AddReference("RevitApi")
from Autodesk.Revit.DB import *
#from Autodesk.Revit.DB.HostedSweep import *
clr.AddReference("RevitNodes")
import Revit
clr.AddReference("RevitServices")
import RevitServices
from RevitServices.Persistence import *
from RevitServices.Transactions import *
clr.ImportExtensions(Revit.GeometryConversion)

# Введенные в этом узле данные сохраняется в виде списка в переменных IN.

crv = IN[0]
n = len(crv)


# Разместите код под этой строкой

# Назначьте вывод переменной OUT.
OUT = n
# ----------------------------------------
