# Dynamo graph Шары_Пересечки.dyn (Dynamo 2.12.0.5650)
# packages: BumbleBee 2021.25.3, Genius Loci 2022.3.9

string = StringInput("NIIPI_Clash_Sphere")
byName = Family.ByName(name=string)
types = Family.Types(family=byName)

# group: Вычленяем из Excel данные
file_path = Filename("M:\14 КСК\Проектирование\08  Стадия П\Revit\03-04_АР-КР\Проверки на пересечения\Пересечение АР_ОВ-ВК_Корпус 1.xlsx")
file_from_path = FileObject(path=file_path)
boolean = BoolSelector(true)
get_worksheet_names = Custom[Get Worksheet Names](filePath=file_path, runIt=boolean)  # package BumbleBee; This node will query an Excel file and return a list of sheet names that it contains.
code_block = CodeBlock(a=get_worksheet_names) { a[0]; }
code_block_2 = CodeBlock { true; false; }
importExcel = Data.ImportExcel(file=file_from_path, sheetName=code_block, readAsStrings=code_block_2.out0, showExcel=code_block_2.out1)
code_block_3 = CodeBlock { 8; }
dropItems = List.DropItems(list=importExcel, amount=code_block_3)
code_block_4 = CodeBlock { -1; }
dropItems_2 = List.DropItems(list=dropItems, amount=code_block_4)
transpose = List.Transpose(lists=dropItems_2)
code_block_5 = CodeBlock(a=importExcel) { a[7]; }
code_block_6 = CodeBlock(headers=code_block_5)
# ---------- code_block_6.designscript (8 lines) ----------
DSCore.List.IndexOf(headers, "Наименование конфликта");
DSCore.List.IndexOf(headers, "Статус");
DSCore.List.IndexOf(headers, "Дата обнаружения");
DSCore.List.IndexOf(headers, "Точка конфликта");
ID1 = DSCore.List.IndexOf(headers, "Идентификатор элемента");
ID2 = ID1 + 2;
fileName1 = DSCore.List.IndexOf(headers, "Путь");
fileName2 = fileName1 + 2;
# ----------------------------------------
code_block_7 = CodeBlock(list=transpose, I1=code_block_6.out0, I2=code_block_6.out1, I3=code_block_6.out2, I4=code_block_6.out3, I5=code_block_6.ID1, I6=code_block_6.ID2, I7=code_block_6.fileName2) { names = list[I1]; status = list[I2]; date = list[I3]; point = list[I4]; id1 = list[I5]; id2 = list[I6]; fn = list[I7]; }

code_block_8 = CodeBlock { "X:"; ", Y:"; ", Z:"; }
split = String.Split(string=code_block_7.point, separator0=code_block_8.out0, separator1=code_block_8.out1, separator2=code_block_8.out2)
toNumber = String.ToNumber(string=split)
convert_between_units = DynamoConvert(toNumber, MeasurementType="Length", FromConversion="Meters", ToConversion="Millimeters")
transpose_2 = List.Transpose(lists=convert_between_units)
code_block_9 = CodeBlock(a=transpose_2) { x = a[0]; y = a[1]; z = a[2]; }

# group: Создаем систему координат, конвертим координаты из Navisworks, хуяк-хуяк и готово
XY = Plane.XY()
toCoordinateSystem = Plane.ToCoordinateSystem(plane=XY)
origin = Point.Origin()
ZAxis = Vector.ZAxis()
get_project_locations = Custom[Get Project Locations]()  # package Genius Loci; Works only in Revit 2018 and later. Retrieves the project positions of the given document in the Survey Coordinate System. (Coordinates of Internal origin, project base point and survey point)
code_block_10 = CodeBlock(pbp=get_project_locations.Project_Base_Point) { pbp[1]; }
rotate = CoordinateSystem.Rotate(coordinateSystem=toCoordinateSystem, origin=origin, axis=ZAxis, degrees=code_block_10)
origin_2 = Point.Origin()
code_block_11 = CodeBlock(a=get_project_locations.Internal_Origin) { a.X; a.Y; }
code_block_12 = CodeBlock(y=code_block_11.out1, x=code_block_11.out0) { N_s_disp = y*-1; E_w_disp = x*-1; }
byCartesianCoordinates = Point.ByCartesianCoordinates(coordinateSystem=rotate, x=code_block_12.E_w_disp, y=code_block_12.N_s_disp)
byTwoPoints = Vector.ByTwoPoints(start=origin_2, end=byCartesianCoordinates)
distanceTo = Geometry.DistanceTo(geometry=origin_2, other=byCartesianCoordinates)
translate = CoordinateSystem.Translate(coordinateSystem=rotate, direction=byTwoPoints, distance=distanceTo)
code_block_13 = CodeBlock(a=get_project_locations.Project_Base_Point) { a[0].Z; }

code_block_14 = CodeBlock(b=code_block_9.z, a=code_block_13) { b - a; }

# group (continued): Создаем систему координат, конвертим координаты из Navisworks, хуяк-хуяк и готово
byCartesianCoordinates_2 = Point.ByCartesianCoordinates(coordinateSystem=translate, x=code_block_9.x, y=code_block_9.y, z=code_block_14)

byPoint = FamilyInstance.ByPoint(familyType=types, point=byCartesianCoordinates_2, lacing=Longest)
string_2 = StringInput("NIIPI_Имя конфликта")
setParameterByName = Element.SetParameterByName(element=byPoint, parameterName=string_2, value=code_block_7.names)
string_3 = StringInput("NIIPI_Дата конфликта")
setParameterByName_2 = Element.SetParameterByName(element=setParameterByName, parameterName=string_3, value=code_block_7.date)
string_4 = StringInput("ID1")
setParameterByName_3 = Element.SetParameterByName(element=setParameterByName_2, parameterName=string_4, value=code_block_7.id1)
string_5 = StringInput("ID2")
setParameterByName_4 = Element.SetParameterByName(element=setParameterByName_3, parameterName=string_5, value=code_block_7.id2)
string_6 = StringInput("NIIPI_X_Navis")
code_block_15 = CodeBlock { 0; 1; 2; }
getItemAtIndex = List.GetItemAtIndex(list=toNumber@L2, index=code_block_15.out0)
setParameterByName_5 = Element.SetParameterByName(element=setParameterByName_4, parameterName=string_6, value=getItemAtIndex)
string_7 = StringInput("NIIPI_Y_Navis")
getItemAtIndex_2 = List.GetItemAtIndex(list=toNumber@L2, index=code_block_15.out1)
setParameterByName_6 = Element.SetParameterByName(element=setParameterByName_5, parameterName=string_7, value=getItemAtIndex_2)
string_8 = StringInput("NIIPI_Z_Navis")
getItemAtIndex_3 = List.GetItemAtIndex(list=toNumber@L2, index=code_block_15.out2)
setParameterByName_7 = Element.SetParameterByName(element=setParameterByName_6, parameterName=string_8, value=getItemAtIndex_3)
string_9 = StringInput("NIIPI_Раздел")

# group: Находим название файла и вычленяем оттуда раздел
code_block_16 = CodeBlock { " > "; }
split_2 = String.Split(string=code_block_7.fn, separator0=code_block_16)
code_block_17 = CodeBlock(a=split_2) { String.Contains(a,".rvt", false) != false || String.Contains(a,".nwc", false) != false; }
filterByBoolMask = List.FilterByBoolMask(list=split_2, mask=code_block_17)
flatten = List.Flatten(list=filterByBoolMask.in)
code_block_18 = CodeBlock { "_"; }
indexOf = String.IndexOf(string=flatten, searchFor=code_block_18)
code_block_19 = CodeBlock(a=indexOf) { 0; a; }
substring = String.Substring(string=flatten, startIndex=code_block_19.out0, length=code_block_19.a)

setParameterByName_8 = Element.SetParameterByName(element=setParameterByName_7, parameterName=string_9, value=substring)
