# Dynamo graph 00_Проекция точек на поверхность.dyn (Dynamo 2.6.1.8786)
# packages: spring nodes 210.1.1

select_model_element = DSModelElementSelection()  # 1 picked in the model
mesh = Topography.Mesh(topography=select_model_element)
ꟿ_mesh_topolysurface = Custom[ꟿ Mesh.ToPolySurface](mesh=mesh)  # package spring nodes; Converts a Dynamo mesh to a polysurface. By default the node is single threaded, but if you specify a higher number of threads in the `NUMTHREAD` input, the node will run multi-threaded to speed up the conversion. *WARNING* Using multi-threaded code with Dynamo's geometry kernel may crash Revit in some cases.
select_model_element_2 = DSModelElementSelection()  # 1 picked in the model
string = StringInput("000ГП_ограждение")
curvesFromCADLayers = CAD.CurvesFromCADLayers(importInstance=select_model_element_2, layerNames=string)
code_block = CodeBlock(a=curvesFromCADLayers.Curve) { a.Length<1300?true:false; }
filterByBoolMask = List.FilterByBoolMask(list=curvesFromCADLayers.Curve, mask=code_block)
code_block_2 = CodeBlock(a=filterByBoolMask.out) { a; }
flatten = List.Flatten(list=code_block_2)
startPoint = Curve.StartPoint(curve=flatten)
endPoint = Curve.EndPoint(curve=flatten)
code_block_3 = CodeBlock(a=endPoint) { a[4]; }
code_block_4 = CodeBlock(a=startPoint, b=code_block_3) { [a,b]; }
flatten_2 = List.Flatten(list=code_block_4)
code_block_5 = CodeBlock(a=flatten_2) { a.X; a.Y; a.Z-10000; }
byCoordinates = Point.ByCoordinates(x=code_block_5.out0, y=code_block_5.out1, z=code_block_5.out2)
code_block_6 = CodeBlock(a=flatten_2) { a.X; a.Y; a.Z+300000; }
byCoordinates_2 = Point.ByCoordinates(x=code_block_6.out0, y=code_block_6.out1, z=code_block_6.out2)
byStartPointEndPoint = Line.ByStartPointEndPoint(startPoint=byCoordinates, endPoint=byCoordinates_2)
intersect = Geometry.Intersect(geometry=ꟿ_mesh_topolysurface, other=byStartPointEndPoint, lacing=Longest)
flatten_3 = List.Flatten(list=intersect)
byFace = FamilyInstance.ByFace()  # unwired: familyType, face, line
byFace_2 = FamilyInstance.ByFace()  # unwired: familyType, face, line
