# Dynamo graph 01.1_Создание 3d и выгрузка в Navis по разделам_единично.dyn "01_Создание 3d и выгрузка в Navis_единично" (Dynamo 2.6.1.8786)
# packages: spring nodes 210.1.1

current = Document.Current()

# group: Указать папку выгрузки. Проверка на существование папки с таким же названием, как у файла
current_2 = Document.Current()
filePath = Document.FilePath(document=current_2)
папка_выгрузки = StringInput("C:\Users\aprohorov\Desktop\TESTNWC")
python_script = Python(IN[0]=filePath, IN[1]=папка_выгрузки)
# ---------- python_script.python (24 lines) ----------
# Загрузить стандартную библиотеку Python и библиотеку DesignScript
import sys
import clr
clr.AddReference('ProtoGeometry')
from Autodesk.DesignScript.Geometry import *
import os

docpath = IN[0]
downloadpath = IN[1]


indslash = docpath.rfind("\\")
filename = docpath[indslash+1:-4]

testway = downloadpath + "\\" + filename

if os.path.isdir(testway) == False:
	os.mkdir(testway)
	OUT = testway
else:
	OUT = testway


"""d = os.mkdir(c)"""
# ----------------------------------------

# group: Сбор 3d-видов ненулевых названий
element_types = ElementTypes("View3D")
all_elements_of_type = ElementsOfType(element_type=element_types)
code_block = CodeBlock(a=all_elements_of_type) { a!=null; }
filterByBoolMask = List.FilterByBoolMask(list=all_elements_of_type, mask=code_block)
code_block_2 = CodeBlock(a=filterByBoolMask.in) { a; }
code_block_3 = CodeBlock(a=filterByBoolMask.in) { a.Name; }

# group: ПАРАМЕТР ГРУППИРОВАНИЯ
string = StringInput("EO_Шифр тома")
code_block_4 = CodeBlock { "УКАЗАТЬ ПАРАМЕТР ГРУППИРОВАНИЯ"; }

# group: Сбор уникальных шифров
element_types_2 = ElementTypes("FamilyInstance")
all_elements_of_type_2 = ElementsOfType(element_type=element_types_2)
getParameterValueByName = Element.GetParameterValueByName(element=all_elements_of_type_2, parameterName=string)
code_block_5 = CodeBlock(a=getParameterValueByName) { a!=""; }
filterByBoolMask_2 = List.FilterByBoolMask(list=getParameterValueByName, mask=code_block_5)
uniqueItems = List.UniqueItems(list=filterByBoolMask_2.in)

# group: Создание 3d-видов по разделам
origin = Point.Origin()
setDifference = List.SetDifference(list1=uniqueItems, list2=code_block_3)
count = List.Count(list=setDifference)
cycle = List.Cycle(list=origin, amount=count)
code_block_6 = CodeBlock { 10; }
code_block_7 = CodeBlock { false; }
byCoordinates = Vector.ByCoordinates(x=code_block_6, y=code_block_6, z=code_block_6, normalized=code_block_7)
add = Point.Add(point=cycle, vectorToAdd=byCoordinates)
byEyePointAndTarget = AxonometricView.ByEyePointAndTarget(eyePoint=add, target=cycle, name=setDifference)

# group: Сбор 3d-видов по разделам (вне зависимости от того, были ли они или создались)
code_block_8 = CodeBlock(a=code_block_2, b=byEyePointAndTarget) { [a,b]; }
flatten = List.Flatten(list=code_block_8)
code_block_9 = CodeBlock(a=uniqueItems, b=byEyePointAndTarget) { [a,b.Name]; }
flatten_2 = List.Flatten(list=code_block_9)
uniqueItems_2 = List.UniqueItems(list=flatten_2)

byNameContains = Revit.ElementFilter.ByNameContains(element=flatten, value=uniqueItems_2)

# group (continued): Сбор 3d-видов по разделам (вне зависимости от того, были ли они или создались)
flatten_3 = List.Flatten(list=byNameContains)

enumerate_naviswork_coordinates = Custom[Enumerate Naviswork Coordinates and Exportscope]()  # package spring nodes; Use with the "Export NWC in Document" node.
code_block_10 = CodeBlock(a=enumerate_naviswork_coordinates.ExportScope, b=enumerate_naviswork_coordinates.ChooseCoordinates) { a[1]; b[1]; }
code_block_11 = CodeBlock { false; }
code_block_12 = CodeBlock { true; }

# group: Скрываем элементы, не соответствующие разделам
ꟿ_collect_elementsinview = Custom[ꟿ Collect.ElementsInView](view=flatten_3)  # package spring nodes; Selects all elements visible in the input view.
getParameterValueByName_2 = Element.GetParameterValueByName(element=ꟿ_collect_elementsinview, parameterName=string)
code_block_13 = CodeBlock(a=getParameterValueByName_2, b=flatten_3) { a!=b.Name; }
filterByBoolMask_3 = List.FilterByBoolMask(list=ꟿ_collect_elementsinview, mask=code_block_13)
hideElements = archilab.Revit.Views.Views.HideElements(view=flatten_3, elements=filterByBoolMask_3.in)

code_block_14 = CodeBlock(pass=code_block_12, waitfor=hideElements) { [pass,waitfor][0]; }
export_nwc_in_document = Custom[Export NWC in Document](document=current, DirectoryPath=python_script, view=flatten_3, Filename=uniqueItems_2, exportScope=code_block_10.out0, chooseCoordinates=code_block_10.out1, ExportLinks=code_block_11, RunIt=code_block_14)  # package spring nodes; !! This node needs Navisworks Exporters for Revit to export NWC. This node exports Views to NWC files in the active or given document. Navisworks options are embedded inside the python script.
