# Dynamo graph 02_Очистка файлов.dyn "02_Очистка файлов и перемещение в исходящие" (Dynamo 2.6.1.8786)

# group: Удалить CAD
element_types = ElementTypes("CADLinkType")
all_elements_of_type = ElementsOfType(element_type=element_types)
delete = Element.Delete(element=all_elements_of_type)

# group: Разгруппировка групп
element_types_2 = ElementTypes("Group")
all_elements_of_type_2 = ElementsOfType(element_type=element_types_2)
ungroupElements = Group.UngroupElements(group=all_elements_of_type_2)
