# Dynamo graph 04.1_Установка буров для Z координаты_v2.dyn (Dynamo 2.6.2.15705)

# group: УКАЗАТЬ СЕМЕЙСТВО БУРА
family_types = FamilyTypes("БурZ:БурZ")

# group: УКАЗАТЬ ТОЧКИ ИЗ КАКАДА
file_path = Filename("..\..\..\..\..\01_Проекты\01_Дюртюли-Ачит\01_Рабочая\DWG\140-232\Д-Ачит_2э_км140-232_опоры.xls")

file_from_path = FileObject(path=file_path)
string = StringInput("Summary")
boolean = BoolSelector(false)
importExcel = Data.ImportExcel(file=file_from_path, sheetName=string, showExcel=boolean)
code_block = CodeBlock { 1; }
dropItems = List.DropItems(list=importExcel, amount=code_block)
code_block_2 = CodeBlock { 0; 1; 2; }
getItemAtIndex = List.GetItemAtIndex(list=dropItems@L2, index=code_block_2.out0)
toNumber = String.ToNumber(str=getItemAtIndex)
code_block_3 = CodeBlock(x=toNumber) { x*1000; }
getItemAtIndex_2 = List.GetItemAtIndex(list=dropItems@L2, index=code_block_2.out1)
toNumber_2 = String.ToNumber(str=getItemAtIndex_2)
code_block_4 = CodeBlock(y=toNumber_2) { y*1000; }
code_block_5 = CodeBlock { 300000; }
byCoordinates = FamilyInstance.ByCoordinates(familyType=family_types, x=code_block_3, y=code_block_4, z=code_block_5)
string_2 = StringInput("ADSK_Размер_УголПоворота")
getItemAtIndex_3 = List.GetItemAtIndex(list=dropItems@L2, index=code_block_2.out2)
toNumber_3 = String.ToNumber(str=getItemAtIndex_3)
setParameterByName = Element.SetParameterByName(element=byCoordinates, parameterName=string_2, value=toNumber_3)
