# Dynamo graph 04.3_Выгрузка XYZ буров и номеров.dyn (Dynamo 2.6.2.15705)

# group: УКАЗАТЬ ТАБЛИЦУ ВЫГРУЗКИ XYZ
file_path = Filename("..\..\..\..\..\01_Проекты\01_Дюртюли-Ачит\01_Рабочая\Д-Ачит_3э_км232-275_НомерXYZDeg.xlsx")

string = StringInput("Sheet1")
code_block = CodeBlock { 0; }
code_block_2 = CodeBlock { ["id","num","x","y","z","deg"]; }

# group: УКАЗАТЬ РЕЗУЛЬТАТ КОЛЛИЗИЙ
file_path_2 = Filename("..\..\..\..\..\01_Проекты\01_Дюртюли-Ачит\01_Рабочая\Navisworks\отчеты\232-275_БурыZ_ref.xlsx")

file_from_path = FileObject(path=file_path_2)
string_2 = StringInput("Лист1")
boolean = BoolSelector(true)
boolean_2 = BoolSelector(false)
importExcel = Data.ImportExcel(file=file_from_path, sheetName=string_2, readAsStrings=boolean, showExcel=boolean_2)
code_block_3 = CodeBlock { 1; }
dropItems = List.DropItems(list=importExcel, amount=code_block_3)
code_block_4 = CodeBlock { 0; }
getItemAtIndex = List.GetItemAtIndex(list=dropItems@L2, index=code_block_4)
element_by_id = ElementById(Id=getItemAtIndex)
string_3 = StringInput("ADSK_Примечание")
getParameterValueByName = Element.GetParameterValueByName(element=element_by_id, parameterName=string_3)
string_from_object = FromObject(obj=getParameterValueByName)
location = FamilyInstance.Location(familyInstance=element_by_id)
code_block_5 = CodeBlock(a=location) { a.X; a.Y; }
code_block_6 = CodeBlock { 1; }
getItemAtIndex_2 = List.GetItemAtIndex(list=dropItems@L2, index=code_block_6)
string_4 = StringInput(",")
string_5 = StringInput(".")
replace = String.Replace(str=getItemAtIndex_2, searchFor=string_4, replaceWith=string_5)
toNumber = String.ToNumber(str=replace)
code_block_7 = CodeBlock(a=toNumber) { a*1000; }
code_block_8 = CodeBlock(Z=code_block_7) { Z; }
string_6 = StringInput("ADSK_Размер_УголПоворота")
getParameterValueByName_2 = Element.GetParameterValueByName(element=element_by_id, parameterName=string_6)
code_block_9 = CodeBlock(id=getItemAtIndex, num=string_from_object, x=code_block_5.out0, y=code_block_5.out1, z=code_block_8, deg=getParameterValueByName_2) { [id,"Опора " + num,x,y,z,deg]; }
transpose = List.Transpose(lists=code_block_9)
addItemToFront = List.AddItemToFront(item=code_block_2, list=transpose)
boolean_3 = BoolSelector(true)
exportExcel = Data.ExportExcel(filePath=file_path, sheetName=string, startRow=code_block, startCol=code_block, data=addItemToFront, overWrite=boolean_3)
uniqueItems = List.UniqueItems(list=getItemAtIndex)
uniqueItems_2 = List.UniqueItems(list=getParameterValueByName)
