# Dynamo graph 04.4_Подгрузка отсутствующих файлов.dyn (Dynamo 2.6.2.15705)
# packages: Morpheus 2019.8.26

code_block = CodeBlock { ","; }

# group: Пути файлов извне (все этапы)
string = StringInput("C:\01_Проекты\01_Дюртюли-Ачит\01_Рабочая\Revit\Все вложенные")
directory_from_path = DirectoryObject(path=string)
string_2 = StringInput("*.rvt")
getDirectoryContents = FileSystem.GetDirectoryContents(directory=directory_from_path, searchString=string_2)

# group: Список буров по этапам
file_path = Filename("..\..\..\..\..\01_Проекты\01_Дюртюли-Ачит\01_Рабочая\Д-Ачит_3э_км232-275_НомерXYZDeg.xlsx")
file_from_path = FileObject(path=file_path)
string_3 = StringInput("Sheet1")
boolean = BoolSelector(true)
boolean_2 = BoolSelector(false)
importExcel = Data.ImportExcel(file=file_from_path, sheetName=string_3, readAsStrings=boolean, showExcel=boolean_2)
code_block_2 = CodeBlock { 1; }
dropItems = List.DropItems(list=importExcel, amount=code_block_2)
code_block_3 = CodeBlock { 1; }
getItemAtIndex = List.GetItemAtIndex(list=dropItems@L2, index=code_block_3)
uniqueItems = List.UniqueItems(list=getItemAtIndex)

# group: Вытаскиваем уже имеющиеся файлы
element_types = ElementTypes("RevitLinkInstance")
all_elements_of_type = ElementsOfType(element_type=element_types)
code_block_4 = CodeBlock(a=all_elements_of_type) { a.Name; }
code_block_5 = CodeBlock { " "; }
split = String.Split(str=code_block_4, separator0=code_block_5)
code_block_6 = CodeBlock { 1; }
getItemAtIndex_2 = List.GetItemAtIndex(list=split@L2, index=code_block_6)

# group: Вычисляем неподгруженные файлы
python_script = Python(IN[0]=getDirectoryContents.files, IN[1]=uniqueItems)
# ---------- python_script.python (25 lines) ----------
# Загрузить стандартную библиотеку Python и библиотеку DesignScript
import sys
import clr
clr.AddReference('ProtoGeometry')
from Autodesk.DesignScript.Geometry import *

incomefiles_dirty = IN[0]
burz = IN[1]

incomefiles = []
templist1, templist2 = [], []

for ifile in incomefiles_dirty:
	if "*.0***.rvt" or "копи" not in ifile:
		incomefiles.append(ifile)

for incomefile in incomefiles:
	cut_incomefile = incomefile[incomefile.rfind("\\")+1:-4]
	oporanum = cut_incomefile[cut_incomefile.find(" ")+1:cut_incomefile.rfind(" ")]
	for bur in burz:
		if bur[6:]==oporanum:
			templist2.append(incomefile)
			break	
	
OUT = templist2
# ----------------------------------------
python_script_2 = Python(IN[0]=python_script, IN[1]=getItemAtIndex_2)
# ---------- python_script_2.python (22 lines) ----------
# Загрузить стандартную библиотеку Python и библиотеку DesignScript
import sys
import clr
clr.AddReference('ProtoGeometry')
from Autodesk.DesignScript.Geometry import *

burz = IN[0]
loads = IN[1]

templist1, templist2 = [], []

for bur in burz:
	cut_bur = bur[bur.rfind("\\")+1:-4]
	burnum = cut_bur[cut_bur.find(" ")+1:cut_bur.rfind(" ")]
	templist2.append(burnum)
	for load in loads:
		if load==burnum:
			templist1.append(bur)
			break
			
	
OUT = templist1
# ----------------------------------------
setDifference = List.SetDifference(list1=python_script, list2=python_script_2)

originToOrigin = Custom[LinkModel.OriginToOrigin](Filepaths=setDifference)  # package Morpheus; Link models origin to origin. Optionally, the node can place the models on the selected worksets and pin them in place.
code_block_7 = CodeBlock(a=dropItems) { a; }
python_script_3 = Python(IN[0]=setDifference, IN[1]=code_block_7)
# ---------- python_script_3.python (23 lines) ----------
# Загрузить стандартную библиотеку Python и библиотеку DesignScript
import sys
import clr
clr.AddReference('ProtoGeometry')
from Autodesk.DesignScript.Geometry import *

filestoload = IN[0]
burz = IN[1]

templist1, templist2 = [], []

for filetoload in filestoload:
	cut_filetoload = filetoload[filetoload.rfind("\\")+1:-4]
	ftlnum = cut_filetoload[cut_filetoload.find(" ")+1:cut_filetoload.rfind(" ")]
	templist1.append(ftlnum)
	
	for bur in burz:
		if bur[1][6:]==ftlnum:
			templist2.append([bur[2],bur[3],bur[4],bur[5]])
			break	
			
	
OUT = templist2
# ----------------------------------------
code_block_8 = CodeBlock { 0; 1; 2; 3; }
X = List.GetItemAtIndex(list=python_script_3@L2, index=code_block_8.out0)
Y = List.GetItemAtIndex(list=python_script_3@L2, index=code_block_8.out1)
Z = List.GetItemAtIndex(list=python_script_3@L2, index=code_block_8.out2)
DEG = List.GetItemAtIndex(list=python_script_3@L2, index=code_block_8.out3)
code_block_9 = CodeBlock(x=X, y=Y, z=Z, deg=DEG)
# ---------- code_block_9.designscript (4 lines) ----------
String.Contains(x,",",false)==true?String.Replace(x,",","."):x;
String.Contains(y,",",false)==true?String.Replace(y,",","."):y;
String.Contains(z,",",false)==true?String.Replace(z,",","."):z;
String.Contains(deg,",",false)==true?String.Replace(deg,",","."):deg;
# ----------------------------------------
toNumber = String.ToNumber(str=code_block_9.out0)
toNumber_2 = String.ToNumber(str=code_block_9.out1)
toNumber_3 = String.ToNumber(str=code_block_9.out2)

# group: Добавить высоту по Z
прибавка_по_z = DoubleInput(0)

code_block_10 = CodeBlock(z=toNumber_3, zz=прибавка_по_z) { z+zz; }
byCoordinates = Point.ByCoordinates(x=toNumber, y=toNumber_2, z=code_block_10)
set_location = Python(IN[0]=originToOrigin, IN[1]=byCoordinates)
# ---------- set_location.python (72 lines) ----------
#Alban de Chasteigner 2020
#twitter : @geniusloci_bim
#geniusloci.bim@gmail.com
#https://github.com/albandechasteigner/GeniusLociForDynamo

import clr
# Import RevitAPI Classes
clr.AddReference('RevitAPI')
import Autodesk
from Autodesk.Revit.DB import *

clr.AddReference("RevitNodes")
import Revit
clr.ImportExtensions(Revit.GeometryConversion)

clr.AddReference("RevitServices")
import RevitServices
from RevitServices.Persistence import DocumentManager
from RevitServices.Transactions import TransactionManager
doc = DocumentManager.Instance.CurrentDBDocument

elements = UnwrapElement(IN[0]) if isinstance(IN[0],list) else [UnwrapElement(IN[0])]
locations = IN[1] if isinstance(IN[1],list) else [IN[1]]

TransactionManager.Instance.EnsureInTransaction(doc)
for element,location in zip(elements,locations):
	if hasattr(element, "Location"):
		loc = element.Location
		if loc:	
			# point-based elements (e.g. most loadable families)
			if isinstance(loc,LocationPoint):
				loca=loc.Point
			# line-based elements (e.g. walls)
			elif isinstance(loc,LocationCurve):
				loca=loc.Curve.Evaluate(0.5,True)
			elif isinstance(element,Instance):
				loca = element.GetTotalTransform().Origin
			elif hasattr(element, "Origin"):
				loca = element.Origin
			##Section Marker and ReferenceElevationMarker(Doesn't work for ReferenceElevationMarker)
			elif ElementId(BuiltInCategory.OST_Viewers) == element.Category.Id :
				viewSection = doc.GetElement(ElementId(element.Id.IntegerValue + 1))
				loca = viewSection.Origin
			#Elevation Marker
			elif isinstance(element,Autodesk.Revit.DB.ElevationMarker) :
				marker = doc.GetElement(ElementId(element.Id.IntegerValue + 1))
				box=marker.BoundingBox[doc.ActiveView]
				loca = (box.Min+box.Max)/2
			# Grid	
			elif isinstance(element,Autodesk.Revit.DB.Grid):
				loca=element.Curve.Evaluate(0.5,True)
			# view specific elements (e.g. filled regions)
			elif hasattr(element, "OwnerViewId") and element.OwnerViewId != ElementId.InvalidElementId :
				view=element.Document.GetElement(element.OwnerViewId)
				box = element.BoundingBox[view]
				loca = (box.Min+box.Max)/2
			# sketch-based elements (e.g. floors)
			else :
				box = element.get_BoundingBox(None)
				loca = (box.Min+box.Max)/2
			ElementTransformUtils.MoveElement(doc,element.Id,location.ToRevitType()-loca)
	elif hasattr(element, "OwnerViewId"):
		view=element.Document.GetElement(element.OwnerViewId)
		box = element.BoundingBox[view]
		loca = (box.Min+box.Max)/2
		ElementTransformUtils.MoveElement(doc,element.Id,location.ToRevitType()-loca)
	elif isinstance(element,Leader):
		element.End=location.ToXyz()
TransactionManager.Instance.TransactionTaskDone()

if isinstance(IN[0], list): OUT = elements
else: OUT = elements[0]
# ----------------------------------------
toNumber_4 = String.ToNumber(str=code_block_9.out3)
code_block_11 = CodeBlock(a=toNumber_4) { a>0?180+(a-18.62):0; }
set_rotation = Python(IN[0]=set_location, IN[1]=code_block_11)
# ---------- set_rotation.python (145 lines) ----------
#Alban de Chasteigner 2020
#twitter : @geniusloci_bim
#geniusloci.bim@gmail.com
#https://github.com/albandechasteigner/GeniusLociForDynamo

import clr
clr.AddReference("RevitNodes")
import Revit
clr.ImportExtensions(Revit.GeometryConversion)

clr.AddReference("RevitAPI")
import Autodesk
from Autodesk.Revit.DB import *
import math

clr.AddReference("RevitServices")
import RevitServices
from RevitServices.Persistence import DocumentManager
from RevitServices.Transactions import TransactionManager
doc = DocumentManager.Instance.CurrentDBDocument

elements = UnwrapElement(IN[0]) if isinstance(IN[0],list) else [UnwrapElement(IN[0])]
angles = [i* math.pi/180 for i in IN[1]] if isinstance(IN[1],list) else [IN[1]* math.pi/180]

def GetCropBox(view):
	provider= ParameterValueProvider(ElementId(BuiltInParameter.ID_PARAM))
	rule = FilterElementIdRule(provider, FilterNumericEquals(), view.Id )
	filter= ElementParameterFilter(rule)
	return doc.GetElement(FilteredElementCollector(view.Document).WherePasses(filter).ToElementIds().Find(lambda x: x.IntegerValue != view.Id.IntegerValue))

TransactionManager.Instance.EnsureInTransaction(doc)
for angle, element in zip(angles, elements):
	#if angle>math.pi:
		#angle=abs(angle-2*math.pi)
	#else:angle
	#Get initial Rotation Angle using transform
	#transform=element.GetTransform()
	#vectorTran = transform.OfVector(transform.BasisX)
	#rot = transform.BasisX.AngleOnPlaneTo(vectorTran, transform.BasisZ) 
	#rot = rot * (180 / math.pi)
	if hasattr(element, "Location"):
		loc = element.Location
		if loc:	
			# Annotation symbol, importInstance and linkInstance
			if hasattr(element, "GetTotalTransform"):
				trans=element.GetTotalTransform()
				loca = trans.Origin
				rot = -trans.BasisX.AngleOnPlaneTo(XYZ.BasisX, XYZ.BasisZ)
			# point-based elements (e.g. most loadable families)
			elif isinstance(loc,LocationPoint):
				loca=loc.Point
				if hasattr(loc, "Rotation"):
					rot=loc.Rotation
				# Group, assembly
				else:rot = 0
			# line-based elements (e.g. walls)
			elif isinstance(loc,LocationCurve):
				loca=loc.Curve.Evaluate(0.5,True)
				rot=loc.Curve.Direction.AngleTo(XYZ.BasisX)
			elif isinstance(element,Grid):
				line=element.Curve
				start=line.GetEndPoint(0)
				end=line.GetEndPoint(1)   
				box=BoundingBoxXYZ()
				box.Min = start
				box.Max = end
				loca = (box.Min+box.Max)/2
				rot = 0			
			elif isinstance(element,ReferencePlane):
				doc=element.Document
				view = doc.ActiveView
				for crv in element.GetCurvesInView(DatumExtentType.ViewSpecific,view):
					line = crv
				start=line.GetEndPoint(0)
				end=line.GetEndPoint(1)   
				box=BoundingBoxXYZ()
				box.Min = start
				box.Max = end
				loca = (box.Min+box.Max)/2
				rot = 0	
			# CropBox
			elif element.Category == None :
				view=doc.GetElement(element.get_Parameter(BuiltInParameter.ID_PARAM).AsElementId())
				box = view.CropBox
				transform = box.Transform
				min = transform.OfPoint(box.Min)
				max = transform.OfPoint(box.Max)
				loca = (min+max)/2
				rot = 0	
			# ViewSection Marker
			elif ElementId(BuiltInCategory.OST_Viewers) == element.Category.Id :
				viewSection = doc.GetElement(ElementId(element.Id.IntegerValue + 1))
				shape=viewSection.GetCropRegionShapeManager().GetCropShape()
				#Last line of the rectangle
				l=[s for s in shape[0]][3]
				loca = l.Evaluate(0.5, True)
				#loca = viewSection.Origin
				rot = 0
			# SectionBox
			elif ElementId(BuiltInCategory.OST_SectionBox) == element.Category.Id:
				box = doc.GetElement(ElementId(element.Id.IntegerValue + 1)).GetSectionBox()
				transform = box.Transform
				min = transform.OfPoint(box.Min)
				max = transform.OfPoint(box.Max)
				loca = (min+max)/2
				rot = 0
			else:
				box = element.get_BoundingBox(None)
				loca = (box.Min+box.Max)/2
				rot = 0
				# sketch-based elements (ceiling, floor and roof)
				if hasattr(element, "FindInserts"):
					for ref in HostObjectUtils.GetTopFaces(element):
						geomFace=element.GetGeometryObjectFromReference(ref)
						#Get BoundingBox max UV point
						maxUV = geomFace.GetBoundingBox().Max
						#Get transform
						trans=geomFace.ComputeDerivatives(maxUV)
						if isinstance(element,Ceiling):
							rot = abs(trans.BasisZ.AngleOnPlaneTo(XYZ.BasisX, XYZ.BasisZ)-2*math.pi)
						else:
							rot = abs(trans.BasisY.AngleOnPlaneTo(XYZ.BasisX, XYZ.BasisZ)-math.pi)
				else:rot = 0
		#PlanView, SectionView and 3D View
		elif hasattr(element, "CropBox") :
			box = element.CropBox
			element = GetCropBox(element)
			transform = box.Transform
			min = transform.OfPoint(box.Min)
			max = transform.OfPoint(box.Max)
			loca = (min+max)/2
			rot = 0									
	# view specific elements (e.g. filled regions)
	elif hasattr(element, "OwnerViewId"):
		view=doc.GetElement(element.OwnerViewId)
		box = element.BoundingBox[view]
		loca = (box.Min+box.Max)/2
		rot = 0
	line = Line.CreateBound(loca, XYZ(loca.X,loca.Y,loca.Z+1))
	#Set Rotation
	Autodesk.Revit.DB.ElementTransformUtils.RotateElement(doc, element.Id, line, angle-rot)
TransactionManager.Instance.TransactionTaskDone()

if isinstance(IN[0], list): OUT = elements
else: OUT = elements[0]
# ----------------------------------------
