# Dynamo graph 05_Копирование файлов.dyn (Dynamo 2.6.2.15705)

directory_path = Directory("C:\01_Проекты\01_Дюртюли-Ачит\00_Исходные данные\Revit\Поэлементно 2 этап")
file_path = Filename("C:\01_Проекты\01_Дюртюли-Ачит\00_Исходные данные\Дислокация и объемы_My.xlsx")
file_from_path = FileObject(path=file_path)
string = StringInput("Лист6")
boolean = BoolSelector(true)
boolean_2 = BoolSelector(false)
importExcel = Data.ImportExcel(file=file_from_path, sheetName=string, readAsStrings=boolean, showExcel=boolean_2)
code_block = CodeBlock { 1; }
dropItems = List.DropItems(list=importExcel, amount=code_block)
code_block_2 = CodeBlock { 3; }
getItemAtIndex = List.GetItemAtIndex(list=dropItems@L2, index=code_block_2)
code_block_3 = CodeBlock(a=getItemAtIndex) { a!=null; }
filterByBoolMask = List.FilterByBoolMask(list=getItemAtIndex, mask=code_block_3)
code_block_4 = CodeBlock(a=directory_path, b=filterByBoolMask.in) { a + "\\" + b + ".rvt"; }
code_block_5 = CodeBlock(a=code_block_4) { a[0]; }
file_from_path_2 = FileObject(path=code_block_5)
code_block_6 = CodeBlock { 1; }
dropItems_2 = List.DropItems(list=code_block_4, amount=code_block_6)
boolean_3 = BoolSelector(true)
copyFile = FileSystem.CopyFile(file=file_from_path_2, destinationPath=dropItems_2, overwrite=boolean_3)
