# Dynamo graph 06_Проверка списков.dyn (Dynamo 2.6.2.15705)

# group: Сводный EXCEL
file_path = Filename("C:\01_Проекты\01_Дюртюли-Ачит\00_Исходные данные\Дислокация и объемы_My.xlsx")
file_from_path = FileObject(path=file_path)
string = StringInput("Лист8")
boolean = BoolSelector(true)
boolean_2 = BoolSelector(false)
importExcel = Data.ImportExcel(file=file_from_path, sheetName=string, readAsStrings=boolean, showExcel=boolean_2)

code_block = CodeBlock { 1; }
dropItems = List.DropItems(list=importExcel, amount=code_block)
code_block_2 = CodeBlock { 0; }
getItemAtIndex = List.GetItemAtIndex(list=dropItems@L2, index=code_block_2)
directory_path = Directory("C:\01_Проекты\01_Дюртюли-Ачит\00_Исходные данные\Revit\Поэлементно 2 этап")
directory_from_path = DirectoryObject(path=directory_path)
string_2 = StringInput("*.rvt")
getDirectoryContents = FileSystem.GetDirectoryContents(directory=directory_from_path, searchString=string_2)
string_from_object = FromObject(obj=getDirectoryContents.files)
python_script = Python(IN[0]=string_from_object)
# ---------- python_script.python (18 lines) ----------
# Загрузить стандартную библиотеку Python и библиотеку DesignScript
import sys
import clr
clr.AddReference('ProtoGeometry')
from Autodesk.DesignScript.Geometry import *

files = IN[0]
temp = []
for f in files:
	ff = f[f.rfind("\\")+1:-4]
	if ff.count(" ") >= 2:
		fff = ff[ff.find(" ")+1:ff.rfind(" ")]
		temp.append(fff)
	else:
		temp.append(ff)
	
	
OUT = temp
# ----------------------------------------
setDifference = List.SetDifference(list1=getItemAtIndex, list2=python_script)
