# Dynamo graph 07_Нахождение max Z.dyn (Dynamo 2.6.2.15705)

file_path = Filename("..\..\..\..\..\01_Проекты\01_Дюртюли-Ачит\01_Рабочая\Navisworks\отчеты\140-232_БурыZ_ref.xlsx")
string = StringInput("Лист1")
code_block = CodeBlock { 0; }
file_path_2 = Filename("..\..\..\..\..\01_Проекты\01_Дюртюли-Ачит\01_Рабочая\Navisworks\отчеты\140-232_БурыZ.xlsx")
file_from_path = FileObject(path=file_path_2)
string_2 = StringInput("Лист1")
boolean = BoolSelector(true)
boolean_2 = BoolSelector(false)
importExcel = Data.ImportExcel(file=file_from_path, sheetName=string_2, readAsStrings=boolean, showExcel=boolean_2)
code_block_2 = CodeBlock(a=importExcel) { a[0]; }
code_block_3 = CodeBlock { 1; }
dropItems = List.DropItems(list=importExcel, amount=code_block_3)
code_block_4 = CodeBlock { 1; }
getItemAtIndex = List.GetItemAtIndex(list=dropItems@L2, index=code_block_4)
code_block_5 = CodeBlock { 0; }
getItemAtIndex_2 = List.GetItemAtIndex(list=dropItems@L2, index=code_block_5)
groupByKey = List.GroupByKey(list=getItemAtIndex, keys=getItemAtIndex_2)
code_block_6 = CodeBlock(a=groupByKey.unique_keys) { a; }
maximumItem = List.MaximumItem(list=groupByKey.groups@L2)
code_block_7 = CodeBlock(a=code_block_6, b=maximumItem) { [a,b]; }
transpose = List.Transpose(lists=code_block_7)
addItemToFront = List.AddItemToFront(item=code_block_2, list=transpose)
boolean_3 = BoolSelector(true)
exportExcel = Data.ExportExcel(filePath=file_path, sheetName=string, startRow=code_block, startCol=code_block, data=addItemToFront, overWrite=boolean_3)
