# Dynamo graph 08_Удаление групп и КСИ парамы.dyn (Dynamo 2.6.2.15705)
# packages: Orchid 206.6.0.8434

code_block = CodeBlock { "КСИ Код класса#XNKC0001"; }
code_block_2 = CodeBlock { "КСИ Наименование класса#XNKC0002"; }
code_block_3 = CodeBlock { "КСИ Класс строительной информации#XNKC0003"; }
code_block_4 = CodeBlock { "КСИ Функциональный код#XNKF0001"; }
code_block_5 = CodeBlock { "КСИ Функциональный код многоуровневый#XNKF0002"; }
code_block_6 = CodeBlock { "КСИ Место расположения#XNKL0001"; }
code_block_7 = CodeBlock { "КСИ Код типа класса#XNKT0001"; }
code_block_8 = CodeBlock { "КСИ Наименование типа класса#XNKT0002"; }
code_block_9 = CodeBlock { "КСИ Составной код#XNKC0004"; }
code_block_10 = CodeBlock(a=code_block, b=code_block_2, c=code_block_3, d=code_block_4, e=code_block_5, f=code_block_6, g=code_block_7, h=code_block_8, i=code_block_9) { [a,b,c,d,e,f,g,h,i]; }
categories = Categories("OST_IOSModelGroups")
all_elements_of_category = ElementsOfCategory(Category=categories)
ungroupElements = Group.UngroupElements(group=all_elements_of_category)
o_datastream_await = Orchid.Common.DataStream.Await(pass=code_block_10, waitFor=ungroupElements)
code_block_11 = CodeBlock { "12 Идентификация"; }
select_builtin_parameter_group = BuiltInParameterGroup("PG_TEXT")
boolean = BoolSelector(true)
o_sharedparameter_add = Orchid.RevitProject.Parameters.SharedParameter.Add(parameterName=o_datastream_await, groupName=code_block_11, group=select_builtin_parameter_group, instance=boolean)
code_block_12 = CodeBlock(a=all_elements_of_category) { a.Name; }
