# Dynamo graph 11_Назначение EO-параметров.dyn (Dynamo 2.6.2.15705)
# packages: Orchid 206.6.0.5797, archi-lab.net 2021.25.2721

code_block = CodeBlock()
# ---------- code_block.designscript (7 lines) ----------
["EO_Кодификатор_V0",
"EO_Номер тома",
"EO_Подраздел проекта",
"EO_Раздел проекта",
"EO_Шифр тома",
"EO_Местоположение",
"EO_Наименование документа"];
# ----------------------------------------
string = StringInput("12 Идентификация")
parameter_groups = ParameterGroupUi("PG_TEXT")
boolean = BoolSelector(true)
code_block_2 = CodeBlock()
# ---------- code_block_2.designscript (110 lines) ----------
["Антураж",
"Арматура воздуховодов",
"Арматура трубопроводов",
"Арматурная сетка несущей конструкции",
"Арматурная сетка несущей конструкции - Проволочная арматура",
"Арматурные пучки несущих конструкций",
"Армирование по площади несущей конструкции",
"Армирование по траектории несущей конструкции",
"Балочные системы",
"Ванты моста",
"Витражные системы",
"Водяные контуры",
"Воздуховоды",
"Воздуховоды по осевой",
"Воздухораспределители",
"Выключатели",
"Генплан",
"Гибкие воздуховоды",
"Гибкие трубы",
"Датчики",
"Двери",
"Дорожки",
"Импосты витража",
"Кабельные лотки",
"Каркас моста",
"Каркас моста - Арки",
"Каркас моста - Главные балки",
"Каркас моста - Диафрагмы",
"Каркас моста - Перекрестный раскос",
"Каркас моста - Фермы",
"Каркас несущий",
"Колонны",
"Комплекты мебели",
"Короба",
"Крыши",
"Крыши - Желоба",
"Крыши - Лобовые доски",
"Крыши - Подшивные доски",
"Лестницы",
"Лестницы - Марши",
"Лестницы - Опоры",
"Лестницы - Площадки",
"Мебель",
"Наборы оборудования",
"Настилы моста",
"Несущая арматура",
"Несущие колонны",
"Обобщенные модели",
"Оборудование",
"Оборудование зоны",
"Ограждение",
"Ограждение - Опоры",
"Ограждение - Верхние поручни",
"Ограждение - Перила",
"Озеленение",
"Окна",
"Опоры",
"Опоры - Башни опор",
"Опоры - Сваи опор",
"Опоры - Стены опор",
"Опоры - Стойки опор",
"Опоры - Оголовки опор",
"Опоры - Фундаменты опор",
"Осветительные приборы",
"Охранная сигнализация",
"Пандус",
"Панели витража",
"Парковка",
"Перекрытия",
"Перекрытия - Ребра плит",
"Пожарная сигнализация",
"Помещения",
"Потолки",
"Провода",
"Пространства",
"Ребра жесткости несущей конструкции",
"Сантехнические приборы",
"Система коммутации",
"Системы воздуховодов",
"Системы воздухоснабжения",
"Соединения несущих конструкций",
"Соединения несущих конструкций - Анкеры",
"Соединения несущих конструкций - Болты",
"Соединения несущих конструкций - Гибкие упоры",
"Соединения несущих конструкций - Другие",
"Соединения несущих конструкций - Пластины",
"Соединители несущей арматуры",
"Соединительные детали воздуховодов",
"Соединительные детали кабельных лотков",
"Соединительные детали коробов",
"Соединительные детали трубопроводов",
"Специальное оборудование",
"Спринклеры",
"Стены",
"Стены - Выступающие профили",
"Телефонные устройства",
"Топография",
"Трассы",
"Трубопровод по осевой",
"Трубопроводные системы",
"Трубы",
"Устройства вызова и оповещения",
"Устройства связи",
"Участки кабельного лотка",
"Фундамент несущей конструкции",
"Части",
"Шкафы",
"Электрические приборы",
"Электрооборудование"
];
# ----------------------------------------
byName = Category.ByName(name=code_block_2)
o_sharedparameter_add = Orchid.RevitProject.Parameters.SharedParameter.Add(parameterName=code_block, groupName=string, group=parameter_groups, instance=boolean, category=byName)
