# Dynamo graph 12_Кодификация_V0.dyn (Dynamo 2.6.2.15705)
# packages: Orchid 206.6.0.5797

o_document_current = Orchid.RevitProject.Common.Document.Current()
o_category_indocument = Orchid.RevitProject.Categories.Category.InDocument(document=o_document_current)
code_block = CodeBlock(a=o_category_indocument) { a.Name; }
python_script = Python(IN[0]=code_block)
# ---------- python_script.python (19 lines) ----------
# Загрузить стандартную библиотеку Python и библиотеку DesignScript
import sys
import clr
clr.AddReference('ProtoGeometry')
from Autodesk.DesignScript.Geometry import *

# Введенные в этом узле данные сохраняется в виде списка в переменных IN.
a = IN[0]
b = []
for i in a:
	if "Анал" in i or "анал" in i or "Марк" in i or "Виды" in i or "Ссылк" in i or "Схем" in i or "Размер" in i or "Импорт" in i or "Вариант" in i or "Элементы узлов" in i or "Управление вибрацией" in i or "Линии" in i or "Границы" in i:
		b.append(False)
	else:
		b.append(True)

# Разместите код под этой строкой

# Назначьте вывод переменной OUT.
OUT = b
# ----------------------------------------
filterByBoolMask = List.FilterByBoolMask(list=o_category_indocument, mask=python_script)
o_subcategory_bycategory = Orchid.RevitProject.Categories.SubCategory.ByCategory(document=o_document_current, category=filterByBoolMask.in)
code_block_2 = CodeBlock(a=filterByBoolMask.in, b=o_subcategory_bycategory) { [a,b]; }
flatten = List.Flatten(list=code_block_2)
o_element_bycategory = Orchid.RevitProject.Elements.Element.ByCategory(category=flatten)
flatten_2 = List.Flatten(list=o_element_bycategory)
code_block_3 = CodeBlock { "EO_Кодификатор_V0"; }
o_document_name = Orchid.RevitProject.Common.Document.Name(document=o_document_current)
имя_файла = Python(IN[0]=o_document_name)
# ---------- имя_файла.python (20 lines) ----------
# Загрузить стандартную библиотеку Python и библиотеку DesignScript
import sys
import clr
clr.AddReference('ProtoGeometry')
from Autodesk.DesignScript.Geometry import *

# Введенные в этом узле данные сохраняется в виде списка в переменных IN.
a = IN[0]
b = ""

for i in a:
	if i == "-" or i == " " or i == "+":
		b += ""
	else:
		b += i

# Разместите код под этой строкой

# Назначьте вывод переменной OUT.
OUT = b
# ----------------------------------------
getCategory = Element.GetCategory(element=flatten_2)
code_block_4 = CodeBlock(a=getCategory) { a.Name; }
имя_категории = Python(IN[0]=code_block_4)
# ---------- имя_категории.python (29 lines) ----------
# Загрузить стандартную библиотеку Python и библиотеку DesignScript
import sys
import clr
clr.AddReference('ProtoGeometry')
from Autodesk.DesignScript.Geometry import *

# Введенные в этом узле данные сохраняется в виде списка в переменных IN.
a = IN[0]
b = []


for i in a:
	l = len(i)
	g,h,j,k = i[0:3],i[l//4],i[l//2],i[(3 * (l//4))]
	if " " in g or "<" in g or ">" in g or "-" in g:
		g = "0"
	if " " in h or "<" in h or ">" in h or "-" in h:
		h = "1"
	if " " in j or "<" in j or ">" in j or "-" in j:
		j = "2"
	if " " in k or "<" in k or ">" in k or "-" in k:
		k = "3"
	c = g + h + j + k
	b.append(c)
	
# Разместите код под этой строкой

# Назначьте вывод переменной OUT.
OUT = b
# ----------------------------------------
code_block_5 = CodeBlock(a=flatten_2) { a.Name; }
имя_элемента = Python(IN[0]=code_block_5)
# ---------- имя_элемента.python (33 lines) ----------
# Загрузить стандартную библиотеку Python и библиотеку DesignScript
import sys
import clr
clr.AddReference('ProtoGeometry')
from Autodesk.DesignScript.Geometry import *

# Введенные в этом узле данные сохраняется в виде списка в переменных IN.
a = IN[0]
b = []


for i in a:
	l = len(i)
	if l == 0:
		b.append("empt")
	else:
	
		g,h,j,k = i[0],i[l//4],i[l//2],i[(3 * (l//4))]
		if " " in g or "<" in g or ">" in g or "-" in g:
			g = "0"
		if " " in h or "<" in h or ">" in h or "-" in h:
			h = "1"
		if " " in j or "<" in j or ">" in j or "-" in j:
			j = "2"
		if " " in k or "<" in k or ">" in k or "-" in k:
			k = "3"
		c = g + h + j + k
		b.append(c)
		
# Разместите код под этой строкой

# Назначьте вывод переменной OUT.
OUT = b
# ----------------------------------------
id = Element.Id(element=flatten_2)
count = List.Count(list=id)
randomList = Math.RandomList(amount=count)
code_block_6 = CodeBlock(x=randomList) { x*1000000; }
floor = Math.Floor(number=code_block_6)
python_script_2 = Python(IN[0]=имя_файла, IN[1]=имя_категории, IN[2]=имя_элемента, IN[3]=id, IN[4]=floor)
# ---------- python_script_2.python (24 lines) ----------
# Загрузить стандартную библиотеку Python и библиотеку DesignScript
import sys
import clr
clr.AddReference('ProtoGeometry')
from Autodesk.DesignScript.Geometry import *

# Введенные в этом узле данные сохраняется в виде списка в переменных IN.
fn = IN[0]
cn = IN[1]
en = IN[2]
eid = IN[3]
rn = IN[4]


cc = []

for i in range(len(cn)):
	temp = str(fn) + "_" + str(cn[i]) + "_" + str(en[i]) + "_" + str(eid[i]) + "_" + str(rn[i])
	cc.append(temp)

# Разместите код под этой строкой

# Назначьте вывод переменной OUT.
OUT = cc
# ----------------------------------------
setParameterByName = Element.SetParameterByName(element=flatten_2, parameterName=code_block_3, value=python_script_2)  # frozen
