# Dynamo graph 19_Проверка EO-заполнения.dyn (Dynamo 2.6.2.15705)
# packages: archi-lab.net 2021.25.2721, spring nodes 210.1.1, Orchid 206.6.0.8434

# group: Создаем 3D-вид
origin = Point.Origin()
code_block = CodeBlock { 10; }
code_block_2 = CodeBlock { false; }
byCoordinates = Vector.ByCoordinates(x=code_block, y=code_block, z=code_block, normalized=code_block_2)
add = Point.Add(point=origin, vectorToAdd=byCoordinates)
byEyePointAndTarget = AxonometricView.ByEyePointAndTarget(eyePoint=add, target=origin)
string = StringInput("Уровень детализации")
code_block_3 = CodeBlock { 3; }
setParameterByName = Element.SetParameterByName(element=byEyePointAndTarget, parameterName=string, value=code_block_3)
python_script = Python(IN[0]=setParameterByName)
# ---------- python_script.python (26 lines) ----------
# Загрузить стандартную библиотеку Python и библиотеку DesignScript
import sys
import clr
clr.AddReference('ProtoGeometry')
from Autodesk.DesignScript.Geometry import *
clr.AddReference('RevitAPI')
from Autodesk.Revit.DB import *

clr.AddReference('RevitServices')
import RevitServices
from RevitServices.Persistence import DocumentManager
from RevitServices.Transactions import TransactionManager

doc = DocumentManager.Instance.CurrentDBDocument
list = []

TransactionManager.Instance.EnsureInTransaction(doc)

view = UnwrapElement(IN[0])

view.get_Parameter(BuiltInParameter.MODEL_GRAPHICS_STYLE).Set(4)
list.append(view)

TransactionManager.Instance.TransactionTaskDone()

OUT = list
# ----------------------------------------

# group: Скрываем элементы, не соответствующие разделам
code_block_4 = CodeBlock { "Уровни"; }
byName = Category.ByName(name=code_block_4)
all_elements_of_category_in_view = ElementsOfCategoryInView(Category=byName, View=python_script)
code_block_5 = CodeBlock { "Линии"; }
byName_2 = Category.ByName(name=code_block_5)
all_elements_of_category_in_view_2 = ElementsOfCategoryInView(Category=byName_2, View=python_script)
code_block_6 = CodeBlock { "Элементы узлов"; }
byName_3 = Category.ByName(name=code_block_6)
all_elements_of_category_in_view_3 = ElementsOfCategoryInView(Category=byName_3, View=python_script)
code_block_7 = CodeBlock { "Границы 3D вида"; }
byName_4 = Category.ByName(name=code_block_7)
all_elements_of_category_in_view_4 = ElementsOfCategoryInView(Category=byName_4, View=python_script)
code_block_8 = CodeBlock { "Оси"; }
byName_5 = Category.ByName(name=code_block_8)
all_elements_of_category_in_view_5 = ElementsOfCategoryInView(Category=byName_5, View=python_script)
code_block_9 = CodeBlock { "Связанные файлы"; }
byName_6 = Category.ByName(name=code_block_9)
all_elements_of_category_in_view_6 = ElementsOfCategoryInView(Category=byName_6, View=python_script)
element_types = ElementTypes("CADLinkType")
all_elements_of_type = ElementsOfType(element_type=element_types)
element_types_2 = ElementTypes("ImportInstance")
all_elements_of_type_2 = ElementsOfType(element_type=element_types_2)

list_create = List.Create(item0=all_elements_of_category_in_view, item1=all_elements_of_category_in_view_2, item2=all_elements_of_category_in_view_3, item3=all_elements_of_category_in_view_4, item4=all_elements_of_category_in_view_5, item5=all_elements_of_category_in_view_6, item6=all_elements_of_type, item7=all_elements_of_type_2)

# group (continued): Скрываем элементы, не соответствующие разделам
flatten = List.Flatten(list=list_create)
hideElements = archilab.Revit.Views.Views.HideElements(view=python_script, elements=flatten)

code_block_10 = CodeBlock(pass=python_script, waitfor=hideElements) { [pass,waitfor][0]; }

# group: Скрываем неэкспортируемые элементы
ꟿ_collect_elementsinview = Custom[ꟿ Collect.ElementsInView](view=code_block_10)  # package spring nodes; Selects all elements visible in the input view.
flatten_2 = List.Flatten(list=ꟿ_collect_elementsinview)
code_block_11 = CodeBlock()
# ---------- code_block_11.designscript (2 lines) ----------
["EO_Подраздел проекта","EO_Раздел проекта","EO_Наименование документа","EO_Шифр тома",
"EO_Номер тома"];
# ----------------------------------------
getParameterValueByName = Element.GetParameterValueByName(element=flatten_2, parameterName=code_block_11, lacing=CrossProduct)
code_block_12 = CodeBlock { 0; 1; 2; 3; 4; }
code_block_13 = CodeBlock(t1=getParameterValueByName, num0=code_block_12.out0, num1=code_block_12.out1, num2=code_block_12.out2, num3=code_block_12.out3, num4=code_block_12.out4)
# ---------- code_block_13.designscript (12 lines) ----------
eo0 = DSCore.List.GetItemAtIndex(t1@L2<1>, num0);
eo1 = DSCore.List.GetItemAtIndex(t1@L2<1>, num1);
eo2 = DSCore.List.GetItemAtIndex(t1@L2<1>, num2);
eo3 = DSCore.List.GetItemAtIndex(t1@L2<1>, num3);
eo4 = DSCore.List.GetItemAtIndex(t1@L2<1>, num4);

check0 = eo0!="N/A"&&eo0!="null"&&eo0!="";
check1 = eo1!="N/A"&&eo1!="null"&&eo1!="";
check2 = eo2!="N/A"&&eo2!="null"&&eo2!="";
check3 = eo3!="N/A"&&eo3!="null"&&eo3!="";
check4 = eo0!="N/A"&&eo4!="null"&&eo4!="";
checkout = check0||check1||check2||check3||check4;
# ----------------------------------------
filterByBoolMask = List.FilterByBoolMask(list=flatten_2, mask=code_block_13.checkout)
hideElements_2 = archilab.Revit.Views.Views.HideElements(view=code_block_10, elements=filterByBoolMask.out)

code_block_14 = CodeBlock(pass=python_script, waitfor=hideElements_2) { [pass,waitfor][0]; }
o_document_current = Orchid.RevitProject.Common.Document.Current()
o_document_name = Orchid.RevitProject.Common.Document.Name(document=o_document_current)
flatten_3 = List.Flatten(list=filterByBoolMask.in)
code_block_15 = CodeBlock(a=flatten_3) { a.Id; }
code_block_16 = CodeBlock { 1; }
chop = List.Chop(list=code_block_15, lengths=code_block_16)
code_block_17 = CodeBlock()  # same code as code_block_11
getParameterValueByName_2 = Element.GetParameterValueByName(element=flatten_3, parameterName=code_block_17, lacing=CrossProduct)
addItemToFront = List.AddItemToFront(item=chop@L2, list=getParameterValueByName_2@L2, lacing=Longest)
flatten_4 = List.Flatten(list=addItemToFront@L3)
boolean = BoolSelector(false)
o_document_path = Orchid.RevitProject.Common.Document.Path(document=o_document_current, withExtension=boolean)
string_2 = StringInput("Sheet")

# group: ВЫБРАТЬ EXCEL С НАИМЕНОВАНИЯМИ ТОМОВ
file_path = Filename("C:\01_Проекты\01_Шали-Бавлы\01_Рабочая\3 этап\xls\Шали-Бавлы_3 этап_Именования томов.xlsx")
file_from_path = FileObject(path=file_path)
boolean_2 = BoolSelector(true)
boolean_3 = BoolSelector(false)
importExcel = Data.ImportExcel(file=file_from_path, sheetName=string_2, readAsStrings=boolean_2, showExcel=boolean_3)

code_block_18 = CodeBlock { 1; }
dropItems = List.DropItems(list=importExcel@L2, amount=code_block_18)
concat = String.Concat(string0=dropItems@L2)
python_script_2 = Python(IN[0]=flatten_4, IN[1]=o_document_path, IN[2]=concat)
# ---------- python_script_2.python (35 lines) ----------
# Загрузить стандартную библиотеку Python и библиотеку DesignScript
import sys
import clr
clr.AddReference('ProtoGeometry')
from Autodesk.DesignScript.Geometry import *

fulldata = IN[0]
docpath = IN[1] + ".txt"
books = IN[2]
eo_tlist = []



for fd in fulldata:
	id,eo1,eo2,eo3,eo4,eo5 = fd[0],fd[1],fd[2],fd[3],fd[4],fd[5]
	if eo1=="N/A" or eo1=="null" or eo1=="" or eo1=="None":
		continue
	else:
		eostrsum = str(eo1)+str(eo2)+str(eo3)+str(eo4)+str(eo5)
		cnt = 0
		for book in books:
			if book == eostrsum:
				cnt+=1
				eo_tlist.append(book)
		if cnt == 0:
			eo_tlist.append("Элемент "+str(id)+" неправильно заполнен / В БД нет тома"+str(eo1)+str(eo2)+str(eo3)+str(eo4)+str(eo5))

if len(eo_tlist) > 0:
	txtfile = open(docpath, "w+")
	for i in eo_tlist:
		txtfile.write(i.encode('utf-8'))
	txtfile.close()
	
OUT = eo_tlist
		
# ----------------------------------------
