# Dynamo graph 20_Кодификация_V1.dyn (Dynamo 2.6.2.15705)
# packages: archi-lab.net 2021.25.2721, spring nodes 210.1.1, Orchid 206.6.0.8434

string = StringInput("TempView_Codification")

# group: Создание 3d-вида для выгрузки
origin = Point.Origin()
code_block = CodeBlock { 10; }
code_block_2 = CodeBlock { false; }
byCoordinates = Vector.ByCoordinates(x=code_block, y=code_block, z=code_block, normalized=code_block_2)
add = Point.Add(point=origin, vectorToAdd=byCoordinates)
byEyePointAndTarget = AxonometricView.ByEyePointAndTarget(eyePoint=add, target=origin, name=string)
string_2 = StringInput("Уровень детализации")
code_block_3 = CodeBlock { 3; }
setParameterByName = Element.SetParameterByName(element=byEyePointAndTarget, parameterName=string_2, value=code_block_3)
python_script = Python(IN[0]=setParameterByName)
# ---------- python_script.python (26 lines) ----------
# Загрузить стандартную библиотеку Python и библиотеку DesignScript
import sys
import clr
clr.AddReference('ProtoGeometry')
from Autodesk.DesignScript.Geometry import *
clr.AddReference('RevitAPI')
from Autodesk.Revit.DB import *

clr.AddReference('RevitServices')
import RevitServices
from RevitServices.Persistence import DocumentManager
from RevitServices.Transactions import TransactionManager

doc = DocumentManager.Instance.CurrentDBDocument
list = []

TransactionManager.Instance.EnsureInTransaction(doc)

view = UnwrapElement(IN[0])

view.get_Parameter(BuiltInParameter.MODEL_GRAPHICS_STYLE).Set(4)
list.append(view)

TransactionManager.Instance.TransactionTaskDone()

OUT = list
# ----------------------------------------

# group: Скрываем элементы, не соответствующие разделам
code_block_4 = CodeBlock { "Уровни"; }
byName = Category.ByName(name=code_block_4)
all_elements_of_category_in_view = ElementsOfCategoryInView(Category=byName, View=python_script)
code_block_5 = CodeBlock { "Линии"; }
byName_2 = Category.ByName(name=code_block_5)
all_elements_of_category_in_view_2 = ElementsOfCategoryInView(Category=byName_2, View=python_script)
code_block_6 = CodeBlock { "Элементы узлов"; }
byName_3 = Category.ByName(name=code_block_6)
all_elements_of_category_in_view_3 = ElementsOfCategoryInView(Category=byName_3, View=python_script)
code_block_7 = CodeBlock { "Границы 3D вида"; }
byName_4 = Category.ByName(name=code_block_7)
all_elements_of_category_in_view_4 = ElementsOfCategoryInView(Category=byName_4, View=python_script)
code_block_8 = CodeBlock { "Оси"; }
byName_5 = Category.ByName(name=code_block_8)
all_elements_of_category_in_view_5 = ElementsOfCategoryInView(Category=byName_5, View=python_script)
code_block_9 = CodeBlock { "Связанные файлы"; }
byName_6 = Category.ByName(name=code_block_9)
all_elements_of_category_in_view_6 = ElementsOfCategoryInView(Category=byName_6, View=python_script)
element_types = ElementTypes("CADLinkType")
all_elements_of_type = ElementsOfType(element_type=element_types)
element_types_2 = ElementTypes("ImportInstance")
all_elements_of_type_2 = ElementsOfType(element_type=element_types_2)

list_create = List.Create(item0=all_elements_of_category_in_view, item1=all_elements_of_category_in_view_2, item2=all_elements_of_category_in_view_3, item3=all_elements_of_category_in_view_4, item4=all_elements_of_category_in_view_5, item5=all_elements_of_category_in_view_6, item6=all_elements_of_type, item7=all_elements_of_type_2)

# group (continued): Скрываем элементы, не соответствующие разделам
flatten = List.Flatten(list=list_create)
hideElements = archilab.Revit.Views.Views.HideElements(view=python_script, elements=flatten)

code_block_10 = CodeBlock(pass=python_script, waitfor=hideElements) { [pass,waitfor][0]; }

# group: Второй этап скрытия - убираем элементы с нулевым заполнением ЕО-параметров
ꟿ_collect_elementsinview = Custom[ꟿ Collect.ElementsInView](view=code_block_10)  # package spring nodes; Selects all elements visible in the input view.
flatten_2 = List.Flatten(list=ꟿ_collect_elementsinview)
code_block_11 = CodeBlock()
# ---------- code_block_11.designscript (2 lines) ----------
["EO_Подраздел проекта","EO_Раздел проекта","EO_Наименование документа","EO_Шифр тома",
"EO_Номер тома"];
# ----------------------------------------
getParameterValueByName = Element.GetParameterValueByName(element=flatten_2, parameterName=code_block_11, lacing=CrossProduct)
code_block_12 = CodeBlock { 0; 1; 2; 3; 4; }
code_block_13 = CodeBlock(t1=getParameterValueByName, num0=code_block_12.out0, num1=code_block_12.out1, num2=code_block_12.out2, num3=code_block_12.out3, num4=code_block_12.out4)
# ---------- code_block_13.designscript (12 lines) ----------
eo0 = DSCore.List.GetItemAtIndex(t1@L2<1>, num0);
eo1 = DSCore.List.GetItemAtIndex(t1@L2<1>, num1);
eo2 = DSCore.List.GetItemAtIndex(t1@L2<1>, num2);
eo3 = DSCore.List.GetItemAtIndex(t1@L2<1>, num3);
eo4 = DSCore.List.GetItemAtIndex(t1@L2<1>, num4);

check0 = eo0!="N/A"&&eo0!="null"&&eo0!="";
check1 = eo1!="N/A"&&eo1!="null"&&eo1!="";
check2 = eo2!="N/A"&&eo2!="null"&&eo2!="";
check3 = eo3!="N/A"&&eo3!="null"&&eo3!="";
check4 = eo0!="N/A"&&eo4!="null"&&eo4!="";
checkout = check0||check1||check2||check3||check4;
# ----------------------------------------
filterByBoolMask = List.FilterByBoolMask(list=flatten_2, mask=code_block_13.checkout)
hideElements_2 = archilab.Revit.Views.Views.HideElements(view=code_block_10, elements=filterByBoolMask.out)

code_block_14 = CodeBlock(pass=code_block_10, waitfor=hideElements_2) { [pass,waitfor][0]; }
ꟿ_collect_elementsinview_2 = Custom[ꟿ Collect.ElementsInView](view=code_block_14)
flatten_3 = List.Flatten(list=ꟿ_collect_elementsinview_2)
string_3 = StringInput("EO_Кодификатор_V0")
getParameterValueByName_2 = Element.GetParameterValueByName(element=flatten_3, parameterName=string_3)
code_block_15 = CodeBlock(cod=getParameterValueByName_2) { cod==""; }
filterByBoolMask_2 = List.FilterByBoolMask(list=flatten_3, mask=code_block_15)
code_block_16 = CodeBlock(a=filterByBoolMask_2.in) { a.Id; }
code_block_17 = CodeBlock { "EO_Кодификатор_V0"; }
current = Document.Current()
o_document_name = Orchid.RevitProject.Common.Document.Name(document=current)
имя_файла = Python(IN[0]=o_document_name)
# ---------- имя_файла.python (20 lines) ----------
# Загрузить стандартную библиотеку Python и библиотеку DesignScript
import sys
import clr
clr.AddReference('ProtoGeometry')
from Autodesk.DesignScript.Geometry import *

# Введенные в этом узле данные сохраняется в виде списка в переменных IN.
a = IN[0]
b = ""

for i in a:
	if i == "-" or i == " " or i == "+":
		b += ""
	else:
		b += i

# Разместите код под этой строкой

# Назначьте вывод переменной OUT.
OUT = b
# ----------------------------------------
getCategory = Element.GetCategory(element=filterByBoolMask_2.in)
имя_категории = Python(IN[0]=getCategory)
# ---------- имя_категории.python (48 lines) ----------
# Загрузить стандартную библиотеку Python и библиотеку DesignScript
import sys
import clr
import functools
import operator

clr.AddReference('ProtoGeometry')
from Autodesk.DesignScript.Geometry import *


def flatten(S):
    if S == []:
        return S
    if isinstance(S[0], list):
        return flatten(S[0]) + flatten(S[1:])
    return S[:1] + flatten(S[1:])
	


# Введенные в этом узле данные сохраняется в виде списка в переменных IN.
cats = IN[0]
cats_r,names = [],[]
b = []

cats_r = flatten(cats)

for cat in cats_r:
	names.append(cat.Name)


for i in names:
	l = len(i)
	g,h,j,k = i[0:3],i[l//4],i[l//2],i[(3 * (l//4))]
	if g in (" ","<",">","-","{","}"):
		g = "0"
	if h in (" ","<",">","-","{","}"):
		h = "1"
	if j in (" ","<",">","-","{","}"):
		j = "2"
	if k in (" ","<",">","-","{","}"):
		k = "3"
	c = str(g) + str(h) + str(j) + str(k)
	b.append(c)
	
# Разместите код под этой строкой

# Назначьте вывод переменной OUT.
OUT = b
# ----------------------------------------
code_block_18 = CodeBlock(a=filterByBoolMask_2.in) { a.Name; }
имя_элемента = Python(IN[0]=code_block_18)
# ---------- имя_элемента.python (33 lines) ----------
# Загрузить стандартную библиотеку Python и библиотеку DesignScript
import sys
import clr
clr.AddReference('ProtoGeometry')
from Autodesk.DesignScript.Geometry import *

# Введенные в этом узле данные сохраняется в виде списка в переменных IN.
a = IN[0]
b = []


for i in a:
	l = len(i)
	if l == 0:
		b.append("empty")
	else:
	
		g,h,j,k = i[0],i[l//4],i[l//2],i[(3 * (l//4))]
		if g in (" ","<",">","-","{","}"):
			g = "0"
		if h in (" ","<",">","-","{","}"):
			h = "1"
		if j in (" ","<",">","-","{","}"):
			j = "2"
		if k in (" ","<",">","-","{","}"):
			k = "3"
		c = g + h + j + k
		b.append(c)
		
# Разместите код под этой строкой

# Назначьте вывод переменной OUT.
OUT = b
# ----------------------------------------
count = List.Count(list=filterByBoolMask_2.in)
python_script_2 = Python(IN[0]=имя_файла, IN[1]=имя_категории, IN[2]=имя_элемента, IN[3]=count)
# ---------- python_script_2.python (31 lines) ----------
# Загрузить стандартную библиотеку Python и библиотеку DesignScript
import sys
import clr
import random
import string

clr.AddReference('ProtoGeometry')
from Autodesk.DesignScript.Geometry import *

def generate_alphanum_random_string(length):
    letters_and_digits = string.ascii_letters + string.digits
    rand_string = ''.join(random.sample(letters_and_digits, length))
    return rand_string

# Введенные в этом узле данные сохраняется в виде списка в переменных IN.
fn = IN[0]
cn = IN[1]
en = IN[2]
listcount = IN[3]


generateids = random.sample(range(1000000,11000000),listcount)


cc = []

for i in range(len(cn)):
	gids = generate_alphanum_random_string(16)
	cc.append("_".join([unicode(fn), unicode(cn[i]), unicode(en[i]), unicode(gids)]))

OUT = cc
# ----------------------------------------
setParameterByName_2 = Element.SetParameterByName(element=filterByBoolMask_2.in, parameterName=code_block_17, value=python_script_2)
code_block_19 = CodeBlock(pass=python_script, waitfor=setParameterByName_2) { [pass,waitfor][0]; }
o_element_delete = Orchid.RevitProject.Elements.Element.Delete(element=code_block_19)  # frozen
o_datastream_await = Orchid.Common.DataStream.Await()  # unwired: pass, waitFor
o_datastream_await_2 = Orchid.Common.DataStream.Await()  # unwired: pass, waitFor
