# Dynamo graph 22_Кодификация_V2.dyn (Dynamo 2.6.2.15705)
# packages: spring nodes 210.1.1, Orchid 206.6.0.8434

setParameterByName = Element.SetParameterByName()  # unwired: element, parameterName, value
string = StringInput("TempView_Codification")

# group: Создание 3d-вида для выгрузки
origin = Point.Origin()
code_block = CodeBlock { 10; }
code_block_2 = CodeBlock { false; }
byCoordinates = Vector.ByCoordinates(x=code_block, y=code_block, z=code_block, normalized=code_block_2)
add = Point.Add(point=origin, vectorToAdd=byCoordinates)
byEyePointAndTarget = AxonometricView.ByEyePointAndTarget(eyePoint=add, target=origin, name=string)
string_2 = StringInput("Уровень детализации")
code_block_3 = CodeBlock { 3; }
setParameterByName_2 = Element.SetParameterByName(element=byEyePointAndTarget, parameterName=string_2, value=code_block_3)
python_script = Python(IN[0]=setParameterByName_2)
# ---------- python_script.python (26 lines) ----------
# Загрузить стандартную библиотеку Python и библиотеку DesignScript
import sys
import clr
clr.AddReference('ProtoGeometry')
from Autodesk.DesignScript.Geometry import *
clr.AddReference('RevitAPI')
from Autodesk.Revit.DB import *

clr.AddReference('RevitServices')
import RevitServices
from RevitServices.Persistence import DocumentManager
from RevitServices.Transactions import TransactionManager

doc = DocumentManager.Instance.CurrentDBDocument
list = []

TransactionManager.Instance.EnsureInTransaction(doc)

view = UnwrapElement(IN[0])

view.get_Parameter(BuiltInParameter.MODEL_GRAPHICS_STYLE).Set(4)
list.append(view)

TransactionManager.Instance.TransactionTaskDone()

OUT = list
# ----------------------------------------

ꟿ_collect_elementsinview = Custom[ꟿ Collect.ElementsInView](view=python_script)  # package spring nodes; Selects all elements visible in the input view.
flatten = List.Flatten(list=ꟿ_collect_elementsinview)
string_3 = StringInput("EO_Кодификатор_V0")
getParameterValueByName = Element.GetParameterValueByName(element=flatten, parameterName=string_3)
code_block_4 = CodeBlock(cod=getParameterValueByName) { cod==""; }
filterByBoolMask = List.FilterByBoolMask(list=flatten, mask=code_block_4)
code_block_5 = CodeBlock { "EO_Кодификатор_V0"; }
current = Document.Current()
o_document_name = Orchid.RevitProject.Common.Document.Name(document=current)
имя_файла = Python(IN[0]=o_document_name)
# ---------- имя_файла.python (20 lines) ----------
# Загрузить стандартную библиотеку Python и библиотеку DesignScript
import sys
import clr
clr.AddReference('ProtoGeometry')
from Autodesk.DesignScript.Geometry import *

# Введенные в этом узле данные сохраняется в виде списка в переменных IN.
a = IN[0]
b = ""

for i in a:
	if i == "-" or i == " " or i == "+":
		b += ""
	else:
		b += i

# Разместите код под этой строкой

# Назначьте вывод переменной OUT.
OUT = b
# ----------------------------------------
count = List.Count(list=filterByBoolMask.in)
python_script_2 = Python(IN[0]=имя_файла, IN[1]=count)
# ---------- python_script_2.python (26 lines) ----------
# Загрузить стандартную библиотеку Python и библиотеку DesignScript
import sys
import clr
import random
import string

clr.AddReference('ProtoGeometry')
from Autodesk.DesignScript.Geometry import *

def generate_alphanum_random_string(length):
    letters_and_digits = string.ascii_letters + string.digits
    rand_string = ''.join(random.sample(letters_and_digits, length))
    return rand_string

# Введенные в этом узле данные сохраняется в виде списка в переменных IN.
fn = IN[0]

listcount = IN[1]

cc = []

for i in range(listcount):
	gids = generate_alphanum_random_string(16)
	cc.append("_".join([unicode(fn), unicode(gids)]))

OUT = cc
# ----------------------------------------
python_script_3 = Python(IN[0]=filterByBoolMask.in, IN[1]=code_block_5, IN[2]=python_script_2)  # frozen
# ---------- python_script_3.python (48 lines) ----------
import clr

#Import the Revit API
clr.AddReference('RevitAPI')
import Autodesk
from Autodesk.Revit.DB import *

#Import DocumentManager and TransactionManager
clr.AddReference('RevitServices')
import RevitServices
from RevitServices.Persistence import DocumentManager
from RevitServices.Transactions import TransactionManager

#Reference the active Document and application
doc = DocumentManager.Instance.CurrentDBDocument

elem = UnwrapElement(IN[0])
parname = IN[1]
values = UnwrapElement(IN[2])

tlist = []


for i in range(len(elem)):
#	try:
	elem_param = elem[i].LookupParameter('EO_Кодификатор_V0')
	try:
		TransactionManager.Instance.EnsureInTransaction(doc)
		elem_param.Set(values[i])
		tlist.append("success")
		TransactionManager.Instance.TransactionTaskDone()
	except:
		tlist.append("no parameter")
#	except:
#		tlist.append("no parameter")





#TransactionManager.Instance.EnsureInTransaction(doc)
#if elem_param.Set('Hello World'):
#	OUT = 'Success'
#else:
#	OUT = 'Failed to Set Parameter'
#TransactionManager.Instance.TransactionTaskDone()

OUT = tlist
# ----------------------------------------
all_elements_of_type = ElementsOfType()  # unwired: element_type
all_elements_of_category = ElementsOfCategory()  # unwired: Category
categories = Categories()  # nothing selected
element_types = ElementTypes("FamilyInstance")
all_elements_of_type_2 = ElementsOfType(element_type=element_types)
