# Dynamo graph 22_Кодификация_V3.dyn (Dynamo 2.6.2.15705)
# packages: Orchid 206.6.0.8434

right_categories = Python()  # unwired: IN[0]
# ---------- right_categories.python (216 lines) ----------
# Загрузить стандартную библиотеку Python и библиотеку DesignScript
import sys
import clr
clr.AddReference('ProtoGeometry')
from Autodesk.DesignScript.Geometry import *

# Введенные в этом узле данные сохраняется в виде списка в переменных IN.
dataEnteringNode = IN
a = ['OST_TrussChord',
'OST_TrussWeb',
'OST_Coupler',
'OST_StructConnectionOthers',
'OST_StructConnectionBolts',
'OST_StructConnectionAnchors',
'OST_StructConnectionPlates',
'OST_StructConnectionProfiles',
'OST_StructConnectionReference',
'OST_StructConnectionSymbol',
'OST_StructConnections',
'OST_FabricReinforcementWire',
'OST_FabricReinforcementBoundary',
'OST_FabricReinforcement',
'OST_RebarShape',
'OST_PathRein',
'OST_AreaRein',
'OST_Rebar',
'OST_FabricationPipeworkInsulation',
'OST_FabricationDuctworkLining',
'OST_FabricationContainmentDrop',
'OST_FabricationContainmentRise',
'OST_FabricationPipeworkDrop',
'OST_FabricationPipeworkRise',
'OST_FabricationContainmentSymbology',
'OST_FabricationContainmentCenterLine',
'OST_FabricationContainment',
'OST_FabricationPipework',
'OST_FabricationHangers',
'OST_FabricationDuctwork',
'OST_PipeSegments',
'OST_PlaceHolderPipes',
'OST_PlaceHolderDucts',
'OST_ElectricalInternalCircuits',
'OST_PanelScheduleGraphics',
'OST_CableTrayRun',
'OST_ConduitRun',
'OST_ConduitDrop',
'OST_ConduitRiseDrop',
'OST_CableTrayDrop',
'OST_CableTrayRiseDrop',
'OST_Conduit',
'OST_CableTray',
'OST_ConduitFitting',
'OST_CableTrayFitting',
'OST_HVAC_Zones',
'OST_SwitchSystem',
'OST_Sprinklers',
'OST_LightingDevices',
'OST_FireAlarmDevices',
'OST_DataDevices',
'OST_CommunicationDevices',
'OST_SecurityDevices',
'OST_NurseCallDevices',
'OST_TelephoneDevices',
'OST_PipeAccessory',
'OST_PipeCurvesRiseDrop',
'OST_FlexPipeCurves',
'OST_PipeFitting',
'OST_PipeCurves',
'OST_PipingSystem',
'OST_Wire',
'OST_ElectricalCircuit',
'OST_FlexDuctCurves',
'OST_DuctAccessory',
'OST_DuctSystem',
'OST_DuctTerminal',
'OST_DuctFitting',
'OST_DuctCurves',
'OST_BridgeBearings',
'OST_BridgeGirders',
'OST_BridgeFoundations',
'OST_BridgeDecks',
'OST_BridgeArches',
'OST_BridgeCables',
'OST_BridgeTowers',
'OST_BridgePiers',
'OST_BridgeAbutments',
'OST_MEPSpaces',
'OST_MassShade',
'OST_MassOpening',
'OST_MassSkylights',
'OST_MassGlazing',
'OST_MassRoof',
'OST_MassExteriorWall',
'OST_MassInteriorWall',
'OST_MassZone',
'OST_MassForm',
'OST_MassFloor',
'OST_Mass',
'OST_DividedSurface_PatternFill',
'OST_RampsStringer',
'OST_Areas',
'OST_RoofSoffit',
'OST_EdgeSlab',
'OST_Gutter',
'OST_Fascia',
'OST_Entourage',
'OST_Planting',
'OST_StructuralStiffener',
'OST_SpecialityEquipment',
'OST_ColumnAnalyticalRigidLinks',
'OST_Topography',
'OST_StructuralTruss',
'OST_AnalyticalRigidLinks',
'OST_StructuralColumns',
'OST_KickerBracing',
'OST_StructuralFramingSystem',
'OST_VerticalBracing',
'OST_HorizontalBracing',
'OST_Purlin',
'OST_Joist',
'OST_Girder',
'OST_StructuralFramingOther',
'OST_StructuralFraming',
'OST_StructuralFoundation',
'OST_Roads',
'OST_Parking',
'OST_PlumbingFixtures',
'OST_MechanicalEquipment',
'OST_LightingFixtureSource',
'OST_LightingFixtures',
'OST_FurnitureSystems',
'OST_ElectricalFixtures',
'OST_ElectricalEquipment',
'OST_Casework',
'OST_StairsSupports',
'OST_RailingHandRailAboveCut',
'OST_RailingTopRailAboveCut',
'OST_RailingTermination',
'OST_RailingSupport',
'OST_RailingHandRail',
'OST_RailingTopRail',
'OST_StairsOutlinesAboveCut',
'OST_StairsOutlines',
'OST_StairsTrisers',
'OST_StairsLandings',
'OST_StairsRuns',
'OST_CeilingsCutPattern',
'OST_CeilingsDefault',
'OST_CeilingsFinish2',
'OST_CeilingsFinish1',
'OST_CeilingsSubstrate',
'OST_CeilingsInsulation',
'OST_CeilingsStructure',
'OST_CeilingsMembrane',
'OST_FloorsInteriorEdges',
'OST_FloorsCutPattern',
'OST_FloorsDefault',
'OST_FloorsFinish2',
'OST_FloorsFinish1',
'OST_FloorsSubstrate',
'OST_FloorsInsulation',
'OST_FloorsStructure',
'OST_FloorsMembrane',
'OST_RoofsInteriorEdges',
'OST_RoofsCutPattern',
'OST_RoofsDefault',
'OST_RoofsFinish2',
'OST_RoofsFinish1',
'OST_RoofsSubstrate',
'OST_RoofsInsulation',
'OST_RoofsStructure',
'OST_RoofsMembrane',
'OST_WallsCutPattern',
'OST_WallsDefault',
'OST_WallsFinish2',
'OST_WallsFinish1',
'OST_WallsSubstrate',
'OST_WallsInsulation',
'OST_WallsStructure',
'OST_WallsMembrane',
'OST_CurtaSystem',
'OST_Cornices',
'OST_Ramps',
'OST_CurtainWallMullions',
'OST_CurtainWallPanels',
'OST_AreaReferenceVisibility',
'OST_RoomReferenceVisibility',
'OST_Rooms',
'OST_GenericModel',
'OST_StairsRailingRail',
'OST_StairsRailingBaluster',
'OST_StairsRailing',
'OST_StairsSupportsAboveCut',
'OST_StairsStringerCarriage',
'OST_Stairs',
'OST_Columns',
'OST_Ceilings',
'OST_Roofs',
'OST_Floors',
'OST_DoorsGlassProjection',
'OST_DoorsFrameMullionProjection',
'OST_DoorsOpeningProjection',
'OST_DoorsPanelProjection',
'OST_Doors',
'OST_WindowsOpeningProjection',
'OST_WindowsSillHeadProjection',
'OST_WindowsFrameMullionProjection',
'OST_WindowsGlassProjection',
'OST_Windows',
'OST_Walls',
'OST_Furniture'
];
# Разместите код под этой строкой

# Назначьте вывод переменной OUT.
OUT = a
# ----------------------------------------
byName = Category.ByName(name=right_categories)
all_elements_of_category = ElementsOfCategory(Category=byName)
flatten = List.Flatten(list=all_elements_of_category)
сбор_незаполненных_элементов = Python(IN[0]=flatten)
# ---------- сбор_незаполненных_элементов.python (30 lines) ----------
import clr

#Import the Revit API
clr.AddReference('RevitAPI')
import Autodesk
from Autodesk.Revit.DB import *

#Import DocumentManager and TransactionManager
clr.AddReference('RevitServices')
import RevitServices
from RevitServices.Persistence import DocumentManager
from RevitServices.Transactions import TransactionManager

#Reference the active Document and application
doc = DocumentManager.Instance.CurrentDBDocument

elem = UnwrapElement(IN[0])

tlist = []


for el in elem:
	try:
		elem_param = el.LookupParameter('EO_Кодификатор_V0').AsString()
		if elem_param in (None, "", " ", "0", 0):
			tlist.append(el)
	except:
		continue

OUT = tlist
# ----------------------------------------
code_block = CodeBlock { "EO_Кодификатор_V0"; }
current = Document.Current()
o_document_name = Orchid.RevitProject.Common.Document.Name(document=current)
имя_файла = Python(IN[0]=o_document_name)
# ---------- имя_файла.python (20 lines) ----------
# Загрузить стандартную библиотеку Python и библиотеку DesignScript
import sys
import clr
clr.AddReference('ProtoGeometry')
from Autodesk.DesignScript.Geometry import *

# Введенные в этом узле данные сохраняется в виде списка в переменных IN.
a = IN[0]
b = ""

for i in a:
	if i == "-" or i == " " or i == "+":
		b += ""
	else:
		b += i

# Разместите код под этой строкой

# Назначьте вывод переменной OUT.
OUT = b
# ----------------------------------------
count = List.Count(list=сбор_незаполненных_элементов)
code_block_2 = CodeBlock(el=сбор_незаполненных_элементов) { el.Name; el.GetCategory.Name; }
генерация_уникального_кода = Python(IN[0]=имя_файла, IN[1]=count, IN[2]=code_block_2.out0, IN[3]=code_block_2.out1)
# ---------- генерация_уникального_кода.python (67 lines) ----------
# Загрузить стандартную библиотеку Python и библиотеку DesignScript
import sys
import clr
import random
import string

clr.AddReference('ProtoGeometry')
from Autodesk.DesignScript.Geometry import *

def generate_alphanum_random_string(length):
    letters_and_digits = string.ascii_letters + string.digits
    rand_string = ''.join(random.sample(letters_and_digits, length))
    return rand_string

# ИСХОДНЫЕ ДАННЫЕ
fn = IN[0]
listcount = IN[1]
names = IN[2]
cats = IN[3]

# ПЕРЕМЕННЫЕ
uidlist = []
nameslist = []
catlist = []
flist = []

for l in range(listcount):
	uidik = generate_alphanum_random_string(16)
	
	if len(names[l]) == 0:
		newname = "empty"
	else:
		ln = len(names[l])
		n1, n2, n3, n4 = names[l][0], names[l][ln//4], names[l][ln//2], names[l][3 * ln//4]

		if n1 in (" ", "<", ">", "-", "{", "}"):
			n1 = 0
		if n2 in (" ", "<", ">", "-", "{", "}"):
			n2 = 1
		if n3 in (" ", "<", ">", "-", "{", "}"):
			n3 = 2
		if n4 in (" ", "<", ">", "-", "{", "}"):
			n4 = 3
		newname = unicode(n1) + unicode(n2) + unicode(n3) + unicode(n4)	
	
	if len(cats[l]) == 0:
		newcatname = "empty"
	else:
		lc = len(cats[l])
		c1, c2, c3, c4 = cats[l][0], cats[l][lc//4], cats[l][lc//2], cats[l][3 * lc//4]
		if c1 in (" ", "<", ">", "-", "{", "}"):
			c1 = 0
		if c2 in (" ", "<", ">", "-", "{", "}"):
			c2 = 1
		if c3 in (" ", "<", ">", "-", "{", "}"):
			c3 = 2
		if c4 in (" ", "<", ">", "-", "{", "}"):
			c4 = 3
		newcatname = unicode(c1) + unicode(c2) + unicode(c3) + unicode(c4)	
	
	
	
	
	flist.append(unicode(fn)+"_"+unicode(newcatname)+"_"+unicode(newname)+"_"+unicode(uidik))

OUT = flist
	
# ----------------------------------------
заполнение_кодификатора = Python(IN[0]=сбор_незаполненных_элементов, IN[1]=code_block, IN[2]=генерация_уникального_кода)
# ---------- заполнение_кодификатора.python (34 lines) ----------
import clr

#Import the Revit API
clr.AddReference('RevitAPI')
import Autodesk
from Autodesk.Revit.DB import *

#Import DocumentManager and TransactionManager
clr.AddReference('RevitServices')
import RevitServices
from RevitServices.Persistence import DocumentManager
from RevitServices.Transactions import TransactionManager

#Reference the active Document and application
doc = DocumentManager.Instance.CurrentDBDocument

elem = UnwrapElement(IN[0])
parname = IN[1]
values = UnwrapElement(IN[2])

tlist = []


for i in range(len(elem)):
	elem_param = elem[i].LookupParameter('EO_Кодификатор_V0')
	try:
		TransactionManager.Instance.EnsureInTransaction(doc)
		elem_param.Set(values[i])
		tlist.append("success")
		TransactionManager.Instance.TransactionTaskDone()
	except:
		tlist.append("no parameter")

OUT = tlist
# ----------------------------------------
