# Dynamo graph 25_Оффсет Mesh.dyn "25_Оффсет слоев" (Dynamo 2.6.2.15705)

select_model_element = DSModelElementSelection()  # 1 picked in the model
geometry = Element.Geometry(element=select_model_element)
code_block = CodeBlock(a=geometry) { a[293]; }
faceIndices = Mesh.FaceIndices(mesh=code_block)
A = IndexGroup.A(indexGroup=faceIndices)
B = IndexGroup.B(indexGroup=faceIndices)
C = IndexGroup.C(indexGroup=faceIndices)
code_block_2 = CodeBlock(a=A, b=B, c=C) { [a,b,c]; }
transpose = List.Transpose(lists=code_block_2)
vertexPositions = Mesh.VertexPositions(mesh=code_block)
vertexNormals = Mesh.VertexNormals(mesh=code_block)
X = Vector.X(vector=vertexNormals)
Y = Vector.Y(vector=vertexNormals)
code_block_3 = CodeBlock { 0; }
byCoordinates = Vector.ByCoordinates(x=X, y=Y, z=code_block_3)
code_block_4 = CodeBlock { 10; }
translate = Geometry.Translate(geometry=vertexPositions, direction=byCoordinates, distance=code_block_4)
X_2 = Point.X(point=translate)
Y_2 = Point.Y(point=translate)
Z = Point.Z(point=translate)
code_block_5 = CodeBlock(z=Z) { z-5; }
byCoordinates_2 = Point.ByCoordinates(x=X_2, y=Y_2, z=code_block_5)
byPointsFaceIndices = Mesh.ByPointsFaceIndices(vertexPositions=byCoordinates_2, indices=faceIndices)
string = StringInput("C:\Users\aprohorov\Desktop\1test.sat")
exportToSAT = ExportWithUnits(geometry=byPointsFaceIndices, filePath=string, SelectedExportedUnitsSource=[0, 1, 2, 3, 5, 4], SelectedExportedUnit=2)
exportMeshes = Autodesk.Dynamo.MeshToolkit.Mesh.ExportMeshes()  # unwired: filename, meshes
